# Grasshopper definition Geom_types_and_Allowed_Geom_Checks.gh (Grasshopper 1.0.8)

config = Config()  # -> out, OK, opts; inputs go: list, opts: list, save_to: list, python: list, sDNA_paths: list, auto_get_Geom: list, auto_read_User_Text: list, auto_write_Shp: list, auto_read_Shp: list, auto_plot_data: list, show_all: list, sync: list
#   port go: true: runs tools. false: do not run tools but still read other Params.
#   port opts: sDNA_GH options data structure. Python dictionary.
#   port save_to: The name of the .toml file to save your options to. Default: C:\Users\drjam\AppData\Roaming\Grasshopper\UserObjects\sdna-gh\sDNA_GH\config.toml
#   port python: File path of the Python executable to run sDNA with, or its parent folder. Python is required for sDNA tools (download link in readme). Default:
#   port sDNA_paths: File path to the folder of the sDNA installation to be used with sDNA_GH. This must contain sDNAUISpec.py and runsdnacommand.py. Default: ['C:\\Users\\drjam\\pipx\\venvs\\sdna-plus\\Lib\\site-packages\\sDNA']
#   port auto_get_Geom: true: Run Read Rhino geometry before Read User Text. false: don't. Default: False
#   port auto_read_User_Text: true: Run Read User Text before Write shapefile. false: don't. Default: False
#   port auto_write_Shp: true: Run Write shapefile before sDNA tools. false: don't. Default: True
#   port auto_read_Shp: true: Run Read shapefile after sDNA tools. false: don't. Default: True
#   port auto_plot_data: true: Run Recolour objects after Read shapefile. false: don't. Default: False
#   port show_all: true: show all possible input Params on sDNA tools. false: only show required Params. Default: True
#   port sync: false: desynchronise from other components' options. true: synchronise with other synchronised components, sharing the global sDNA_GH options. Default: False
#   port OK: true: tools ran successfully. false: tools did not run, or there was an error.
#   port opts: sDNA_GH options data structure. Python dictionary.
# ---------- config: Python ----------
#! /usr/bin/awk NR==3
# -*- coding: utf-8 -*-
# This module requires Grasshopper Python (Rhino3D)

# MIT License

# Copyright (c) [2021] [Cardiff University, a body incorporated
# by Royal Charter and a registered charity (number:
# 1136855) whose administrative offices are at 7th floor 30-
# 36 Newport Road, University CF24 0DE, Wales, UK]

# Permission is hereby granted, free of charge, to any person obtaining a copy
# of this software and associated documentation files (the "Software"), to deal
# in the Software without restriction, including without limitation the rights
# to use, copy, modify, merge, publish, distribute, sublicense, and/or sell
# copies of the Software, and to permit persons to whom the Software is
# furnished to do so, subject to the following conditions:

# The above copyright notice and this permission notice shall be included in all
# copies or substantial portions of the Software.

# THE SOFTWARE IS PROVIDED "AS IS", WITHOUT WARRANTY OF ANY KIND, EXPRESS OR
# IMPLIED, INCLUDING BUT NOT LIMITED TO THE WARRANTIES OF MERCHANTABILITY,
# FITNESS FOR A PARTICULAR PURPOSE AND NONINFRINGEMENT. IN NO EVENT SHALL THE
# AUTHORS OR COPYRIGHT HOLDERS BE LIABLE FOR ANY CLAIM, DAMAGES OR OTHER
# LIABILITY, WHETHER IN AN ACTION OF CONTRACT, TORT OR OTHERWISE, ARISING FROM,
# OUT OF OR IN CONNECTION WITH THE SOFTWARE OR THE USE OR OTHER DEALINGS IN THE
# SOFTWARE.



"""Loads custom user options and configuration files (`.toml`).  Saves options to a `.toml` file if go is true.  If a `.toml` file is specified in `save_to`, it is saved to.  Otherwise the default value of `save_to` is the installation-wide user options file.  One is created if it does not already exist.  This will overwrite existing files.

If not using a `config.toml` file, then e.g. when using a config component to set true `auto_` options, to guarantee your components are setup correctly when reloading a saved `.gh` file, this component must run before all your others.  To ensure a component runs first, select it and press `Ctrl` + `B` (or from the pull-down menu select `Edit` -> `Arrange` -> `Put To Back`) before saving the `.gh` file.
"""

__authors__ = {'James Parrott', 'Crispin Cooper'}
__version__ = '3.0.1'



import sys
import os
import functools
import importlib

from ghpythonlib.componentbase import executingcomponent as component
import Grasshopper
import scriptcontext as sc

import_module = importlib.import_module
try:
    reload #type: ignore
except NameError:
    reload = importlib.reload

try:
    basestring #type: ignore
except NameError:
    basestring = str

try:
    ghdoc #type: ignore
except NameError:
    from .skel.basic.ghdoc import ghdoc

ZIP_FILE_NAME = 'sdna-gh'
PACKAGE_NAME = 'sDNA_GH'
PLUG_IN_NAME = 'sDNA'               
RELOAD_IF_ALREADY_IMPORTED = False
REPOSITORY = os.path.dirname(os.path.dirname(ghdoc.Path)) if ghdoc.Path else None
# Assume we are in repo_folder/dev/sDNA_build_components.gh

SELFTEST = 'selftest'
APITEST_PREFIX = 'sDNA_GH_API_test_'
DEPS = ['toml_tools', 'shapefile', 'mapclassif_Iron']


def get_dir_of_python_package_containing_ghuser():
    # Assume this is run from a Grasshopper component in a .ghuser file, in some
    # sub-directory called PACKAGE_NAME.
    #
    # Tries to find the root dir of PACKAGE_NAME, in case the plug-in's zip file 
    # was extracted somewhere other than C:\Users\...\AppData\Roaming\Grasshopper\UserObjects
    #
    # False positives are possible if there are multiple sDNA_GH installations.

    gh_comp_server = Grasshopper.Kernel.GH_ComponentServer()

    for file_ in gh_comp_server.ExternalFiles(True, True):
        path = file_.FilePath
        if PACKAGE_NAME in path:
            break
        #
    else: # for loop did not break
        return None

    dir_ = os.path.dirname(path)

    while PACKAGE_NAME in dir_:
        dir_ = os.path.dirname(dir_)

    return dir_



class Output(object): 

    def set_logger(self, logger, flush = True):
        self.logger = logger
        if flush and self.tmp_logs:
            self.flush()

    def __init__(self
                ,tmp_logs = None
                ,logger = None
                ):
        if not isinstance(tmp_logs, list): #assert not isinstance(None, list)
            tmp_logs = []
        self.tmp_logs = tmp_logs
        self.set_logger(logger, flush = False)



    def store(self, message, logging_level):
        self.tmp_logs.append( (message, logging_level) )

    def __call__(self, message, logging_level = "INFO", logging_dict = {}):
        #type: (str, str, dict, list) -> str
        
        #logger.debug(s)

        if logging_dict == {} and self.logger is not None: 
            logging_dict = dict( DEBUG = self.logger.debug
                                ,INFO = self.logger.info
                                ,WARNING = self.logger.warning
                                ,ERROR = self.logger.error
                                ,CRITICAL = self.logger.critical
                                )

        logging_level = logging_level.upper()
        if logging_level in logging_dict:
            logging_dict[logging_level](message)
        else:
            self.store(message, logging_level)

        return '%s : %s ' % (logging_level, message)

    def __getattr__(self, attr):
        return functools.partial(self.__call__, logging_level = attr.upper())

    def flush(self):
        tmp_logs = self.tmp_logs[:] # __call__ might cache back to tmp_logs
        self.tmp_logs[:] = [] # Mutate list initialised with.  Avoid double 
                              # logging in case re - stored in tmp_logs
        for tmp_log_message, tmp_log_level in tmp_logs:
            self.__call__(tmp_log_message, tmp_log_level)

output = Output()


class InvalidArgsError(Exception):
    
    """Custom exception to log the error message, and to at least allow 
       attempts to give users actionable advice to fix the issue, in 
       the event of a problem.  
    """
    message_fmt = 'Invalid import args: %s'
    def __init__(self
                ,message_fmt = ''
                ,message = ''
                ,logger = output
                , **kwargs
                ):
        if message_fmt and isinstance(message_fmt, basestring):
            self.message_fmt = message_fmt
        if kwargs and (not message or not isinstance(message, basestring)):
            message = self.message_fmt % kwargs
        logger.error(message)
        self.kwargs = kwargs
        super(InvalidArgsError, self).__init__(message)    


class ModuleNameError(InvalidArgsError):
    message_fmt = 'Invalid module name: %s'


class FilePathError(InvalidArgsError):
    message_fmt = 'Invalid path to import module from: %s'


# We only know the sDNA version to import as a string.  This is more secure too.
def _import(module_name = ''
           ,folder = ''
           ,sub_folder = ''
           ,logger = output
           ,reload_already_imported = RELOAD_IF_ALREADY_IMPORTED
           ,strict=True
           ):

    # type: (str, str, str, type[any], bool) -> type[any]
    """ Imports the named module from the specified folder\subfolder only, 
        and returns it.
        
        Avoids name clashes and casual hijack attempts.  In some 
        environments supporting a Python implementation (such as 
        GhPython in Grasshopper) it may not be desirable to ask the user 
        to set PYTHONPATH.  Hence here, we insert the specified folder
        into sys.path (if they are not already in there).
    """
    if not module_name or not isinstance(module_name, basestring):
        raise ModuleNameError(module_name = module_name
                             ,folder = folder
                             ,sub_folder = sub_folder
                             ,logger = logger
                             )
    logger.debug(module_name)
    if module_name in sys.modules:   # sys.modules is also shared between GHPython components 
                                     # (and is even saved until Rhino is closed).
        logger.debug('Module %s already in sys.modules' % module_name)
        if reload_already_imported:
            logger.debug('Reloading %s.... ' % module_name)
            reload(sys.modules[module_name]) # type: ignore
        return sys.modules[module_name]
    #
    #
    # Load module_name for first time:
    #
    #
    search_path = os.path.join(folder, sub_folder)

    old_sys_dot_path = sys.path

    if (search_path 
        and isinstance(search_path, basestring) 
        and os.path.isdir(search_path)):
        #
        logger.debug('Search path == %s' % search_path)

        if search_path not in sys.path:
            if strict:
                logger.warning('Prepending sys.path with: %s' % search_path)
                sys.path.insert(0, search_path)
            else:
                logger.warning('Appending sys.path with: %s' % search_path)
                sys.path.append(search_path)

    elif strict:
        raise FilePathError(module_name = module_name
                           ,search_path = search_path
                           ,logger = logger
                           )

    logger.debug('Trying import... ')
    try:
        module = import_module(module_name, '')
        return module       
    finally:
        sys.path = old_sys_dot_path

    raise Exception('Could not import module: %s from: %s' % (module_name, search_path))




class ModulesNotFoundError(InvalidArgsError):
    message_fmt = 'Modules not found in any location %s'

def find_complete_installation_dir(
    m_names,
    dirs,
    logger = output,
    folders_error_msg = 'Please supply valid folders to import from. %s',
    ):
    #type(list[str], list[str], type[any], str) -> str

    logger.debug('Testing paths : %s ' % dirs)
    
    if isinstance(dirs, basestring):
        dirs = [dirs]


    if not any(os.path.isdir(dir_) or os.path.isdir(os.path.dirname(dir_)) 
               for dir_ in dirs
              ):
        raise FilePathError(message_fmt = folders_error_msg
                           ,m_names = m_names
                           ,logger = logger
                           )

    for dir_ in dirs:
        logger.debug('Type(dir_) : %s' % type(dir_).__name__)
        logger.debug('Type(path) : %s path == %s' %(type(dir_).__name__, dir_))

        if os.path.isfile(dir_):
            dir_ = os.path.dirname(dir_)
        if all( any(os.path.isfile(os.path.join(dir_, name.replace('.', os.sep) + ending)) 
                    for ending in ['.py','.pyc', '%s__init__.py' % os.sep ] 
                   )
                for name in m_names
              ):
            #
            logger.debug('Importing %s' % repr(m_names))
            return dir_

    # No directory found in dirs containing all modules
    raise ModulesNotFoundError(
                     message_fmt = modules_not_found_msg
                    ,m_names = m_names
                    ,folders = dirs
                    ,logger = logger
                    )

def load_modules(m_names
                ,folders
                ,logger = output
                ,module_name_error_msg = 'Please supply valid names of modules to import, %s'
                ,folders_error_msg = 'Please supply valid folders to import from. %s'
                ,modules_not_found_msg = 'Specified modules not found in any folder, %s'
                ):
    #type(str/ Iterable, list, type[any], str, str) -> tuple / None
    """ Tries to import all modules in m_names, from the first folder in 
        folders to contain a .py or .pyc files with the same name as each 
        module.

        Returns a tuple of all the modules and the path they were found in.  Else 
        raises a ModulesNotFoundError.
    """
    if not m_names:
        raise ModuleNameError(message_fmt = 'No module names supplied, m_names = %s'
                             ,m_names = m_names
                             ,logger = logger
                             )

    if isinstance(m_names, basestring):
        m_names = [m_names] 

    if any( not isinstance(m_name, basestring) for m_name in m_names ):
        raise ModuleNameError(message_fmt = module_name_error_msg
                             ,m_names = m_names
                             ,logger = logger
                             )
    
    logger.debug('m_names == %s of type : %s' % (m_names, type(m_names).__name__))

    if all(m_name in sys.modules for m_name in m_names):
        last_module_name = m_names[-1]
        last_module = sys.modules[last_module_name]
        folder = os.path.dirname(os.path.dirname(last_module.__file__))
    else:
        folder = find_complete_installation_dir(
            m_names,
            folders,
            logger,
            folders_error_msg,
            )

    # tuple of modules, and the path to them all
    return tuple(_import(name, folder, '', logger = logger) 
                    for name in m_names
                ) + (folder,)


class MissingEnvironmentVariable(Exception):
    pass


if __name__ == '__main__': # False in a compiled component.  But then the user
                           # can't add or remove Params to the component.  
    
    # Grasshopper will look for class MyComponent(component) in global scope
    # so a main() guard function is a little tricky to define.






    nick_name = ghenv.Component.NickName #type: ignore

    main_sDNA_GH_module = '%s.main' % PACKAGE_NAME
    checkers_module_name = '%s.skel.tools.helpers.checkers' % PACKAGE_NAME
    test_runners_module_name = '%s.tests.test_running_component_classes' % PACKAGE_NAME

    # builder can only load sDNA_GH from its parent directory, 
    # e.g. if in a dir one level up in the main repo
    # such as sDNA_build_components.gh.
    if (REPOSITORY and 
        nick_name == 'Build_components'):
        #
        build_env_custom_deps = os.getenv('SDNA_GH_BUILD_DEPS', None)

        if build_env_custom_deps is None:
            raise MissingEnvironmentVariable(
                'The environment variable SDNA_GH_BUILD_DEPS must be set '
                'to a directory containing the dependencies: ' + ', '.join(DEPS) +
                '. Run the components builder via "build_components.bat'
                ', or by building a Python wheel from the source repo. '
                ) 
        #

        sDNA_GH_search_paths = [os.path.join(REPOSITORY, 'src')]

        
        load_modules(
                 m_names = DEPS
                ,folders = build_env_custom_deps
                ,folders_error_msg = ('Could not find deps: %s in folder: %s'
                                        % (DEPS, build_env_custom_deps)
                                        )
                ,modules_not_found_msg = (
                                        'Failed to import deps: %s from folder: %s'
                                        % (DEPS, build_env_custom_deps)
                                        )
                )
    else:
        sDNA_GH_search_paths = [get_dir_of_python_package_containing_ghuser()]
        
    

    sc.doc = ghdoc #type: ignore

    output.debug(sDNA_GH_search_paths)


    class sDNA_GH(object):
        pass

    sDNA_GH.main, checkers, test_runners, sDNA_GH_path = load_modules(
             m_names = [main_sDNA_GH_module,
                        checkers_module_name,
                        test_runners_module_name,
                       ]
            ,folders = sDNA_GH_search_paths
            ,folders_error_msg = ('Please unzip %s.zip '
                                 +' in the folder %s '
                                 +'and ensure a subfolder called %s is created '
                                 +'inside it, containing main.py ' 
                                 +'and all the sDNA_GH python files '
                                 +'including those within other subfolders. '
                                 ) % (ZIP_FILE_NAME
                                     ,Grasshopper.Folders.DefaultUserObjectFolder
                                     ,os.path.join(ZIP_FILE_NAME, PACKAGE_NAME)
                                     )
            ,modules_not_found_msg = ('Some sDNA_GH files may be missing.  '
                                     +'Please: 1) Copy %s.zip into: %s '
                                     +'2) Unblock it if necessary. '
                                     +'3) Right click '
                                     +'it, select Extract All... and click Extract, '
                                     +'to extract it to that location. '
                                     +'4) Ensure that main.py and all sDNA_GH python' 
                                     +' files and subfolders are inside: %s '
                                     +'5) Reinitialise the component or restart Rhino.'
                                     ) % (ZIP_FILE_NAME
                                         ,Grasshopper.Folders.DefaultUserObjectFolder
                                         ,os.path.join(Grasshopper.Folders.DefaultUserObjectFolder
                                                      ,ZIP_FILE_NAME  
                                                      ,PACKAGE_NAME
                                                      )
                                         )
            )

    




    logger = sDNA_GH.main.logger.getChild('launcher')
    output.set_logger(logger, flush = True)


    class MyComponent(component):
        pass  # Required.  Idiomatic to Grasshopper.  Must be called "MyComponent"  
              # too (it is looked for by the parser or scope checker?) otherwise 
              # Grasshopper may not find the subclass of on 
              # component.  Even though we overwrite this class on the next line
              # immediately below.  


    log_file_dir = os.path.dirname(checkers.get_path(fallback = sDNA_GH_path))

    if nick_name.replace(' ','').replace('_','').lower() == SELFTEST:  
        MyComponent = test_runners.make_test_running_component_class(
                                             log_file_dir = log_file_dir
                                            ,start_dir = sDNA_GH_path
                                            )
    elif nick_name.startswith(APITEST_PREFIX):

        if not os.getenv('NUM_TESTS'):
            raise Exception('The environment variable: NUM_TESTS must be set. ')

        MyComponent = test_runners.make_noninteractive_api_test_running_component_class(
                 test_name = nick_name.partition(APITEST_PREFIX)[2]
                ,log_file_dir = log_file_dir
                )
    else:
        MyComponent = sDNA_GH.main.sDNA_GH_Component
        # Grasshopper calls MyComponent.RunScript automatically (in SDK mode GhPython components).
# ---------- end config ----------
geom_types = GeomTypesAndCounts()  # -> out, a; inputs x: list
# ---------- geom_types: Python ----------
from collections import defaultdict
from sDNA_GH.skel.tools.helpers.rhino_gh_geom import get_geom_and_source_else_leave



ghenv.Component.ToggleObsolete(False)


obj_types = defaultdict(list)

for obj in x:
    geom, source = get_geom_and_source_else_leave(obj)
    
    obj_types[(type(obj).__name__, type(geom).__name__)].append(obj)
    
    
a = '\n'.join('# of (Obj type: %s, geom_type: %s) : %s' % (k + (len(v),) )
               for k, v in obj_types.items()
             )
             
print(a)
# ---------- end geom_types ----------
coords_from_geom = GetCoOrdinatesWithNoChecksFirst()  # -> out, a; inputs x: list
# ---------- coords_from_geom: Python ----------
import Rhino
import scriptcontext as sc

import System

from collections import defaultdict
from sDNA_GH.skel.tools.helpers.rhino_gh_geom import (
                                            get_geom_and_source_else_leave
                                           ,get_points_from_obj
                                           )
from sDNA_GH.skel.tools.helpers.funcs import is_uuid



ghenv.Component.ToggleObsolete(False)


points_types = defaultdict(list)

for obj in x: #[0]:
    
    geom, source = get_geom_and_source_else_leave(obj)
    try:
        points_list = get_points_from_obj(geom)
    except:
        points_list = 'Error when getting points'
    
    if points_list == 'Error when getting points':
        num_type_names = container_type_names = points_list
    else:
        num_type_names = frozenset(
                               type(coord).__name__
                               for point in points_list
                               for coord in point
                              ) 
                              
        
        container_type_names = frozenset(
                               type(point).__name__
                               for point in points_list
                              ) 
    
    points_types[
        (type(obj).__name__,
         type(geom).__name__,
         container_type_names,
         num_type_names,
        )].append(obj)
    
    
a = '\n'.join('# of (Obj type: %s, geom_type: %s, converts to: %s containing: %s) : %s' % (k[0],
                                                                                           k[1],
                                                                                           ', '.join(k[2]),
                                                                                           ', '.join(k[3]), 
                                                                                           len(v)
                                                                                           ) 
               for k, v in points_types.items()
             )
             
print(a)
# ---------- end coords_from_geom ----------
allowed_geom_checks = RunTheGeometryCheckerFunctions()  # -> out, a; inputs x: list
# ---------- allowed_geom_checks: Python ----------
import Rhino
import scriptcontext as sc
import rhinoscriptsyntax

import System

from collections import defaultdict
from sDNA_GH.skel.tools.helpers.rhino_gh_geom import (
                                                    Rhino_obj_checkers_for_shape,
                                                    get_geom_and_source_else_leave)



ghenv.Component.ToggleObsolete(False)

points_types = defaultdict(list)

for obj in x:
    result_of_checks = ''
    geom, source = get_geom_and_source_else_leave(obj)
    for checker in Rhino_obj_checkers_for_shape['POLYLINEZ']:
        if isinstance(checker, str):
            func = getattr(rhinoscriptsyntax, checker) 
            name = checker
        else:
            func = checker
            name = checker.__name__
        result_of_checks += '%s(geom): %s, ' % (str(name), func(geom)
                           )
    print(result_of_checks)
# ---------- end allowed_geom_checks ----------
