# Grasshopper definition Random_colours_generator.gh (Grasshopper 1.0.8)

random_colour_generator = Random_colour_generator(N=1, S=2)

# ==== cluster Random_colour_generator
N = ClusterInput()
S = ClusterInput()
min = Number(-123)
max = Number(173)
dom = ConstructDomain(DomainStart=min, DomainEnd=max)
random = Random(Range=dom, Number=N, Seed=S)
gradient = Gradient(
    LowerLimit=min,
    UpperLimit=max,
    Parameter=random,
    stops=[0: RGB(243, 57, 0), 0.1: RGB(236, 27, 60), 0.2: RGB(210, 0, 118), 0.3: RGB(103, 0, 120), 0.4: RGB(39, 72, 161), 0.5: RGB(1, 192, 229), 0.6: RGB(18, 178, 90), 0.7: RGB(79, 186, 8), 0.8: RGB(220, 237, 32), 0.9: RGB(247, 159, 20), 1: RGB(243, 57, 0)])
C = ClusterOutput(gradient)
