# Grasshopper definition Shp_Data_Tree_component.gh (Grasshopper 1.0.7)

shp_data_tree = Shp_Data_Tree()

# ==== cluster Shp_Data_Tree
key_name = ClusterInput()
key_format_string = ClusterInput()
T = ClusterInput()
rep = ReplaceText(Key_Format_String=key_format_string, Find="{name}", Key_name=key_name, RecursiveReplace=False)
lng = ListLength(Values=T)
repeat = RepeatData(Data=rep, Length=lng)
# Values
graft = GraftTree(Tree=flatten(T), IncludeEmptyLists=True, IncludeNullItems=True)  # -> simplify(Tree)
graft_2 = GraftTree(Tree=flatten(repeat), IncludeEmptyLists=True, IncludeNullItems=True)  # -> simplify(Tree)
path_mapper = PathMapper(graft, source="{A}", target="{0;1;A}")
# Keys
path_mapper_2 = PathMapper(graft_2, source="{A}", target="{0;0;A}")
merge = Merge(Data1=path_mapper, Data2=path_mapper_2)
result = ClusterOutput(merge)
