# Grasshopper definition another_gh_doc.gh (Grasshopper 1.0.8)

read_geom = Read_Geom()  # -> a
# ---------- read_geom: Python ----------
from ghpythonlib.componentbase import executingcomponent as component


class MyComponent(component):
    
    def RunScript(self, x, y):
        x = x or 0
        y = y or 0
        
        return x*y
# ---------- end read_geom ----------
panel = Panel(read_geom)
