# Grasshopper definition exit_Rhino.gh (Grasshopper 1.0.8)
# plug-ins: RhinoCodePluginGH

rhino_rhinoapp_exit_allowcancel_false = IronPython2Script()  # -> out, a; disabled
# ---------- rhino_rhinoapp_exit_allowcancel_false: IronPython ----------
import Rhino

Rhino.RhinoApp.Exit(allowCancel=False)
# ---------- end rhino_rhinoapp_exit_allowcancel_false ----------
from_dale_s_runpythonscript = IronPython2Script()  # -> out, a; disabled
# ---------- from_dale_s_runpythonscript: IronPython ----------
__author__ = 'Dale Fugier'
# https://discourse.mcneel.com/t/sys-exit-shows-popup-window-instead-of-just-exiting/163811/7

import ctypes

import scriptcontext
import Rhino

def close_rhino(code=0):
    scriptcontext.doc = Rhino.RhinoDoc.ActiveDoc
    # Suppress the "Do you want to save this file..." dialog when closing Rhino.
    scriptcontext.doc.Modified = False
    # Post a WM_CLOSE message to Rhino's main window
    hWnd = Rhino.RhinoApp.MainWindowHandle()
    ctypes.windll.user32.PostMessageW(hWnd, 0x0010, 0, code)

close_rhino(17)
# ---------- end from_dale_s_runpythonscript ----------
postquitmessage_code = IronPython2Script()  # -> out, a
# ---------- postquitmessage_code: IronPython ----------
import ctypes
   
    
ctypes.windll.user32.PostQuitMessage(19)
# ---------- end postquitmessage_code ----------
