# Grasshopper definition make_gephi_edges_csv.gh (Grasshopper 1.0.8)

crv = Curve([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])
sdna_integral = SDNA_Integral(go=Toggle(False), Geom=crv)  # -> out, OK, opts, file, Geom, Data, abbrevs, fields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; inputs go: list, opts: list, Geom: list, Data: tree, file: list, prj: list, input_key_str: list, config: list, input: list, output: list, betweenness: list, bidir: list, junctions: list, hull: list, start_gs: list, end_gs: list, analmet: list, radii: list, bandedradii: list, cont: list, radmet: list, weighting: list, origweight: list, destweight: list, zonefiles: list, odfile: list, custommetric: list, disable: list, oneway: list, intermediates: list, advanced: list, lineformula: list, juncformula: list, bake: list, ignore_invalid: list
#   port go: true: runs tools. false: do not run tools but still read other Params.
#   port opts: sDNA_GH options data structure. Python dictionary.
#   port Geom: A list of geometric objects. Requires GUIDs of Rhino objects or native/embedded Grasshopper geometry. To use Rhino objects referenced from Grasshopper parameter objects (instead of their Grasshopper versions which are often obscured unless the Rhino shapes are set to Hidden) run the output of the Geometry (Geo) or Curve (Crv) through a Guid (ID) parameter object first. Note: For sDNA tools all the geometric objects must all be polylines. For write_Shp all the objects must be of the type in shp_type (default: POLYLINEZ).
#   port Data: A Data Tree of a list of keys and list of corresponding values for each object in Geom.
#   port file: File path of the shape file.
#   port prj: File path of the projection file (.prj) to use for the new shapefile. Default :
#   port input_key_str: Format string containing a prefix, a {name} field, and a postfix, to enable more descriptive User Text key names. Default: {name} Only User Text key names matching this pattern will have their values written to shape files by Write_Shp,under the field name in {name}, which can have a max of 10 chars in Write_Shp. The actual values of name in User Text keys must also be specified to the sDNA tools that use them.
#   port config: File path to sDNA_GH options file. Default: C:\Users\drjam\AppData\Roaming\Grasshopper\UserObjects\sdna-gh\sDNA_GH\config.toml
#   port input: Input polyline features. Default value == .Type: File path.
#   port output: Output features. Default value == .Type: File path.
#   port betweenness: Compute betweenness. Default value == True.Type: Boolean.
#   port bidir: Betweenness is bidirectional. Default value == False.Type: Boolean.
#   port junctions: Compute junction counts. Default value == False.Type: Boolean.
#   port hull: Compute convex hull statistics. Default value == False.Type: Boolean.
#   port start_gs: Start grade separation. Default value == . Allowed values: Numeric, input. Type: Text.
#   port end_gs: End grade separation. Default value == . Allowed values: Numeric, input. Type: Text.
#   port analmet: Routing and analysis metric. Default value == EUCLIDEAN. Allowed values: EUCLIDEAN, ANGULAR, HYBRID, CUSTOM, CYCLE, CYCLE_ROUNDTRIP, PEDESTRIAN, VEHICLE, PUBLIC_TRANSPORT, EUCLIDEAN_ANGULAR. Type: Text.
#   port radii: Radii (in units of radial metric or source data projection). Default value == n.Type: Text.
#   port bandedradii: Banded radius. Default value == False.Type: Boolean.
#   port cont: Continuous Space. Default value == False.Type: Boolean.
#   port radmet: Radial metric. Default value == EUCLIDEAN. Allowed values: EUCLIDEAN, MATCH_ANALYTICAL, ANGULAR, HYBRID, CUSTOM, CYCLE, CYCLE_ROUNDTRIP, PEDESTRIAN, VEHICLE, PUBLIC_TRANSPORT, EUCLIDEAN_ANGULAR. Type: Text.
#   port weighting: Weighting. Default value == Link. Allowed values: Link, Length, Polyline. Type: Text.
#   port origweight: Origin weight. Default value == . Allowed values: Numeric, input. Type: Text.
#   port destweight: Destination weight. Default value == . Allowed values: Numeric, input. Type: Text.
#   port zonefiles: Zone table input csv files. Default value == .Type: File path.
#   port odfile: Origin Destination Matrix input file. Default value == .Type: File path.
#   port custommetric: Custom metric field. Default value == . Allowed values: Numeric, input. Type: Text.
#   port disable: Disable lines (field name or expression). Default value == .Type: Text.
#   port oneway: One way restrictions. Default value == . Allowed values: Numeric, input. Type: Text.
#   port intermediates: Intermediate link filter (field name or expression). Default value == .Type: Text.
#   port advanced: Advanced config. Default value == .Type: Text.
#   port lineformula: Line formula (requires hybrid metric).Default value == .Type: Text.
#   port juncformula: Junction formula (requires hybrid metric).Default value == 0.Type: Text.
#   port bake: If new shapes are created, thentrue: bakes the shapefile polylines to Rhino. false: creates Grasshopper polylines only. Default: False
#   port ignore_invalid: True: suppress errors from failing to add shapes to Rhino/GH document. False: skip shapes that could not be added to the document. Default: False If True, the reasons why those shapes are incompatible with Rhino are viewable in *invalid*, but they are also logged as warnings (or errors if False) to *out* and any *log_file* Five validity criteria are defined here:https://developer.rhino3d.com/api/RhinoCommon/html/P_Rhino_Geometry_Polyline_IsValid.htm
#   port OK: true: tools ran successfully. false: tools did not run, or there was an error.
#   port opts: sDNA_GH options data structure. Python dictionary.
#   port file: File path of the shape file.
#   port Geom: A list of geometric objects. Requires GUIDs of Rhino objects or native/embedded Grasshopper geometry. To use Rhino objects referenced from Grasshopper parameter objects (instead of their Grasshopper versions which are often obscured unless the Rhino shapes are set to Hidden) run the output of the Geometry (Geo) or Curve (Crv) through a Guid (ID) parameter object first. Note: For sDNA tools all the geometric objects must all be polylines. For write_Shp all the objects must be of the type in shp_type (default: POLYLINEZ).
#   port Data: A Data Tree of a list of keys and list of corresponding values for each object in Geom.
#   port abbrevs: Abbreviations of sDNA results from the ...names.csv file.
#   port fields: Field names from the Shapefile. Set field to one of these values to parse and/or plot it.
#   port field_prefixes: sDNA_prefixes of field names from the Shapefile. Set field_prefix to one of these values to search for a field to parse and/or plot. WARNING!: May lead to meaningless comparisons (changing the measure "moves the goal posts").
#   port bbox: Bounding box from the Shapefile. Used to calculate leg_frame by the Recolour_objects component. [x_min, y_min, x_max, y_max]. All Numbers.
#   port invalid: Duplicates specific console output in out. Details why particular shapes (if any) in the shapefile could not be added to a document in Rhino, raising errors. ignore_invalid (currently: False) must be True to read invalid, to suppress those same errors (errors stop this and all output Params from receiving data).
# ---------- sdna_integral: Python ----------
#! /usr/bin/awk NR==3
# -*- coding: utf-8 -*-
# This module requires Grasshopper Python (Rhino3D)

# MIT License

# Copyright (c) [2021] [Cardiff University, a body incorporated
# by Royal Charter and a registered charity (number:
# 1136855) whose administrative offices are at 7th floor 30-
# 36 Newport Road, University CF24 0DE, Wales, UK]

# Permission is hereby granted, free of charge, to any person obtaining a copy
# of this software and associated documentation files (the "Software"), to deal
# in the Software without restriction, including without limitation the rights
# to use, copy, modify, merge, publish, distribute, sublicense, and/or sell
# copies of the Software, and to permit persons to whom the Software is
# furnished to do so, subject to the following conditions:

# The above copyright notice and this permission notice shall be included in all
# copies or substantial portions of the Software.

# THE SOFTWARE IS PROVIDED "AS IS", WITHOUT WARRANTY OF ANY KIND, EXPRESS OR
# IMPLIED, INCLUDING BUT NOT LIMITED TO THE WARRANTIES OF MERCHANTABILITY,
# FITNESS FOR A PARTICULAR PURPOSE AND NONINFRINGEMENT. IN NO EVENT SHALL THE
# AUTHORS OR COPYRIGHT HOLDERS BE LIABLE FOR ANY CLAIM, DAMAGES OR OTHER
# LIABILITY, WHETHER IN AN ACTION OF CONTRACT, TORT OR OTHERWISE, ARISING FROM,
# OUT OF OR IN CONNECTION WITH THE SOFTWARE OR THE USE OR OTHER DEALINGS IN THE
# SOFTWARE.



"""sDNA Integral is the core analysis tool of sDNA. It computes several flow, accessibility, severance and efficiency measures on networks. 

This automatically calls other support tools, handling an entire Rhino geometry workflow from this one component, additionally running Read_Geom and Write_Shp before the sDNA tool itself, and then Read_Shp and Recolour_Objects afterwards  (unless `auto_write_Shp` = false or `auto_read_Shp` = false respectively).   **WARNING!  All sDNA tools will delete the shapefile named in input after it has been read in, if `del_after_sDNA` = true and `strict_no_del` = false (as they are by default).**  

To add or remove existing `Geom`etry before the results file is read in (to control creation of new geometry objects), set `auto_read_Shp` = false and connect a Read_Shp component.  To analyse a network of Grasshopper Geometry set `auto_get_Geom` and `auto_read_User_Text` to false.  To access the data and geom objects before parsing and recolouring, `auto_plot_data` = false (and connect Parse_Data and Recolour_Objects components).  This allows picking a results field from `abbrevs` to parse without repeating the whole analysis, and using a Grasshopper Colour Gradient component on the canvas to generate colours.  Connect a Grasshopper Legend component to plot a legend. To recolour Grasshopper geometry instead of Rhino Geometry (i.e. unbaked objects), connect the `Data` and `Geom` outputs to a Grasshopper Custom Preview component.

To use sDNA's advanced config options in sDNA_GH, add in an input Param to an sDNA component with the same name as each advanced config option you wish to include (omitting a trailing equals sign and leaving the Param unconnected, unless you wish to provide a value for it); the `advanced` config string can then be saved to a `config.toml` file with an sDNA_GH Config component).  Alternatively create an `advanced` config string manually.  The sDNA tools in that component will gather all user-specified input Params and construct the `advanced` config string from them.  Alternatively, prepare the and connect it to `advanced`.  See the readme for the list of supported advanced config options.
"""

__author__ = 'James Parrott'
__version__ = '3.0.0.alpha_3'



import sys
import os
import functools
import importlib

from ghpythonlib.componentbase import executingcomponent as component
import Grasshopper
import scriptcontext as sc

import_module = importlib.import_module
try:
    reload #type: ignore
except NameError:
    reload = importlib.reload

try:
    basestring #type: ignore
except NameError:
    basestring = str

try:
    ghdoc #type: ignore
except NameError:
    from .custom.skel.basic.ghdoc import ghdoc

ZIP_FILE_NAME = 'sdna-gh'
PACKAGE_NAME = 'sDNA_GH'
PLUG_IN_NAME = 'sDNA'               
RELOAD_IF_ALREADY_IMPORTED = False
REPOSITORY = os.path.dirname(os.path.dirname(ghdoc.Path)) if ghdoc.Path else None
# Assume we are in repo_folder/dev/sDNA_build_components.gh

USER_INSTALLATION_FOLDER = os.path.join(
                                    Grasshopper.Folders.DefaultUserObjectFolder
                                   ,ZIP_FILE_NAME
                                   )
SELFTEST = 'selftest'
APITEST_PREFIX = 'sDNA_GH_API_test_'




class Output(object): 

    def set_logger(self, logger, flush = True):
        self.logger = logger
        if flush and self.tmp_logs:
            self.flush()

    def __init__(self
                ,tmp_logs = None
                ,logger = None
                ):
        if not isinstance(tmp_logs, list): #assert not isinstance(None, list)
            tmp_logs = []
        self.tmp_logs = tmp_logs
        self.set_logger(logger, flush = False)



    def store(self, message, logging_level):
        self.tmp_logs.append( (message, logging_level) )

    def __call__(self, message, logging_level = "INFO", logging_dict = {}):
        #type: (str, str, dict, list) -> str
        
        #logger.debug(s)

        if logging_dict == {} and self.logger is not None: 
            logging_dict = dict( DEBUG = self.logger.debug
                                ,INFO = self.logger.info
                                ,WARNING = self.logger.warning
                                ,ERROR = self.logger.error
                                ,CRITICAL = self.logger.critical
                                )

        logging_level = logging_level.upper()
        if logging_level in logging_dict:
            logging_dict[logging_level](message)
        else:
            self.store(message, logging_level)

        return '%s : %s ' % (logging_level, message)

    def __getattr__(self, attr):
        return functools.partial(self.__call__, logging_level = attr.upper())

    def flush(self):
        tmp_logs = self.tmp_logs[:] # __call__ might cache back to tmp_logs
        self.tmp_logs[:] = [] # Mutate list initialised with.  Avoid double 
                              # logging in case re - stored in tmp_logs
        for tmp_log_message, tmp_log_level in tmp_logs:
            self.__call__(tmp_log_message, tmp_log_level)

output = Output()


class InvalidArgsError(Exception):
    
    """Custom exception to log the error message, and to at least allow 
       attempts to give users actionable advice to fix the issue, in 
       the event of a problem.  
    """
    message_fmt = 'Invalid import args: %s'
    def __init__(self
                ,message_fmt = ''
                ,message = ''
                ,logger = output
                , **kwargs
                ):
        if message_fmt and isinstance(message_fmt, basestring):
            self.message_fmt = message_fmt
        if kwargs and (not message or not isinstance(message, basestring)):
            message = self.message_fmt % kwargs
        logger.error(message)
        self.kwargs = kwargs
        super(InvalidArgsError, self).__init__(message)    


class ModuleNameError(InvalidArgsError):
    message_fmt = 'Invalid module name: %s'


class FilePathError(InvalidArgsError):
    message_fmt = 'Invalid path to import module from: %s'


# We only know the sDNA version to import as a string.  This is more secure too.
def strict_import(module_name = ''
                 ,folder = ''
                 ,sub_folder = ''
                 ,logger = output
                 ,reload_already_imported = RELOAD_IF_ALREADY_IMPORTED
                 ):

    # type: (str, str, str, type[any], bool) -> type[any]
    """ Imports the named module from the specified folder\subfolder only, 
        and returns it.
        
        Avoids name clashes and casual hijack attempts.  In some 
        environments supporting a Python implementation (such as 
        GhPython in Grasshopper) it may not be desirable to ask the user 
        to set PYTHONPATH.  Hence here, we insert the specified folder
        into sys.path (if they are not already in there).
    """
    if not module_name or not isinstance(module_name, basestring):
        raise ModuleNameError(module_name = module_name
                             ,folder = folder
                             ,sub_folder = sub_folder
                             ,logger = logger
                             )
    logger.debug(module_name)
    if module_name in sys.modules:   # sys.modules is also shared between GHPython components 
                                     # (and is even saved until Rhino is closed).
        logger.debug('Module %s already in sys.modules' % module_name)
        if reload_already_imported:
            logger.debug('Reloading %s.... ' % module_name)
            reload(sys.modules[module_name]) # type: ignore
        return sys.modules[module_name]
    #
    #
    # Load module_name for first time:
    #
    #
    search_path = os.path.join(folder, sub_folder)

    if (search_path 
        and isinstance(search_path, basestring) 
        and os.path.isdir(search_path)):
        #
        logger.debug('Search path == %s' % search_path)
        #if search_folder_only:
        #    sys.path = [search_path]
        if search_path not in sys.path:
            sys.path.insert(0, search_path)
    else:
        raise FilePathError(module_name = module_name
                           ,search_path = search_path
                           ,logger = logger
                           )

    logger.debug('Trying import... ')
    module = import_module(module_name, '')           

    return module       


class ModulesNotFoundError(InvalidArgsError):
    message_fmt = 'Modules not found in any location %s'


def load_modules(m_names
                ,folders
                ,logger = output
                ,module_name_error_msg = 'Please supply valid names of modules to import, %s'
                ,folders_error_msg = 'Please supply valid folders to import from. %s'
                ,modules_not_found_msg = 'Specified modules not found in any folder, %s'):
    #type(str/ Iterable, list, type[any], str, str) -> tuple / None
    """ Tries to import all modules in m_names, from the first folder in 
        folders to contain a .py or .pyc files with the same name as each 
        module.

        Returns a tuple of all the modules and the path they were found in.  Else 
        raises a ModulesNotFoundError.
    """
    if not m_names:
        raise ModuleNameError(message_fmt = 'No module names supplied, m_names = %s'
                             ,m_names = m_names
                             ,logger = logger
                             )

    if any( not isinstance(m_name, basestring) for m_name in m_names ):
        # if m_names is a basestring, the error is not raised 
        raise ModuleNameError(message_fmt = module_name_error_msg
                             ,m_names = m_names
                             ,logger = logger
                             )
    
    if isinstance(m_names, basestring):
        m_names = [m_names] 

    logger.debug('m_names == %s of type : %s' % (m_names, type(m_names).__name__))

    logger.debug('Testing paths : %s ' % folders)
    
    if isinstance(folders, basestring):
        folders = [folders]

    if not any(os.path.isdir(folder) or os.path.isdir(os.path.dirname(folder)) 
               for folder in folders
              ):
        raise FilePathError(message_fmt = folders_error_msg
                           ,m_names = m_names
                           ,logger = logger
                           )

    for folder in folders:
        logger.debug('Type(folder) : %s' % type(folder).__name__)
        logger.debug('Type(path) : %s path == %s' %(type(folder).__name__, folder))

        if os.path.isfile(folder):
            folder = os.path.dirname(folder)
        if all( any(os.path.isfile(os.path.join(folder, name.replace('.', os.sep) + ending)) 
                    for ending in ['.py','.pyc'] 
                   )
                for name in m_names
              ):
            #
            logger.debug('Importing %s' % repr(m_names))

            return tuple(strict_import(name, folder, '', logger = logger) 
                         for name in m_names
                        ) + (folder,)
            # tuple of modules, followed by the path to them
    raise ModulesNotFoundError(message_fmt = modules_not_found_msg
                              ,m_names = m_names
                              ,folders = folders
                              ,logger = logger
                              )




if __name__ == '__main__': # False in a compiled component.  But then the user
                           # can't add or remove Params to the component.  
    
    # Grasshopper will look for class MyComponent(component) in global scope
    # so a main function is a little tricky to define.

    nick_name = ghenv.Component.NickName #type: ignore


    if (REPOSITORY and 
        nick_name == 'Build_components'):
        #
        sDNA_GH_search_path = REPOSITORY 
        # builder can only load sDNA_GH from its parent directory, 
        # e.g. if in a dir one level up in the main repo
        # such as sDNA_build_components.gh.
    else:
        sDNA_GH_search_path = USER_INSTALLATION_FOLDER


    sc.doc = ghdoc #type: ignore

    output.debug(sDNA_GH_search_path)

    class sDNA_GH(object):
        pass

    if 'sDNA_GH.main' in sys.modules:
        sDNA_GH.main = sys.modules['sDNA_GH.main']
    else:
        sDNA_GH.main, _ = load_modules(
             m_names = PACKAGE_NAME + '.main'
            ,folders = sDNA_GH_search_path
            ,folders_error_msg = 'Please unzip %s.zip '
                                % ZIP_FILE_NAME
                                +' in the folder %s '
                                % Grasshopper.Folders.DefaultUserObjectFolder
                                +'and ensure a subfolder called %s is created '
                                % os.path.join(ZIP_FILE_NAME, PACKAGE_NAME)
                                +'inside it, containing main.py ' 
                                +'and all the sDNA_GH python files '
                                +'including those within other subfolders. ' 
            ,modules_not_found_msg = 'Some sDNA_GH files may be missing.  '
                                    +('Please: 1) Copy %s.zip into: %s '
                                    % (ZIP_FILE_NAME
                                      ,Grasshopper.Folders.DefaultUserObjectFolder
                                      ))
                                    +'2) Unblock it if necessary. '
                                    +'3) Right click '
                                    +'it, select Extract All... and click Extract, '
                                    +'to extract it to that location. '
                                    +'4) Ensure that main.py and all sDNA_GH python' 
                                    +(' files and subfolders are inside: %s '
                                    % os.path.join(USER_INSTALLATION_FOLDER
                                                  ,PACKAGE_NAME
                                                  ))
                                    +'5) Reinitialise the component or restart Rhino.'
            )         


    logger = sDNA_GH.main.logger.getChild('launcher')
    output.set_logger(logger, flush = True)


    class MyComponent(component):
        pass  # Required.  Idiomatic to Grasshopper.  Must be called "MyComponent"  
            # too (it is looked for by the parser or scope checker?) otherwise 
            # Grasshopper may not find the subclass of on 
            # component.  Even though we overwrite this class on the next line
            # immediately below.  


    
    test_runners, _ = load_modules('%s.tests.test_running_component_classes' % PACKAGE_NAME
                                  ,sDNA_GH_search_path
                                  )

    if nick_name.replace(' ','').replace('_','').lower() == SELFTEST:  
        MyComponent = test_runners.make_test_running_component_class(
                package_location = sDNA_GH_search_path
                )
    elif nick_name.startswith(APITEST_PREFIX) and os.getenv('NUM_SDNA_GH_API_TESTS'):
        MyComponent = test_runners.make_noninteractive_api_test_running_component_class(
                package_location = sDNA_GH_search_path
                ,test_name = nick_name.partition(APITEST_PREFIX)[2]
                )
    else:
        MyComponent = sDNA_GH.main.sDNA_GH_Component
        # Grasshopper calls MyComponent.RunScript automatically (in SDK mode GhPython components).
# ---------- end sdna_integral ----------
nodes_and_connections = NodesAndConnections(curves=crv)  # -> nodes, start_nodes, start_indexes, end_nodes, end_indexes, pairs_of_nodes, pairs_of_indexes
panel = Panel(sdna_integral.fields)
prepare_edges_csv_text_for_gelphi = PrepareEdgesCSVTextForGelphi(
    pairs_of_indices=nodes_and_connections.pairs_of_indexes,
    edge_attribute_names=sdna_integral.fields,
    data=sdna_integral.Data)
panel_2 = Panel(prepare_edges_csv_text_for_gelphi)
write_text_file = GH_Python(go=Toggle(False), text=prepare_edges_csv_text_for_gelphi)  # -> out, path
# ---------- write_text_file: Python ----------
import os.path
import tempfile

import System
import clr
clr.AddReference('Microsoft.VisualBasic')
import Microsoft.VisualBasic

from ghpythonlib.componentbase import executingcomponent as component
import Grasshopper, GhPython
import Rhino
import rhinoscriptsyntax as rs
import scriptcontext as sc



def recycle_file(path):
    recycle_option = Microsoft.VisualBasic.FileIO.RecycleOption.SendToRecycleBin

    ui_option = Microsoft.VisualBasic.FileIO.UIOption.OnlyErrorDialogs
    
    Microsoft.VisualBasic.FileIO.FileSystem.DeleteFile(path, ui_option, recycle_option)


def get_path(fallback = None, inst = None):
    #type(dict, type[any]) -> str
    #refers to `magic' global ghdoc so needs to 
    # be in module scope (imported above)
    
    path_getters = [lambda : Rhino.RhinoDoc.ActiveDoc.Path
                   ,lambda : ghdoc.Path
                   ,lambda : inst.ghdoc.Path  #e.g. via old Component decorator
                   ,lambda : sc.doc.Path
                   ,lambda : fallback
                   ]
    path = None
    for path_getter in path_getters:
        try:
            path = path_getter()
        except AttributeError:
            continue
        if isinstance(path, basestring) and (os.path.isfile(path) or os.path.isdir(path)):
            return path 
    return None 


class MyComponent(component):
    
    i = 1
    
    def RunScript(self, go, text, path, ext, append, overwrite, encoding):
        
        if not go:
            return None
        
        text = text or ''
        
        if not path:
            fallback = os.path.join(tempfile.gettempdir(), 'text_file_from_Grasshopper')
            path = get_path(fallback, self)
            path = os.path.splitext(path)[0]
            
        if ext:
            path += ext
        elif not os.path.splitext(path)[1]:
            path += '.csv'
            
        if overwrite:
            if os.path.exists(path):
                print('Sending %s to Recycle Bin... ' % path)
                recycle_file(path)
                print('Moved: %s to Recycle Bin. ' % path)
        else:
            while os.path.exists(path):
                name, ext = os.path.splitext(path)
                path = '%s_(%s)%s' % (name, self.i, ext)
                self.i += 1
        
        mode = 'ab' if append else 'wb'
        
        encoding = encoding or 'utf-8'
        
        with open(path, mode) as f:
            f.write(text.encode(encoding))
        
        return path
# ---------- end write_text_file ----------
panel_3 = Panel(write_text_file.path)

# ==== cluster NodesAndConnections
curves = ClusterInput()  # Any Geometry supported by End Points.
end = EndPoints(Curve=curves)  # -> Start, End
weave = Weave(Pattern=[0, 1], Stream0=end.Start, Stream1=end.End, NullGaps=False)
merge = Merge(Data1=end.Start, Data2=end.End)
_2 = Integer(2)
partition = PartitionList(List=weave, Size=_2)
cullpt = CullDuplicates(Points=merge, Tolerance=0.1, CullMode=3)  # -> Points, Indices, Valence
cp = ClosestPoint(Point=end.Start, Cloud=cullpt.Points)  # -> ClosestPoint, CPIndex, Distance
cp_2 = ClosestPoint(Point=end.End, Cloud=cullpt.Points)  # -> ClosestPoint, CPIndex, Distance
cp_3 = ClosestPoint(Point=partition, Cloud=cullpt.Points)  # -> ClosestPoint, CPIndex, Distance
nodes = ClusterOutput(cullpt.Points)  # Start and end points with duplicates removed.
start_nodes = ClusterOutput(cp.ClosestPoint)  # The start node of each connection
start_indexes = ClusterOutput(cp.ClosestPoint)  # The index of the start node of each connection.
end_nodes = ClusterOutput(cp_2.ClosestPoint)  # The end node of each connection.
end_indexes = ClusterOutput(cp_2.CPIndex)  # The index of the end node of each connection.
pairs_of_indexes = ClusterOutput(cp_3.CPIndex)  # Start node index and end node index for each connection.
pairs_of_nodes = ClusterOutput(cp_3.ClosestPoint)  # Start node and End node for each connection.

# ==== cluster PrepareEdgesCSVTextForGelphi
edge_attribute_names = ClusterInput()  # The names of the associated attributes of the edges of the Graph, e.g. fields from sDNA.
pairs_of_indices = ClusterInput()  # The two nodes the Graph edge is connected to.
joiner = ClusterInput()  # The character to be used to separate columns in the '.csv' file. Default is ";" for Gephi.
data = ClusterInput()  # sDNA_GH Data Tree to be used to define each Edge's attributes in the Graph.
split = SplitTree(Data=data, Masks=flatten("{0;1;*}"))  # -> Positive, Negative
simplify = SimplifyTree(Tree=pairs_of_indices, Front=False)
joiner_2 = Panel(";")
panel = Panel("""Source
Target""")
simplify_2 = SimplifyTree(Tree=split.Positive, Front=False)
_0 = Integer(0)
combine = CombineData(Input0=joiner, Input1=joiner_2)  # -> Result, Index
merge = Merge(Data1=panel, Data2=edge_attribute_names)
item = ListItem(List=combine.Result, Index=_0, Wrap=True)
merge_2 = Merge(Data1=simplify, Data2=simplify_2)
join = TextJoin(Text=merge, Join=item)
join_2 = TextJoin(Text=merge_2, Join=item)
new_line = Panel("")
join_3 = TextJoin(Text=flatten(join_2), Join=new_line)
concat = Concatenate(FragmentA=join, FragmentB=new_line, FragmentC=join_3)
text = ClusterOutput(concat)  # The text of the '.csv' file, including Source and Target columns (by default semi-colon separated) for Gelphi
