# Grasshopper definition readme_component.gh (Grasshopper 1.0.8)

readme_getter = GhPythonScript()  # -> out, a
# ---------- readme_getter: Python ----------
import os

from ghpythonlib.componentbase import executingcomponent as component
import Grasshopper, GhPython
import System
import Rhino
import rhinoscriptsyntax as rs

def text_file_to_str(file, extra_new_line_char = '', encoding = 'utf-8'):
    #type(str, str) -> str
    """ A simple text file reader.  """
    if file is None or not isinstance(file, basestring):
        msg = 'file == %s is not a string' % file
        logger.error(msg)
        raise TypeError(msg)
    elif not os.path.isfile(file):
        msg = 'file == %s is not a file path' % file
        logger.error(msg)
        raise ValueError(msg)
    else:
        with open(file, 'rb') as f:
            file_contents = extra_new_line_char.join(line.decode(encoding)
                                                     for line in f
                                                    )
    return file_contents

class MyComponent(component):
    
    def RunScript(self, x, y):
        
        sDNA_GH_path = os.path.dirname(ghdoc.Path)
        
        README_md_path = os.path.join(sDNA_GH_path, 'README.md')
        if not os.path.isfile(README_md_path):
            README_md_path = os.path.join(os.path.dirname(sDNA_GH_path), 'README.md')
        # Readme.md is a level higher in the repo than in the sDNA_GH
        # folder in a user installation - it is moved intentionally
        # by create_release_sDNA_GH_zip.bat 
        readme = text_file_to_str(README_md_path)
        a = 'anything'
        
        doc = self.Attributes.Owner.OnPingDocument()
        readme_component = next(component 
                                for component in doc.Objects
                                if component.NickName == 'Readme.txt'
                               ) 
        
        readme_component.SetUserText(readme)
        
        return a
# ---------- end readme_getter ----------
readme_txt = Panel("""# sDNA_GH
Authors
* James Parrott
* Crispin Cooper (Cardiff University)

sDNA is a world leading tool for Spatial Design Network Analysis.  sDNA_GH is a plug-in for Grasshopper providing components that run the tools from a local [sDNA](https://github.com/fiftysevendegreesofrad/sdna_open/releases) installation, on Rhino and Grasshopper geometry and data.  

Shenzhen University and Hong Kong University funded the initial and subsequent development phases respectively.  Wedderburn Transport Planning and Alain Chiaradia worked on defining the idea, and staunchly supported the project along with Cardiff University.  Sara Nalaskowska, Siddharth Khakhar and Fan Zitian, all provided invaluable help during development and testing.  Huge thanks to all.


## sDNA_GH functionality
sDNA_GH: 
 - Reads a network's polyline Geometry from Rhino or Grasshopper.
 - Reads data from any User Text on Rhino objects. 
 - Writes a network's links (formed by one or more polylines), and associated data to shapefiles.
 - Initiates an sDNA tool that processes that shapefile, and e.g. carries out a network preparation or an analysis.
 - Reads polyline shapefiles produced by the sDNA tool, and any associated data e.g. the results from sDNA.
 - Parses the selected data field, and normalises and classifies the data, sorting the polylines if necessary.
 - Colours can be allocated to each polyline based on the parsed data, either using a Colour Gradient component, or automatically.   
 - Visually represents the results from sDNA by colouring a new layer of polylines, or the original Rhino shapes.
 - Allows easy adding of a native Legend.

## User manual.  
__version__ = '3.0.0.alpha_3'

## Table of contents

- [sDNA_GH](#sdna_gh)
  - [sDNA](#sdna)
  - [sDNA_GH functionality](#sdna_gh-functionality)
  - [User manual.](#user-manual)
    - [System Requirements.](#system-requirements)
      - [Software](#software)
      - [Hardware](#hardware)
    - [Installation.](#installation)
    - [Usage.](#usage)
      - [Components.](#components)
        - [Automatic multi-tools.](#automatic-multi-tools)
        - [Running individual tools.](#running-individual-tools)
        - [Component Execution Order.](#component-execution-order)
      - [Options.](#options)
        - [Adding Component Input and Output Params.](#adding-component-input-and-output-params)
        - [Logging options](#logging-options)
        - [Local meta options.](#local-meta-options)
        - [Shared state vs desynchronised components.](#shared-state-vs-desynchronised-components)
      - [Tools.](#tools)
        - [Common component input and output Params](#common-component-input-and-output-params)
        - [Support tools](#support-tools)
        - [Shapefile tools](#shapefile-tools)
        - [Plotting tools](#plotting-tools)
        - [User Text tools](#user-text-tools)
        - [Data tools](#data-tools)
      - [sDNA Tools](#sdna-tools)
        - [Analysis tools](#analysis-tools)
        - [Preparation tools](#preparation-tools)
        - [Geometric analysis tools](#geometric-analysis-tools)
        - [Calibration tools](#calibration-tools)
        - [Dev tool(s)](#dev-tools)
    - [Example Grasshopper definitions.](#example-grasshopper-definitions)
      - [Running sDNA Integral on a random grid read from Rhino.](#running-sdna-integral-on-a-random-grid-read-from-rhino)
        - [Selecting and specifying an sDNA Results field.](#selecting-and-specifying-an-sdna-results-field)
        - [Reading shapefile data with existing geometry.](#reading-shapefile-data-with-existing-geometry)
        - [Using a Grasshopper Colour gradient component.](#using-a-grasshopper-colour-gradient-component)
        - [Adding a legend with a Legend component.](#adding-a-legend-with-a-legend-component)
        - [Customising legend class boundaries and tag names.](#customising-legend-class-boundaries-and-tag-names)
      - [Running sDNA Integral on a random grid of Grasshopper geometry (colouring with the Custom Preview component).](#running-sdna-integral-on-a-random-grid-of-grasshopper-geometry-colouring-with-the-custom-preview-component)
      - [Running sDNA Integral on a network of polylines, approximating a network of arcs from intersecting circles.](#running-sdna-integral-on-a-network-of-polylines-approximating-a-network-of-arcs-from-intersecting-circles)
        - [Recolouring the arcs instead of polylines.](#recolouring-the-arcs-instead-of-polylines)
      - [Writing polylines and data to shapefiles.](#writing-polylines-and-data-to-shapefiles)
      - [Reading in polylines and data from shapefiles.](#reading-in-polylines-and-data-from-shapefiles)
      - [Writing User Text.](#writing-user-text)
      - [Reading User Text for sDNA (e.g. User weights).](#reading-user-text-for-sdna-eg-user-weights)
      - [Baking (saving Grasshopper objects to a Rhino document) with User Text. -->](#baking-saving-grasshopper-objects-to-a-rhino-document-with-user-text---)
    - [License.](#license)
    - [Copyright.](#copyright)
  - [Contact.](#contact)
  - [Developer manual.](#developer-manual)
    - [Dependencies.](#dependencies)
      - [](#)
    - [Build instructions.](#build-instructions)
      - [To build new sDNA components.](#to-build-new-sdna-components)
    - [Misc](#misc)


### System Requirements. 
#### Software
1. Windows (8.1, 10, or 11) 
2. Python.  (Please note non-CPythons, e.g. Iron Python, are not supported, as invalid shapefiles will be produced).
3. sDNA. 
4. Rhino and Grasshopper (tested in Rhino 7)
#### Hardware
1. 64-bit Intel or AMD processor (Not ARM) 
2. No more than 63 CPU Cores. 
3. 8 GB memory (RAM) or more is recommended. 
4. 1.2 GB disk space. 

### Installation.
1. Ensure you have an installation of [Rhino 3D](https://www.rhino3d.com/download/) including Grasshopper (versions 6 and 7 are supported).

sDNA_GH provides some functionality without sDNA installed, e.g. Selecting real Rhino objects, User Text components, reading and writing shapefiles, parsing data, and recolouring objects.  But to use the sDNA components, an installation of sDNA is required.

#### sDNA dependencies.
sDNA itself may require the 64 bit (x64) Visual Studio redistributable [^0].  

#### Official sDNA installer (and Python).
2. Ensure you have a supported version of [Python](https://www.python.org/downloads/windows/) (CPython, the reference implementation).  Do not run sDNA in non CPythons, as invalid shape files will be produced.  sDNA has been tested with a lot of different CPython versions.  But these do not include the CPython shipped with Rhino 8.    
3. sDNA Learn requires numpy.  Numpy can be installed by opening a `cmd` window and typing: `python -m pip install numpy`.  Optional:  If this Python installation is also used by other 
processes, to guarantee there are no dependency conflicts, create a venv to run sDNA in, e.g. firstly by entering: `python -m venv <path_to_sDNA_venv>`  `<path_to_sDNA_venv>\Scripts\pip.exe install numpy` (enter `<path_to_sDNA_venv>\Scripts\activate.bat` to test the venv from the command line) and secondly within Grasshopper set
`python` to <path_to_sDNA_venv>\Scripts` on a config component (or in config.toml) in step 13.iii below. 
4. To use sDNA with sDNA_GH, ensure you have an installation of [sDNA](https://sdna.cardiff.ac.uk/sdna/software/download/).  sDNA+ is now [open source](https://github.com/fiftysevendegreesofrad/sdna_plus).  As above, sDNA may also require a Visual Studio redistributable.  If you chose a non-default installation directory, remember it for step 13.ii.


#### sDNA_GH

5. Download `sdna-gh.zip` from (food4rhino)[https://www.food4rhino.com/en/app/sdnagh] or the [sDNA_GH releases page on Github](https://github.com/JamesParrott/sDNA_GH/releases).
6. Ensure `sdna-gh.zip` is unblocked: Open File Explorer and go to your Downloads folder (or whichever folder you saved it in).  Right click it and select `Properties` from the bottom of the menu.  Then click on the _Unblock_ check box at the bottom (right of _Security_), then click `OK` or `Apply`.  The check box and _Security_ section should disappear.  This should unblock all the files in the zip archive.  Please do not automatically trust and unblock all software downloaded from anywhere on the internet [^1].  
7. Open Rhino and Grasshopper.
8. In Grasshopper's pull down menus (above the tabs ribbon at the top) click `File` -> `Special folders` -> `User Objects Folder`.  The default in Rhino 7 is `%appdata%\Grasshopper\UserObjects`.  Note, this is different to the Components Folder used by many other plug-ins (i.e. not `%appdata%\Grasshopper\Libraries`).
9. Copy `sdna-gh.zip` to this folder (e.g. it should be at `%appdata%\Grasshopper\UserObjects\sdna-gh.zip`).
10. Unzip `sdna-gh.zip` to this location (in Windows 10 right click `sdna-gh.zip` and select `Extract All ...`, then click `Extract` to use the suggested location).  In the User Objects folder, a new folder called `sdna-gh` should have been created, itself containing a subfolder called `sDNA_GH` (plus license.md and copies of these readme files).  If necessary, rename the outer parent folder (inside the User Objects folder) to exactly "sdna-gh" (no quotes). E.g. if you previously downloaded an earlier version of sDNA_GH (or any other file called) sdna-gh.zip, your web browser may have renamed a second download to sdna-gh(1).zip.  In this case, you will need to either rename the file or the folder created by unzipping it.

11. Restart Rhino and Grasshopper.
12. The sDNA_GH plug in components should now be available under a new "sDNA" tab in the ribbon amongst the tabs for all the plug-ins you have installed (right of `Mesh`, `Intersect`, `Transform` and `Display` etc).  
13. To use sDNA with sDNA_GH, if no preferences are specified, sDNA_GH will search for sDNA and Python installations automatically, using the first one of each it finds.  If you are using sDNA Learn with Python in a venv as recommended, or otherwise to ensure sDNA_GH uses a particular version of sDNA and the correct Python interpreter, it is recommended on first usage to:
    -place a Config component on the canvas (the component with a gear/cog icon in `Extra`).
    -Specify the file path of the sDNA folder (containing `sDNAUISpec.py` and `runsdnacommand.py`) of the sDNA installation you wish to use in the `sDNA_folders` input (e.g. `C:\Program Files (x86)\sDNA`).
    -Specify the file path of the sDNA venv's Python (e.g. <path_to_sDNA_venv>`\Scripts\python.exe` from step 3), or the path of the chosen Python interpreter's main executable in the `python` input.
    -Specify any other options you wish to save and reuse on all projects, if necessary by zooming in, and adding a custom input Param with each option's name.
    -Connect a true Boolean toggle to `go`.  An installation wide user options file (`config.toml`) will be created if there isn't one already.
    -To save options to other project specific `config.toml` files, specify the file path in `save_to` and repeat the previous 4 sub steps.

14. If a newer version of sDNA is used in future with tools unknown to sDNA_GH at the time it was built, if a Config component is placed, and the path of the new sDNA specified in `sDNA_folders`, sDNA_GH will attempt to automatically build components and user objects for the new sDNA tools, and add them to Grasshopper for you.  Set `make_new_comps` to false to prevent this.


### Usage.  
#### Tools.
Each tool has a component that runs that tool.  `auto_` rules may cause a component to also run other tools as well.  
For example, by default, sDNA components run Write_Shp before, and Read_Shp after, their sDNA tool. 

##### Common component input and output Params
**OK** This output is true when a component has executed successfully.

**go** Set this input to true (e.g. from a boolean toggle component) to run a component's tool.

**file** Specifies the path of a file to write to, or that was written to.

**Data**
It is possible to do most tasks in sDNA_GH without ever looking at `Data` in detail.  The order of the deepest branches must correspond with the order of the Geometric objects.  But for example to specify weights elsewhere than on their corresponding Polylines, it is also possible to construct `Data` manually.  If so, `Data` must be a Data Tree 2 branches deep at the first level: a branch each for keys {0;0} and values {0;1}.  The two nodes of this structure should have a branch for each geometric object (so the nth's keys and values should have paths {0;0;n} and {0;1;n}).  The lists at these nodes must be of equal length.  The mth key and value of the nth geometric object should be {0;0;n}[m] and {0;1;n}[m] respectively.  Read_Shp supplies a Data Tree in this required format, if the data is read from User Text or from a Shapefile.  Grasshopper's path tools can be used to adjust compatible Data Trees into this format.  

**Geom** Accepts a list of geometric objects (Guids of Rhino objects or native Grasshopper objects).  Data trees of objects need to be flattened into lists. To use Rhino objects referenced from Grasshopper parameter objects (instead of their Grasshopper versions which are often obscured unless the Rhino shapes are set to Hidden) run the output of the Geometry (Geo) or Curve (Crv) through a Guid (ID) parameter object first. 

**gdm** An alternative to both **Geom** and **Data**.  Accepts a Geometry-data-mapping, a list of nested dictionaries (standard Python objects).  The keys are the UUIDs of geometric objects.  The values are also dictionaries, containing key/value pairs for use as User Text.

**opts** Accepts an options data structure (a nested dictionary of named tuples) from another sDNA_GH component.  Only of use if they are not synced to the global module options.

**config** The path of a TOML file (e.g. `config.toml`) to be read in containing sDNA_GH options settings. Shared between synchronised components.

##### Support tools
###### Config (config)
Loads custom user options and configuration files (`.toml`).  Saves options to a `.toml` file if go is true.  If a `.toml` file is specified in `save_to`, it is saved to.  Otherwise the default value of `save_to` is the installation-wide user options file.  One is created if it does not already exist.  This will overwrite existing files.

If not using a `config.toml` file, then e.g. when using a config component to set true `auto_` options, to guarantee your components are setup correctly when reloading a saved `.gh` file, this component must run before all your others.  To ensure a component runs first, select it and press `Ctrl` + `B` (or from the pull-down menu select `Edit` -> `Arrange` -> `Put To Back`) before saving the `.gh` file.



###### Read_Geom (get_Geom)
Gets real strings of the uuid references to Rhino polylines and degree-1 Nurbs curves for subsequent sDNA_GH tools.  Grasshopper Geom and Curve params create Grasshopper references to Rhino objects.  The actual Rhino uuid is required to read and write User Text on a
Rhino object.

Set `selected` to true, to only read objects that are selected.  Similarly, specify `layer` to the name of a layer, to only read objects from that layer.  

Note, if `sync = True` it will remember its previous setting, in which case to go back to selecting all layers, `layer` must be set to any value that is not the name of a layer.  Similarly, to go back to selecting everything (not just selected geometry) set `selected = false`.  If the component has `sync = false`, an input Params that has had its value set, when subsequently disconnected will fallback to whatever its previous value was. 




##### Shapefile tools
###### Write_Shp (write_shapefile)
Writes a DataTree in `Data` and a list of polylines in `Geom` to a shapefile.  If not specified in `file`, a default file name based on the Rhino doc or Grasshopper doc name is used (unless `auto_update_Rhino_doc_path = false`).  `overwrite_shp` = true overwrites existing files, otherwise if it is false Write_Shp creates new automatically named files up to a maximum of `max_new_files` (20 by default).  **WARNING!  Shapefiles created with default names (due to no valid file path being specified in `file` by the user) will be deleted by subsequent sDNA tools if `strict_no_del` = false, `overwrite_shp` = false, and `del_after_sDNA` = true.**  

To create a projection (.prj) file for the new shapefile, specify the path of an existing .prj file in `prj`.  

If no Data is supplied, if no read_User_Text component is connected to its input, and if `auto_read_User_Text` is true, this tool will first call read_User_Text.  

To work with sDNA, data records are only written to the Shapefile (associated with a shape corresponding to a Rhino / GH polyline) if its field matches the template string specified in `input_key_str`.  The field name has a maximum of 10 characters long, and is taken from the `{name}` value (in the key name if it originated as User Text). To write all data with any key name (shorter then 11 characters) to the Shapefile, set `input_key_str` to `{name}`.  

Shapefile data entries (records) only allow a maximum width of 254 Ascii characters, or 254 bytes for Unicode strings.  Encodings can require more than one byte per code point.  So some UTF-8 and UTF-16 encoded Unicode strings may only be 120 code points long, or even shorter.  
This is an intrinsic limitation of the shapefile format [https://en.wikipedia.org/wiki/Shapefile#Data_storage].  

Rhino and Grasshopper shapes must support certain methods (to retrieve the points list of their vertices) to be written to shp files of the following types: `PolylineVertices` for `POLYLINE`s and `POLYGON`s, `PointCoordinates` for `POINT`s, `PointCloudPoints` for `MULTIPOINT`, and `MeshVertices` for `MULTIPATCH`.  Please note:  `MULTIPATCH`s are not supported, and `POINT`s and `MULTIPOINT`s are experimental and untested.

Write_Shp attempts to coerce data types to set the Shapefile field type and size correctly.  The full coercion order is bool -> int -> (float / Decimal) -> Date -> string (Shapefile field types L -> N -> F -> D -> C respectively).  If attempts at boolean and integer conversion fail, by default the data is then coerced to a Decimal.  The number of significant figures for 
Decimals is 12 by default.  This can be altered in `precision`.  If `decimal` is set to 
false, Write_Shp coerces the value to a float instead of a Decimal object.  The maximum number of decimal places is `max_dp`.
Dates are attempted to be built using Python's `datetime.date` object.  If a datetime.date cannot be built, if `yyyy_mm_dd` is true, a date must be in yyyy mm dd format.  Otherwise if `yyyy_mm_dd` is false as it is by default, dd mm yyyy and mm dd yyyy are also supported.  In both cases, the supported separators are one of: -.,:/\ or a single space.


###### Read_Shp (read_shapefile)
Reads in polylines and associated data records from a shapefile of polylines.  Creates new objects if `new_geom` = true or no objects corresponding to the shapefile are specified in `Geom`.  Specify the path of the .shp file to read in `file`.  **WARNING!  If a valid file path was not specified in `file` on a preceding Write_Shp component, and that file was used by an sDNA tool, Read_Shp deletes sDNA output shapefiles with default names if `strict_no_del` = false, `overwrite_shp` = false, and `del_after_read` = true.**  If a list of existing geometry is provided in `Geom` that corresponds to (is the same length as) the data records in the shapefile, and if new_geom = false, only the data is read from the shapefile.  Otherwise the polylines in the shapefile are added as new Rhino Polyline objects if bake = true; otherwise as Grasshopper Polyline objects.  

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""")
