# Grasshopper definition remotely_call_another_component.gh (Grasshopper 1.0.8)
# plug-ins: RhinoCodePluginGH

panel = Panel("1000*x + y")
panel_2 = Panel("x + 1000*y")
set_and_read_data = IronPython2Script(x=Slider(42, range=0..100), y=Slider(76, range=0..100), comp_name="x*y", gh_doc_name="another_gh_doc.gh")  # -> out, a
# ---------- set_and_read_data: IronPython ----------
#! python2

import os

import Grasshopper





def GH_doc_components(doc):
    return {component.NickName : component
            for component in doc.Objects
            }

def set_data_on(param, val):
    param.ClearData()
    param.AddVolatileData(Grasshopper.Kernel.Data.GH_Path(0), 0, val)

def get_data_from(param):
    return Grasshopper.DataTree[object](param.VolatileData).Branch(0)[0]

class MyComponent(Grasshopper.Kernel.GH_ScriptInstance):
    def __init__(self):
        # This component must be re-initialised 
        # after the component to be run remotely has been placed.
        # or e.g. set this to run last by selecting it and pressing
        # Ctrl+B
        self.GH_Doc = ghdoc.Component.Attributes.DocObject.OnPingDocument()
        self.GH_Doc_components = GH_doc_components(self.GH_Doc)

        self.all_docs_comps = {
                          os.path.splitext(os.path.basename(doc.FilePath))[0] : (doc, GH_doc_components(doc)) 
                          for doc in Grasshopper.Instances.DocumentServer.GetEnumerator()
                         }

    def RunScript(self, x, y, comp_name, gh_doc_name): 




        x = x or 10
        y = y or 37
        comp_name = comp_name or '1000*x + y'

        if gh_doc_name is None:
            doc, comps = self.GH_Doc, self.GH_Doc_components
        else:
            gh_doc_name = os.path.splitext(gh_doc_name)[0]
            doc, comps = self.all_docs_comps[gh_doc_name]

        comp = comps[comp_name] 


        set_data_on(comp.Params.Input[0], x)
        set_data_on(comp.Params.Input[1], y)

        comp.ExpireSolution(False)
        comp.CollectData()
        comp.ComputeData()

        a = get_data_from(comp.Params.Output[0])

        print(a)
        return a
# ---------- end set_and_read_data ----------
_1000_x_y = Read_Geom()  # -> a
# ---------- _1000_x_y: Python ----------
from ghpythonlib.componentbase import executingcomponent as component


class MyComponent(component):
    
    def RunScript(self, x, y):
        x = x or 0
        y = y or 0
        
        return x*1000 + y
# ---------- end _1000_x_y ----------
x_1000_y = Read_Geom()  # -> a
# ---------- x_1000_y: Python ----------
from ghpythonlib.componentbase import executingcomponent as component


class MyComponent(component):
    
    def RunScript(self, x, y):
        x = x or 0
        y = y or 0
        
        return x + 1000*y
# ---------- end x_1000_y ----------
panel_3 = Panel(_1000_x_y)
panel_4 = Panel(x_1000_y)
panel_5 = Panel(set_and_read_data.out)
