# Grasshopper definition test_adding_user_obj_component.gh (Grasshopper 1.0.8)

list = ValueList({"Config", "Parse_Data", "Read_Geom", "Read_Shp", "Read_Usertext", "Recolour_Objects", "sDNA_Access_Map", "sDNA_Geodesics", "sDNA_Hulls", "sDNA_Integral", "sDNA_Int_From_OD", "sDNA_Learn", "sDNA_Line_Measures", "sDNA_Net_Radii", "sDNA_Predict", "sDNA_Prepare", "sDNA_Skim", "Self_test", "Write_Shp", "Write_Usertext", "Geom types and counts", "Get co-ordinates (with no checks first)", "Readme", "Run the Geometry checker functions", "Shp_Data_Tree", "Unload_sDNA", "Unpack_Network_Radii"}, selected="sDNA_Hulls")
add_plug_in_component_to_canvas = Unload_sDNA(place=Button(), comp=list, plugin="sDNA_GH")  # -> out, comp_names, files
# ---------- add_plug_in_component_to_canvas: Python ----------
import os
from collections import OrderedDict

import System 

import Grasshopper
from ghpythonlib.componentbase import executingcomponent as component

ghenv.Component.ToggleObsolete(False)

def get_position(comp_number, row_width = 800, row_height = 175, pos = (200, 550)):
    l = comp_number * row_height
    x = pos[0] + (l % row_width)
    y = pos[1] + 220 * (l // row_width)
    return x, y

GH_doc = ghdoc.Component.Attributes.Owner.OnPingDocument()
#
gh_comp_server = Grasshopper.Kernel.GH_ComponentServer()
#print(list(gh_comp_server.FindObjects(guid)))

def add_instance_of_userobject_to_canvas(name, plugin_files, comp_number=1, pos = (200, 550)):
    
    file_obj = next((v
                     for k, v in plugin_files.items() 
                     if name.lower() in k.lower()
                    )
                    ,None)
                    
    if file_obj is None:
        raise Exception('No user object found called: %s' % name)
    
#    print(dir(file_obj))
#    print(file_obj.GetHashCode())
#    guid = file_obj.FileHash
#    print(guid)
                    
    user_obj = Grasshopper.Kernel.GH_UserObject(file_obj.FilePath)

    comp_obj = user_obj.InstantiateObject()
    
    comp_obj.Locked = False
    
    
    
    sizeF = System.Drawing.SizeF(*get_position(comp_number, pos=pos))
    
    
    comp_obj.Attributes.Pivot = System.Drawing.PointF.Add(comp_obj.Attributes.Pivot, sizeF)
    
    success = GH_doc.AddObject(docObject = comp_obj, update = False)
    
    if not success:
        raise Exception('Could not add comp: %s to GH canvas' % comp_obj)
    
    return comp_obj 

#
#obj = gh_comp_server.FindAssemblyByObject(doc)
#
#print(obj)
#


#import ghpythonlib.components as ghcomp
            
class MyComponent(component):
    
    comp_number = 0
    
    def RunScript(self, place, comp, plugin):

        #
        
        comp = comp or ''
        plugin = plugin or ''
        #        print(file_.FileName)
        
        
        plugin_files = OrderedDict(
                        (os.path.splitext(file_.FileName)[0], file_)
                        for file_ in gh_comp_server.ExternalFiles(True, True)
                        if plugin.lower() in file_.FilePath.lower()
                       )
        
        
        
        #print(dir(ghcomp))
        if place and comp:
            add_instance_of_userobject_to_canvas(
                    comp,
                    plugin_files,
                    self.comp_number,
                    pos = (self.Attributes.Pivot.X-1000, self.Attributes.Pivot.Y+100),
                    )
            
            # Increment so the next component is not placed on top of this one.
            self.comp_number += 1
            
        comps = list(plugin_files.keys())
        comp_files = list(plugin_files.values())
        
        # return outputs if you have them; here I try it for you:
        return None, comps, comp_files
# ---------- end add_plug_in_component_to_canvas ----------
panel = Panel(add_plug_in_component_to_canvas.out)
