# Grasshopper definition test_data_tree_conversion_to_gdm.gh (Grasshopper 1.0.7)
# plug-ins: EleFront

update = Button()
python = GhPythonScript()  # -> out, a
# ---------- python: Python ----------
__author__ = "James"
__version__ = "2022.03.07"

import rhinoscriptsyntax as rs

import ghpythonlib.treehelpers as th

#x = th.tree_to_list([[1,2,3,4,5]])

#print x
#print dir(x)
# ---------- end python ----------
delete_sdna_gh = Button()
update_2 = Button()
test_data_tree_conversion = GhPythonScript(Data=update)  # -> out, a
# ---------- test_data_tree_conversion: Python ----------
from ghpythonlib.componentbase import executingcomponent as component
import Grasshopper, GhPython
import System
import Rhino
import rhinoscriptsyntax as rs
import scriptcontext as sc
from ghpythonlib import treehelpers as th
from itertools import repeat, chain 
from os.path import isdir

import sys

path = r'C:\Users\James\Documents\Rhino\Grasshopper\sDNA\source\repos\GHsDNAv0.01\sDNA_GH'
if path not in sys.path and isdir(path):
    sys.path.insert(0, r'C:\Users\James\Documents\Rhino\Grasshopper\sDNA\source\repos\GHsDNAv0.01\sDNA_GH')


class MyComponent(component):
    def RunScript(self, Geom, Data):
        from sDNA_GH.tools import ( opts
                                   ,convert_Data_tree_and_Geom_list_to_gdm as conv)
        opts = opts['options']
        from itertools import repeat
        
        print conv([], [[[],[]],[[],[]],[[],[]]], opts)
        print conv(Geom, Data, opts)
        sc.doc = Rhino.RhinoDoc.ActiveDoc
        objs = rs.ObjectsByType(4)
        print( conv( ['a','b','c','d']
                    ,[[[],[]]]*4+ [1,2,3]
                    ,opts).items() 
             )
        sc.doc = ghdoc
        print( conv([], [12,34,23,68,45,23,3.0], opts))
        a=''
        return a
# ---------- end test_data_tree_conversion ----------
reset_sdna_gh = GhPythonScript(del_sDNA_GH=delete_sdna_gh, update=update_2)  # -> out, a
# ---------- reset_sdna_gh: Python ----------
#! /usr/bin/python2.7
# -*- coding: utf-8 -*-
__author__ = 'James Parrott'
__version__ = '0.00'
__copyright__ = 'Cardiff University'
__license__ = {  'Python standard library modules and ' : 'Python Software Foundation 2.7.18' # https://docs.python.org/2.7/license.html
                ,'wrapper_logging' : 'Python Software Foundation 2.7.18'
                ,'wrapper_pyshp' : 'MIT' # https://pypi.org/project/pyshp/ 
                ,'sDNAUISpec.py' : 'MIT' # https://github.com/fiftysevendegreesofrad/sdna_open/blob/master/LICENSE.md
                ,'everything else' : 'same as for sDNA ' # https://sdna.cardiff.ac.uk/sdna/legal-license/ 
               }

import sys, os, Grasshopper, logging
#print('\n'.join([key for key in sys.modules if 'sDNA' in key]))
#print('functools' in sys.modules)
print('Our packages and modules in sys.modules:')
print('\n'.join([key for key in sys.modules if 'sdna' in key.lower() and not '.' in key]))
#print os.getenv('APPDATA')
#print ghdoc.Path
#print Grasshopper.Folders.DefaultAssemblyFolder
#print Grasshopper.Folders.AppDataFolder
#print sys.argv[0]
#print("Classmethod found == " + str('classmethod' in __builtins__))
def is_imported(s):
    return s in sys.modules
if del_sDNA_GH == True:
    if 'logging' in sys.modules:
        sys.modules['logging'].shutdown()
    shared_cached_modules_etc = sys.modules.copy().keys()
    for y in shared_cached_modules_etc:
        if 'sDNA' in y or y == 'runsdnacommand':
            del sys.modules[y]


        
print('sDNA_GH imported == ' + str(is_imported('sDNA_GH')))
print('sDNA_GH.tools imported == ' + str(is_imported('sDNA_GH.tools')))
print('sDNAUISpec imported == ' + str(is_imported('sDNAUISpec')))
print('runsdnacommand == ' + str(is_imported('runsdnacommand')))
if False: #is_imported('sDNA_GH'):
    print sys.modules['sDNA_GH'].__all__
    print dir(sys.modules['sDNA_GH'])
    if is_imported('sDNA_GH.tools'):
        print dir(sys.modules['sDNA_GH.tools'])
    if hasattr(sys.modules['sDNA_GH'],'third_party_python_modules'):
        print dir(sys.modules['sDNA_GH'].third_party_python_modules)

#print sys.modules.keys()
#print os.getcwd()
#print sys.path[0]
#print 'a' in globals()
#a = "This is a!"
#print('\n'.join(dir(sys.modules['sDNA_GH'].third_party_python_modules)))
# ---------- end reset_sdna_gh ----------
panel = Panel(reset_sdna_gh.out)
panel_2 = Panel(test_data_tree_conversion.out)
geo = Geometry([<curve referenced from the Rhino model> x4])
getatt = GetElefrontAttributes(Geometry=geo)
getua = GetUserAttributes(Geometry=geo)  # -> Keys, Values, BakeName
deatt = DeconstructAttributes(ReferencedGeometryOrAttributes=getatt)  # -> Keys, Values
panel_3 = Panel(getua.Values)
panel_4 = Panel(getua.Keys)
