# Grasshopper definition test_input_as_path.gh (Grasshopper 1.0.7)

python = GhPythonScript()  # -> out, a
# ---------- python: Python ----------
sDNA_GH_launcher.py
# ---------- end python ----------
panel = Panel(python.out)
