# Grasshopper definition test_rhino_gh_bat.gh (Grasshopper 1.0.7)

python = GhPythonScript()  # -> out, a
# ---------- python: Python ----------
__author__ = "James"
__version__ = "2022.03.08"

from random import randint as rn

import rhinoscriptsyntax as rs
import Rhino
import scriptcontext as sc





sc.doc = Rhino.RhinoDoc.ActiveDoc                             

keys=[]
for _ in range(10):
    key = rs.AddCircle([rn(0,10),rn(0,10)],rn(0,10))
    rs.ObjectColor(key,[rn(25,225), rn(25,225), rn(25,225)])
    keys += [key]

rs.ObjectColorSource(keys, 1)  # 1 => colour from object
rs.ObjectPrintColorSource(keys, 2)  # 2 => colour from object
rs.ObjectPrintWidthSource(keys, 1)  # 1 => print width from object
rs.ObjectPrintWidth(keys, 4) # width in mm
rs.Command('_PrintDisplay _State=_On Color=Display Thickness=8 _enter')
sc.doc.Views.Redraw()
sc.doc = ghdoc
# ---------- end python ----------
panel = Panel(python.out)
