# Grasshopper definition sDNA_GH_builder.gh (Grasshopper 1.0.7)
# plug-ins: MetaHopper

# ---- group: Metahopper Clone Objects
knob = ControlKnob(Decimals=0, Limit=False, Maximum=10, Minimum=0, Range=10, Value=3)
series = Series(Start=0, Step=1, Count=knob)
X = UnitX(Factor=Slider(304.332, range=-1000..750))
multiplication = Multiplication(A=Slider(46.512, range=0..100), B=series)
Y = UnitY(Factor=multiplication)
addition = Addition(A=Y, B=X)
selobj = GetSelectedObjects()  # -> ComponentObjects, ParamObjects, OtherObjects
create = InstantiateObject(Run=Toggle(False), Object=selobj.ComponentObjects, Location=addition)

# ----
# 1) read_Usertext
# 2) read_shapes_and_data_from_shapefile
# 3) write_objects_and_data_to_shapefile
# 4) write_data_to_Usertext
# 5) bake_and_write_data_as_Usertext_to_Rhino
# 6) parse_data
# 7) recolour_objects
# 8) plot_data_on_Rhino_objects
# 9) get_objects_from_Rhino
# 10) sDNA_general
# 11) sDNAIntegral  :  Analysis
# 12) sDNASkim  :  Analysis
# 13) sDNAIntegralFromOD  :  Analysis
# 14) sDNAGeodesics  :  Analysis geometry
# 15) sDNAHulls  :  Analysis geometry
# 16) sDNANetRadii  :  Analysis geometry
# 17) sDNAAccessibilityMap  :  Analysis
# 18) sDNAPrepare  :  Preparation
# 19) sDNALineMeasures  :  Preparation
# 20) sDNALearn  :  Calibration
# 21) sDNAPredict  :  Calibration
# 22) Python : Dev tools ✓
python = GhPythonScript()  # -> a; inputs x: list
# ---------- python: Python ----------
from ghpythonlib.componentbase import executingcomponent as component
import Grasshopper, GhPython
import System
import Rhino
import rhinoscriptsyntax as rs
import scriptcontext as sc
from random import randint as ri

class MyComponent(component):
    
    def RunScript(self, x, y):

        if x:
            objs=x
            print objs[0]
            n = len(objs)
        else:
            n=51
        cols = []
        for _ in range(n):

            col = rs.CreateColor([ri(0,255),ri(0,255),ri(0,255)])
            cols += [col]

        a=cols
        
        
        return a
# ---------- end python ----------
geo = Geometry([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])  # disabled
path = FilePath("C:\Users\James\Documents\Rhino\Grasshopper\sDNA\source\repos\GHsDNAv0.01\sDNA_GH\sDNA_GH\sDNA_GH_launcher.py")
path_2 = FilePath("C:\Users\James\Documents\Rhino\Grasshopper\GHsDNA_shapefiles\marvin.shp")
preview = CustomPreview(Geometry=geo, Material=python)
file = ReadFile(File=path, PerLineParse=False)
sdnaintegral = GhPythonScript()  # -> out, OK, Data, f_name, gdm, a, opts, l_metas, Geom; inputs go: list of Boolean, Data: tree, Geom: list, f_name: list, gdm: list, opts: list, l_metas: list; disabled
# ---------- sdnaintegral: Python ----------
#! /usr/bin/python2.7
# -*- coding: utf-8 -*-
__author__ = 'James Parrott'
__version__ = '0.01'


import os, sys 
from os.path import isfile, isdir, join, split, dirname
from importlib import import_module

try:        
    from ghpythonlib.componentbase import executingcomponent as component
    import Grasshopper
except ImportError:
    print( "No Grasshopper env found.  Building test environment.  ")
    
    component = object

    class Grasshopper:
        class Folders:
            #DefaultAssemblyFolder = r'C:\Users\James\Documents\Rhino\Grasshopper\sDNA\source\repos\GHsDNAv0.01'
            DefaultAssemblyFolder = os.getenv('APPDATA') + r'\Grasshopper\Libraries'

sDNA_GH_subfolder = 'sDNA_GH' 
sDNA_GH_package = 'sDNA_GH'               
reload_config_and_other_modules_if_already_loaded = False
#sDNA_GH_search_paths = [r'C:\Users\James\Documents\Rhino\Grasshopper\sDNA\source\repos\GHsDNAv0.01\sDNA_GH']
sDNA_GH_search_paths = [ join(Grasshopper.Folders.DefaultAssemblyFolder, sDNA_GH_subfolder) ]  
                                            # Grasshopper.Folders.AppDataFolder + r'\Libraries'
                                            # %appdata%  + r'\Grasshopper\Libraries'
                                            # os.getenv('APPDATA') + r'\Grasshopper\Libraries'



def output(s, level='INFO', inst = None):        # e.g. inst is a MyComponent.  
                         # Inst is a proxy argument for both 'self' and 'cls'.
    #type: (str, MyComponent, str) -> None
    message = s
    if hasattr(inst,'nick_name'):
        message = inst.nick_name + ' : ' + message
    message_with_level =  'sDNA_GH_launcher' + '  ' + level + ' : ' + message
    #print(message_with_level)
    try:
        sDNA_GH_tools.output(message, level, inst)
    except:
        try:
            getattr(sDNA_GH_tools.wrapper_logging.logging,level.lower())("From sDNA_GH_launcher via logging: " + message)
        except:
            print(message_with_level)
            if hasattr(inst,'a') and hasattr(inst.a,'write'):
                inst.a.write("From sDNA_GH_launcher via inst: " + message_with_level)
    return message_with_level


def strict_import(  module_name = ''
                   ,folder = ''
                   ,sub_folder = ''
                   ,output = output
                   ,search_folder_only = False
                   ):

    # type: (str, str, str, function, bool) -> type[any]
    #
    if module_name == '':
        output('No module to import','INFO')
        return None
    output(module_name,'DEBUG')
    if module_name in sys.modules:   # sys.modules is also shared between GHPython components 
                                    # and is even saved until Rhino is closed.
        output('Module ' + module_name + ' already in sys.modules.  ','DEBUG')
        if reload_config_and_other_modules_if_already_loaded:
            output('Reloading ' +  module_name  + '.... ','DEBUG')
            reload(sys.modules[module_name]) # type: ignore
        return sys.modules[module_name]
    #
    #
    # Load module_name for first time:
    #
    #
    search_path = join(folder, sub_folder)

    tmp = sys.path
    if search_path and isinstance(search_path, str) and isdir(search_path):
        output('Search path == ' + search_path, 'DEBUG')
        if search_folder_only:
            sys.path = [search_path]
        else:
            sys.path.insert(0, search_path)
    else:
        output('Invalid search path : ' + search_path, 'DEBUG')
        if search_folder_only:
            return None

    output('Trying import... ','DEBUG')
    m = import_module(module_name, '')           
    sys.path = tmp
    return m       


def load_modules(self, m_names, path_lists):
    m_names = m_names if isinstance(m_names, tuple) else [m_names] 
    output('m_names == ' + str(m_names) + ' of type : ' + type(m_names).__name__,'DEBUG')
    if any((name.startswith('.') or name.startswith('..')) in name for name in m_names):
        output(m_names,'DEBUG')
        raise ImportError( output('Relative import attempted, but not supported','CRITICAL') )

    output('Testing paths : ' + '\n'.join(map(str,path_lists)),'DEBUG')
    output('Type(path_lists) : ' + type(path_lists).__name__,'DEBUG')


    for path_list in path_lists:
        test_paths = path_list if isinstance(path_list, list) else [path_list]
        test_paths = test_paths[:]
        #output('Type(path_list) : ' + type(path_list).__name__,'DEBUG')
        #output('Type(test_paths) : ' + type(test_paths).__name__,'DEBUG')

        for path in test_paths:
            output('Type(path) : ' + type(path).__name__ + ' path == ' + path,'DEBUG')
            if isfile(path):
                path = dirname(path)
            if all( any(isfile(join(path, name.replace('.', os.sep) + ending)) 
                        for ending in ['.py','.pyc'] 
                        )
                    for name in m_names
                ):
                output('Importing ' + str(m_names) +' ','DEBUG')
                return tuple(strict_import(name, path, '') for name in m_names) + (path,)
    return None


#try:
from Grasshopper.Folders import DefaultAssemblyFolder
sDNA_GH_search_paths += [join(DefaultAssemblyFolder
                                ,sDNA_GH_subfolder
                                ) 
                        ]            
# except:
#     raise ImportError(output( 'Unable to import the main sDNA_GH Python Package.  '
#                              +'Check the folder sDNA_GH containing the package '
#                              +'is a sub folder of the '
#                              +'sDNA_GH folder containing the plug-in components'
#                              +'and the installation procedure was done correctly'
#                              +'as per README.md'
#                              ,'ERROR'
#                              )
#                       )


try:
    nick_name = ghenv.Component.NickName #type: ignore
except:
    nick_name = 'selftest'


sDNA_GH_tools, _ = load_modules( None
                                ,sDNA_GH_package + '.tools'
                                ,sDNA_GH_search_paths
                                )         

class MyComponent(component):
    pass  # Required.  Idiomatic to Grasshopper.  Must be called "MyComponent"  
          # too, otherwise Grasshopper may not find the class building on 
          # component.  Despite component being passed to the class decorator
          # and overwriting this very class immediately below.  
          # Initial parser step / scope check trips this?

MyComponent = sDNA_GH_tools.component_decorator(component, load_modules)


if nick_name.replace(' ','').replace('_','').lower() == 'selftest':  

    if sys.argv[0].endswith(join(sDNA_GH_package,'__main__.py')):   
        from .tests.unit_tests import unit_tests_sDNA_GH
    else:
        unit_tests_sDNA_GH, _ = load_modules( None
                                             ,'sDNA_GH.tests.unit_tests.unit_tests_sDNA_GH'
                                             ,sDNA_GH_search_paths
                                             )

    MyComponent._RunScript = MyComponent.RunScript
    MyComponent.RunScript = unit_tests_sDNA_GH.run_launcher_tests
# ---------- end sdnaintegral ----------
sdnaintegral_2 = GhPythonScript(go=Toggle(False), Geom=geo)  # -> out, OK, Data, Geom, f_name, gdm, a, opts, l_metas; inputs go: list, Data: tree, Geom: list, f_name: list, gdm: list, opts: list, l_metas: list; disabled
# ---------- sdnaintegral_2: Python ----------
#! /usr/bin/python2.7
# -*- coding: utf-8 -*-
__author__ = 'James Parrott'
__version__ = '0.01'


import os, sys 
from os.path import isfile, isdir, join, split, dirname
from importlib import import_module

try:        
    from ghpythonlib.componentbase import executingcomponent as component
    import Grasshopper
    import scriptcontext as sc
except ImportError:
    print( "No Grasshopper env found.  Building test environment.  ")
    
    component = object

    class Grasshopper:
        class Folders:
            #DefaultAssemblyFolder = r'C:\Users\James\Documents\Rhino\Grasshopper\sDNA\source\repos\GHsDNAv0.01'
            DefaultAssemblyFolder = os.getenv('APPDATA') + r'\Grasshopper\Libraries'

sDNA_GH_subfolder = 'sDNA_GH' 
sDNA_GH_package = 'sDNA_GH'               
reload_config_and_other_modules_if_already_loaded = False
#sDNA_GH_search_paths = [r'C:\Users\James\Documents\Rhino\Grasshopper\sDNA\source\repos\GHsDNAv0.01\sDNA_GH']
sDNA_GH_search_paths = [ join(Grasshopper.Folders.DefaultAssemblyFolder, sDNA_GH_subfolder) ]  
                                            # Grasshopper.Folders.AppDataFolder + r'\Libraries'
                                            # %appdata%  + r'\Grasshopper\Libraries'
                                            # os.getenv('APPDATA') + r'\Grasshopper\Libraries'



def output(s, level='INFO', inst = None):        # e.g. inst is a MyComponent.  
                         # Inst is a proxy argument for both 'self' and 'cls'.
    #type: (str, MyComponent, str) -> None
    message = s
    if hasattr(inst,'nick_name'):
        message = inst.nick_name + ' : ' + message
    message_with_level =  'sDNA_GH_launcher' + '  ' + level + ' : ' + message
    #print(message_with_level)
    try:
        sDNA_GH_tools.output(message, level, inst)
    except:
        try:
            getattr(sDNA_GH_tools.wrapper_logging.logging,level.lower())("From sDNA_GH_launcher via logging: " + message)
        except:
            print(message_with_level)
            if hasattr(inst,'a') and hasattr(inst.a,'write'):
                inst.a.write("From sDNA_GH_launcher via inst: " + message_with_level)
    return message_with_level


def strict_import(  module_name = ''
                   ,folder = ''
                   ,sub_folder = ''
                   ,output = output
                   ,search_folder_only = False
                   ):

    # type: (str, str, str, function, bool) -> type[any]
    #
    if module_name == '':
        output('No module to import','INFO')
        return None
    output(module_name,'DEBUG')
    if module_name in sys.modules:   # sys.modules is also shared between GHPython components 
                                    # and is even saved until Rhino is closed.
        output('Module ' + module_name + ' already in sys.modules.  ','DEBUG')
        if reload_config_and_other_modules_if_already_loaded:
            output('Reloading ' +  module_name  + '.... ','DEBUG')
            reload(sys.modules[module_name]) # type: ignore
        return sys.modules[module_name]
    #
    #
    # Load module_name for first time:
    #
    #
    search_path = join(folder, sub_folder)

    tmp = sys.path
    if search_path and isinstance(search_path, str) and isdir(search_path):
        output('Search path == ' + search_path, 'DEBUG')
        if search_folder_only:
            sys.path = [search_path]
        else:
            sys.path.insert(0, search_path)
    else:
        output('Invalid search path : ' + search_path, 'DEBUG')
        if search_folder_only:
            return None

    output('Trying import... ','DEBUG')
    m = import_module(module_name, '')           
    sys.path = tmp
    return m       


def load_modules(self, m_names, path_lists):
    m_names = m_names if isinstance(m_names, tuple) else [m_names] 
    output('m_names == ' + str(m_names) + ' of type : ' + type(m_names).__name__,'DEBUG')
    if any((name.startswith('.') or name.startswith('..')) in name for name in m_names):
        output(m_names,'DEBUG')
        raise ImportError( output('Relative import attempted, but not supported','CRITICAL') )

    output('Testing paths : ' + '\n'.join(map(str,path_lists)),'DEBUG')
    output('Type(path_lists) : ' + type(path_lists).__name__,'DEBUG')


    for path_list in path_lists:
        test_paths = path_list if isinstance(path_list, list) else [path_list]
        test_paths = test_paths[:]
        #output('Type(path_list) : ' + type(path_list).__name__,'DEBUG')
        #output('Type(test_paths) : ' + type(test_paths).__name__,'DEBUG')

        for path in test_paths:
            output('Type(path) : ' + type(path).__name__ + ' path == ' + path,'DEBUG')
            if isfile(path):
                path = dirname(path)
            if all( any(isfile(join(path, name.replace('.', os.sep) + ending)) 
                        for ending in ['.py','.pyc'] 
                        )
                    for name in m_names
                ):
                output('Importing ' + str(m_names) +' ','DEBUG')
                return tuple(strict_import(name, path, '') for name in m_names) + (path,)
    return None


#try:
from Grasshopper.Folders import DefaultAssemblyFolder
sDNA_GH_search_paths += [join(DefaultAssemblyFolder
                                ,sDNA_GH_subfolder
                                ) 
                        ]            
# except:
#     raise ImportError(output( 'Unable to import the main sDNA_GH Python Package.  '
#                              +'Check the folder sDNA_GH containing the package '
#                              +'is a sub folder of the '
#                              +'sDNA_GH folder containing the plug-in components'
#                              +'and the installation procedure was done correctly'
#                              +'as per README.md'
#                              ,'ERROR'
#                              )
#                       )


try:
    nick_name = ghenv.Component.NickName #type: ignore
except:
    nick_name = 'selftest'

sc.doc = ghdoc
sDNA_GH_tools, _ = load_modules( None
                                ,sDNA_GH_package + '.tools'
                                ,sDNA_GH_search_paths
                                )         

class MyComponent(component):
    pass  # Required.  Idiomatic to Grasshopper.  Must be called "MyComponent"  
          # too, otherwise Grasshopper may not find the class building on 
          # component.  Despite component being passed to the class decorator
          # and overwriting this very class immediately below.  
          # Initial parser step / scope check trips this?

MyComponent = sDNA_GH_tools.component_decorator(component, load_modules)


if nick_name.replace(' ','').replace('_','').lower() == 'selftest':  

    if sys.argv[0].endswith(join(sDNA_GH_package,'__main__.py')):   
        from .tests.unit_tests import unit_tests_sDNA_GH
    else:
        unit_tests_sDNA_GH, _ = load_modules( None
                                             ,'sDNA_GH.tests.unit_tests.unit_tests_sDNA_GH'
                                             ,sDNA_GH_search_paths
                                             )

    MyComponent._RunScript = MyComponent.RunScript
    MyComponent.RunScript = unit_tests_sDNA_GH.run_launcher_tests
# ---------- end sdnaintegral_2 ----------
toggle = BooleanToggle(True)
sdna_demo = GhPythonScript()  # -> out, Geom, f_name, gdm, a, opts, l_metas; inputs go: list of Boolean, Data: tree, Geom: list, f_name: list, gdm: list, opts: list, l_metas: list; disabled
# ---------- sdna_demo: Python ----------
#! /usr/bin/python2.7
# -*- coding: utf-8 -*-
__author__ = 'James Parrott'
__version__ = '0.01'


import os, sys 
from os.path import isfile, isdir, join, split, dirname
from importlib import import_module

try:        
    from ghpythonlib.componentbase import executingcomponent as component
    import Grasshopper
except ImportError:
    print( "No Grasshopper env found.  Building test environment.  ")
    
    component = object

    class Grasshopper:
        class Folders:
            #DefaultAssemblyFolder = r'C:\Users\James\Documents\Rhino\Grasshopper\sDNA\source\repos\GHsDNAv0.01'
            DefaultAssemblyFolder = os.getenv('APPDATA') + r'\Grasshopper\Libraries'

sDNA_GH_subfolder = 'sDNA_GH' 
sDNA_GH_package = 'sDNA_GH'               
reload_config_and_other_modules_if_already_loaded = False
#sDNA_GH_search_paths = [r'C:\Users\James\Documents\Rhino\Grasshopper\sDNA\source\repos\GHsDNAv0.01\sDNA_GH']
sDNA_GH_search_paths = [ join(Grasshopper.Folders.DefaultAssemblyFolder,'sDNA_GH') ]  
                                            # Grasshopper.Folders.AppDataFolder + r'\Libraries'
                                            # %appdata%  + r'\Grasshopper\Libraries'
                                            # os.getenv('APPDATA') + r'\Grasshopper\Libraries'



def output(s, level='INFO', inst = None):        # e.g. inst is a MyComponent.  
                         # Inst is a proxy argument for both 'self' and 'cls'.
    #type: (str, MyComponent, str) -> None
    message = s
    if hasattr(inst,'nick_name'):
        message = inst.nick_name + ' : ' + message
    message_with_level =  'sDNA_GH_launcher' + '  ' + level + ' : ' + message
    #print(message_with_level)
    try:
        sDNA_GH_tools.output(message, level, inst)
    except:
        try:
            getattr(sDNA_GH_tools.wrapper_logging.logging,level.lower())("From sDNA_GH_launcher via logging: " + message)
        except:
            print(message_with_level)
            if hasattr(inst,'a') and hasattr(inst.a,'write'):
                inst.a.write("From sDNA_GH_launcher via inst: " + message_with_level)
    return message_with_level


def strict_import(  module_name = ''
                   ,folder = ''
                   ,sub_folder = ''
                   ,output = output
                   ,search_folder_only = False
                   ):

    # type: (str, str, str, function, bool) -> type[any]
    #
    if module_name == '':
        output('No module to import','INFO')
        return None
    output(module_name,'DEBUG')
    if module_name in sys.modules:   # sys.modules is also shared between GHPython components 
                                    # and is even saved until Rhino is closed.
        output('Module ' + module_name + ' already in sys.modules.  ','DEBUG')
        if reload_config_and_other_modules_if_already_loaded:
            output('Reloading ' +  module_name  + '.... ','DEBUG')
            reload(sys.modules[module_name]) # type: ignore
        return sys.modules[module_name]
    #
    #
    # Load module_name for first time:
    #
    #
    search_path = join(folder, sub_folder)

    tmp = sys.path
    if search_path and isinstance(search_path, str) and isdir(search_path):
        output('Search path == ' + search_path, 'DEBUG')
        if search_folder_only:
            sys.path = [search_path]
        else:
            sys.path.insert(0, search_path)
    else:
        output('Invalid search path : ' + search_path, 'DEBUG')
        if search_folder_only:
            return None

    output('Trying import... ','DEBUG')
    m = import_module(module_name, '')           
    sys.path = tmp
    return m       


def load_modules(self, m_names, path_lists):
    m_names = m_names if isinstance(m_names, tuple) else [m_names] 
    output('m_names == ' + str(m_names) + ' of type : ' + type(m_names).__name__,'DEBUG')
    if any((name.startswith('.') or name.startswith('..')) in name for name in m_names):
        output(m_names,'DEBUG')
        raise ImportError( output('Relative import attempted, but not supported','CRITICAL') )

    output('Testing paths : ' + '\n'.join(map(str,path_lists)),'DEBUG')
    output('Type(path_lists) : ' + type(path_lists).__name__,'DEBUG')


    for path_list in path_lists:
        test_paths = path_list if isinstance(path_list, list) else [path_list]
        test_paths = test_paths[:]
        #output('Type(path_list) : ' + type(path_list).__name__,'DEBUG')
        #output('Type(test_paths) : ' + type(test_paths).__name__,'DEBUG')

        for path in test_paths:
            output('Type(path) : ' + type(path).__name__ + ' path == ' + path,'DEBUG')
            if isfile(path):
                path = dirname(path)
            if all( any(isfile(join(path, name.replace('.', os.sep) + ending)) 
                        for ending in ['.py','.pyc'] 
                        )
                    for name in m_names
                ):
                output('Importing ' + str(m_names) +' ','DEBUG')
                return tuple(strict_import(name, path, '') for name in m_names) + (path,)
    return None


try:
    from Grasshopper.Folders import DefaultAssemblyFolder
    sDNA_GH_search_paths += [join(DefaultAssemblyFolder
                                 ,sDNA_GH_subfolder
                                 ) 
                            ]
except:
    raise ImportError(output( 'Unable to import the main sDNA_GH Python Package.  '
                             +'Check the folder sDNA_GH containing the package '
                             +'is a sub folder of the '
                             +'sDNA_GH folder containing the plug-in components'
                             +'and the installation procedure was done correctly'
                             +'as pe as per README.md'
                             ,'ERROR'
                             )
                      )


try:
    nick_name = ghenv.Component.NickName #type: ignore
except:
    nick_name = 'selftest'


sDNA_GH_tools, _ = load_modules( None
                                ,sDNA_GH_package + '.tools'
                                ,sDNA_GH_search_paths
                                )         

class MyComponent(component):
    pass  # Required.  Idiomatic to Grasshopper.  Must be called "MyComponent"  
          # too, otherwise Grasshopper may not find the class building on 
          # component.  Despite component being passed to the class decorator
          # and overwriting this very class immediately below.  
          # Initial parser step / scope check trips this?

MyComponent = sDNA_GH_tools.component_decorator(component, load_modules)


if nick_name.replace(' ','').replace('_','').lower() == 'selftest':  

    if sys.argv[0].endswith(join(sDNA_GH_package,'__main__.py')):   
        from .tests.unit_tests import unit_tests_sDNA_GH
    else:
        unit_tests_sDNA_GH, _ = load_modules( None
                                             ,'sDNA_GH.tests.unit_tests.unit_tests_sDNA_GH'
                                             ,sDNA_GH_search_paths
                                             )

    MyComponent._RunScript = MyComponent.RunScript
    MyComponent.RunScript = unit_tests_sDNA_GH.run_launcher_tests
# ---------- end sdna_demo ----------
sdna_demo_2 = GhPythonScript(go=Toggle(False))  # -> OK, f_name, Geom, Data, a, opts; disabled
# ---------- sdna_demo_2: Python ----------
#! /usr/bin/python2.7
# -*- coding: utf-8 -*-
__author__ = 'James Parrott'
__version__ = '0.01'
 


GHsDNA_subfolder = 'GHsDNA'   
GHsDNA_package = 'GHsDNA'                
reload_config_and_other_modules_if_already_loaded = False 
GHsDNA_search_paths = [r'C:\Users\James\Documents\Rhino\Grasshopper\sDNA\source\repos\GHsDNAv0.01\GHsDNA']

#######################################################################################################################
# Please note!
#  
#
component_tool = None    # Note to user, if you rename this component in Grasshopper, 
                                        # EITHER: add an entry in name_map dictionary below from the name you've
                                        # given it to the name of the tool you want
                                        # this component to actually run.
                                        # 
                                        # OR: hardcode component_tool here to the name in support_component_names,
                                        # special_names, names_map, or in sDNA_tool_names, of the tool you want 
                                        # and make sure metas.allow_components_to_change_type_on_rename == False
                                        # Abbreviations are supported via the name_map dictionary below
                    #Abbreviation = Tool Name
name_map = dict(    sDNA_Demo = [ 'Read_From_Rhino'
                                 ,'Read_Usertext'
                                 ,'Write_Shp'
                                 ,'sDNAIntegral'
                                 ,'Read_Shp'
                                 ,'Write_Usertext'
                                 ,'Parse_Data'
                                 ,'Recolour_objects'
                                 ]
                    ,sDNA_Demo_old_plot = [
                                  'Read_From_Rhino'
                                 ,'Read_Usertext'
                                 ,'Write_Shp'
                                 ,'sDNAIntegral'
                                 ,'Read_Shp'
                                 ,'Write_Usertext'
                                 ,'Visualise_Data'
                                 ]
                    ,Read_From_Rhino = 'get_objects_from_Rhino'
                    ,Read_Usertext = 'read_Usertext'
                    ,Write_Shp = 'write_objects_and_data_to_shapefile'
                    ,Read_Shp = 'read_shapes_and_data_from_shapefile'
                    ,Write_Usertext = 'write_data_to_Usertext'
                    ,Bake_UserText = 'bake_and_write_data_as_Usertext_to_Rhino'
                    ,Visualise_Data = 'plot_data_on_Rhino_objects'
                    ,Parse_Data = 'parse_data'
                    ,Recolour_objects='recolour_objects'
                    ,Recolor_objects ='recolour_objects'
                    #,'main_sequence'
                    #,'sDNAIntegral'
                    #,'sDNASkim'
                    ,sDNAIntFromOD = 'sDNAIntegralFromOD'
                    #,'sDNAGeodesics'
                    #,'sDNAHulls'
                    #,'sDNANetRadii'
                    #,'sDNAAccessibilityMap'
                    #,'sDNAPrepare'
                    #,'sDNALineMeasures'
                    #,'sDNALearn'
                    #,'sDNAPredict'
                )
#######################################################################################################################



import os,sys 
from os.path import isfile, isdir, join, split, dirname
from importlib import import_module

from ghpythonlib.componentbase import executingcomponent as component
import Grasshopper, GhPython
import System
import Rhino
import rhinoscriptsyntax as rs
import scriptcontext as sc
import ghpythonlib.treehelpers as th


def output(s, level='INFO', inst = None):        # e.g. inst is a MyComponent.  
                         # Inst is a proxy argument for both 'self' and 'cls'.
    #type: (str, MyComponent, str) -> None
    message = s
    if hasattr(inst,'nick_name'):
        message = inst.nick_name + ' : ' + message
    message_with_level = level + ' : ' + message
    #print(message_with_level)
    try:
        GHsDNA.tools.output("From GHsDNA output " + message, level, inst)
    except:
        try:
            getattr(GHsDNA.tools.wrapper_logging.logging,level.lower())("from logging " + message)
        except:
            print(message_with_level)
            if hasattr(inst,'a') and hasattr(inst.a,'write'):
                inst.a.write(message_with_level + " via inst")
    return message_with_level

def strict_import(  module_name = ''
                   ,folder = ''
                   ,sub_folder = ''
                   ,output = output
                  ):

    # type: (str,str,str,function) -> type[any]
    #
    if module_name == '':
        output('No module to import','INFO')
        return None
    output(module_name,'DEBUG')
    if module_name in sys.modules:   # sys.modules is also shared between GHPython components 
                                    # and is even saved until Rhino is closed.
        output('Module ' + module_name + ' already in sys.modules.  ','DEBUG')
        if reload_config_and_other_modules_if_already_loaded:
            output('Reloading ' +  module_name  + '.... ','DEBUG')
            reload(sys.modules[module_name]) # type: ignore
        return sys.modules[module_name]
    #
    #
    # Load module_name for first time:
    #
    #
    search_path = join(folder,sub_folder)
    output("Search path == " + search_path,'DEBUG')
    tmp = sys.path
    sys.path.insert(0, search_path)
    m = import_module(module_name, '')           
    sys.path = tmp
    return m       


class GHsDNA():
    pass


def load_modules(m_names, path_lists):
    m_names = m_names if isinstance(m_names, tuple) else [m_names]  # Need this one to be immmutable, so it's hashable to use as a dict key
    output('m_names == ' + str(m_names) + ' of type : ' + type(m_names).__name__,'DEBUG')
    if any((name.startswith('.') or name.startswith('..')) in name for name in m_names):
        output(m_names,'DEBUG')
        raise ImportError( output('Relative import attempted, but not supported','CRITICAL') )

    output('Testing paths : ' + '\n'.join(map(str,path_lists)),'DEBUG')
    output('Type(path_lists) : ' + type(path_lists).__name__,'DEBUG')


    for path_list in path_lists:
        test_paths = path_list if isinstance(path_list, list) else [path_list]
        test_paths = test_paths[:]
        #output('Type(path_list) : ' + type(path_list).__name__,'DEBUG')
        #output('Type(test_paths) : ' + type(test_paths).__name__,'DEBUG')

        for path in test_paths:
            output('Type(path) : ' + type(path).__name__ + ' path == ' + path,'DEBUG')
            if isfile(path):
                path = dirname(path)
            if all(any(isfile(join(path, name.replace('.', os.sep) + ending)) 
                        for ending in ['.py','.pyc'] )
                            for name in m_names):
                # We haven't checked every folder in a package has an __init__.py
                output('Importing ' + str(m_names) +' ','DEBUG')
                return tuple(strict_import(name, path, '') for name in m_names) + (path,)
    return None



def is_file_any_type(s):
    return isinstance(s, str) and isfile(s)

class MyComponent(component):

    global GHsDNA, GHsDNA_search_paths, component_tool, log_file
    GHsDNA_search_paths += [join(Grasshopper.Folders.DefaultAssemblyFolder
                                ,GHsDNA_subfolder
                                ) 
                            ]
                          
    GHsDNA.tools, GHsDNA_path = load_modules('GHsDNA.tools'
                                             ,GHsDNA_search_paths)

    opts = GHsDNA.tools.opts   # mutable.  Reference breakable and remakeable 
                               # to de sync / sync local opts to global opts
    local_metas = GHsDNA.tools.local_metas   # immutable.  controls syncing /
                                             # desyncing / read / write of the
                                             # above, opts.
                                             # Although local, can be set on 
                                             # groups of components using the 
                                             # default section of a project 
                                             # config.ini, or passed as a
                                             # Grasshopper parameter between
                                             # components
    tools_dict = GHsDNA.tools.tools_dict

  
    class_logger_name = "MyComponent"
    if GHsDNA.tools.logger.__class__.__name__ == 'WriteableFlushableList':
        log_file = (  ghdoc.Path.rpartition('.')[0]  #type: ignore
                    + opts['options'].log_file_suffix + '_tracker1'
                    + '.log' ) 
        log_file_dir = split(log_file)[0]
        if isdir(log_file_dir):
            GHsDNA.tools.logger = GHsDNA.tools.wrapper_logging.new_Logger( 
                                            'GHsDNA'
                                            ,log_file 
                                            ,opts['options'].logger_file_level
                                            ,opts['options'].logger_console_level
                                            )
        else:
            pass
            output('Invalid log file dir ' + log_file_dir + ' ', 'ERROR')

    logger = GHsDNA.tools.logger #.getChild( class_logger_name)
   


    my_tools = None

    def update_tools(self):
        self.my_tools = GHsDNA.tools.tool_factory( self.nick_name
                                                  ,name_map
                                                  ,self.opts)
        output('My_tools ==\n'
                +'\n'.join([tool.func_name for tool in self.my_tools])
                ,'DEBUG')


    def update_name(self):
        global name_map
        
        self.nick_name = ghenv.Component.NickName if component_tool==None else component_tool # type: ignore
        self.logger = self.logger.getChild(self.nick_name)
        self.update_tools()


        
    def update_sDNA(self):
        output('Self has attr sDNA == ' + str(hasattr(self,'sDNA'))+' ','DEBUG')
        output('self.opts[metas].sDNA == (' + str(self.opts['metas'].sDNAUISpec)
                + ', ' + self.opts['metas'].runsdna + ') ','DEBUG')

        if hasattr(self,'sDNA'):
            output('Self has attr sDNA == ' + str(hasattr(self,'sDNA'))+' ','DEBUG')
        
        sDNA = ( self.opts['metas'].sDNAUISpec  # Needs to be hashable to be
                ,self.opts['metas'].runsdna )   # a dict key => tuple not list

        if not hasattr(self,'sDNA') or self.sDNA != sDNA:
            self.UISpec, self.run, path = load_modules(sDNA, self.opts['metas'].sDNA_search_paths)

            output('Self has attr UISpec == ' + str(hasattr(self,'UISpec'))+' ' , 'DEBUG')
            output('Self has attr run == ' + str(hasattr(self,'run'))+' ' ,'DEBUG')

            self.sDNA = sDNA
            self.sDNA_path = path
            self.opts['metas'] = self.opts['metas']._replace(    sDNA = self.sDNA
                                                                ,sDNA_path = path 
                                                             )
            self.opts['options'] = self.opts['options']._replace(  UISpec = self.UISpec
                                                                  ,run = self.run 
                                                                  )  

            assert self.opts['metas'].sDNA_path == dirname(self.opts['options'].UISpec.__file__)                                                                  






    def __init__(self):

        
        self.a = GHsDNA.tools.WriteableFlushableList()
        GHsDNA.tools.wrapper_logging.add_custom_file_to_logger( self.logger
                                                               ,self.a
                                                               ,self.opts['options'].logger_custom_level)

        #runsdnacommand, sDNAUISpec = load_sDNA(options)


        self.update_sDNA()
        self.update_name()

        component.__init__(self)

  



    #GHsDNA = strict_import('GHsDNA', join(Grasshopper.Folders.DefaultAssemblyFolder,'GHsDNA'), sub_folder = 'GHsDNA')   
                                        # Grasshopper.Folders.AppDataFolder + r'\Libraries'
                                        # %appdata%  + r'\Grasshopper\Libraries'
                                        # os.getenv('APPDATA') + r'\Grasshopper\Libraries'
    def RunScript(self, go, f_name, Geom, Data, *args):
        # type (bool, str, Rhino Geometry, datatree, tuple(namedtuple,namedtuple), *dict)->bool, str, Rhino_Geom, datatree, str
        #if not 'opts' in globals():
        #    global opts
        #reload(GHsDNA.tools) # type: ignore
        self.a = GHsDNA.tools.WriteableFlushableList() #Reset. Discard output persisting from previous calls to this method (should be logged anyway).
        args_dict = {key.Name : val for key, val in zip(ghenv.Component.Params.Input[1:], args) } # type: ignore
        
        external_opts = args_dict.get('opts',{})
        external_local_metas = args_dict.get('local_metas',{})
        #print('#1 self.local_metas == ' + str(self.local_metas))
        
        if self.nick_name != ghenv.Component.NickName:  # type: ignore
            self.update_name()
            output( ' Tools in ' + self.nick_name + ' changed to : ' 
                            + str(self.my_tools), 'WARNING' )
        
        
        synched = self.local_metas.sync_to_shared_global_opts
        old_sDNA = self.opts['metas'].sDNA

        #print('#1.05 self.local_metas == ' + str(self.local_metas))

        #if not self.local_metas.sync_to_shared_global_opts and self.local_metas.read_from_shared_global_opts:
        #    self.opts = GHsDNA.tools.opts.copy() 
        
        self.local_metas = GHsDNA.tools.override_all_opts( args_dict 
                                                          ,self.opts # also mutates self.opts; local_metas immutable
                                                          ,external_opts 
                                                          ,self.local_metas 
                                                          ,external_local_metas
                                                          ,self.nick_name)
        #output('#2 self.local_metas == ' + str(self.local_metas),'DEBUG')
        
        if (self.opts['metas'].auto_update_Rhino_doc_path 
            and not isfile(self.opts['options'].Rhino_doc_path)):
            path = Rhino.RhinoDoc.ActiveDoc.Path
            if not isinstance(path, str) or not isfile(path):
                path = ghdoc.Path #type: ignore
            self.opts['options'] = self.opts['options']._replace(
                                                    Rhino_doc_path = path)

        if self.opts['metas'].allow_components_to_change_type: 
            #assert False
            
            if self.local_metas.sync_to_shared_global_opts != synched:
                self.opts = GHsDNA.tools.opts if self.local_metas.sync_to_shared_global_opts else self.opts.copy()

            if self.opts['metas'].sDNA != old_sDNA:
                self.update_sDNA()
                self.update_tools()

                
        #load_GHsDNA()
        #reload(tools)
        
        #y = globals().copy(); 
        #print([x for x in y if not x.startswith('__') ])        
        #z = locals().copy();
        #print([x for x in z if not x.startswith('__') ])
        #
        #
        ############################################################################################
        # TODO: Wrap sDNAPrepare, to map subprocess.returncode to True if 1
        # Check with Crispin if return code 0 means preparation was successful, or just successful execution.
        # And if we have to delete groups based on deletion flag or can leave that to sDNA
        ############################################################################################
        #
        Defined_tools = [y for z in self.tools_dict.values() for y in z]
        Undefined_tools = [x for x in self.my_tools if x not in Defined_tools]

        if Undefined_tools:
            output('Defined_tools == ' + str(Defined_tools), 'DEBUG')
            output('Undefined tools == ' + str(Undefined_tools), 'DEBUG')
            raise ValueError(output('Tool function not in cache, possibly ' 
                                    + 'unsupported.  Check input tool_name '
                                    +'if sDNAGeneral, else tool_factory '
                                    ,'ERROR',self))


        if go in [True, [True]]: # [True] in case go set to List Access in GH component but only connected to a normal boolean
            returncode = 999
            assert isinstance(self.my_tools, list)

            output('my_tools == '+str(self.my_tools),'DEBUG')

            geom_data_map = GHsDNA.tools.convert_Data_tree_and_Geom_list_to_gdm(Geom, Data, self.opts)

            returncode, ret_f_name, gdm, a = GHsDNA.tools.run_tools(self.my_tools, f_name, geom_data_map, self.opts)

            if isinstance(gdm, dict):
                NewData, Geometry = GHsDNA.tools.convert_dictionary_to_data_tree_or_lists(gdm)                

            return returncode==0, ret_f_name, Geometry, NewData, a, self.opts.copy(), self.local_metas
                                         #In Python 3 .keys() returns a dictview not a list
        else:   
            return False, f_name, Geom, Data, self.a
# ---------- end sdna_demo_2 ----------
python_2 = GhPythonScript(x=geo, y=sdnaintegral_2.Geom)  # -> out, a; inputs x: list, y: list
# ---------- python_2: Python ----------
__author__ = "James"
__version__ = "2022.03.29"

import rhinoscriptsyntax as rs
print x[0]
print y[0]
# ---------- end python_2 ----------
preview_2 = CustomPreview(Geometry=sdnaintegral_2.Geom, Material=sdnaintegral_2.Data)
legend = Legend(
    Colour=[RGB(211, 211, 211), RGB(105, 105, 105), RGB(128, 0, 0), RGB(0, 0, 128)],
    Tags=["One Fish", "Two Fish", "Red Fish", "Blue Fish"],
    LegendType=1)
rename = RenameObject()
python_3 = GhPythonScript()  # -> a; disabled
# ---------- python_3: Python ----------
from ghpythonlib.componentbase import executingcomponent as component
import Grasshopper, GhPython
import System
import Rhino
import rhinoscriptsyntax as rs

class MyComponent(component):
    
    def RunScript(self, x, y):
        a = dir(self.Params.Output)
        d={}
        d[self.Params.Output] = 4
        l = self.Params.Output[:]
        return isinstance(d, dict)
# ---------- end python_3 ----------
legend_2 = Legend(Colour=sdna_demo_2.Data, Tags=sdna_demo_2.Geom, Rectangle=sdna_demo_2.f_name, LegendType=1)
delete_sdna_gh = Button()
python_4 = GhPythonScript()  # -> out, a; inputs x: tree
# ---------- python_4: Python ----------
#! /usr/bin/python2.7
# -*- coding: utf-8 -*-
__author__ = 'James Parrott'
__version__ = '0.00'
__copyright__ = 'Cardiff University'
__license__ = {  'Python standard library modules and ' : 'Python Software Foundation 2.7.18' # https://docs.python.org/2.7/license.html
                ,'wrapper_logging' : 'Python Software Foundation 2.7.18'
                ,'wrapper_pyshp' : 'MIT' # https://pypi.org/project/pyshp/ 
                ,'sDNAUISpec.py' : 'MIT' # https://github.com/fiftysevendegreesofrad/sdna_open/blob/master/LICENSE.md
                ,'everything else' : 'same as for sDNA ' # https://sdna.cardiff.ac.uk/sdna/legal-license/ 
               }
if x:
    print 'bool(x) == True'
    print x
    
a=''

import sys
from Grasshopper import DataTree
from ghpythonlib import treehelpers as th
#print sys.path
print 'x is DataTree == ' + str(isinstance(x, DataTree))
print 'x is DataTree[obj] == ' + str(isinstance(x, DataTree[object]))
#print th.tree_to_list(x)
print (isinstance(x, DataTree[object]) and getattr(x, 'BranchCount', 0) > 0)
print x==DataTree[object]()
# ---------- end python_4 ----------
update = Button()
python_5 = GhPythonScript()  # -> a; inputs x: tree
# ---------- python_5: Python ----------
from ghpythonlib.componentbase import executingcomponent as component
import Grasshopper, GhPython
import System
import Rhino
import rhinoscriptsyntax as rs

class MyComponent(component):
    
    def RunScript(self, x, y):
        a = self.Params
        print [x.NickName for x in a.Output]
        return a
# ---------- end python_5 ----------
python_6 = GhPythonScript()  # -> out, a; disabled
# ---------- python_6: Python ----------
#! /usr/bin/python2.7
# -*- coding: utf-8 -*-
__author__ = 'James Parrott'
__version__ = '0.00'
__copyright__ = 'Cardiff University'
__license__ = {  'Python standard library modules and ' : 'Python Software Foundation 2.7.18' # https://docs.python.org/2.7/license.html
                ,'wrapper_logging' : 'Python Software Foundation 2.7.18'
                ,'wrapper_pyshp' : 'MIT' # https://pypi.org/project/pyshp/ 
                ,'sDNAUISpec.py' : 'MIT' # https://github.com/fiftysevendegreesofrad/sdna_open/blob/master/LICENSE.md
                ,'everything else' : 'same as for sDNA ' # https://sdna.cardiff.ac.uk/sdna/legal-license/ 
               }

import ghpythonlib.treehelpers as th
import rhinoscriptsyntax as rs
import uuid, sys
import scriptcontext as sc
import Rhino

s='de5b73ac-055b-494c-9efd-306c186ffaa3'
print (rs.IsObject(s) if uuid.UUID(s) else False)

print 'ghdoc' in globals()

#rs.AddPolyline([(0,0),(10,10)]) # Works

import sys
try:
    print sys.modules['logging'].logger
except:
    pass

#print dir(th.Tree)
#print isinstance(None, th.Tree)

sc.doc = Rhino.RhinoDoc.ActiveDoc

objs = rs.ObjectsByType(4)

#print rs.LinetypeNames()

#print type(objs[0])

#print dir(objs[0])

#print '\n'.join([str(obj) for obj in objs if rs.IsPolyline(obj)]) #objs[0].TopologyDescription
f = rs.IsObject
if objs:
    isobj = rs.IsObject(objs[0])
    print ["IsObject == " + str(f(obj))+'\n' for obj in [objs[0]]] 
    if isobj:
        iscurve = rs.IsCurve(objs[0])
        print "IsCurve == " + str(iscurve )
        if iscurve:
            isline = rs.IsLine(objs[0])
            print "IsLine == " + str(isline )        
            if isline:
                ispline = rs.IsPolyline(objs[0])
                print "IsPolyline == " + str(ispline )
    print rs.PolylineVertices(objs[0])

sc.doc = ghdoc

print __name__
#print __file__
print '__file__' in dir(__builtins__)

print
for obj in objs:
    print(str(obj))
# ---------- end python_6 ----------
python_7 = GhPythonScript(del_sDNA_GH=delete_sdna_gh, update=update)  # -> out, a
# ---------- python_7: Python ----------
#! /usr/bin/python2.7
# -*- coding: utf-8 -*-
__author__ = 'James Parrott'
__version__ = '0.00'
__copyright__ = 'Cardiff University'
__license__ = {  'Python standard library modules and ' : 'Python Software Foundation 2.7.18' # https://docs.python.org/2.7/license.html
                ,'wrapper_logging' : 'Python Software Foundation 2.7.18'
                ,'wrapper_pyshp' : 'MIT' # https://pypi.org/project/pyshp/ 
                ,'sDNAUISpec.py' : 'MIT' # https://github.com/fiftysevendegreesofrad/sdna_open/blob/master/LICENSE.md
                ,'everything else' : 'same as for sDNA ' # https://sdna.cardiff.ac.uk/sdna/legal-license/ 
               }

import sys, os, Grasshopper, logging
#print('\n'.join([key for key in sys.modules if 'sDNA' in key]))
#print('functools' in sys.modules)
print('Our packages and modules in sys.modules:')
print('\n'.join([key for key in sys.modules if 'sdna' in key.lower()]))# and not '.' in key]))
#print os.getenv('APPDATA')
#print ghdoc.Path
#print Grasshopper.Folders.DefaultAssemblyFolder
#print Grasshopper.Folders.AppDataFolder
#print sys.argv[0]
#print("Classmethod found == " + str('classmethod' in __builtins__))
def is_imported(s):
    return s in sys.modules
if del_sDNA_GH == True:
    if 'logging' in sys.modules:
        sys.modules['logging'].shutdown()
    shared_cached_modules_etc = sys.modules.copy().keys()
    for y in shared_cached_modules_etc:
        if 'sDNA' in y or y == 'runsdnacommand':
            del sys.modules[y]


        
print('sDNA_GH imported == ' + str(is_imported('sDNA_GH')))
print('sDNA_GH.tools imported == ' + str(is_imported('sDNA_GH.tools')))
print('sDNAUISpec imported == ' + str(is_imported('sDNAUISpec')))
print('runsdnacommand == ' + str(is_imported('runsdnacommand')))
if False: #is_imported('sDNA_GH'):
    print sys.modules['sDNA_GH'].__all__
    print dir(sys.modules['sDNA_GH'])
    if is_imported('sDNA_GH.tools'):
        print dir(sys.modules['sDNA_GH.tools'])
    if hasattr(sys.modules['sDNA_GH'],'third_party_python_modules'):
        print dir(sys.modules['sDNA_GH'].third_party_python_modules)

#print sys.modules.keys()
#print os.getcwd()
#print sys.path[0]
#print 'a' in globals()
#a = "This is a!"
#print('\n'.join(dir(sys.modules['sDNA_GH'].third_party_python_modules)))
# ---------- end python_7 ----------
panel = Panel(python_6.out)
python_8 = GhPythonScript()  # -> out, a; disabled
# ---------- python_8: Python ----------
#! /usr/bin/python2.7
# -*- coding: utf-8 -*-
__author__ = 'James Parrott'
__version__ = '0.00'
__copyright__ = 'Cardiff University'
__license__ = {  'Python standard library modules and ' : 'Python Software Foundation 2.7.18' # https://docs.python.org/2.7/license.html
                ,'wrapper_logging' : 'Python Software Foundation 2.7.18'
                ,'wrapper_pyshp' : 'MIT' # https://pypi.org/project/pyshp/ 
                ,'sDNAUISpec.py' : 'MIT' # https://github.com/fiftysevendegreesofrad/sdna_open/blob/master/LICENSE.md
                ,'everything else' : 'same as for sDNA ' # https://sdna.cardiff.ac.uk/sdna/legal-license/ 
               }

import scriptcontext as sc
import sys
from os.path import join
from importlib import import_module

print dir(sys.modules['GHsDNA.custom_python_modules.wrapper_pyshp'])

del sys.modules['GHsDNA']


"""

def strict_import(  module_name = None
                   ,folder = ''
                   ,sub_folder = ''
                   ,pkg = None 
                   ,output = lambda s : sys.stdout.write(s + '\n')
                  ):

    # type: (str,str) -> module

    #
    if module_name == None:
        output('No module to import')
    else:
        if module_name in sc.sticky:   
            return sc.sticky[module_name]    # https://developer.rhino3d.com/guides/rhinopython/ghpython-global-sticky/
        elif module_name in sys.modules:   # sys.modules is also shared between GHPython components 
                                        # and is even saved until Rhino is closed.
            output('Module ' + module_name + ' already in sys.modules.  Reloading.... ')
            #if metas.reload_config_and_other_modules_if_already_loaded:
            try:
                reload(sys.modules[module_name])
                return sys.modules[module_name]
            except:
                output('Could not reload module ' + module_name)
                return None
        tmp = sys.path
        sys.path = [join(folder,sub_folder)]
        try:
            m = import_module(module_name, pkg)           
            sc.sticky[module_name] = m
        except:
            output('Module ' + module_name + ' not found in ' + '\n'.join(test_files)) #sys.path[0])
            m = 679.0
        finally:
            sys.path = tmp
            return m
            #TODO search sub folders and a few levels of parent folders
            #TODO attempt to download required .gh and other .py modules?        

strict_import('GHsDNA', r'C:\Users\James\Documents\Rhino\Grasshopper\sDNA\source\repos\GHsDNAv0.00\GHsDNA', '', 'GHsDNA')
GHsDNA = strict_import('.GHsDNA', r'C:\Users\James\Documents\Rhino\Grasshopper\sDNA\source\repos\GHsDNAv0.00\GHsDNA', 'GHsDNA', 'GHsDNA')
#tmp = sys.path
#sys.path = [join(r'C:\Users\James\Documents\Rhino\Grasshopper\sDNA\source\repos\GHsDNAv0.00\GHsDNA','')]
#print sys.path[0]
#import_module('GHsDNA', 'GHsDNA')
#from GHsDNA import GHsDNA
print dir(GHsDNA)

#sys.path = tmp
#print '\n'.join(sys.modules.keys())

"""
# ---------- end python_8 ----------
panel_2 = Panel(python_7.out)
anon = GhPythonScript()  # -> a
# ---------- anon: Python ----------
#! /usr/bin/python2.7
# -*- coding: utf-8 -*-
__author__ = 'James Parrott'
__version__ = '0.01'


import os, sys 
from os.path import isfile, isdir, join, split, dirname
from importlib import import_module

try:        
    from ghpythonlib.componentbase import executingcomponent as component
    import Grasshopper
    import scriptcontext as sc
except ImportError:
    print( "No Grasshopper env found.  Building test environment.  ")
    
    component = object

    class Grasshopper:
        class Folders:
            #DefaultAssemblyFolder = r'C:\Users\James\Documents\Rhino\Grasshopper\sDNA\source\repos\GHsDNAv0.01'
            DefaultAssemblyFolder = os.getenv('APPDATA') + r'\Grasshopper\Libraries'

sDNA_GH_subfolder = 'sDNA_GH' 
sDNA_GH_package = 'sDNA_GH'               
reload_config_and_other_modules_if_already_loaded = False
#sDNA_GH_search_paths = [r'C:\Users\James\Documents\Rhino\Grasshopper\sDNA\source\repos\GHsDNAv0.01\sDNA_GH']
sDNA_GH_search_paths = [ join(Grasshopper.Folders.DefaultAssemblyFolder, sDNA_GH_subfolder) ]  
                                            # Grasshopper.Folders.AppDataFolder + r'\Libraries'
                                            # %appdata%  + r'\Grasshopper\Libraries'
                                            # os.getenv('APPDATA') + r'\Grasshopper\Libraries'



def output(s, level='INFO', inst = None):        # e.g. inst is a MyComponent.  
                         # Inst is a proxy argument for both 'self' and 'cls'.
    #type: (str, MyComponent, str) -> None
    message = s
    if hasattr(inst,'nick_name'):
        message = inst.nick_name + ' : ' + message
    message_with_level =  'sDNA_GH_launcher' + '  ' + level + ' : ' + message
    #print(message_with_level)
    try:
        sDNA_GH_tools.output(message, level, inst)
    except:
        try:
            getattr(sDNA_GH_tools.wrapper_logging.logging,level.lower())("From sDNA_GH_launcher via logging: " + message)
        except:
            print(message_with_level)
    return message_with_level


def strict_import(  module_name = ''
                   ,folder = ''
                   ,sub_folder = ''
                   ,output = output
                   ,search_folder_only = False
                   ):

    # type: (str, str, str, function, bool) -> type[any]
    #
    if module_name == '':
        output('No module to import','INFO')
        return None
    output(module_name,'DEBUG')
    if module_name in sys.modules:   # sys.modules is also shared between GHPython components 
                                    # and is even saved until Rhino is closed.
        output('Module ' + module_name + ' already in sys.modules.  ','DEBUG')
        if reload_config_and_other_modules_if_already_loaded:
            output('Reloading ' +  module_name  + '.... ','DEBUG')
            reload(sys.modules[module_name]) # type: ignore
        return sys.modules[module_name]
    #
    #
    # Load module_name for first time:
    #
    #
    search_path = join(folder, sub_folder)

    tmp = sys.path
    if search_path and isinstance(search_path, str) and isdir(search_path):
        output('Search path == ' + search_path, 'DEBUG')
        if search_folder_only:
            sys.path = [search_path]
        else:
            sys.path.insert(0, search_path)
    else:
        output('Invalid search path : ' + search_path, 'DEBUG')
        if search_folder_only:
            return None

    output('Trying import... ','DEBUG')
    m = import_module(module_name, '')           
    sys.path = tmp
    return m       


def load_modules(self, m_names, path_lists):
    m_names = m_names if isinstance(m_names, tuple) else [m_names] 
    output('m_names == ' + str(m_names) + ' of type : ' + type(m_names).__name__,'DEBUG')
    if any((name.startswith('.') or name.startswith('..')) in name for name in m_names):
        output(m_names,'DEBUG')
        raise ImportError( output('Relative import attempted, but not supported','CRITICAL') )

    output('Testing paths : ' + '\n'.join(map(str,path_lists)),'DEBUG')
    output('Type(path_lists) : ' + type(path_lists).__name__,'DEBUG')


    for path_list in path_lists:
        test_paths = path_list if isinstance(path_list, list) else [path_list]
        test_paths = test_paths[:]
        #output('Type(path_list) : ' + type(path_list).__name__,'DEBUG')
        #output('Type(test_paths) : ' + type(test_paths).__name__,'DEBUG')

        for path in test_paths:
            output('Type(path) : ' + type(path).__name__ + ' path == ' + path,'DEBUG')
            if isfile(path):
                path = dirname(path)
            if all( any(isfile(join(path, name.replace('.', os.sep) + ending)) 
                        for ending in ['.py','.pyc'] 
                        )
                    for name in m_names
                ):
                output('Importing ' + str(m_names) +' ','DEBUG')
                return tuple(strict_import(name, path, '') for name in m_names) + (path,)
    return None


#try:
from Grasshopper.Folders import DefaultAssemblyFolder
sDNA_GH_search_paths += [join(DefaultAssemblyFolder
                                ,sDNA_GH_subfolder
                                ) 
                        ]            
# except:
#     raise ImportError(output( 'Unable to import the main sDNA_GH Python Package.  '
#                              +'Check the folder sDNA_GH containing the package '
#                              +'is a sub folder of the '
#                              +'sDNA_GH folder containing the plug-in components'
#                              +'and the installation procedure was done correctly'
#                              +'as per README.md'
#                              ,'ERROR'
#                              )
#                       )


try:
    nick_name = ghenv.Component.NickName #type: ignore
except:
    nick_name = 'selftest'

sc.doc = ghdoc #type: ignore

sDNA_GH_tools, _ = load_modules( None
                                ,sDNA_GH_package + '.tools'
                                ,sDNA_GH_search_paths
                                )         

class MyComponent(component):
    pass  # Required.  Idiomatic to Grasshopper.  Must be called "MyComponent"  
          # too, otherwise Grasshopper may not find the class building on 
          # component.  Despite component being passed to the class decorator
          # and overwriting this very class immediately below.  
          # Initial parser step / scope check trips this?

MyComponent = sDNA_GH_tools.component_decorator( component
                                                ,ghenv #type: ignore
                                                ,nick_name
                                                ,load_modules
                                                )


if nick_name.replace(' ','').replace('_','').lower() == 'selftest':  

    if sys.argv[0].endswith(join(sDNA_GH_package,'__main__.py')):   
        from .tests.unit_tests import unit_tests_sDNA_GH
    else:
        unit_tests_sDNA_GH, _ = load_modules( None
                                             ,'sDNA_GH.tests.unit_tests.unit_tests_sDNA_GH'
                                             ,sDNA_GH_search_paths
                                             )

    MyComponent._RunScript = MyComponent.RunScript
    MyComponent.RunScript = unit_tests_sDNA_GH.run_launcher_tests
# ---------- end anon ----------
