# Grasshopper definition sDNA_build_components.gh (Grasshopper 1.0.7)

path = FilePath("C:\Users\James\Documents\Rhino\Grasshopper\sDNA\source\repos\GHsDNAv0.01\sDNA_GH\sDNA_GH\sDNA_GH_launcher.py")
panel = Panel("pass")
python = GhPythonScript()  # -> OK, names; inputs go: list, opts: list
# ---------- python: Python ----------
#! /usr/bin/python2.7
# -*- coding: utf-8 -*-
__author__ = 'James Parrott'
__version__ = '0.01'


import os, sys 
from os.path import isfile, isdir, join, split, dirname
from importlib import import_module

try:        
    from ghpythonlib.componentbase import executingcomponent as component
    import Grasshopper
    import scriptcontext as sc
except ImportError:
    print( "No Grasshopper env found.  Building test environment.  ")
    
    component = object

    class Grasshopper:
        class Folders:
            #DefaultAssemblyFolder = r'C:\Users\James\Documents\Rhino\Grasshopper\sDNA\source\repos\GHsDNAv0.01'
            DefaultAssemblyFolder = os.getenv('APPDATA') + r'\Grasshopper\Libraries'

sDNA_GH_subfolder = 'sDNA_GH' 
sDNA_GH_package = 'sDNA_GH'               
reload_config_and_other_modules_if_already_loaded = False
#sDNA_GH_search_paths = [r'C:\Users\James\Documents\Rhino\Grasshopper\sDNA\source\repos\GHsDNAv0.01\sDNA_GH']
sDNA_GH_search_paths = [ join(Grasshopper.Folders.DefaultAssemblyFolder, sDNA_GH_subfolder) ]  
                                            # Grasshopper.Folders.AppDataFolder + r'\Libraries'
                                            # %appdata%  + r'\Grasshopper\Libraries'
                                            # os.getenv('APPDATA') + r'\Grasshopper\Libraries'



def output(s, level='INFO', inst = None):        # e.g. inst is a MyComponent.  
                         # Inst is a proxy argument for both 'self' and 'cls'.
    #type: (str, MyComponent, str) -> None
    message = s
    if hasattr(inst,'nick_name'):
        message = inst.nick_name + ' : ' + message
    message_with_level =  'sDNA_GH_launcher' + '  ' + level + ' : ' + message
    #print(message_with_level)
    try:
        sDNA_GH_tools.output(message, level, inst)
    except:
        try:
            getattr(sDNA_GH_tools.wrapper_logging.logging,level.lower())("From sDNA_GH_launcher via logging: " + message)
        except:
            print(message_with_level)
    return message_with_level


def strict_import(  module_name = ''
                   ,folder = ''
                   ,sub_folder = ''
                   ,output = output
                   ,search_folder_only = False
                   ):

    # type: (str, str, str, function, bool) -> type[any]
    #
    if module_name == '':
        output('No module to import','INFO')
        return None
    output(module_name,'DEBUG')
    if module_name in sys.modules:   # sys.modules is also shared between GHPython components 
                                    # and is even saved until Rhino is closed.
        output('Module ' + module_name + ' already in sys.modules.  ','DEBUG')
        if reload_config_and_other_modules_if_already_loaded:
            output('Reloading ' +  module_name  + '.... ','DEBUG')
            reload(sys.modules[module_name]) # type: ignore
        return sys.modules[module_name]
    #
    #
    # Load module_name for first time:
    #
    #
    search_path = join(folder, sub_folder)

    tmp = sys.path
    if search_path and isinstance(search_path, str) and isdir(search_path):
        output('Search path == ' + search_path, 'DEBUG')
        if search_folder_only:
            sys.path = [search_path]
        else:
            sys.path.insert(0, search_path)
    else:
        output('Invalid search path : ' + search_path, 'DEBUG')
        if search_folder_only:
            return None

    output('Trying import... ','DEBUG')
    m = import_module(module_name, '')           
    sys.path = tmp
    return m       


def load_modules(self, m_names, path_lists):
    m_names = m_names if isinstance(m_names, tuple) else [m_names] 
    output('m_names == ' + str(m_names) + ' of type : ' + type(m_names).__name__,'DEBUG')
    if any((name.startswith('.') or name.startswith('..')) in name for name in m_names):
        output(m_names,'DEBUG')
        raise ImportError( output('Relative import attempted, but not supported','CRITICAL') )

    output('Testing paths : ' + '\n'.join(map(str,path_lists)),'DEBUG')
    output('Type(path_lists) : ' + type(path_lists).__name__,'DEBUG')


    for path_list in path_lists:
        test_paths = path_list if isinstance(path_list, list) else [path_list]
        test_paths = test_paths[:]
        #output('Type(path_list) : ' + type(path_list).__name__,'DEBUG')
        #output('Type(test_paths) : ' + type(test_paths).__name__,'DEBUG')

        for path in test_paths:
            output('Type(path) : ' + type(path).__name__ + ' path == ' + path,'DEBUG')
            if isfile(path):
                path = dirname(path)
            if all( any(isfile(join(path, name.replace('.', os.sep) + ending)) 
                        for ending in ['.py','.pyc'] 
                        )
                    for name in m_names
                ):
                output('Importing ' + str(m_names) +' ','DEBUG')
                return tuple(strict_import(name, path, '') for name in m_names) + (path,)
    return None


#try:
from Grasshopper.Folders import DefaultAssemblyFolder
sDNA_GH_search_paths += [join(DefaultAssemblyFolder
                                ,sDNA_GH_subfolder
                                ) 
                        ]            
# except:
#     raise ImportError(output( 'Unable to import the main sDNA_GH Python Package.  '
#                              +'Check the folder sDNA_GH containing the package '
#                              +'is a sub folder of the '
#                              +'sDNA_GH folder containing the plug-in components'
#                              +'and the installation procedure was done correctly'
#                              +'as per README.md'
#                              ,'ERROR'
#                              )
#                       )


try:
    nick_name = ghenv.Component.NickName #type: ignore
except:
    nick_name = 'selftest'

sc.doc = ghdoc #type: ignore

sDNA_GH_tools, _ = load_modules( None
                                ,sDNA_GH_package + '.tools'
                                ,sDNA_GH_search_paths
                                )         

class MyComponent(component):
    pass  # Required.  Idiomatic to Grasshopper.  Must be called "MyComponent"  
          # too, otherwise Grasshopper may not find the class building on 
          # component.  Despite component being passed to the class decorator
          # and overwriting this very class immediately below.  
          # Initial parser step / scope check trips this?

MyComponent = sDNA_GH_tools.component_decorator( component
                                                ,ghenv #type: ignore
                                                ,nick_name
                                                ,load_modules
                                                )


if nick_name.replace(' ','').replace('_','').lower() == 'selftest':  

    if sys.argv[0].endswith(join(sDNA_GH_package,'__main__.py')):   
        from .tests.unit_tests import unit_tests_sDNA_GH
    else:
        unit_tests_sDNA_GH, _ = load_modules( None
                                             ,'sDNA_GH.tests.unit_tests.unit_tests_sDNA_GH'
                                             ,sDNA_GH_search_paths
                                             )

    MyComponent._RunScript = MyComponent.RunScript
    MyComponent.RunScript = unit_tests_sDNA_GH.run_launcher_tests
# ---------- end python ----------
python_2 = GhPythonScript()  # -> OK, names; inputs go: list, opts: list; same code as python
python_3 = GhPythonScript()  # -> OK, names; inputs go: list, opts: list; same code as python
python_4 = GhPythonScript()  # -> OK, names; inputs go: list, opts: list; same code as python
python_5 = GhPythonScript()  # -> OK, names; inputs go: list, opts: list; same code as python
file = ReadFile(File=path, PerLineParse=False)
python_6 = GhPythonScript()  # -> OK, names; inputs go: list, opts: list; same code as python
python_7 = GhPythonScript()  # -> OK, names; inputs go: list, opts: list; same code as python
python_8 = GhPythonScript()  # -> OK, names; inputs go: list, opts: list; same code as python
python_9 = GhPythonScript()  # -> OK, names; inputs go: list, opts: list; same code as python
python_10 = GhPythonScript()  # -> OK, names; inputs go: list, opts: list; same code as python
python_11 = GhPythonScript()  # -> OK, names; inputs go: list, opts: list; disabled; same code as python
build_components = GhPythonScript(go=Toggle(False), launcher_code=file)  # -> out, OK; inputs go: list, launcher_code: list, opts: list, name_map: list, categories: list; same code as python
python_12 = GhPythonScript()  # -> OK, names; inputs go: list, opts: list; same code as python
python_13 = GhPythonScript()  # -> OK, names; inputs go: list, opts: list; same code as python
python_14 = GhPythonScript()  # -> OK, names; inputs go: list, opts: list; same code as python
python_15 = GhPythonScript()  # -> OK, names; inputs go: list, opts: list; same code as python
python_16 = GhPythonScript()  # -> OK, names; inputs go: list, opts: list; same code as python
python_17 = GhPythonScript()  # -> OK, names; inputs go: list, opts: list; same code as python
python_18 = GhPythonScript()  # -> OK, names; inputs go: list, opts: list; same code as python
python_19 = GhPythonScript()  # -> OK, names; inputs go: list, opts: list; same code as python
python_20 = GhPythonScript()  # -> OK, names; inputs go: list, opts: list; same code as python
python_21 = GhPythonScript()  # -> OK, names; inputs go: list, opts: list; same code as python
python_22 = GhPythonScript()  # -> OK, names; inputs go: list, opts: list; same code as python
python_23 = GhPythonScript()  # -> OK, names; inputs go: list, opts: list; same code as python
python_24 = GhPythonScript()  # -> OK, names; inputs go: list, opts: list; same code as python
python_25 = GhPythonScript()  # -> OK, names; inputs go: list, opts: list; same code as python
python_26 = GhPythonScript()  # -> OK, names; inputs go: list, opts: list; same code as python
panel_2 = Panel(build_components.out)
delete_sdna_gh = Button()
update = Button()
python_27 = GhPythonScript()  # -> OK, names; inputs go: list, opts: list; same code as python
python_28 = GhPythonScript()  # -> OK, names; inputs go: list, opts: list; same code as python
python_29 = GhPythonScript()  # -> OK, names; inputs go: list, opts: list; same code as python
python_30 = GhPythonScript()  # -> OK, names; inputs go: list, opts: list; same code as python
python_31 = GhPythonScript()  # -> OK, names; inputs go: list, opts: list; same code as python
python_32 = GhPythonScript()  # -> OK, names; inputs go: list, opts: list; same code as python
python_33 = GhPythonScript()  # -> OK, names; inputs go: list, opts: list; same code as python
python_34 = GhPythonScript()  # -> OK, names; inputs go: list, opts: list; same code as python
python_35 = GhPythonScript()  # -> OK, names; inputs go: list, opts: list; same code as python
python_36 = GhPythonScript()  # -> OK, names; inputs go: list, opts: list; same code as python
python_37 = GhPythonScript(del_sDNA_GH=delete_sdna_gh, update=update)  # -> out, a
# ---------- python_37: Python ----------
#! /usr/bin/python2.7
# -*- coding: utf-8 -*-
__author__ = 'James Parrott'
__version__ = '0.00'
__copyright__ = 'Cardiff University'
__license__ = {  'Python standard library modules and ' : 'Python Software Foundation 2.7.18' # https://docs.python.org/2.7/license.html
                ,'wrapper_logging' : 'Python Software Foundation 2.7.18'
                ,'wrapper_pyshp' : 'MIT' # https://pypi.org/project/pyshp/ 
                ,'sDNAUISpec.py' : 'MIT' # https://github.com/fiftysevendegreesofrad/sdna_open/blob/master/LICENSE.md
                ,'everything else' : 'same as for sDNA ' # https://sdna.cardiff.ac.uk/sdna/legal-license/ 
               }

import sys, os, Grasshopper, logging
#print('\n'.join([key for key in sys.modules if 'sDNA' in key]))
#print('functools' in sys.modules)
print('Our packages and modules in sys.modules:')
print('\n'.join([key for key in sys.modules if 'sdna' in key.lower()]))# and not '.' in key]))
#print os.getenv('APPDATA')
#print ghdoc.Path
#print Grasshopper.Folders.DefaultAssemblyFolder
#print Grasshopper.Folders.AppDataFolder
#print sys.argv[0]
#print("Classmethod found == " + str('classmethod' in __builtins__))
def is_imported(s):
    return s in sys.modules
if del_sDNA_GH == True:
    if 'logging' in sys.modules:
        sys.modules['logging'].shutdown()
    shared_cached_modules_etc = sys.modules.copy().keys()
    for y in shared_cached_modules_etc:
        if 'sDNA' in y or y == 'runsdnacommand':
            del sys.modules[y]


        
print('sDNA_GH imported == ' + str(is_imported('sDNA_GH')))
print('sDNA_GH.tools imported == ' + str(is_imported('sDNA_GH.tools')))
print('sDNAUISpec imported == ' + str(is_imported('sDNAUISpec')))
print('runsdnacommand == ' + str(is_imported('runsdnacommand')))
if False: #is_imported('sDNA_GH'):
    print sys.modules['sDNA_GH'].__all__
    print dir(sys.modules['sDNA_GH'])
    if is_imported('sDNA_GH.tools'):
        print dir(sys.modules['sDNA_GH.tools'])
    if hasattr(sys.modules['sDNA_GH'],'third_party_python_modules'):
        print dir(sys.modules['sDNA_GH'].third_party_python_modules)

#print sys.modules.keys()
#print os.getcwd()
#print sys.path[0]
#print 'a' in globals()
#a = "This is a!"
#print('\n'.join(dir(sys.modules['sDNA_GH'].third_party_python_modules)))
# ---------- end python_37 ----------
python_38 = GhPythonScript()  # -> OK, names; inputs go: list, opts: list; same code as python
python_39 = GhPythonScript()  # -> OK, names; inputs go: list, opts: list; same code as python
python_40 = GhPythonScript()  # -> OK, names; inputs go: list, opts: list; same code as python
python_41 = GhPythonScript()  # -> OK, names; inputs go: list, opts: list; same code as python
python_42 = GhPythonScript()  # -> OK, names; inputs go: list, opts: list; same code as python
panel_3 = Panel(python_37.out)
