# Grasshopper definition test_import_sDNA_GH_tools.gh (Grasshopper 1.0.7)

python = GhPythonScript(x=Button())  # -> out, a
# ---------- python: Python ----------
#! /usr/bin/python2.7
# -*- coding: utf-8 -*-
__author__ = 'James Parrott'
__version__ = '0.00'
__copyright__ = 'Cardiff University'
__license__ = {  'Python standard library modules and ' : 'Python Software Foundation 2.7.18' # https://docs.python.org/2.7/license.html
                ,'wrapper_logging' : 'Python Software Foundation 2.7.18'
                ,'wrapper_pyshp' : 'MIT' # https://pypi.org/project/pyshp/ 
                ,'sDNAUISpec.py' : 'MIT' # https://github.com/fiftysevendegreesofrad/sdna_open/blob/master/LICENSE.md
                ,'everything else' : 'same as for sDNA ' # https://sdna.cardiff.ac.uk/sdna/legal-license/ 
               }
import sys
from os.path import join
from importlib import import_module
from time import asctime
print(asctime())
tmp_dir = r'C:\Users\James\Documents\Rhino\Grasshopper\sDNA\source\repos\GHsDNAv0.00'
sub_dir = 'GHsDNA'

#if not tmp_dir in sys.path:
#    sys.path.insert(0,join(tmp_dir, sub_dir))
class GHsDNA:
    pass
    

tmp = sys.path    
#sys.path = [join(tmp_dir, sub_dir)]    
#GHsDNA.tools = import_module('GHsDNA.tools', '')
#sys.path = tmp


if not tmp_dir in sys.path:
    sys.path.insert(0,join(tmp_dir, sub_dir))
#sys.path = [join(tmp_dir, sub_dir)]    
GHsDNA.tools = import_module('GHsDNA.tools', '')
sys.path = tmp
# ---------- end python ----------
python_2 = GhPythonScript(x=Button())  # -> out, a
# ---------- python_2: Python ----------
#! /usr/bin/python2.7
# -*- coding: utf-8 -*-
__author__ = 'James Parrott'
__version__ = '0.00'
__copyright__ = 'Cardiff University'
__license__ = {  'Python standard library modules and ' : 'Python Software Foundation 2.7.18' # https://docs.python.org/2.7/license.html
                ,'wrapper_logging' : 'Python Software Foundation 2.7.18'
                ,'wrapper_pyshp' : 'MIT' # https://pypi.org/project/pyshp/ 
                ,'sDNAUISpec.py' : 'MIT' # https://github.com/fiftysevendegreesofrad/sdna_open/blob/master/LICENSE.md
                ,'everything else' : 'same as for sDNA ' # https://sdna.cardiff.ac.uk/sdna/legal-license/ 
               }

import sys
import importlib
import subprocess
#print(sys.modules['GHsDNA.tools'].opts)
print ('\n'.join([k for k in sys.modules if k.startswith('s')]))
normal_sys_modules =  ['ComplexPolygon2Feature', 'rhinoscript.view', 'ghpythonlib.GhPython', 'json._json', 'locale', 'clr', 'scriptcontext', 'rhinoscript.hatch', 'rhinoscript.dimension', 'Python_de0d0a8704264cfa97adcb043b73a985', 'GhPython', 'functools', 'DecomposeExtrusion', 'ghpythonlib.component', 'System', 'rhinoscript.utility', 'math', '_weakref', 'numbers', 'exceptions', 'rhinoscript.group', 'rhinoscript.scriptcontext', 'sDNAIntegral_3be8569489db45cb8325a8e96965c043', 'rhinoscript.userinterface', 'Python_e37b1cb4e20443cf9a14d7d587cc6630', 'rhinoscript.linetype', 'Python_9dbf0e91cbe44741a6564bc12448408e', 'json.sys', 'Tommy_ac31c614ebe34d32a8deab56b4fc0c56', 'rhinoscript.grips', 'linecache', 'os', 'codecs', 'Python_c909faf616bc45bdad62d90972a604de', '_locale', 'Transformation', 'ghpythonlib', 'Python_8bb484ac02e249a2b63bddf738b65517', 'nt', 'RhinoPython', 'Python_c0f4da5742fd4875bfe7f3911c9c59af', 'Reprojection', 'UserDict', 'struct', 'warnings', 'zipimport', 'thread', 'ntpath', 'operator', 'rhinoscript', 'rhinoscript.plane', 'ghpythonlib.System', 'ghpythonlib.scriptcontext', '_collections', 'encodings.__builtin__', 'json.json', 'rhinoscript.material', 'rhinoscriptsyntax', 'rhinoscript.toolbar', 'Python_546334e2e29d4fb69d7fc343c3ce2e3e', 'encodings.aliases', 'WriteFile', 'ghpythonlib.collections', '_warnings', '__future__', 'gettext', 'Python_fcbe003643c54e48b6532318a6384c9c', 'abc', 'heapq', 'rhinoscript.Eto', 'json.struct', '_shared', '_heapq', 'errno', 'GetWKT', 'copy', 'json', 'Python_8d6d906d66b3478399f7489f711edff4', 'Eto', 'collections', '_codecs', '_functools', 'ghpythonlib.treehelpers', 'itertools', 'Rhino', 'rhinoscript.object', 'Python_d396a1fb0e6441508fa6555b4d306ff5', 'sys', 'rhinoscript.line', 'time', 're', 'rhinoscript.mesh', 'Python_d8fa512bcb7f4b78bfd0c3f8ae701b7d', 'json.scanner', '_struct', 'Python_1d8fc2b582c24e53b6db41be383163c2', 'keyword', '_abcoll', 'Python_7c8886c170a14ade94089eebda53a6a5', 'argparse', 'Dicky_9bcc01f19c04453ba3b721263c7ba159', 'SourceOffset', 'json.re', 'rhinoscript.datetime', 'Python_32bc0598b3e3475e8dd544d0531af2fc', '__main__', 'rhinoscript.geometry', 'EPSG4326', 'Python_6d36570de4c14c389ea9c6562695730e', 'encodings.codecs', 'encodings.encodings', 'rhinoscript.document', 'rhinoscript.selection', 'Python_718596572bdc4849ac6763793ca03bf4', 'genericpath', '_info', 'rhinoscript.application', 'Points2Feature', 'rhinoscript.math', 'Python_aeaa2d088f134ca3ad64878eb641ae29', 'weakref', 'ghpythonlib.componentbase', 'os.path', 'json.decoder', '__builtin__', 'rhinoscript.RhinoPython', 'rhinoscript.System', 'ghpythonlib.sys', 'Lines2Feature', 'ghpythonlib.re', 'Python_6f32e703a8264534a6f8f7b5f10ebfd7', 'ghpythonlib.types', 'rhinoscript.light', 'ghpythonlib.components', 'ghpythonlib.parallel', 'rhinoscript.string', 'rhinoscript.transformation', 'ghpythonlib.Rhino', 'JoinGeoJSON', 'Polygons2Feature', 'Python_31b372a60e1546ffbc2031b54a9c4e16', 'encodings', 'textwrap', 'ghpythonlib.os', 'Python_f665eada515e469f95e9321f1cf16d7d', 'cul_de_sac', 'types', 'rhinoscript.Rhino', 'datetime', 'Python_e8cc31045895470eb00d192086df1515', 'ghpythonlib.clr', '_weakrefset', 'Grasshopper', 'Python_55a3668065db4c1794fa1b31135958c3', 'rhinoscript.time', 'rhinoscript.layer', 'GetUTM', 'Python_2100e290400e4d5a9cac1edce5abe485', 'rhinoscript.numbers', 'string', 'rhinoscript.pointvector', 'rhinoscript.curve', 'rhinoscript.surface', 'rhinoscript.block', 'ghpythonlib.Grasshopper', 'stat', 'json.encoder', 'ReadGeoJSON', 'rhinoscript.userdata', 'copy_reg']


#print('\n'.join([x for x in sys.modules.keys() if not x in normal_sys_modules]))

#print(dir(sys.modules['GHsDNA.tools']))
if 'GHsDNA.tools' in sys.modules:
    class GHsDNA():
        pass
    GHsDNA.tools = sys.modules['GHsDNA.tools']
    reload(GHsDNA.tools)
try:
    pass
    #print(' GHsDNA.tools  == ' + str(sys.modules['GHsDNA'].tools)[:31])
    #print(dir(sys.modules['GHsDNA'].tools))
except:
    pass
#print(dir(importlib))
# ---------- end python_2 ----------
python_3 = GhPythonScript(x=Button())  # -> out, a
# ---------- python_3: Python ----------
#! /usr/bin/python2.7
# -*- coding: utf-8 -*-
__author__ = 'James Parrott'
__version__ = '0.00'
__copyright__ = 'Cardiff University'
__license__ = {  'Python standard library modules and ' : 'Python Software Foundation 2.7.18' # https://docs.python.org/2.7/license.html
                ,'wrapper_logging' : 'Python Software Foundation 2.7.18'
                ,'wrapper_pyshp' : 'MIT' # https://pypi.org/project/pyshp/ 
                ,'sDNAUISpec.py' : 'MIT' # https://github.com/fiftysevendegreesofrad/sdna_open/blob/master/LICENSE.md
                ,'everything else' : 'same as for sDNA ' # https://sdna.cardiff.ac.uk/sdna/legal-license/ 
               }

import sys
from os.path import join
from importlib import import_module
from time import asctime
print(asctime())
tmp_dir = r'C:\Users\James\Documents\Rhino\Grasshopper\sDNA\source\repos\GHsDNAv0.00'
sub_dir = 'GHsDNA'

#if not tmp_dir in sys.path:
#    sys.path.insert(0,join(tmp_dir, sub_dir))
class GHsDNA:
    pass
#GHsDNA.tools = import_module('GHsDNA.tools', '')

#reload(GHsDNA.tools)


def output(*args):
    message = ' '.join(args)
    #sys.stdout.write(message)
    print(message)

def strict_import(  module_name = None
                   ,folder = ''
                   ,sub_folder = ''
                   ,output = output
                  ):

    # type: (str,str,str,str,function) -> type[any]

    #
    if module_name == None:
        output('No module to import','INFO')
        return None
    else:
        output(module_name,'DEBUG')
        if False: #module_name in sys.modules:   # sys.modules is also shared between GHPython components 
                                        # and is even saved until Rhino is closed.
            output('Module ' + module_name + ' already in sys.modules.  ','INFO')
            #if metas.reload_config_and_other_modules_if_already_loaded:
            #            output('Reloading ' +  module_name  + '.... ','INFO')
            #try:
            #    reload(sys.modules[module_name])
            #    output('Module ' + module_name + ' reloaded. ','INFO')
            #except:
            #    output('Could not reload module but returning found module' + absolute_name,'WARNING')
            #finally:    
            return sys.modules[module_name]
        #
        #
        # Load module_name for first time:
        #
        #
        tmp = sys.path
        sys.path = [join(folder,sub_folder)]
        #try:
        if True:    
            output('sys.path[0] == ' + sys.path[0],'DEBUG')
            output('module_name == ' + module_name,'DEBUG')
            m = import_module('GHsDNA.tools', '')
        #except:
        elif 0:
            output('Import of module ' + module_name + ' failed from sys.path == ' + sys.path[0], 'CRITICAL') #
            m = "The world's best sentinel value" # and not a module.
        #finally:
        sys.path = tmp
        return m       
            
            

#GHsDNA.tools = strict_import('GHsDNA.tools', tmp_dir, sub_dir, output)


#GHsDNA = strict_import('GHsDNA',tmp_dir,'GHsDNA','')
#GHsDNA = strict_import('GHsDNA.tools',tmp_dir,'GHsDNA','')
#GHsDNA = strict_import('GHsDNA.tools',tmp_dir,'GHsDNA','GHsDNA')
#tools = strict_import('GHsDNA.tools',tmp_dir,'GHsDNA','GHsDNA')
#tools = strict_import('.tools',tmp_dir,'GHsDNA',GHsDNA)
#tools = strict_import('tools',tmp_dir,'GHsDNA','')
#tools = strict_import('GHsDNA.tools',tmp_dir,'GHsDNA','')
#import GHsDNA.tools
try:
    print('\n'*2 + str(tools)[:31]+'\n')
except:
    pass
normal_sys_modules =  ['ComplexPolygon2Feature', 'rhinoscript.view', 'ghpythonlib.GhPython', 'json._json', 'locale', 'clr', 'scriptcontext', 'rhinoscript.hatch', 'rhinoscript.dimension', 'Python_de0d0a8704264cfa97adcb043b73a985', 'GhPython', 'functools', 'DecomposeExtrusion', 'ghpythonlib.component', 'System', 'rhinoscript.utility', 'math', '_weakref', 'numbers', 'exceptions', 'rhinoscript.group', 'rhinoscript.scriptcontext', 'sDNAIntegral_3be8569489db45cb8325a8e96965c043', 'rhinoscript.userinterface', 'Python_e37b1cb4e20443cf9a14d7d587cc6630', 'rhinoscript.linetype', 'Python_9dbf0e91cbe44741a6564bc12448408e', 'json.sys', 'Tommy_ac31c614ebe34d32a8deab56b4fc0c56', 'rhinoscript.grips', 'linecache', 'os', 'codecs', 'Python_c909faf616bc45bdad62d90972a604de', '_locale', 'Transformation', 'ghpythonlib', 'Python_8bb484ac02e249a2b63bddf738b65517', 'nt', 'RhinoPython', 'Python_c0f4da5742fd4875bfe7f3911c9c59af', 'Reprojection', 'UserDict', 'struct', 'warnings', 'zipimport', 'thread', 'ntpath', 'operator', 'rhinoscript', 'rhinoscript.plane', 'ghpythonlib.System', 'ghpythonlib.scriptcontext', '_collections', 'encodings.__builtin__', 'json.json', 'rhinoscript.material', 'rhinoscriptsyntax', 'rhinoscript.toolbar', 'Python_546334e2e29d4fb69d7fc343c3ce2e3e', 'encodings.aliases', 'WriteFile', 'ghpythonlib.collections', '_warnings', '__future__', 'gettext', 'Python_fcbe003643c54e48b6532318a6384c9c', 'abc', 'heapq', 'rhinoscript.Eto', 'json.struct', '_shared', '_heapq', 'errno', 'GetWKT', 'copy', 'json', 'Python_8d6d906d66b3478399f7489f711edff4', 'Eto', 'collections', '_codecs', '_functools', 'ghpythonlib.treehelpers', 'itertools', 'Rhino', 'rhinoscript.object', 'Python_d396a1fb0e6441508fa6555b4d306ff5', 'sys', 'rhinoscript.line', 'time', 're', 'rhinoscript.mesh', 'Python_d8fa512bcb7f4b78bfd0c3f8ae701b7d', 'json.scanner', '_struct', 'Python_1d8fc2b582c24e53b6db41be383163c2', 'keyword', '_abcoll', 'Python_7c8886c170a14ade94089eebda53a6a5', 'argparse', 'Dicky_9bcc01f19c04453ba3b721263c7ba159', 'SourceOffset', 'json.re', 'rhinoscript.datetime', 'Python_32bc0598b3e3475e8dd544d0531af2fc', '__main__', 'rhinoscript.geometry', 'EPSG4326', 'Python_6d36570de4c14c389ea9c6562695730e', 'encodings.codecs', 'encodings.encodings', 'rhinoscript.document', 'rhinoscript.selection', 'Python_718596572bdc4849ac6763793ca03bf4', 'genericpath', '_info', 'rhinoscript.application', 'Points2Feature', 'rhinoscript.math', 'Python_aeaa2d088f134ca3ad64878eb641ae29', 'weakref', 'ghpythonlib.componentbase', 'os.path', 'json.decoder', '__builtin__', 'rhinoscript.RhinoPython', 'rhinoscript.System', 'ghpythonlib.sys', 'Lines2Feature', 'ghpythonlib.re', 'Python_6f32e703a8264534a6f8f7b5f10ebfd7', 'ghpythonlib.types', 'rhinoscript.light', 'ghpythonlib.components', 'ghpythonlib.parallel', 'rhinoscript.string', 'rhinoscript.transformation', 'ghpythonlib.Rhino', 'JoinGeoJSON', 'Polygons2Feature', 'Python_31b372a60e1546ffbc2031b54a9c4e16', 'encodings', 'textwrap', 'ghpythonlib.os', 'Python_f665eada515e469f95e9321f1cf16d7d', 'cul_de_sac', 'types', 'rhinoscript.Rhino', 'datetime', 'Python_e8cc31045895470eb00d192086df1515', 'ghpythonlib.clr', '_weakrefset', 'Grasshopper', 'Python_55a3668065db4c1794fa1b31135958c3', 'rhinoscript.time', 'rhinoscript.layer', 'GetUTM', 'Python_2100e290400e4d5a9cac1edce5abe485', 'rhinoscript.numbers', 'string', 'rhinoscript.pointvector', 'rhinoscript.curve', 'rhinoscript.surface', 'rhinoscript.block', 'ghpythonlib.Grasshopper', 'stat', 'json.encoder', 'ReadGeoJSON', 'rhinoscript.userdata', 'copy_reg']


print('\n'.join([x for x in sys.modules.keys() if not x in normal_sys_modules]))
# ---------- end python_3 ----------
panel = Panel(python_3.out)
panel_2 = Panel(python_2.out)
panel_3 = Panel(python.out)
