# Grasshopper definition sDNA_build_components.gh (Grasshopper 1.0.7)

path = FilePath("C:\Users\James\Documents\Rhino\Grasshopper\sDNA\source\repos\GHsDNAv0.01\sDNA_GH\sDNA_GH\launcher.py")
sdna_general = SDNA_General()  # disabled
# ---------- sdna_general: Python ----------
#! /usr/bin/python as module, Grasshopper Python as script / main
# -*- coding: utf-8 -*-
__author__ = 'James Parrott'
__version__ = '0.02'


import os, sys
from importlib import import_module
if (not hasattr(__builtins__, 'reload') 
    and (isinstance(__builtins__, dict) 
         and 'reload' not in __builtins__ )):  
    from importlib import reload 
    # reload was builtin until Python 3.4
    # __builtins__ is a dict in GhPython not a module as elsewhere


sDNA_GH_subfolder = 'sDNA_GH' 
sDNA_GH_package = 'sDNA_GH'               
reload_config_and_other_modules_if_already_loaded = False


# There may be multiple components, all running this same launcher code.
# Therefore we want the root logger to live in the sDNA_GH.setup module
# that they each import.  Te logging system is configurable by the user,
# but only through the options that are read in during the main package
# import, and we want to create logs before this too.  So before a 
# component has imported sDNA_GH.setup, logging is routed through output, 
# a callable instance of Output, with a cache, defined below.  output's cache 
# is flushed through the normal logging system, after a logger has been set up 
# according to the user's configuration, after the main package import.
#
# This Output class is used to define two Classes from this single 
# code definition.  Python scripts can happily import themselves, but here
# this is because all the code in this file 
# must be read into a GhPython component via its the code input (which 
# essentially copy and pastes it to there).
# The first function definition is when the code in this file runs 
# in a GH component.  
# The second function definition is during import of sDNA_GH below, 
# as it itself imports this function from .launcher
# Therefore there really are two functions in Python, with two separate caches.
#
# The behaviours can be different of course if changes are made to one and not
# the other, e.g. if the code is forgotten to be copied into the component.

class Output(object): 

    def set_logger(self, logger, flush = True):
        self.logger = logger
        if flush and self.tmp_logs:
            self.flush()

    def __init__(self
                ,tmp_logs = None
                ,logger = None
                ):
        if not isinstance(tmp_logs, list): #assert not isinstance(None, list)
            tmp_logs = []
        self.tmp_logs = tmp_logs
        if logger is not None:
            self.set_logger(logger, flush = False)



    def store(self, message, logging_level):
        self.tmp_logs.append( (message, logging_level) )

    def __call__(self, message, logging_level = "INFO", logging_dict = {}):
        #type: (str, str, dict, list) -> str
        
        #print(s)

        if logging_dict == {} and hasattr(self, 'logger'): 
            logging_dict = dict( DEBUG = self.logger.debug
                                ,INFO = self.logger.info
                                ,WARNING = self.logger.warning
                                ,ERROR = self.logger.error
                                ,CRITICAL = self.logger.critical
                                )

        logging_level = logging_level.upper()
        if logging_level in logging_dict:
            logging_dict[logging_level](message)
        else:
            self.store(message, logging_level)

        return logging_level + ' : ' + message + ' '

    def flush(self):
        tmp_logs = self.tmp_logs[:] # __call__ might cache back to tmp_logs
        self.tmp_logs[:] = [] # Mutate list initialised with
        for tmp_log_message, tmp_log_level in tmp_logs:
            self.__call__(tmp_log_message, tmp_log_level)

output = Output()





# We only know the sDNA version to import as a string.  This is more secure too.
def strict_import(  module_name = ''
                   ,folder = ''
                   ,sub_folder = ''
                   ,output = output
                   ,search_folder_only = False
                   ):

    # type: (str, str, str, function, bool) -> type[any]
    #
    if module_name == '':
        output('No module to import','INFO')
        return None
    output(module_name,'DEBUG')
    if module_name in sys.modules:   # sys.modules is also shared between GHPython components 
                                     # (and is even saved until Rhino is closed).
        output('Module ' + module_name + ' already in sys.modules.  ','DEBUG')
        if reload_config_and_other_modules_if_already_loaded:
            output('Reloading ' +  module_name  + '.... ','DEBUG')
            reload(sys.modules[module_name]) # type: ignore
        return sys.modules[module_name]
    #
    #
    # Load module_name for first time:
    #
    #
    search_path = os.path.join(folder, sub_folder)

    tmp = sys.path
    if search_path and isinstance(search_path, str) and os.path.isdir(search_path):
        output('Search path == ' + search_path, 'DEBUG')
        if search_folder_only:
            sys.path = [search_path]
        else:
            sys.path.insert(0, search_path)
    else:
        output('Invalid search path : ' + search_path, 'DEBUG')
        if search_folder_only:
            return None

    output('Trying import... ','DEBUG')
    module = import_module(module_name, '')           
    sys.path = tmp
    return module       



def load_modules(m_names, path_lists):
    m_names = m_names if isinstance(m_names, tuple) else [m_names] 
    output('m_names == ' + str(m_names) + ' of type : ' + type(m_names).__name__,'DEBUG')
    if any((name.startswith('.') or name.startswith('..')) in name for name in m_names):
        output(m_names,'DEBUG')
        raise ImportError( output('Relative import attempted, but not supported','CRITICAL') )

    output('Testing paths : ' + '\n'.join(map(str,path_lists)),'DEBUG')
    output('Type(path_lists) : ' + type(path_lists).__name__,'DEBUG')


    for path_list in path_lists:
        test_paths = path_list if isinstance(path_list, list) else [path_list]
        test_paths = test_paths[:]
        output('Type(path_list) : ' + type(path_list).__name__,'DEBUG')
        output('Type(test_paths) : ' + type(test_paths).__name__,'DEBUG')

        for path in test_paths:
            output('Type(path) : ' + type(path).__name__ + ' path == ' + path,'DEBUG')
            if os.path.isfile(path):
                path = os.path.dirname(path)
            if all( any(os.path.isfile(os.path.join(path, name.replace('.', os.sep) + ending)) 
                        for ending in ['.py','.pyc'] 
                        )
                    for name in m_names
                ):
                output('Importing ' + str(m_names) +' ','DEBUG')
                return tuple(strict_import(name, path, '') for name in m_names) + (path,)
                # tuple of modules, followed by the path to them
    return None


if __name__ == '__main__': # False in a compiled component.  But then the user
                           # can't add or remove Params to the component.  
    
    # Grasshopper will look for class MyComponent(component) in global scope
    # so a main function is a little tricky to define.

    from ghpythonlib.componentbase import executingcomponent as component
    import Grasshopper
    import scriptcontext as sc
    # Do Grasshopper API imports here separately to
    # Let the above functions be accessed outside the GhPython


    sDNA_GH_search_paths = [ os.path.join(Grasshopper.Folders.DefaultUserObjectFolder
                                         , sDNA_GH_subfolder
                                         ) 
                           ]
                                            #join(Grasshopper.Folders.DefaultAssemblyFolder, sDNA_GH_subfolder) ]  
                                            # Grasshopper.Folders.AppDataFolder + r'\Libraries'
                                            # %appdata%  + r'\Grasshopper\Libraries'
                                            # os.getenv('APPDATA') + r'\Grasshopper\Libraries'
                                            # Grasshopper.Folders.AppDataFolder + r'\UserObjects'
                                            # %appdata%  + r'\Grasshopper\UserObjects'
                                            # os.getenv('APPDATA') + r'\Grasshopper\UserObjects'

    sDNA_GH_search_paths += [os.path.join(Grasshopper.Folders.DefaultAssemblyFolder
                                         ,sDNA_GH_subfolder
                                         ) 
                            ]  # Might need to install sDNA_GH 
                               # in \Grasshopper\Libraries in Rhino 6?

    nick_name = ghenv.Component.NickName #type: ignore


    sc.doc = ghdoc #type: ignore

    print(sDNA_GH_search_paths)

    class sDNA_GH(object):
        pass
    sDNA_GH.setup, _ = load_modules(sDNA_GH_package + '.setup'
                             ,sDNA_GH_search_paths
                             )         


    logger = sDNA_GH.setup.logger.getChild('launcher')
    output.set_logger(logger, flush = True)


    class MyComponent(component):
        pass  # Required.  Idiomatic to Grasshopper.  Must be called "MyComponent"  
            # too, otherwise Grasshopper may not find the class building on 
            # component.  Despite component being passed to the class decorator
            # and overwriting this very class immediately below.  
            # Initial parser step / scope check trips this?

    MyComponent = sDNA_GH.setup.sDNA_GH_Component


    if nick_name.replace(' ','').replace('_','').lower() == 'selftest':  

        if sys.argv[0].endswith(os.path.join(sDNA_GH_package,'__main__.py')):   
            from .tests.unit_tests import unit_tests_sDNA_GH
        else:
            unit_tests_sDNA_GH, _ = load_modules('sDNA_GH.tests.unit_tests.unit_tests_sDNA_GH'
                                                ,sDNA_GH_search_paths
                                                )

        MyComponent._RunScript = MyComponent.RunScript
        MyComponent.RunScript = unit_tests_sDNA_GH.run_launcher_tests
# ---------- end sdna_general ----------
sdna_predict = SDNA_Predict()  # disabled; same code as sdna_general
sdna_geodesics = SDNA_Geodesics()  # disabled; same code as sdna_general
sdna_access_map = SDNA_Access_Map()  # disabled; same code as sdna_general
load_config = Load_Config()  # disabled; same code as sdna_general
parse_data = Parse_Data()  # disabled; same code as sdna_general
read_shp = Read_Shp()  # disabled; same code as sdna_general
panel = Panel("""#! /usr/bin/python as module, Grasshopper Python as script / main
# -*- coding: utf-8 -*-
__author__ = 'James Parrott'
__version__ = '0.02'


import os, sys
from importlib import import_module
if (not hasattr(__builtins__, 'reload') 
    and (isinstance(__builtins__, dict) 
         and 'reload' not in __builtins__ )):  
    from importlib import reload 
    # reload was builtin until Python 3.4
    # __builtins__ is a dict in GhPython not a module as elsewhere


sDNA_GH_subfolder = 'sDNA_GH' 
sDNA_GH_package = 'sDNA_GH'               
reload_config_and_other_modules_if_already_loaded = False


# There may be multiple components, all running this same launcher code.
# Therefore we want the root logger to live in the sDNA_GH.setup module
# that they each import.  Te logging system is configurable by the user,
# but only through the options that are read in during the main package
# import, and we want to create logs before this too.  So before a 
# component has imported sDNA_GH.setup, logging is routed through output, 
# a callable instance of Output, with a cache, defined below.  output's cache 
# is flushed through the normal logging system, after a logger has been set up 
# according to the user's configuration, after the main package import.
#
# This Output class is used to define two Classes from this single 
# code definition.  Python scripts can happily import themselves, but here
# this is because all the code in this file 
# must be read into a GhPython component via its the code input (which 
# essentially copy and pastes it to there).
# The first function definition is when the code in this file runs 
# in a GH component.  
# The second function definition is during import of sDNA_GH below, 
# as it itself imports this function from .launcher
# Therefore there really are two functions in Python, with two separate caches.
#
# The behaviours can be different of course if changes are made to one and not
# the other, e.g. if the code is forgotten to be copied into the component.

class Output(object): 

    def set_logger(self, logger, flush = True):
        self.logger = logger
        if flush and self.tmp_logs:
            self.flush()

    def __init__(self
                ,tmp_logs = None
                ,logger = None
                ):
        if not isinstance(tmp_logs, list): #assert not isinstance(None, list)
            tmp_logs = []
        self.tmp_logs = tmp_logs
        if logger is not None:
            self.set_logger(logger, flush = False)



    def store(self, message, logging_level):
        self.tmp_logs.append( (message, logging_level) )

    def __call__(self, message, logging_level = "INFO", logging_dict = {}):
        #type: (str, str, dict, list) -> str
        
        #print(s)

        if logging_dict == {} and hasattr(self, 'logger'): 
            logging_dict = dict( DEBUG = self.logger.debug
                                ,INFO = self.logger.info
                                ,WARNING = self.logger.warning
                                ,ERROR = self.logger.error
                                ,CRITICAL = self.logger.critical
                                )

        logging_level = logging_level.upper()
        if logging_level in logging_dict:
            logging_dict[logging_level](message)
        else:
            self.store(message, logging_level)

        return logging_level + ' : ' + message + ' '

    def flush(self):
        tmp_logs = self.tmp_logs[:] # __call__ might cache back to tmp_logs
        self.tmp_logs[:] = [] # Mutate list initialised with
        for tmp_log_message, tmp_log_level in tmp_logs:
            self.__call__(tmp_log_message, tmp_log_level)

output = Output()





# We only know the sDNA version to import as a string.  This is more secure too.
def strict_import(  module_name = ''
                   ,folder = ''
                   ,sub_folder = ''
                   ,output = output
                   ,search_folder_only = False
                   ):

    # type: (str, str, str, function, bool) -> type[any]
    #
    if module_name == '':
        output('No module to import','INFO')
        return None
    output(module_name,'DEBUG')
    if module_name in sys.modules:   # sys.modules is also shared between GHPython components 
                                     # (and is even saved until Rhino is closed).
        output('Module ' + module_name + ' already in sys.modules.  ','DEBUG')
        if reload_config_and_other_modules_if_already_loaded:
            output('Reloading ' +  module_name  + '.... ','DEBUG')
            reload(sys.modules[module_name]) # type: ignore
        return sys.modules[module_name]
    #
    #
    # Load module_name for first time:
    #
    #
    search_path = os.path.join(folder, sub_folder)

    tmp = sys.path
    if search_path and isinstance(search_path, str) and os.path.isdir(search_path):
        output('Search path == ' + search_path, 'DEBUG')
        if search_folder_only:
            sys.path = [search_path]
        else:
            sys.path.insert(0, search_path)
    else:
        output('Invalid search path : ' + search_path, 'DEBUG')
        if search_folder_only:
            return None

    output('Trying import... ','DEBUG')
    module = import_module(module_name, '')           
    sys.path = tmp
    return module       



def load_modules(m_names, path_lists):
    m_names = m_names if isinstance(m_names, tuple) else [m_names] 
    output('m_names == ' + str(m_names) + ' of type : ' + type(m_names).__name__,'DEBUG')
    if any((name.startswith('.') or name.startswith('..')) in name for name in m_names):
        output(m_names,'DEBUG')
        raise ImportError( output('Relative import attempted, but not supported','CRITICAL') )

    output('Testing paths : ' + '\n'.join(map(str,path_lists)),'DEBUG')
    output('Type(path_lists) : ' + type(path_lists).__name__,'DEBUG')


    for path_list in path_lists:
        test_paths = path_list if isinstance(path_list, list) else [path_list]
        test_paths = test_paths[:]
        output('Type(path_list) : ' + type(path_list).__name__,'DEBUG')
        output('Type(test_paths) : ' + type(test_paths).__name__,'DEBUG')

        for path in test_paths:
            output('Type(path) : ' + type(path).__name__ + ' path == ' + path,'DEBUG')
            if os.path.isfile(path):
                path = os.path.dirname(path)
            if all( any(os.path.isfile(os.path.join(path, name.replace('.', os.sep) + ending)) 
                        for ending in ['.py','.pyc'] 
                        )
                    for name in m_names
                ):
                output('Importing ' + str(m_names) +' ','DEBUG')
                return tuple(strict_import(name, path, '') for name in m_names) + (path,)
                # tuple of modules, followed by the path to them
    return None


if __name__ == '__main__': # False in a compiled component.  But then the user
                           # can't add or remove Params to the component.  
    
    # Grasshopper will look for class MyComponent(component) in global scope
    # so a main function is a little tricky to define.

    from ghpythonlib.componentbase import executingcomponent as component
    import Grasshopper
    import scriptcontext as sc
    # Do Grasshopper API imports here separately to
    # Let the above functions be accessed outside the GhPython


    sDNA_GH_search_paths = [ os.path.join(Grasshopper.Folders.DefaultUserObjectFolder
                                         , sDNA_GH_subfolder
                                         ) 
                           ]
                                            #join(Grasshopper.Folders.DefaultAssemblyFolder, sDNA_GH_subfolder) ]  
                                            # Grasshopper.Folders.AppDataFolder + r'\Libraries'
                                            # %appdata%  + r'\Grasshopper\Libraries'
                                            # os.getenv('APPDATA') + r'\Grasshopper\Libraries'
                                            # Grasshopper.Folders.AppDataFolder + r'\UserObjects'
                                            # %appdata%  + r'\Grasshopper\UserObjects'
                                            # os.getenv('APPDATA') + r'\Grasshopper\UserObjects'

    sDNA_GH_search_paths += [os.path.join(Grasshopper.Folders.DefaultAssemblyFolder
                                         ,sDNA_GH_subfolder
                                         ) 
                            ]  # Might need to install sDNA_GH 
                               # in \Grasshopper\Libraries in Rhino 6?

    nick_name = ghenv.Component.NickName #type: ignore


    sc.doc = ghdoc #type: ignore

    print(sDNA_GH_search_paths)

    class sDNA_GH(object):
        pass
    sDNA_GH.setup, _ = load_modules(sDNA_GH_package + '.setup'
                             ,sDNA_GH_search_paths
                             )         


    logger = sDNA_GH.setup.logger.getChild('launcher')
    output.set_logger(logger, flush = True)


    class MyComponent(component):
        pass  # Required.  Idiomatic to Grasshopper.  Must be called "MyComponent"  
            # too, otherwise Grasshopper may not find the class building on 
            # component.  Despite component being passed to the class decorator
            # and overwriting this very class immediately below.  
            # Initial parser step / scope check trips this?

    MyComponent = sDNA_GH.setup.sDNA_GH_Component


    if nick_name.replace(' ','').replace('_','').lower() == 'selftest':  

        if sys.argv[0].endswith(os.path.join(sDNA_GH_package,'__main__.py')):   
            from .tests.unit_tests import unit_tests_sDNA_GH
        else:
            unit_tests_sDNA_GH, _ = load_modules('sDNA_GH.tests.unit_tests.unit_tests_sDNA_GH'
                                                ,sDNA_GH_search_paths
                                                )

        MyComponent._RunScript = MyComponent.RunScript
        MyComponent.RunScript = unit_tests_sDNA_GH.run_launcher_tests  """)
bake_usertext = Bake_UserText()  # disabled; same code as sdna_general
sdna_prepare = SDNA_Prepare()  # disabled; same code as sdna_general
sdna_learn = SDNA_Learn()  # disabled; same code as sdna_general
build_components = Build_components()  # disabled; same code as sdna_general
sdna_hulls = SDNA_Hulls()  # disabled; same code as sdna_general
sdna_int_from_od = SDNA_Int_From_OD()  # disabled; same code as sdna_general
read_geom = Read_Geom()  # disabled; same code as sdna_general
write_shp = Write_Shp()  # disabled; same code as sdna_general
recolour_objects = Recolour_Objects()  # disabled; same code as sdna_general
read_usertext = Read_Usertext()  # disabled; same code as sdna_general
sdna_line_measures = SDNA_Line_Measures()  # disabled; same code as sdna_general
sdna_gh = Text("sDNA_GH")
sdna_integral = SDNA_Integral()  # disabled; same code as sdna_general
sdna_net_radii = SDNA_Net_Radii()  # disabled; same code as sdna_general
python = Python()  # disabled; same code as sdna_general
write_usertext = Write_Usertext()  # disabled; same code as sdna_general
toggle = BooleanToggle(True)
file = ReadFile(File=path, PerLineParse=False)
sdna_skim = SDNA_Skim()  # disabled; same code as sdna_general
unload_sdna = GhPythonScript()  # -> out; disabled
# ---------- unload_sdna: Python ----------
#! Grasshopper Python
# -*- coding: utf-8 -*-
__author__ = 'James Parrott'
__version__ = '0.00'

import sys

from ghpythonlib.componentbase import executingcomponent as component
import rhinoscriptsyntax as rs

class MyComponent(component):
    
    def RunScript(self, unload, update):

        #print('\n'.join([key for key in sys.modules if 'sDNA' in key]))
        #print('functools' in sys.modules)
        print('sDNA_GH packages and modules in sys.modules:')
        print('\n'.join([key for key in sys.modules if 'sdna' in key.lower()]))# and not '.' in key]))
        #print os.getenv('APPDATA')
        #print ghdoc.Path
        #print Grasshopper.Folders.DefaultAssemblyFolder
        #print Grasshopper.Folders.AppDataFolder
        #print sys.argv[0]
        #print("Classmethod found == " + str('classmethod' in __builtins__))
        def is_imported(s):
            return s in sys.modules
        if unload == True:
            if 'logging' in sys.modules:
                sys.modules['logging'].shutdown()
            shared_cached_modules_etc = sys.modules.copy().keys()
            for y in shared_cached_modules_etc:
                if 'sDNA' in y or y == 'runsdnacommand':
                    del sys.modules[y]
        
        
                
        print('sDNA_GH imported == ' + str(is_imported('sDNA_GH')))
        print('sDNA_GH.tools imported == ' + str(is_imported('sDNA_GH.tools')))
        print('sDNAUISpec imported == ' + str(is_imported('sDNAUISpec')))
        print('runsdnacommand == ' + str(is_imported('runsdnacommand')))
        if False: #is_imported('sDNA_GH'):
            print(sys.modules['sDNA_GH'].__all__)
            print(dir(sys.modules['sDNA_GH']))
            if is_imported('sDNA_GH.tools'):
                print( dir(sys.modules['sDNA_GH.tools']))
            if hasattr(sys.modules['sDNA_GH'],'third_party_python_modules'):
                print(dir(sys.modules['sDNA_GH'].third_party_python_modules))
        

        #print('\n'.join(dir(sys.modules['sDNA_GH'].third_party_python_modules)))
        
        return
# ---------- end unload_sdna ----------
build_components_2 = GhPythonScript(launcher_code=file, plug_in_name=sdna_gh)  # -> out, OK, opts; inputs go: list, opts: list, launcher_code: list, plug_in_name: list; same code as sdna_general
panel_2 = Panel(build_components_2.out)
delete_sdna_gh = Button()
update = Button()
unload_sdna_2 = GhPythonScript(unload=delete_sdna_gh, update=update)  # -> out, a
# ---------- unload_sdna_2: Python ----------
#! Grasshopper Python
# -*- coding: utf-8 -*-
__author__ = 'James Parrott'
__version__ = '0.00'


import sys, os, Grasshopper, logging
#print('\n'.join([key for key in sys.modules if 'sDNA' in key]))
#print('functools' in sys.modules)
print('sDNA_GH packages and modules in sys.modules:')
print('\n'.join([key for key in sys.modules if 'sdna' in key.lower()]))# and not '.' in key]))
#print os.getenv('APPDATA')
#print ghdoc.Path
#print Grasshopper.Folders.DefaultAssemblyFolder
#print Grasshopper.Folders.AppDataFolder
#print sys.argv[0]
#print("Classmethod found == " + str('classmethod' in __builtins__))
def is_imported(s):
    return s in sys.modules
if unload == True:
    if 'logging' in sys.modules:
        sys.modules['logging'].shutdown()
    shared_cached_modules_etc = sys.modules.copy().keys()
    for y in shared_cached_modules_etc:
        if 'sDNA' in y or y == 'runsdnacommand':
            del sys.modules[y]


        
print('sDNA_GH imported == ' + str(is_imported('sDNA_GH')))
print('sDNA_GH.tools imported == ' + str(is_imported('sDNA_GH.tools')))
print('sDNAUISpec imported == ' + str(is_imported('sDNAUISpec')))
print('runsdnacommand == ' + str(is_imported('runsdnacommand')))
if False: #is_imported('sDNA_GH'):
    print sys.modules['sDNA_GH'].__all__
    print dir(sys.modules['sDNA_GH'])
    if is_imported('sDNA_GH.tools'):
        print dir(sys.modules['sDNA_GH.tools'])
    if hasattr(sys.modules['sDNA_GH'],'third_party_python_modules'):
        print dir(sys.modules['sDNA_GH'].third_party_python_modules)

#print sys.modules.keys()
#print os.getcwd()
#print sys.path[0]
#print 'a' in globals()
#a = "This is a!"
#print('\n'.join(dir(sys.modules['sDNA_GH'].third_party_python_modules)))
# ---------- end unload_sdna_2 ----------
panel_3 = Panel(unload_sdna_2.out)
unload_sdna_3 = GhPythonScript()  # -> out; same code as unload_sdna
