# Grasshopper definition 10_circles_test_multiple_comps.gh (Grasshopper 1.0.7)

geo = Geometry([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])  # disabled
mcx = MultipleCurves(Curves=geo)  # -> Points, IndexA, IndexB, ParamA, ParamB; disabled
shatter = Shatter(Curve=geo, Parameters=mcx.ParamA)  # disabled
topoly = CurveToPolyline(Curve=shatter, ToleranceDistance=0, ToleranceAngle=0.07, MinEdge=6)  # -> Polyline, Segments; disabled
path = FilePath("C:\Users\James\Documents\Rhino\Grasshopper\sDNA\source\repos\GHsDNAv0.01\sDNA_GH\sDNA_GH\sDNA_GH_launcher.py")
arc = CircularArc(Tree({0;0}: [{Angle=0, Angle=0.02223072957, Plane=Plane(origin=(9.971194654, 9.650991224, 0), x=(0.9975937224, -0.06933083785, 0), y=(0.06933083785, 0.9975937224, 0)), Radius=18.00675927}, {Angle=0.02223072957, Angle=0.06800803726, Plane=Plane(origin=(9.971194654, 9.650991224, 0), x=(0.9975937224, -0.06933083785, 0), y=(0.06933083785, 0.9975937224, 0)), Radius=18.00675927}, {Angle=0.06800803726, Angle=0.08318976433, Plane=Plane(origin=(9.971194654, 9.650991224, 0), x=(0.9975937224, -0.06933083785, 0), y=(0.06933083785, 0.9975937224, 0)), Radius=18.00675927}, {Angle=0.08318976433, Angle=0.1441911, Plane=Plane(origin=(9.971194654, 9.650991224, 0), x=(0.9975937224, -0.06933083785, 0), y=(0.06933083785, 0.9975937224, 0)), Radius=18.00675927}, {Angle=0.1441911, Angle=0.2729151055, Plane=Plane(origin=(9.971194654, 9.650991224, 0), x=(0.9975937224, -0.06933083785, 0), y=(0.06933083785, 0.9975937224, 0)), Radius=18.00675927}, {Angle=0.2729151055, Angle=0.3004151632, Plane=Plane(origin=(9.971194654, 9.650991224, 0), x=(0.9975937224, -0.06933083785, 0), y=(0.06933083785, 0.9975937224, 0)), Radius=18.00675927}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], {0;1}: [{Angle=0, Angle=0.02076078341, Plane=Plane(origin=(39.72529301, 9.720348097, 0), x=(-0.9999741224, 0.007194058435, 0), y=(-0.007194058435, -0.9999741224, 0)), Radius=19.28170956}, {Angle=0.02076078341, Angle=0.0635111919, Plane=Plane(origin=(39.72529301, 9.720348097, 0), x=(-0.9999741224, 0.007194058435, 0), y=(-0.007194058435, -0.9999741224, 0)), Radius=19.28170956}, {Angle=0.0635111919, Angle=0.0776890688, Plane=Plane(origin=(39.72529301, 9.720348097, 0), x=(-0.9999741224, 0.007194058435, 0), y=(-0.007194058435, -0.9999741224, 0)), Radius=19.28170956}, {Angle=0.0776890688, Angle=0.134656858, Plane=Plane(origin=(39.72529301, 9.720348097, 0), x=(-0.9999741224, 0.007194058435, 0), y=(-0.007194058435, -0.9999741224, 0)), Radius=19.28170956}, {Angle=0.134656858, Angle=0.254869341, Plane=Plane(origin=(39.72529301, 9.720348097, 0), x=(-0.9999741224, 0.007194058435, 0), y=(-0.007194058435, -0.9999741224, 0)), Radius=19.28170956}, {Angle=0.254869341, Angle=0.2805510325, Plane=Plane(origin=(39.72529301, 9.720348097, 0), x=(-0.9999741224, 0.007194058435, 0), y=(-0.007194058435, -0.9999741224, 0)), Radius=19.28170956}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], {0;2}: [{Angle=0, Angle=0.02223072957, Plane=Plane(origin=(9.371814273, 39.62001026, 0), x=(0.9975937224, -0.06933083785, 0), y=(0.06933083785, 0.9975937224, 0)), Radius=18.00675927}, {Angle=0.02223072957, Angle=0.06800803726, Plane=Plane(origin=(9.371814273, 39.62001026, 0), x=(0.9975937224, -0.06933083785, 0), y=(0.06933083785, 0.9975937224, 0)), Radius=18.00675927}, {Angle=0.06800803726, Angle=0.08318976433, Plane=Plane(origin=(9.371814273, 39.62001026, 0), x=(0.9975937224, -0.06933083785, 0), y=(0.06933083785, 0.9975937224, 0)), Radius=18.00675927}, {Angle=0.08318976433, Angle=0.1441911, Plane=Plane(origin=(9.371814273, 39.62001026, 0), x=(0.9975937224, -0.06933083785, 0), y=(0.06933083785, 0.9975937224, 0)), Radius=18.00675927}, {Angle=0.1441911, Angle=0.2729151055, Plane=Plane(origin=(9.371814273, 39.62001026, 0), x=(0.9975937224, -0.06933083785, 0), y=(0.06933083785, 0.9975937224, 0)), Radius=18.00675927}, {Angle=0.2729151055, Angle=0.3004151632, Plane=Plane(origin=(9.371814273, 39.62001026, 0), x=(0.9975937224, -0.06933083785, 0), y=(0.06933083785, 0.9975937224, 0)), Radius=18.00675927}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], {0;3}: [{Angle=0, Angle=0.02223072957, Plane=Plane(origin=(39.25520754, 40.81877103, 0), x=(0.9975937224, -0.06933083785, 0), y=(0.06933083785, 0.9975937224, 0)), Radius=18.00675927}, {Angle=0.02223072957, Angle=0.06800803726, Plane=Plane(origin=(39.25520754, 40.81877103, 0), x=(0.9975937224, -0.06933083785, 0), y=(0.06933083785, 0.9975937224, 0)), Radius=18.00675927}, {Angle=0.06800803726, Angle=0.08318976433, Plane=Plane(origin=(39.25520754, 40.81877103, 0), x=(0.9975937224, -0.06933083785, 0), y=(0.06933083785, 0.9975937224, 0)), Radius=18.00675927}, {Angle=0.08318976433, Angle=0.1441911, Plane=Plane(origin=(39.25520754, 40.81877103, 0), x=(0.9975937224, -0.06933083785, 0), y=(0.06933083785, 0.9975937224, 0)), Radius=18.00675927}, {Angle=0.1441911, Angle=0.2729151055, Plane=Plane(origin=(39.25520754, 40.81877103, 0), x=(0.9975937224, -0.06933083785, 0), y=(0.06933083785, 0.9975937224, 0)), Radius=18.00675927}, {Angle=0.2729151055, Angle=0.3004151632, Plane=Plane(origin=(39.25520754, 40.81877103, 0), x=(0.9975937224, -0.06933083785, 0), y=(0.06933083785, 0.9975937224, 0)), Radius=18.00675927}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], {0;4}: [{Angle=0, Angle=0.02223072957, Plane=Plane(origin=(9.371814273, 39.62001026, 0), x=(0.9975937224, -0.06933083785, 0), y=(0.06933083785, 0.9975937224, 0)), Radius=18.00675927}, {Angle=0.02223072957, Angle=0.06800803726, Plane=Plane(origin=(9.371814273, 39.62001026, 0), x=(0.9975937224, -0.06933083785, 0), y=(0.06933083785, 0.9975937224, 0)), Radius=18.00675927}, {Angle=0.06800803726, Angle=0.08318976433, Plane=Plane(origin=(9.371814273, 39.62001026, 0), x=(0.9975937224, -0.06933083785, 0), y=(0.06933083785, 0.9975937224, 0)), Radius=18.00675927}, {Angle=0.08318976433, Angle=0.1441911, Plane=Plane(origin=(9.371814273, 39.62001026, 0), x=(0.9975937224, -0.06933083785, 0), y=(0.06933083785, 0.9975937224, 0)), Radius=18.00675927}, {Angle=0.1441911, Angle=0.2729151055, Plane=Plane(origin=(9.371814273, 39.62001026, 0), x=(0.9975937224, -0.06933083785, 0), y=(0.06933083785, 0.9975937224, 0)), Radius=18.00675927}, {Angle=0.2729151055, Angle=0.3004151632, Plane=Plane(origin=(9.371814273, 39.62001026, 0), x=(0.9975937224, -0.06933083785, 0), y=(0.06933083785, 0.9975937224, 0)), Radius=18.00675927}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], {0;5}: [{Angle=0, Angle=0.05975979238, Plane=Plane(origin=(9.282763473, 38.81255927, 0), x=(-0.8436614877, 0.5368754922, 0), y=(-0.5368754922, -0.8436614877, 0)), Radius=6.698540606}, {Angle=0.05975979238, Angle=0.1828165906, Plane=Plane(origin=(9.282763473, 38.81255927, 0), x=(-0.8436614877, 0.5368754922, 0), y=(-0.5368754922, -0.8436614877, 0)), Radius=6.698540606}, {Angle=0.1828165906, Angle=0.2236275255, Plane=Plane(origin=(9.282763473, 38.81255927, 0), x=(-0.8436614877, 0.5368754922, 0), y=(-0.5368754922, -0.8436614877, 0)), Radius=6.698540606}, {Angle=0.2236275255, Angle=0.3876089702, Plane=Plane(origin=(9.282763473, 38.81255927, 0), x=(-0.8436614877, 0.5368754922, 0), y=(-0.5368754922, -0.8436614877, 0)), Radius=6.698540606}, {Angle=0.3876089702, Angle=0.7336398921, Plane=Plane(origin=(9.282763473, 38.81255927, 0), x=(-0.8436614877, 0.5368754922, 0), y=(-0.5368754922, -0.8436614877, 0)), Radius=6.698540606}, {Angle=0.7336398921, Angle=0.8075644896, Plane=Plane(origin=(9.282763473, 38.81255927, 0), x=(-0.8436614877, 0.5368754922, 0), y=(-0.5368754922, -0.8436614877, 0)), Radius=6.698540606}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], {0;6}: [{Angle=0, Angle=0.05100273345, Plane=Plane(origin=(39.93678866, 39.84006849, 0), x=(-0.9927732203, 0.1200055541, 0), y=(-0.1200055541, -0.9927732203, 0)), Radius=7.848665527}, {Angle=0.05100273345, Angle=0.1560270789, Plane=Plane(origin=(39.93678866, 39.84006849, 0), x=(-0.9927732203, 0.1200055541, 0), y=(-0.1200055541, -0.9927732203, 0)), Radius=7.848665527}, {Angle=0.1560270789, Angle=0.1908576758, Plane=Plane(origin=(39.93678866, 39.84006849, 0), x=(-0.9927732203, 0.1200055541, 0), y=(-0.1200055541, -0.9927732203, 0)), Radius=7.848665527}, {Angle=0.1908576758, Angle=0.3308096666, Plane=Plane(origin=(39.93678866, 39.84006849, 0), x=(-0.9927732203, 0.1200055541, 0), y=(-0.1200055541, -0.9927732203, 0)), Radius=7.848665527}, {Angle=0.3308096666, Angle=0.6261340339, Plane=Plane(origin=(39.93678866, 39.84006849, 0), x=(-0.9927732203, 0.1200055541, 0), y=(-0.1200055541, -0.9927732203, 0)), Radius=7.848665527}, {Angle=0.6261340339, Angle=0.6892258954, Plane=Plane(origin=(39.93678866, 39.84006849, 0), x=(-0.9927732203, 0.1200055541, 0), y=(-0.1200055541, -0.9927732203, 0)), Radius=7.848665527}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], {0;7}: [{Angle=0, Angle=0.05247550187, Plane=Plane(origin=(10.05339539, 10.21355252, 0), x=(-0.998991554, 0.04489849681, 0), y=(-0.04489849681, -0.998991554, 0)), Radius=7.628386229}, {Angle=0.05247550187, Angle=0.1605325581, Plane=Plane(origin=(10.05339539, 10.21355252, 0), x=(-0.998991554, 0.04489849681, 0), y=(-0.04489849681, -0.998991554, 0)), Radius=7.628386229}, {Angle=0.1605325581, Angle=0.1963689325, Plane=Plane(origin=(10.05339539, 10.21355252, 0), x=(-0.998991554, 0.04489849681, 0), y=(-0.04489849681, -0.998991554, 0)), Radius=7.628386229}, {Angle=0.1963689325, Angle=0.3403622141, Plane=Plane(origin=(10.05339539, 10.21355252, 0), x=(-0.998991554, 0.04489849681, 0), y=(-0.04489849681, -0.998991554, 0)), Radius=7.628386229}, {Angle=0.3403622141, Angle=0.6442144459, Plane=Plane(origin=(10.05339539, 10.21355252, 0), x=(-0.998991554, 0.04489849681, 0), y=(-0.04489849681, -0.998991554, 0)), Radius=7.628386229}, {Angle=0.6442144459, Angle=0.7091281646, Plane=Plane(origin=(10.05339539, 10.21355252, 0), x=(-0.998991554, 0.04489849681, 0), y=(-0.04489849681, -0.998991554, 0)), Radius=7.628386229}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], {0;8}: [{Angle=0, Angle=0.0448507723, Plane=Plane(origin=(40.1080402, 10.12792676, 0), x=(0.9881488268, -0.1534988469, 0), y=(0.1534988469, 0.9881488268, 0)), Radius=8.925228604}, {Angle=0.0448507723, Angle=0.1372070577, Plane=Plane(origin=(40.1080402, 10.12792676, 0), x=(0.9881488268, -0.1534988469, 0), y=(0.1534988469, 0.9881488268, 0)), Radius=8.925228604}, {Angle=0.1372070577, Angle=0.1678363801, Plane=Plane(origin=(40.1080402, 10.12792676, 0), x=(0.9881488268, -0.1534988469, 0), y=(0.1534988469, 0.9881488268, 0)), Radius=8.925228604}, {Angle=0.1678363801, Angle=0.2909073304, Plane=Plane(origin=(40.1080402, 10.12792676, 0), x=(0.9881488268, -0.1534988469, 0), y=(0.1534988469, 0.9881488268, 0)), Radius=8.925228604}, {Angle=0.2909073304, Angle=0.5506096062, Plane=Plane(origin=(40.1080402, 10.12792676, 0), x=(0.9881488268, -0.1534988469, 0), y=(0.1534988469, 0.9881488268, 0)), Radius=8.925228604}, {Angle=0.5506096062, Angle=0.6060913132, Plane=Plane(origin=(40.1080402, 10.12792676, 0), x=(0.9881488268, -0.1534988469, 0), y=(0.1534988469, 0.9881488268, 0)), Radius=8.925228604}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], {0;9}: [{Angle=0, Angle=0.02397579538, Plane=Plane(origin=(25.03790491, 24.42743013, 0), x=(-0.8256844553, 0.5641322365, 0), y=(-0.5641322365, -0.8256844553, 0)), Radius=16.69614666}, {Angle=0.02397579538, Angle=0.07334652605, Plane=Plane(origin=(25.03790491, 24.42743013, 0), x=(-0.8256844553, 0.5641322365, 0), y=(-0.5641322365, -0.8256844553, 0)), Radius=16.69614666}, {Angle=0.07334652605, Angle=0.08971998696, Plane=Plane(origin=(25.03790491, 24.42743013, 0), x=(-0.8256844553, 0.5641322365, 0), y=(-0.5641322365, -0.8256844553, 0)), Radius=16.69614666}, {Angle=0.08971998696, Angle=0.1555097999, Plane=Plane(origin=(25.03790491, 24.42743013, 0), x=(-0.8256844553, 0.5641322365, 0), y=(-0.5641322365, -0.8256844553, 0)), Radius=16.69614666}, {Angle=0.1555097999, Angle=0.2943383709, Plane=Plane(origin=(25.03790491, 24.42743013, 0), x=(-0.8256844553, 0.5641322365, 0), y=(-0.5641322365, -0.8256844553, 0)), Radius=16.69614666}, {Angle=0.2943383709, Angle=0.3239971256, Plane=Plane(origin=(25.03790491, 24.42743013, 0), x=(-0.8256844553, 0.5641322365, 0), y=(-0.5641322365, -0.8256844553, 0)), Radius=16.69614666}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], {0;10}: [{Angle=0, Angle=0.01553750692, Plane=Plane(origin=(24.5241503, 23.3999209, 0), x=(-0.6713483309, 0.7411419693, 0), y=(-0.7411419693, -0.6713483309, 0)), Radius=25.76368255}, {Angle=0.01553750692, Angle=0.04753219396, Plane=Plane(origin=(24.5241503, 23.3999209, 0), x=(-0.6713483309, 0.7411419693, 0), y=(-0.7411419693, -0.6713483309, 0)), Radius=25.76368255}, {Angle=0.04753219396, Angle=0.05814301033, Plane=Plane(origin=(24.5241503, 23.3999209, 0), x=(-0.6713483309, 0.7411419693, 0), y=(-0.7411419693, -0.6713483309, 0)), Radius=25.76368255}, {Angle=0.05814301033, Angle=0.1007780787, Plane=Plane(origin=(24.5241503, 23.3999209, 0), x=(-0.6713483309, 0.7411419693, 0), y=(-0.7411419693, -0.6713483309, 0)), Radius=25.76368255}, {Angle=0.1007780787, Angle=0.190745892, Plane=Plane(origin=(24.5241503, 23.3999209, 0), x=(-0.6713483309, 0.7411419693, 0), y=(-0.7411419693, -0.6713483309, 0)), Radius=25.76368255}, {Angle=0.190745892, Angle=0.2099662389, Plane=Plane(origin=(24.5241503, 23.3999209, 0), x=(-0.6713483309, 0.7411419693, 0), y=(-0.7411419693, -0.6713483309, 0)), Radius=25.76368255}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]))
geo_2 = Geometry(Tree({0;0}: [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], {0;1}: [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], {0;2}: [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], {0;3}: [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], {0;4}: [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], {0;5}: [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], {0;6}: [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], {0;7}: [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], {0;8}: [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], {0;9}: [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], {0;10}: [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]))
txt = Text("MGLEn")
flatten = FlattenTree(Tree=geo_2, Path="{0}")
file = ReadFile(File=path, PerLineParse=False)
flatten_2 = FlattenTree(Tree=arc, Path="{0}")
sdnaintegral = GhPythonScript(go=Toggle(True), Geom=flatten, field=txt)  # -> out, OK, Data, Geom, f_name, gdm, a, opts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; inputs go: list of Boolean, Data: tree, Geom: list, f_name: list, gdm: list, opts: list, l_metas: list, field: list
# ---------- sdnaintegral: Python ----------
#! /usr/bin/python2.7
# -*- coding: utf-8 -*-
__author__ = 'James Parrott'
__version__ = '0.01'


import os, sys 
from os.path import isfile, isdir, join, split, dirname
from importlib import import_module

try:        
    from ghpythonlib.componentbase import executingcomponent as component
    import Grasshopper
    import scriptcontext as sc
except ImportError:
    print( "No Grasshopper env found.  Building test environment.  ")
    
    component = object

    class Grasshopper:
        class Folders:
            #DefaultAssemblyFolder = r'C:\Users\James\Documents\Rhino\Grasshopper\sDNA\source\repos\GHsDNAv0.01'
            DefaultAssemblyFolder = os.getenv('APPDATA') + r'\Grasshopper\Libraries'

sDNA_GH_subfolder = 'sDNA_GH' 
sDNA_GH_package = 'sDNA_GH'               
reload_config_and_other_modules_if_already_loaded = False
#sDNA_GH_search_paths = [r'C:\Users\James\Documents\Rhino\Grasshopper\sDNA\source\repos\GHsDNAv0.01\sDNA_GH']
sDNA_GH_search_paths = [ join(Grasshopper.Folders.DefaultAssemblyFolder, sDNA_GH_subfolder) ]  
                                            # Grasshopper.Folders.AppDataFolder + r'\Libraries'
                                            # %appdata%  + r'\Grasshopper\Libraries'
                                            # os.getenv('APPDATA') + r'\Grasshopper\Libraries'



def output(s, level='INFO', inst = None):        # e.g. inst is a MyComponent.  
                         # Inst is a proxy argument for both 'self' and 'cls'.
    #type: (str, MyComponent, str) -> None
    message = s
    if hasattr(inst,'nick_name'):
        message = inst.nick_name + ' : ' + message
    message_with_level =  'sDNA_GH_launcher' + '  ' + level + ' : ' + message
    #print(message_with_level)
    try:
        sDNA_GH_tools.output(message, level, inst)
    except:
        try:
            getattr(sDNA_GH_tools.wrapper_logging.logging,level.lower())("From sDNA_GH_launcher via logging: " + message)
        except:
            print(message_with_level)
            if hasattr(inst,'a') and hasattr(inst.a,'write'):
                inst.a.write("From sDNA_GH_launcher via inst: " + message_with_level)
    return message_with_level


def strict_import(  module_name = ''
                   ,folder = ''
                   ,sub_folder = ''
                   ,output = output
                   ,search_folder_only = False
                   ):

    # type: (str, str, str, function, bool) -> type[any]
    #
    if module_name == '':
        output('No module to import','INFO')
        return None
    output(module_name,'DEBUG')
    if module_name in sys.modules:   # sys.modules is also shared between GHPython components 
                                    # and is even saved until Rhino is closed.
        output('Module ' + module_name + ' already in sys.modules.  ','DEBUG')
        if reload_config_and_other_modules_if_already_loaded:
            output('Reloading ' +  module_name  + '.... ','DEBUG')
            reload(sys.modules[module_name]) # type: ignore
        return sys.modules[module_name]
    #
    #
    # Load module_name for first time:
    #
    #
    search_path = join(folder, sub_folder)

    tmp = sys.path
    if search_path and isinstance(search_path, str) and isdir(search_path):
        output('Search path == ' + search_path, 'DEBUG')
        if search_folder_only:
            sys.path = [search_path]
        else:
            sys.path.insert(0, search_path)
    else:
        output('Invalid search path : ' + search_path, 'DEBUG')
        if search_folder_only:
            return None

    output('Trying import... ','DEBUG')
    m = import_module(module_name, '')           
    sys.path = tmp
    return m       


def load_modules(self, m_names, path_lists):
    m_names = m_names if isinstance(m_names, tuple) else [m_names] 
    output('m_names == ' + str(m_names) + ' of type : ' + type(m_names).__name__,'DEBUG')
    if any((name.startswith('.') or name.startswith('..')) in name for name in m_names):
        output(m_names,'DEBUG')
        raise ImportError( output('Relative import attempted, but not supported','CRITICAL') )

    output('Testing paths : ' + '\n'.join(map(str,path_lists)),'DEBUG')
    output('Type(path_lists) : ' + type(path_lists).__name__,'DEBUG')


    for path_list in path_lists:
        test_paths = path_list if isinstance(path_list, list) else [path_list]
        test_paths = test_paths[:]
        #output('Type(path_list) : ' + type(path_list).__name__,'DEBUG')
        #output('Type(test_paths) : ' + type(test_paths).__name__,'DEBUG')

        for path in test_paths:
            output('Type(path) : ' + type(path).__name__ + ' path == ' + path,'DEBUG')
            if isfile(path):
                path = dirname(path)
            if all( any(isfile(join(path, name.replace('.', os.sep) + ending)) 
                        for ending in ['.py','.pyc'] 
                        )
                    for name in m_names
                ):
                output('Importing ' + str(m_names) +' ','DEBUG')
                return tuple(strict_import(name, path, '') for name in m_names) + (path,)
    return None


#try:
from Grasshopper.Folders import DefaultAssemblyFolder
sDNA_GH_search_paths += [join(DefaultAssemblyFolder
                                ,sDNA_GH_subfolder
                                ) 
                        ]            
# except:
#     raise ImportError(output( 'Unable to import the main sDNA_GH Python Package.  '
#                              +'Check the folder sDNA_GH containing the package '
#                              +'is a sub folder of the '
#                              +'sDNA_GH folder containing the plug-in components'
#                              +'and the installation procedure was done correctly'
#                              +'as per README.md'
#                              ,'ERROR'
#                              )
#                       )


try:
    nick_name = ghenv.Component.NickName #type: ignore
except:
    nick_name = 'selftest'

sc.doc = ghdoc #type: ignore

sDNA_GH_tools, _ = load_modules( None
                                ,sDNA_GH_package + '.tools'
                                ,sDNA_GH_search_paths
                                )         

class MyComponent(component):
    pass  # Required.  Idiomatic to Grasshopper.  Must be called "MyComponent"  
          # too, otherwise Grasshopper may not find the class building on 
          # component.  Despite component being passed to the class decorator
          # and overwriting this very class immediately below.  
          # Initial parser step / scope check trips this?

MyComponent = sDNA_GH_tools.component_decorator( component
                                                ,ghenv #type: ignore
                                                ,nick_name
                                                ,load_modules
                                                )


if nick_name.replace(' ','').replace('_','').lower() == 'selftest':  

    if sys.argv[0].endswith(join(sDNA_GH_package,'__main__.py')):   
        from .tests.unit_tests import unit_tests_sDNA_GH
    else:
        unit_tests_sDNA_GH, _ = load_modules( None
                                             ,'sDNA_GH.tests.unit_tests.unit_tests_sDNA_GH'
                                             ,sDNA_GH_search_paths
                                             )

    MyComponent._RunScript = MyComponent.RunScript
    MyComponent.RunScript = unit_tests_sDNA_GH.run_launcher_tests
# ---------- end sdnaintegral ----------
delete_sdna_gh = Button()
update = Button()
gradient = Gradient(
    LowerLimit=sdnaintegral.plot_min,
    UpperLimit=sdnaintegral.plot_max,
    Parameter=sdnaintegral.Data,
    stops=[0: RGB(243, 57, 0), 0.1: RGB(236, 27, 60), 0.2: RGB(210, 0, 118), 0.5: RGB(1, 192, 229), 0.6: RGB(18, 178, 90), 0.7: RGB(79, 186, 8), 0.8: RGB(220, 237, 32), 0.9: RGB(247, 159, 20), 1: RGB(243, 57, 0)])
toggle = BooleanToggle(False)
python = GhPythonScript(del_sDNA_GH=delete_sdna_gh, update=update)  # -> out, a
# ---------- python: Python ----------
#! /usr/bin/python2.7
# -*- coding: utf-8 -*-
__author__ = 'James Parrott'
__version__ = '0.00'
__copyright__ = 'Cardiff University'
__license__ = {  'Python standard library modules and ' : 'Python Software Foundation 2.7.18' # https://docs.python.org/2.7/license.html
                ,'wrapper_logging' : 'Python Software Foundation 2.7.18'
                ,'wrapper_pyshp' : 'MIT' # https://pypi.org/project/pyshp/ 
                ,'sDNAUISpec.py' : 'MIT' # https://github.com/fiftysevendegreesofrad/sdna_open/blob/master/LICENSE.md
                ,'everything else' : 'same as for sDNA ' # https://sdna.cardiff.ac.uk/sdna/legal-license/ 
               }

import sys, os, Grasshopper, logging
#print('\n'.join([key for key in sys.modules if 'sDNA' in key]))
#print('functools' in sys.modules)
print('Our packages and modules in sys.modules:')
print('\n'.join([key for key in sys.modules if 'sdna' in key.lower()]))# and not '.' in key]))
#print os.getenv('APPDATA')
#print ghdoc.Path
#print Grasshopper.Folders.DefaultAssemblyFolder
#print Grasshopper.Folders.AppDataFolder
#print sys.argv[0]
#print("Classmethod found == " + str('classmethod' in __builtins__))
def is_imported(s):
    return s in sys.modules
if del_sDNA_GH == True:
    if 'logging' in sys.modules:
        sys.modules['logging'].shutdown()
    shared_cached_modules_etc = sys.modules.copy().keys()
    for y in shared_cached_modules_etc:
        if 'sDNA' in y or y == 'runsdnacommand':
            del sys.modules[y]


        
print('sDNA_GH imported == ' + str(is_imported('sDNA_GH')))
print('sDNA_GH.tools imported == ' + str(is_imported('sDNA_GH.tools')))
print('sDNAUISpec imported == ' + str(is_imported('sDNAUISpec')))
print('runsdnacommand == ' + str(is_imported('runsdnacommand')))
if False: #is_imported('sDNA_GH'):
    print sys.modules['sDNA_GH'].__all__
    print dir(sys.modules['sDNA_GH'])
    if is_imported('sDNA_GH.tools'):
        print dir(sys.modules['sDNA_GH.tools'])
    if hasattr(sys.modules['sDNA_GH'],'third_party_python_modules'):
        print dir(sys.modules['sDNA_GH'].third_party_python_modules)

#print sys.modules.keys()
#print os.getcwd()
#print sys.path[0]
#print 'a' in globals()
#a = "This is a!"
#print('\n'.join(dir(sys.modules['sDNA_GH'].third_party_python_modules)))
# ---------- end python ----------
panel = Panel(python.out)
python_2 = GhPythonScript(x=sdnaintegral.opts)  # -> out, a; inputs x: list
# ---------- python_2: Python ----------
__author__ = "James"
__version__ = "2022.04.02"

import rhinoscriptsyntax as rs

if x:
    print x
# ---------- end python_2 ----------
rectangle = GhPythonScript()  # -> out, a; disabled
# ---------- rectangle: Python ----------
__author__ = "James"
__version__ = "2022.04.02"

import rhinoscriptsyntax as rs
import scriptcontext as sc

rect = rs.AddRectangle(rs.WorldXYPlane(), 20,60)
rs.MoveObject(rect, [60, 0])
print sc.doc == ghdoc
a = rect
# ---------- end rectangle ----------
recolor_objects = GhPythonScript(go=sdnaintegral.OK, Data=gradient, Geom=sdnaintegral.Geom, opts=sdnaintegral.opts)  # -> out, OK, Data, Geom, f_name, gdm, a, opts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; inputs go: list of Boolean, Data: tree, Geom: list, f_name: list, gdm: list, opts: list, l_metas: list; same code as sdnaintegral
panel_2 = Panel(recolor_objects.out)
legend = Legend(Colour=recolor_objects.leg_cols, Tags=recolor_objects.leg_tags, Rectangle=recolor_objects.rectangle, LegendType=1)
preview = CustomPreview(Geometry=flatten_2, Material=recolor_objects.Data)
parse_data = GhPythonScript()  # -> out, OK, Data, f_name, gdm, a, opts, l_metas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; inputs go: list of Boolean, Data: tree, Geom: list, f_name: list, gdm: list, opts: list, l_metas: list; disabled
# ---------- parse_data: Python ----------
#! /usr/bin/python2.7
# -*- coding: utf-8 -*-
__author__ = 'James Parrott'
__version__ = '0.01'


import os, sys 
from os.path import isfile, isdir, join, split, dirname
from importlib import import_module

try:        
    from ghpythonlib.componentbase import executingcomponent as component
    import Grasshopper
except ImportError:
    print( "No Grasshopper env found.  Building test environment.  ")
    
    component = object

    class Grasshopper:
        class Folders:
            #DefaultAssemblyFolder = r'C:\Users\James\Documents\Rhino\Grasshopper\sDNA\source\repos\GHsDNAv0.01'
            DefaultAssemblyFolder = os.getenv('APPDATA') + r'\Grasshopper\Libraries'

sDNA_GH_subfolder = 'sDNA_GH' 
sDNA_GH_package = 'sDNA_GH'               
reload_config_and_other_modules_if_already_loaded = False
#sDNA_GH_search_paths = [r'C:\Users\James\Documents\Rhino\Grasshopper\sDNA\source\repos\GHsDNAv0.01\sDNA_GH']
sDNA_GH_search_paths = [ join(Grasshopper.Folders.DefaultAssemblyFolder,'sDNA_GH') ]  
                                            # Grasshopper.Folders.AppDataFolder + r'\Libraries'
                                            # %appdata%  + r'\Grasshopper\Libraries'
                                            # os.getenv('APPDATA') + r'\Grasshopper\Libraries'



def output(s, level='INFO', inst = None):        # e.g. inst is a MyComponent.  
                         # Inst is a proxy argument for both 'self' and 'cls'.
    #type: (str, MyComponent, str) -> None
    message = s
    if hasattr(inst,'nick_name'):
        message = inst.nick_name + ' : ' + message
    message_with_level =  'sDNA_GH_launcher' + '  ' + level + ' : ' + message
    #print(message_with_level)
    try:
        sDNA_GH_tools.output(message, level, inst)
    except:
        try:
            getattr(sDNA_GH_tools.wrapper_logging.logging,level.lower())("From sDNA_GH_launcher via logging: " + message)
        except:
            print(message_with_level)
            if hasattr(inst,'a') and hasattr(inst.a,'write'):
                inst.a.write("From sDNA_GH_launcher via inst: " + message_with_level)
    return message_with_level


def strict_import(  module_name = ''
                   ,folder = ''
                   ,sub_folder = ''
                   ,output = output
                   ,search_folder_only = False
                   ):

    # type: (str, str, str, function, bool) -> type[any]
    #
    if module_name == '':
        output('No module to import','INFO')
        return None
    output(module_name,'DEBUG')
    if module_name in sys.modules:   # sys.modules is also shared between GHPython components 
                                    # and is even saved until Rhino is closed.
        output('Module ' + module_name + ' already in sys.modules.  ','DEBUG')
        if reload_config_and_other_modules_if_already_loaded:
            output('Reloading ' +  module_name  + '.... ','DEBUG')
            reload(sys.modules[module_name]) # type: ignore
        return sys.modules[module_name]
    #
    #
    # Load module_name for first time:
    #
    #
    search_path = join(folder, sub_folder)

    tmp = sys.path
    if search_path and isinstance(search_path, str) and isdir(search_path):
        output('Search path == ' + search_path, 'DEBUG')
        if search_folder_only:
            sys.path = [search_path]
        else:
            sys.path.insert(0, search_path)
    else:
        output('Invalid search path : ' + search_path, 'DEBUG')
        if search_folder_only:
            return None

    output('Trying import... ','DEBUG')
    m = import_module(module_name, '')           
    sys.path = tmp
    return m       


def load_modules(self, m_names, path_lists):
    m_names = m_names if isinstance(m_names, tuple) else [m_names] 
    output('m_names == ' + str(m_names) + ' of type : ' + type(m_names).__name__,'DEBUG')
    if any((name.startswith('.') or name.startswith('..')) in name for name in m_names):
        output(m_names,'DEBUG')
        raise ImportError( output('Relative import attempted, but not supported','CRITICAL') )

    output('Testing paths : ' + '\n'.join(map(str,path_lists)),'DEBUG')
    output('Type(path_lists) : ' + type(path_lists).__name__,'DEBUG')


    for path_list in path_lists:
        test_paths = path_list if isinstance(path_list, list) else [path_list]
        test_paths = test_paths[:]
        #output('Type(path_list) : ' + type(path_list).__name__,'DEBUG')
        #output('Type(test_paths) : ' + type(test_paths).__name__,'DEBUG')

        for path in test_paths:
            output('Type(path) : ' + type(path).__name__ + ' path == ' + path,'DEBUG')
            if isfile(path):
                path = dirname(path)
            if all( any(isfile(join(path, name.replace('.', os.sep) + ending)) 
                        for ending in ['.py','.pyc'] 
                        )
                    for name in m_names
                ):
                output('Importing ' + str(m_names) +' ','DEBUG')
                return tuple(strict_import(name, path, '') for name in m_names) + (path,)
    return None


try:
    from Grasshopper.Folders import DefaultAssemblyFolder
    sDNA_GH_search_paths += [join(DefaultAssemblyFolder
                                 ,sDNA_GH_subfolder
                                 ) 
                            ]
except:
    raise ImportError(output( 'Unable to import the main sDNA_GH Python Package.  '
                             +'Check the folder sDNA_GH containing the package '
                             +'is a sub folder of the '
                             +'sDNA_GH folder containing the plug-in components'
                             +'and the installation procedure was done correctly'
                             +'as pe as per README.md'
                             ,'ERROR'
                             )
                      )


try:
    nick_name = ghenv.Component.NickName #type: ignore
except:
    nick_name = 'selftest'


sDNA_GH_tools, _ = load_modules( None
                                ,sDNA_GH_package + '.tools'
                                ,sDNA_GH_search_paths
                                )         

class MyComponent(component):
    pass  # Required.  Idiomatic to Grasshopper.  Must be called "MyComponent"  
          # too, otherwise Grasshopper may not find the class building on 
          # component.  Despite component being passed to the class decorator
          # and overwriting this very class immediately below.  
          # Initial parser step / scope check trips this?

MyComponent = sDNA_GH_tools.component_decorator(component, load_modules)


if nick_name.replace(' ','').replace('_','').lower() == 'selftest':  

    if sys.argv[0].endswith(join(sDNA_GH_package,'__main__.py')):   
        from .tests.unit_tests import unit_tests_sDNA_GH
    else:
        unit_tests_sDNA_GH, _ = load_modules( None
                                             ,'sDNA_GH.tests.unit_tests.unit_tests_sDNA_GH'
                                             ,sDNA_GH_search_paths
                                             )

    MyComponent._RunScript = MyComponent.RunScript
    MyComponent.RunScript = unit_tests_sDNA_GH.run_launcher_tests
# ---------- end parse_data ----------
python_3 = GhPythonScript(y=rectangle.a)  # -> out, a
# ---------- python_3: Python ----------
__author__ = "James"
__version__ = "2022.04.02"

import rhinoscriptsyntax as rs
import scriptcontext as sc
import Grasshopper


if x:
    print x
    print type(x)
if y:
    print y
    print type(y)
    
var = Grasshopper.Kernel.Parameters.Param_Geometry
# ---------- end python_3 ----------
