# Grasshopper definition 10_circles_test_multiple_comps_plot_arcs.gh (Grasshopper 1.0.7)

geo = Geometry([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])  # disabled
mcx = MultipleCurves(Curves=geo)  # -> Points, IndexA, IndexB, ParamA, ParamB; disabled
shatter = Shatter(Curve=geo, Parameters=mcx.ParamA)  # disabled
arc = CircularArc(Tree({0;0}: [{Angle=0, Angle=0.02223072957, Plane=Plane(origin=(9.971194654, 9.650991224, 0), x=(0.9975937224, -0.06933083785, 0), y=(0.06933083785, 0.9975937224, 0)), Radius=18.00675927}, {Angle=0.02223072957, Angle=0.06800803726, Plane=Plane(origin=(9.971194654, 9.650991224, 0), x=(0.9975937224, -0.06933083785, 0), y=(0.06933083785, 0.9975937224, 0)), Radius=18.00675927}, {Angle=0.06800803726, Angle=0.08318976433, Plane=Plane(origin=(9.971194654, 9.650991224, 0), x=(0.9975937224, -0.06933083785, 0), y=(0.06933083785, 0.9975937224, 0)), Radius=18.00675927}, {Angle=0.08318976433, Angle=0.1441911, Plane=Plane(origin=(9.971194654, 9.650991224, 0), x=(0.9975937224, -0.06933083785, 0), y=(0.06933083785, 0.9975937224, 0)), Radius=18.00675927}, {Angle=0.1441911, Angle=0.2729151055, Plane=Plane(origin=(9.971194654, 9.650991224, 0), x=(0.9975937224, -0.06933083785, 0), y=(0.06933083785, 0.9975937224, 0)), Radius=18.00675927}, {Angle=0.2729151055, Angle=0.3004151632, Plane=Plane(origin=(9.971194654, 9.650991224, 0), x=(0.9975937224, -0.06933083785, 0), y=(0.06933083785, 0.9975937224, 0)), Radius=18.00675927}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], {0;1}: [{Angle=0, Angle=0.02076078341, Plane=Plane(origin=(39.72529301, 9.720348097, 0), x=(-0.9999741224, 0.007194058435, 0), y=(-0.007194058435, -0.9999741224, 0)), Radius=19.28170956}, {Angle=0.02076078341, Angle=0.0635111919, Plane=Plane(origin=(39.72529301, 9.720348097, 0), x=(-0.9999741224, 0.007194058435, 0), y=(-0.007194058435, -0.9999741224, 0)), Radius=19.28170956}, {Angle=0.0635111919, Angle=0.0776890688, Plane=Plane(origin=(39.72529301, 9.720348097, 0), x=(-0.9999741224, 0.007194058435, 0), y=(-0.007194058435, -0.9999741224, 0)), Radius=19.28170956}, {Angle=0.0776890688, Angle=0.134656858, Plane=Plane(origin=(39.72529301, 9.720348097, 0), x=(-0.9999741224, 0.007194058435, 0), y=(-0.007194058435, -0.9999741224, 0)), Radius=19.28170956}, {Angle=0.134656858, Angle=0.254869341, Plane=Plane(origin=(39.72529301, 9.720348097, 0), x=(-0.9999741224, 0.007194058435, 0), y=(-0.007194058435, -0.9999741224, 0)), Radius=19.28170956}, {Angle=0.254869341, Angle=0.2805510325, Plane=Plane(origin=(39.72529301, 9.720348097, 0), x=(-0.9999741224, 0.007194058435, 0), y=(-0.007194058435, -0.9999741224, 0)), Radius=19.28170956}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], {0;2}: [{Angle=0, Angle=0.02223072957, Plane=Plane(origin=(9.371814273, 39.62001026, 0), x=(0.9975937224, -0.06933083785, 0), y=(0.06933083785, 0.9975937224, 0)), Radius=18.00675927}, {Angle=0.02223072957, Angle=0.06800803726, Plane=Plane(origin=(9.371814273, 39.62001026, 0), x=(0.9975937224, -0.06933083785, 0), y=(0.06933083785, 0.9975937224, 0)), Radius=18.00675927}, {Angle=0.06800803726, Angle=0.08318976433, Plane=Plane(origin=(9.371814273, 39.62001026, 0), x=(0.9975937224, -0.06933083785, 0), y=(0.06933083785, 0.9975937224, 0)), Radius=18.00675927}, {Angle=0.08318976433, Angle=0.1441911, Plane=Plane(origin=(9.371814273, 39.62001026, 0), x=(0.9975937224, -0.06933083785, 0), y=(0.06933083785, 0.9975937224, 0)), Radius=18.00675927}, {Angle=0.1441911, Angle=0.2729151055, Plane=Plane(origin=(9.371814273, 39.62001026, 0), x=(0.9975937224, -0.06933083785, 0), y=(0.06933083785, 0.9975937224, 0)), Radius=18.00675927}, {Angle=0.2729151055, Angle=0.3004151632, Plane=Plane(origin=(9.371814273, 39.62001026, 0), x=(0.9975937224, -0.06933083785, 0), y=(0.06933083785, 0.9975937224, 0)), Radius=18.00675927}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], {0;3}: [{Angle=0, Angle=0.02223072957, Plane=Plane(origin=(39.25520754, 40.81877103, 0), x=(0.9975937224, -0.06933083785, 0), y=(0.06933083785, 0.9975937224, 0)), Radius=18.00675927}, {Angle=0.02223072957, Angle=0.06800803726, Plane=Plane(origin=(39.25520754, 40.81877103, 0), x=(0.9975937224, -0.06933083785, 0), y=(0.06933083785, 0.9975937224, 0)), Radius=18.00675927}, {Angle=0.06800803726, Angle=0.08318976433, Plane=Plane(origin=(39.25520754, 40.81877103, 0), x=(0.9975937224, -0.06933083785, 0), y=(0.06933083785, 0.9975937224, 0)), Radius=18.00675927}, {Angle=0.08318976433, Angle=0.1441911, Plane=Plane(origin=(39.25520754, 40.81877103, 0), x=(0.9975937224, -0.06933083785, 0), y=(0.06933083785, 0.9975937224, 0)), Radius=18.00675927}, {Angle=0.1441911, Angle=0.2729151055, Plane=Plane(origin=(39.25520754, 40.81877103, 0), x=(0.9975937224, -0.06933083785, 0), y=(0.06933083785, 0.9975937224, 0)), Radius=18.00675927}, {Angle=0.2729151055, Angle=0.3004151632, Plane=Plane(origin=(39.25520754, 40.81877103, 0), x=(0.9975937224, -0.06933083785, 0), y=(0.06933083785, 0.9975937224, 0)), Radius=18.00675927}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], {0;4}: [{Angle=0, Angle=0.02223072957, Plane=Plane(origin=(9.371814273, 39.62001026, 0), x=(0.9975937224, -0.06933083785, 0), y=(0.06933083785, 0.9975937224, 0)), Radius=18.00675927}, {Angle=0.02223072957, Angle=0.06800803726, Plane=Plane(origin=(9.371814273, 39.62001026, 0), x=(0.9975937224, -0.06933083785, 0), y=(0.06933083785, 0.9975937224, 0)), Radius=18.00675927}, {Angle=0.06800803726, Angle=0.08318976433, Plane=Plane(origin=(9.371814273, 39.62001026, 0), x=(0.9975937224, -0.06933083785, 0), y=(0.06933083785, 0.9975937224, 0)), Radius=18.00675927}, {Angle=0.08318976433, Angle=0.1441911, Plane=Plane(origin=(9.371814273, 39.62001026, 0), x=(0.9975937224, -0.06933083785, 0), y=(0.06933083785, 0.9975937224, 0)), Radius=18.00675927}, {Angle=0.1441911, Angle=0.2729151055, Plane=Plane(origin=(9.371814273, 39.62001026, 0), x=(0.9975937224, -0.06933083785, 0), y=(0.06933083785, 0.9975937224, 0)), Radius=18.00675927}, {Angle=0.2729151055, Angle=0.3004151632, Plane=Plane(origin=(9.371814273, 39.62001026, 0), x=(0.9975937224, -0.06933083785, 0), y=(0.06933083785, 0.9975937224, 0)), Radius=18.00675927}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], {0;5}: [{Angle=0, Angle=0.05975979238, Plane=Plane(origin=(9.282763473, 38.81255927, 0), x=(-0.8436614877, 0.5368754922, 0), y=(-0.5368754922, -0.8436614877, 0)), Radius=6.698540606}, {Angle=0.05975979238, Angle=0.1828165906, Plane=Plane(origin=(9.282763473, 38.81255927, 0), x=(-0.8436614877, 0.5368754922, 0), y=(-0.5368754922, -0.8436614877, 0)), Radius=6.698540606}, {Angle=0.1828165906, Angle=0.2236275255, Plane=Plane(origin=(9.282763473, 38.81255927, 0), x=(-0.8436614877, 0.5368754922, 0), y=(-0.5368754922, -0.8436614877, 0)), Radius=6.698540606}, {Angle=0.2236275255, Angle=0.3876089702, Plane=Plane(origin=(9.282763473, 38.81255927, 0), x=(-0.8436614877, 0.5368754922, 0), y=(-0.5368754922, -0.8436614877, 0)), Radius=6.698540606}, {Angle=0.3876089702, Angle=0.7336398921, Plane=Plane(origin=(9.282763473, 38.81255927, 0), x=(-0.8436614877, 0.5368754922, 0), y=(-0.5368754922, -0.8436614877, 0)), Radius=6.698540606}, {Angle=0.7336398921, Angle=0.8075644896, Plane=Plane(origin=(9.282763473, 38.81255927, 0), x=(-0.8436614877, 0.5368754922, 0), y=(-0.5368754922, -0.8436614877, 0)), Radius=6.698540606}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], {0;6}: [{Angle=0, Angle=0.05100273345, Plane=Plane(origin=(39.93678866, 39.84006849, 0), x=(-0.9927732203, 0.1200055541, 0), y=(-0.1200055541, -0.9927732203, 0)), Radius=7.848665527}, {Angle=0.05100273345, Angle=0.1560270789, Plane=Plane(origin=(39.93678866, 39.84006849, 0), x=(-0.9927732203, 0.1200055541, 0), y=(-0.1200055541, -0.9927732203, 0)), Radius=7.848665527}, {Angle=0.1560270789, Angle=0.1908576758, Plane=Plane(origin=(39.93678866, 39.84006849, 0), x=(-0.9927732203, 0.1200055541, 0), y=(-0.1200055541, -0.9927732203, 0)), Radius=7.848665527}, {Angle=0.1908576758, Angle=0.3308096666, Plane=Plane(origin=(39.93678866, 39.84006849, 0), x=(-0.9927732203, 0.1200055541, 0), y=(-0.1200055541, -0.9927732203, 0)), Radius=7.848665527}, {Angle=0.3308096666, Angle=0.6261340339, Plane=Plane(origin=(39.93678866, 39.84006849, 0), x=(-0.9927732203, 0.1200055541, 0), y=(-0.1200055541, -0.9927732203, 0)), Radius=7.848665527}, {Angle=0.6261340339, Angle=0.6892258954, Plane=Plane(origin=(39.93678866, 39.84006849, 0), x=(-0.9927732203, 0.1200055541, 0), y=(-0.1200055541, -0.9927732203, 0)), Radius=7.848665527}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], {0;7}: [{Angle=0, Angle=0.05247550187, Plane=Plane(origin=(10.05339539, 10.21355252, 0), x=(-0.998991554, 0.04489849681, 0), y=(-0.04489849681, -0.998991554, 0)), Radius=7.628386229}, {Angle=0.05247550187, Angle=0.1605325581, Plane=Plane(origin=(10.05339539, 10.21355252, 0), x=(-0.998991554, 0.04489849681, 0), y=(-0.04489849681, -0.998991554, 0)), Radius=7.628386229}, {Angle=0.1605325581, Angle=0.1963689325, Plane=Plane(origin=(10.05339539, 10.21355252, 0), x=(-0.998991554, 0.04489849681, 0), y=(-0.04489849681, -0.998991554, 0)), Radius=7.628386229}, {Angle=0.1963689325, Angle=0.3403622141, Plane=Plane(origin=(10.05339539, 10.21355252, 0), x=(-0.998991554, 0.04489849681, 0), y=(-0.04489849681, -0.998991554, 0)), Radius=7.628386229}, {Angle=0.3403622141, Angle=0.6442144459, Plane=Plane(origin=(10.05339539, 10.21355252, 0), x=(-0.998991554, 0.04489849681, 0), y=(-0.04489849681, -0.998991554, 0)), Radius=7.628386229}, {Angle=0.6442144459, Angle=0.7091281646, Plane=Plane(origin=(10.05339539, 10.21355252, 0), x=(-0.998991554, 0.04489849681, 0), y=(-0.04489849681, -0.998991554, 0)), Radius=7.628386229}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], {0;8}: [{Angle=0, Angle=0.0448507723, Plane=Plane(origin=(40.1080402, 10.12792676, 0), x=(0.9881488268, -0.1534988469, 0), y=(0.1534988469, 0.9881488268, 0)), Radius=8.925228604}, {Angle=0.0448507723, Angle=0.1372070577, Plane=Plane(origin=(40.1080402, 10.12792676, 0), x=(0.9881488268, -0.1534988469, 0), y=(0.1534988469, 0.9881488268, 0)), Radius=8.925228604}, {Angle=0.1372070577, Angle=0.1678363801, Plane=Plane(origin=(40.1080402, 10.12792676, 0), x=(0.9881488268, -0.1534988469, 0), y=(0.1534988469, 0.9881488268, 0)), Radius=8.925228604}, {Angle=0.1678363801, Angle=0.2909073304, Plane=Plane(origin=(40.1080402, 10.12792676, 0), x=(0.9881488268, -0.1534988469, 0), y=(0.1534988469, 0.9881488268, 0)), Radius=8.925228604}, {Angle=0.2909073304, Angle=0.5506096062, Plane=Plane(origin=(40.1080402, 10.12792676, 0), x=(0.9881488268, -0.1534988469, 0), y=(0.1534988469, 0.9881488268, 0)), Radius=8.925228604}, {Angle=0.5506096062, Angle=0.6060913132, Plane=Plane(origin=(40.1080402, 10.12792676, 0), x=(0.9881488268, -0.1534988469, 0), y=(0.1534988469, 0.9881488268, 0)), Radius=8.925228604}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], {0;9}: [{Angle=0, Angle=0.02397579538, Plane=Plane(origin=(25.03790491, 24.42743013, 0), x=(-0.8256844553, 0.5641322365, 0), y=(-0.5641322365, -0.8256844553, 0)), Radius=16.69614666}, {Angle=0.02397579538, Angle=0.07334652605, Plane=Plane(origin=(25.03790491, 24.42743013, 0), x=(-0.8256844553, 0.5641322365, 0), y=(-0.5641322365, -0.8256844553, 0)), Radius=16.69614666}, {Angle=0.07334652605, Angle=0.08971998696, Plane=Plane(origin=(25.03790491, 24.42743013, 0), x=(-0.8256844553, 0.5641322365, 0), y=(-0.5641322365, -0.8256844553, 0)), Radius=16.69614666}, {Angle=0.08971998696, Angle=0.1555097999, Plane=Plane(origin=(25.03790491, 24.42743013, 0), x=(-0.8256844553, 0.5641322365, 0), y=(-0.5641322365, -0.8256844553, 0)), Radius=16.69614666}, {Angle=0.1555097999, Angle=0.2943383709, Plane=Plane(origin=(25.03790491, 24.42743013, 0), x=(-0.8256844553, 0.5641322365, 0), y=(-0.5641322365, -0.8256844553, 0)), Radius=16.69614666}, {Angle=0.2943383709, Angle=0.3239971256, Plane=Plane(origin=(25.03790491, 24.42743013, 0), x=(-0.8256844553, 0.5641322365, 0), y=(-0.5641322365, -0.8256844553, 0)), Radius=16.69614666}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], {0;10}: [{Angle=0, Angle=0.01553750692, Plane=Plane(origin=(24.5241503, 23.3999209, 0), x=(-0.6713483309, 0.7411419693, 0), y=(-0.7411419693, -0.6713483309, 0)), Radius=25.76368255}, {Angle=0.01553750692, Angle=0.04753219396, Plane=Plane(origin=(24.5241503, 23.3999209, 0), x=(-0.6713483309, 0.7411419693, 0), y=(-0.7411419693, -0.6713483309, 0)), Radius=25.76368255}, {Angle=0.04753219396, Angle=0.05814301033, Plane=Plane(origin=(24.5241503, 23.3999209, 0), x=(-0.6713483309, 0.7411419693, 0), y=(-0.7411419693, -0.6713483309, 0)), Radius=25.76368255}, {Angle=0.05814301033, Angle=0.1007780787, Plane=Plane(origin=(24.5241503, 23.3999209, 0), x=(-0.6713483309, 0.7411419693, 0), y=(-0.7411419693, -0.6713483309, 0)), Radius=25.76368255}, {Angle=0.1007780787, Angle=0.190745892, Plane=Plane(origin=(24.5241503, 23.3999209, 0), x=(-0.6713483309, 0.7411419693, 0), y=(-0.7411419693, -0.6713483309, 0)), Radius=25.76368255}, {Angle=0.190745892, Angle=0.2099662389, Plane=Plane(origin=(24.5241503, 23.3999209, 0), x=(-0.6713483309, 0.7411419693, 0), y=(-0.7411419693, -0.6713483309, 0)), Radius=25.76368255}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]))
topoly = CurveToPolyline(Curve=shatter, ToleranceDistance=0, ToleranceAngle=0.07, MinEdge=6)  # -> Polyline, Segments; disabled
geo_2 = Geometry(Tree({0;0}: [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], {0;1}: [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], {0;2}: [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], {0;3}: [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], {0;4}: [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], {0;5}: [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], {0;6}: [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], {0;7}: [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], {0;8}: [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], {0;9}: [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], {0;10}: [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]))
flatten = FlattenTree(Tree=arc, Path="{0}")
flatten_2 = FlattenTree(Tree=geo_2, Path="{0}")
config = FilePath("C:\Users\James\AppData\Roaming\Grasshopper\UserObjects\sDNA_GH\config_smart_tools_off.toml")
write_shp = Write_Shp(go=Toggle(True), Geom=flatten_2)  # -> OK, opts, file; inputs go: list, opts: list, file: list, Geom: list, Data: tree, config: list
# ---------- write_shp: Python ----------
#! /usr/bin/python as module, Grasshopper Python as script / main
# -*- coding: utf-8 -*-
__author__ = 'James Parrott'
__version__ = '0.02'


import os, sys
from importlib import import_module
if (not hasattr(__builtins__, 'reload') 
    and (isinstance(__builtins__, dict) 
         and 'reload' not in __builtins__ )):  
    from importlib import reload 
    # reload was builtin until Python 3.4
    # __builtins__ is a dict in GhPython not a module as elsewhere


sDNA_GH_subfolder = 'sDNA_GH' 
sDNA_GH_package = 'sDNA_GH'               
reload_config_and_other_modules_if_already_loaded = False


# There may be multiple components, all running this same launcher code.
# Therefore we want the root logger to live in the sDNA_GH.setup module
# that they each import.  Te logging system is configurable by the user,
# but only through the options that are read in during the main package
# import, and we want to create logs before this too.  So before a 
# component has imported sDNA_GH.setup, logging is routed through output, 
# a callable instance of Output, with a cache, defined below.  output's cache 
# is flushed through the normal logging system, after a logger has been set up 
# according to the user's configuration, after the main package import.
#
# This Output class is used to define two Classes from this single 
# code definition.  Python scripts can happily import themselves, but here
# this is because all the code in this file 
# must be read into a GhPython component via its the code input (which 
# essentially copy and pastes it to there).
# The first function definition is when the code in this file runs 
# in a GH component.  
# The second function definition is during import of sDNA_GH below, 
# as it itself imports this function from .launcher
# Therefore there really are two functions in Python, with two separate caches.
#
# The behaviours can be different of course if changes are made to one and not
# the other, e.g. if the code is forgotten to be copied into the component.

class Output: 

    def set_logger(self, logger, flush = True):
        self.logger = logger
        if flush and self.tmp_logs:
            self.flush()

    def __init__(self
                ,tmp_logs = None
                ,logger = None
                ):
        if not isinstance(tmp_logs, list): #assert not isinstance(None, list)
            tmp_logs = []
        self.tmp_logs = tmp_logs
        if logger is not None:
            self.set_logger(logger, flush = False)



    def store(self, message, logging_level):
        self.tmp_logs.append( (message, logging_level) )

    def __call__(self, message, logging_level = "INFO", logging_dict = {}):
        #type: (str, str, dict, list) -> str
        
        #print(s)

        if logging_dict == {} and hasattr(self, 'logger'): 
            logging_dict = dict( DEBUG = self.logger.debug
                                ,INFO = self.logger.info
                                ,WARNING = self.logger.warning
                                ,ERROR = self.logger.error
                                ,CRITICAL = self.logger.critical
                                )

        logging_level = logging_level.upper()
        if logging_level in logging_dict:
            logging_dict[logging_level](message)
        else:
            self.store(message, logging_level)

        return logging_level + ' : ' + message + ' '

    def flush(self):
        tmp_logs = self.tmp_logs[:] # __call__ might cache back to tmp_logs
        self.tmp_logs[:] = [] # Mutate list initialised with
        for tmp_log_message, tmp_log_level in tmp_logs:
            self.__call__(tmp_log_message, tmp_log_level)

output = Output()





# We only know the sDNA version to import as a string.  This is more secure too.
def strict_import(  module_name = ''
                   ,folder = ''
                   ,sub_folder = ''
                   ,output = output
                   ,search_folder_only = False
                   ):

    # type: (str, str, str, function, bool) -> type[any]
    #
    if module_name == '':
        output('No module to import','INFO')
        return None
    output(module_name,'DEBUG')
    if module_name in sys.modules:   # sys.modules is also shared between GHPython components 
                                     # (and is even saved until Rhino is closed).
        output('Module ' + module_name + ' already in sys.modules.  ','DEBUG')
        if reload_config_and_other_modules_if_already_loaded:
            output('Reloading ' +  module_name  + '.... ','DEBUG')
            reload(sys.modules[module_name]) # type: ignore
        return sys.modules[module_name]
    #
    #
    # Load module_name for first time:
    #
    #
    search_path = os.path.join(folder, sub_folder)

    tmp = sys.path
    if search_path and isinstance(search_path, str) and os.path.isdir(search_path):
        output('Search path == ' + search_path, 'DEBUG')
        if search_folder_only:
            sys.path = [search_path]
        else:
            sys.path.insert(0, search_path)
    else:
        output('Invalid search path : ' + search_path, 'DEBUG')
        if search_folder_only:
            return None

    output('Trying import... ','DEBUG')
    module = import_module(module_name, '')           
    sys.path = tmp
    return module       



def load_modules(m_names, path_lists):
    m_names = m_names if isinstance(m_names, tuple) else [m_names] 
    output('m_names == ' + str(m_names) + ' of type : ' + type(m_names).__name__,'DEBUG')
    if any((name.startswith('.') or name.startswith('..')) in name for name in m_names):
        output(m_names,'DEBUG')
        raise ImportError( output('Relative import attempted, but not supported','CRITICAL') )

    output('Testing paths : ' + '\n'.join(map(str,path_lists)),'DEBUG')
    output('Type(path_lists) : ' + type(path_lists).__name__,'DEBUG')


    for path_list in path_lists:
        test_paths = path_list if isinstance(path_list, list) else [path_list]
        test_paths = test_paths[:]
        output('Type(path_list) : ' + type(path_list).__name__,'DEBUG')
        output('Type(test_paths) : ' + type(test_paths).__name__,'DEBUG')

        for path in test_paths:
            output('Type(path) : ' + type(path).__name__ + ' path == ' + path,'DEBUG')
            if os.path.isfile(path):
                path = os.path.dirname(path)
            if all( any(os.path.isfile(os.path.join(path, name.replace('.', os.sep) + ending)) 
                        for ending in ['.py','.pyc'] 
                        )
                    for name in m_names
                ):
                output('Importing ' + str(m_names) +' ','DEBUG')
                return tuple(strict_import(name, path, '') for name in m_names) + (path,)
                # tuple of modules, followed by the path to them
    return None


if __name__ == '__main__': # False in a compiled component.  But then the user
                           # can't add or remove Params to the component.  
    
    # Grasshopper will look for class MyComponent(component) in global scope
    # so a main function is a little tricky to define.

    from ghpythonlib.componentbase import executingcomponent as component
    import Grasshopper
    import scriptcontext as sc
    # Do Grasshopper API imports here separately to
    # Let the above functions be accessed outside the GhPython


    sDNA_GH_search_paths = [ os.path.join(Grasshopper.Folders.DefaultUserObjectFolder
                                         , sDNA_GH_subfolder
                                         ) 
                           ]
                                            #join(Grasshopper.Folders.DefaultAssemblyFolder, sDNA_GH_subfolder) ]  
                                            # Grasshopper.Folders.AppDataFolder + r'\Libraries'
                                            # %appdata%  + r'\Grasshopper\Libraries'
                                            # os.getenv('APPDATA') + r'\Grasshopper\Libraries'
                                            # Grasshopper.Folders.AppDataFolder + r'\UserObjects'
                                            # %appdata%  + r'\Grasshopper\UserObjects'
                                            # os.getenv('APPDATA') + r'\Grasshopper\UserObjects'

    sDNA_GH_search_paths += [os.path.join(Grasshopper.Folders.DefaultAssemblyFolder
                                         ,sDNA_GH_subfolder
                                         ) 
                            ]  # Might need to install sDNA_GH 
                               # in \Grasshopper\Libraries in Rhino 6?

    nick_name = ghenv.Component.NickName #type: ignore


    sc.doc = ghdoc #type: ignore

    print(sDNA_GH_search_paths)

    class sDNA_GH:
        pass
    sDNA_GH.setup, _ = load_modules(sDNA_GH_package + '.setup'
                             ,sDNA_GH_search_paths
                             )         


    logger = sDNA_GH.setup.logger.getChild('launcher')
    output.set_logger(logger, flush = True)


    class MyComponent(component):
        pass  # Required.  Idiomatic to Grasshopper.  Must be called "MyComponent"  
            # too, otherwise Grasshopper may not find the class building on 
            # component.  Despite component being passed to the class decorator
            # and overwriting this very class immediately below.  
            # Initial parser step / scope check trips this?

    MyComponent = sDNA_GH.setup.sDNA_GH_Component


    if nick_name.replace(' ','').replace('_','').lower() == 'selftest':  

        if sys.argv[0].endswith(os.path.join(sDNA_GH_package,'__main__.py')):   
            from .tests.unit_tests import unit_tests_sDNA_GH
        else:
            unit_tests_sDNA_GH, _ = load_modules('sDNA_GH.tests.unit_tests.unit_tests_sDNA_GH'
                                                ,sDNA_GH_search_paths
                                                )

        MyComponent._RunScript = MyComponent.RunScript
        MyComponent.RunScript = unit_tests_sDNA_GH.run_launcher_tests
# ---------- end write_shp ----------
python = Python(go=Toggle(False), config=config)  # -> out, OK, opts, names; inputs go: list, opts: list; same code as write_shp
sdna_integral = SDNA_Integral(go=write_shp.OK, file=write_shp.file)  # -> OK, opts, file; inputs go: list, opts: list, file: list, config: list; same code as write_shp
txt = Text("MGLEn")
read_shp = Read_Shp(go=sdna_integral.OK, file=sdna_integral.file, Geom=flatten_2)  # -> OK, opts, Geom, Data, gdm, abbrevs, fields, bbox; inputs go: list, opts: list, file: list, Geom: list; same code as write_shp
list = ValueList({"ID", "LConn", "LLen", "LFrac", "LAC", "LSin", "LBear", "MEDn", "NQPDEn", "BtEn", "TPBtEn", "TPDn", "Lnkn", "Lenn", "AngDn", "Wtn", "MGLEn", "MCFn", "DivEn"}, selected="MGLEn")
panel = Panel(read_shp.abbrevs)
parse_data = Parse_Data(go=read_shp.OK, Geom=read_shp.Geom, Data=read_shp.Data, field=list)  # -> out, OK, opts, plot_min, plot_max, Data, Geom, gdm; inputs go: list, opts: list, Geom: list, Data: tree, field: list, plot_max: list, plot_min: list, class_bounds: list
# ---------- parse_data: Python ----------
#! /usr/bin/python as module, Grasshopper Python as script / main
# -*- coding: utf-8 -*-
__author__ = 'James Parrott'
__version__ = '0.02'


import os, sys
from importlib import import_module
if (not hasattr(__builtins__, 'reload') 
    and (isinstance(__builtins__, dict) 
         and 'reload' not in __builtins__ )):  
    from importlib import reload 
    # reload was builtin until Python 3.4
    # __builtins__ is a dict in GhPython not a module as elsewhere


sDNA_GH_subfolder = 'sDNA_GH' 
sDNA_GH_package = 'sDNA_GH'               
reload_config_and_other_modules_if_already_loaded = False


# There may be multiple components, all running this same launcher code.
# Therefore we want the root logger to live in the sDNA_GH.setup module
# that they each import.  Te logging system is configurable by the user,
# but only through the options that are read in during the main package
# import, and we want to create logs before this too.  So before a 
# component has imported sDNA_GH.setup, logging is routed through output, 
# a callable instance of Output, with a cache, defined below.  output's cache 
# is flushed through the normal logging system, after a logger has been set up 
# according to the user's configuration, after the main package import.
#
# This Output class is used to define two Classes from this single 
# code definition.  Python scripts can happily import themselves, but here
# this is because all the code in this file 
# must be read into a GhPython component via its the code input (which 
# essentially copy and pastes it to there).
# The first function definition is when the code in this file runs 
# in a GH component.  
# The second function definition is during import of sDNA_GH below, 
# as it itself imports this function from .launcher
# Therefore there really are two functions in Python, with two separate caches.
#
# The behaviours can be different of course if changes are made to one and not
# the other, e.g. if the code is forgotten to be copied into the component.

class Output(object): 

    def set_logger(self, logger, flush = True):
        self.logger = logger
        if flush and self.tmp_logs:
            self.flush()

    def __init__(self
                ,tmp_logs = None
                ,logger = None
                ):
        if not isinstance(tmp_logs, list): #assert not isinstance(None, list)
            tmp_logs = []
        self.tmp_logs = tmp_logs
        if logger is not None:
            self.set_logger(logger, flush = False)



    def store(self, message, logging_level):
        self.tmp_logs.append( (message, logging_level) )

    def __call__(self, message, logging_level = "INFO", logging_dict = {}):
        #type: (str, str, dict, list) -> str
        
        #print(s)

        if logging_dict == {} and hasattr(self, 'logger'): 
            logging_dict = dict( DEBUG = self.logger.debug
                                ,INFO = self.logger.info
                                ,WARNING = self.logger.warning
                                ,ERROR = self.logger.error
                                ,CRITICAL = self.logger.critical
                                )

        logging_level = logging_level.upper()
        if logging_level in logging_dict:
            logging_dict[logging_level](message)
        else:
            self.store(message, logging_level)

        return logging_level + ' : ' + message + ' '

    def flush(self):
        tmp_logs = self.tmp_logs[:] # __call__ might cache back to tmp_logs
        self.tmp_logs[:] = [] # Mutate list initialised with
        for tmp_log_message, tmp_log_level in tmp_logs:
            self.__call__(tmp_log_message, tmp_log_level)

output = Output()





# We only know the sDNA version to import as a string.  This is more secure too.
def strict_import(  module_name = ''
                   ,folder = ''
                   ,sub_folder = ''
                   ,output = output
                   ,search_folder_only = False
                   ):

    # type: (str, str, str, function, bool) -> type[any]
    #
    if module_name == '':
        output('No module to import','INFO')
        return None
    output(module_name,'DEBUG')
    if module_name in sys.modules:   # sys.modules is also shared between GHPython components 
                                     # (and is even saved until Rhino is closed).
        output('Module ' + module_name + ' already in sys.modules.  ','DEBUG')
        if reload_config_and_other_modules_if_already_loaded:
            output('Reloading ' +  module_name  + '.... ','DEBUG')
            reload(sys.modules[module_name]) # type: ignore
        return sys.modules[module_name]
    #
    #
    # Load module_name for first time:
    #
    #
    search_path = os.path.join(folder, sub_folder)

    tmp = sys.path
    if search_path and isinstance(search_path, str) and os.path.isdir(search_path):
        output('Search path == ' + search_path, 'DEBUG')
        if search_folder_only:
            sys.path = [search_path]
        else:
            sys.path.insert(0, search_path)
    else:
        output('Invalid search path : ' + search_path, 'DEBUG')
        if search_folder_only:
            return None

    output('Trying import... ','DEBUG')
    module = import_module(module_name, '')           
    sys.path = tmp
    return module       



def load_modules(m_names, path_lists):
    m_names = m_names if isinstance(m_names, tuple) else [m_names] 
    output('m_names == ' + str(m_names) + ' of type : ' + type(m_names).__name__,'DEBUG')
    if any((name.startswith('.') or name.startswith('..')) in name for name in m_names):
        output(m_names,'DEBUG')
        raise ImportError( output('Relative import attempted, but not supported','CRITICAL') )

    output('Testing paths : ' + '\n'.join(map(str,path_lists)),'DEBUG')
    output('Type(path_lists) : ' + type(path_lists).__name__,'DEBUG')


    for path_list in path_lists:
        test_paths = path_list if isinstance(path_list, list) else [path_list]
        test_paths = test_paths[:]
        output('Type(path_list) : ' + type(path_list).__name__,'DEBUG')
        output('Type(test_paths) : ' + type(test_paths).__name__,'DEBUG')

        for path in test_paths:
            output('Type(path) : ' + type(path).__name__ + ' path == ' + path,'DEBUG')
            if os.path.isfile(path):
                path = os.path.dirname(path)
            if all( any(os.path.isfile(os.path.join(path, name.replace('.', os.sep) + ending)) 
                        for ending in ['.py','.pyc'] 
                        )
                    for name in m_names
                ):
                output('Importing ' + str(m_names) +' ','DEBUG')
                return tuple(strict_import(name, path, '') for name in m_names) + (path,)
                # tuple of modules, followed by the path to them
    return None


if __name__ == '__main__': # False in a compiled component.  But then the user
                           # can't add or remove Params to the component.  
    
    # Grasshopper will look for class MyComponent(component) in global scope
    # so a main function is a little tricky to define.

    from ghpythonlib.componentbase import executingcomponent as component
    import Grasshopper
    import scriptcontext as sc
    # Do Grasshopper API imports here separately to
    # Let the above functions be accessed outside the GhPython


    sDNA_GH_search_paths = [ os.path.join(Grasshopper.Folders.DefaultUserObjectFolder
                                         , sDNA_GH_subfolder
                                         ) 
                           ]
                                            #join(Grasshopper.Folders.DefaultAssemblyFolder, sDNA_GH_subfolder) ]  
                                            # Grasshopper.Folders.AppDataFolder + r'\Libraries'
                                            # %appdata%  + r'\Grasshopper\Libraries'
                                            # os.getenv('APPDATA') + r'\Grasshopper\Libraries'
                                            # Grasshopper.Folders.AppDataFolder + r'\UserObjects'
                                            # %appdata%  + r'\Grasshopper\UserObjects'
                                            # os.getenv('APPDATA') + r'\Grasshopper\UserObjects'

    sDNA_GH_search_paths += [os.path.join(Grasshopper.Folders.DefaultAssemblyFolder
                                         ,sDNA_GH_subfolder
                                         ) 
                            ]  # Might need to install sDNA_GH 
                               # in \Grasshopper\Libraries in Rhino 6?

    nick_name = ghenv.Component.NickName #type: ignore


    sc.doc = ghdoc #type: ignore

    print(sDNA_GH_search_paths)

    class sDNA_GH(object):
        pass
    sDNA_GH.setup, _ = load_modules(sDNA_GH_package + '.setup'
                             ,sDNA_GH_search_paths
                             )         


    logger = sDNA_GH.setup.logger.getChild('launcher')
    output.set_logger(logger, flush = True)


    class MyComponent(component):
        pass  # Required.  Idiomatic to Grasshopper.  Must be called "MyComponent"  
            # too, otherwise Grasshopper may not find the class building on 
            # component.  Despite component being passed to the class decorator
            # and overwriting this very class immediately below.  
            # Initial parser step / scope check trips this?

    MyComponent = sDNA_GH.setup.sDNA_GH_Component


    if nick_name.replace(' ','').replace('_','').lower() == 'selftest':  

        if sys.argv[0].endswith(os.path.join(sDNA_GH_package,'__main__.py')):   
            from .tests.unit_tests import unit_tests_sDNA_GH
        else:
            unit_tests_sDNA_GH, _ = load_modules('sDNA_GH.tests.unit_tests.unit_tests_sDNA_GH'
                                                ,sDNA_GH_search_paths
                                                )

        MyComponent._RunScript = MyComponent.RunScript
        MyComponent.RunScript = unit_tests_sDNA_GH.run_launcher_tests
# ---------- end parse_data ----------
gradient = Gradient(
    LowerLimit=parse_data.plot_min,
    UpperLimit=parse_data.plot_max,
    Parameter=parse_data.Data,
    stops=[0: RGB(243, 57, 0), 0.1: RGB(236, 27, 60), 0.2: RGB(210, 0, 118), 0.3: RGB(103, 0, 120), 0.4: RGB(39, 72, 161), 0.5: RGB(1, 192, 229), 0.6: RGB(18, 178, 90), 0.7: RGB(79, 186, 8), 0.8: RGB(220, 237, 32), 0.9: RGB(247, 159, 20), 1: RGB(243, 57, 0)])
unload_sdna = Unload_sDNA(unload=Button())
# ---------- unload_sdna: Python ----------
#! Grasshopper Python
# -*- coding: utf-8 -*-
__author__ = 'James Parrott'
__version__ = '0.00'

import sys, os, Grasshopper, logging
from ghpythonlib.componentbase import executingcomponent as component
import Grasshopper, GhPython
import System
import Rhino
import rhinoscriptsyntax as rs

class MyComponent(component):
    
    def RunScript(self, unload, update):
        import sys
        #print('\n'.join([key for key in sys.modules if 'sDNA' in key]))
        #print('functools' in sys.modules)
        print('sDNA_GH packages and modules in sys.modules:')
        print('\n'.join([key for key in sys.modules if 'sdna' in key.lower()]))# and not '.' in key]))
        #print os.getenv('APPDATA')
        #print ghdoc.Path
        #print Grasshopper.Folders.DefaultAssemblyFolder
        #print Grasshopper.Folders.AppDataFolder
        #print sys.argv[0]
        #print("Classmethod found == " + str('classmethod' in __builtins__))
        def is_imported(s):
            return s in sys.modules
        if unload == True:
            if 'logging' in sys.modules:
                sys.modules['logging'].shutdown()
            shared_cached_modules_etc = sys.modules.copy().keys()
            for y in shared_cached_modules_etc:
                if 'sDNA' in y or y == 'runsdnacommand':
                    del sys.modules[y]
        
        
                
        print('sDNA_GH imported == ' + str(is_imported('sDNA_GH')))
        print('sDNA_GH.tools imported == ' + str(is_imported('sDNA_GH.tools')))
        print('sDNAUISpec imported == ' + str(is_imported('sDNAUISpec')))
        print('runsdnacommand == ' + str(is_imported('runsdnacommand')))
        if False: #is_imported('sDNA_GH'):
            print sys.modules['sDNA_GH'].__all__
            print dir(sys.modules['sDNA_GH'])
            if is_imported('sDNA_GH.tools'):
                print dir(sys.modules['sDNA_GH.tools'])
            if hasattr(sys.modules['sDNA_GH'],'third_party_python_modules'):
                print dir(sys.modules['sDNA_GH'].third_party_python_modules)
        
        #print sys.modules.keys()
        #print os.getcwd()
        #print sys.path[0]
        #print 'a' in globals()
        #a = "This is a!"
        #print('\n'.join(dir(sys.modules['sDNA_GH'].third_party_python_modules)))
        
        return
# ---------- end unload_sdna ----------
recolour_objects = Recolour_Objects(
    go=parse_data.OK,
    plot_min=parse_data.plot_min,
    plot_max=parse_data.plot_max,
    Data=gradient,
    Geom=parse_data.Geom,
    bbox=read_shp.bbox)  # -> OK, opts, Geom, Data, leg_cols, leg_tags, leg_frame; inputs go: list, opts: list, plot_min: list, plot_max: list, Data: tree, Geom: list, bbox: list, field: list; same code as write_shp
preview = CustomPreview(Geometry=flatten, Material=recolour_objects.Data)
legend = Legend(Colour=recolour_objects.leg_cols, Tags=recolour_objects.leg_tags, Rectangle=recolour_objects.leg_frame, LegendType=1)
