# Grasshopper definition sDNA_GH.gh (Grasshopper 1.0.7)

toggle = BooleanToggle(False)
python = GhPythonScript()  # -> out, a
# ---------- python: Python ----------
#! /usr/bin/python2.7
# -*- coding: utf-8 -*-
__author__ = 'James Parrott'
__version__ = '0.00'
__copyright__ = 'Cardiff University'
__license__ = {  'Python standard library modules and ' : 'Python Software Foundation 2.7.18' # https://docs.python.org/2.7/license.html
                ,'wrapper_logging' : 'Python Software Foundation 2.7.18'
                ,'wrapper_pyshp' : 'MIT' # https://pypi.org/project/pyshp/ 
                ,'sDNAUISpec.py' : 'MIT' # https://github.com/fiftysevendegreesofrad/sdna_open/blob/master/LICENSE.md
                ,'everything else' : 'same as for sDNA ' # https://sdna.cardiff.ac.uk/sdna/legal-license/ 
               }

#import sys

#print '\n'.join(map(str,sys.modules.keys()))

#from GHsDNA import import_module_or_search_for_it
#wrapper_logging = import_module_or_search_for_it('wrapper_logging','custom_python_modules')

import rhinoscriptsyntax as rs
import scriptcontext as sc
import Rhino
sc.doc=Rhino.RhinoDoc.ActiveDoc
rhino_doc_curves=rs.ObjectsByType(4, select=False, state=0) # 4 => Curves

item_0 = rhino_doc_curves[0]
print item_0
print str(item_0)
print type(item_0)
# ---------- end python ----------
python_2 = GhPythonScript(go=Button())  # -> out, a
# ---------- python_2: Python ----------
#! /usr/bin/python2.7
# -*- coding: utf-8 -*-
__author__ = 'James Parrott'
__version__ = '0.00'
__copyright__ = 'Cardiff University'
__license__ = {  'Python standard library modules and ' : 'Python Software Foundation 2.7.18' # https://docs.python.org/2.7/license.html
                ,'wrapper_logging' : 'Python Software Foundation 2.7.18'
                ,'wrapper_pyshp' : 'MIT' # https://pypi.org/project/pyshp/ 
                ,'sDNAUISpec.py' : 'MIT' # https://github.com/fiftysevendegreesofrad/sdna_open/blob/master/LICENSE.md
                ,'everything else' : 'same as for sDNA ' # https://sdna.cardiff.ac.uk/sdna/legal-license/ 
               }


from ghpythonlib.componentbase import executingcomponent as component
import Grasshopper, GhPython
import System
import Rhino
import rhinoscriptsyntax as rs

import GHsDNA

class MyComponent(component):
    def RunScript(self, go, *args):
        #y = globals().copy(); 
        #print([x for x in y if not x.startswith('__') ])        
        #z = locals().copy();
        #print([x for x in z if not x.startswith('__') ])
        if go == True:
            reload(GHsDNA)
            return GHsDNA.main_sequence(ghenv, args)
        else:
            return "go == " + str(go)
# ---------- end python_2 ----------
panel = Panel(python_2.a)
panel_2 = Panel(python_2.out)
