# Grasshopper definition Rhino_8_API_tests.gh (Grasshopper 1.0.8)

check_read_usertext = Unload_sDNA()  # -> out, a; disabled
# ---------- check_read_usertext: Python ----------
import Grasshopper

GH_DOC = ghdoc.Component.Attributes.DocObject.OnPingDocument()


def GH_doc_components(doc = GH_DOC):
    return {component.NickName : component
            for component in doc.Objects
           }
         
Read_Usertext = GH_doc_components()['Read_Usertext']


Data_Read = next(param
             for param in Read_Usertext.Params.Output
             if param.NickName == 'Data'
            )

Data_read_from_geom = Grasshopper.DataTree[object]()
for path in Data_Read.VolatileData.Paths:
    branch = Data_Read.VolatileData.Branch[path]
    for item in branch:
        Data_read_from_geom.Add(item, path)
        
a = Data_read_from_geom
# ---------- end check_read_usertext ----------
unload_sdna = Unload_sDNA(unload=Button())  # -> out, a
# ---------- unload_sdna: Python ----------
#! /usr/bin/awk NR==3
# -*- coding: utf-8 -*-
# This module requires Grasshopper Python (Rhino3D)

# MIT License

# Copyright (c) [2021] [Cardiff University, a body incorporated
# by Royal Charter and a registered charity (number:
# 1136855) whose administrative offices are at 7th floor 30-
# 36 Newport Road, UniversityCF24 0DE, Wales, UK]

# Permission is hereby granted, free of charge, to any person obtaining a copy
# of this software and associated documentation files (the "Software"), to deal
# in the Software without restriction, including without limitation the rights
# to use, copy, modify, merge, publish, distribute, sublicense, and/or sell
# copies of the Software, and to permit persons to whom the Software is
# furnished to do so, subject to the following conditions:

# The above copyright notice and this permission notice shall be included in all
# copies or substantial portions of the Software.

# THE SOFTWARE IS PROVIDED "AS IS", WITHOUT WARRANTY OF ANY KIND, EXPRESS OR
# IMPLIED, INCLUDING BUT NOT LIMITED TO THE WARRANTIES OF MERCHANTABILITY,
# FITNESS FOR A PARTICULAR PURPOSE AND NONINFRINGEMENT. IN NO EVENT SHALL THE
# AUTHORS OR COPYRIGHT HOLDERS BE LIABLE FOR ANY CLAIM, DAMAGES OR OTHER
# LIABILITY, WHETHER IN AN ACTION OF CONTRACT, TORT OR OTHERWISE, ARISING FROM,
# OUT OF OR IN CONNECTION WITH THE SOFTWARE OR THE USE OR OTHER DEALINGS IN THE
# SOFTWARE.

""" Unload the sDNA_GH Python package and all sDNA modules, by removing them from GhPython's shared cache (sys.modules).  The 
    next sDNA_GH component to run will then reload the package and installation-wide options file (config.toml), and any specified 
    options including a project specific config.toml, without otherwise having to restart Rhino to clear its cache.
"""

__author__ = 'James Parrott'
__version__ = '2.0'


from ghpythonlib.componentbase import executingcomponent as component

class MyComponent(component):
    
    def RunScript(self, unload, update):
        import sys  #Imported here to avoid weird bug 
                    # (unloading/forgetting of sys - IronPython only?)
        #https://discourse.mcneel.com/t/failed-import-of-sys-library-in-ghpython/98696


        print('sDNA_GH packages and modules in sys.modules:')
        print('\n'.join([key for key in sys.modules if 'sdna' in key.lower()]))
        def is_imported(s):
            return s in sys.modules
        if unload is True:
            if 'logging' in sys.modules:
                sys.modules['logging'].shutdown()
            shared_cached_modules_etc = sys.modules.copy().keys()
            for y in shared_cached_modules_etc:
                if any(s in y.lower() for s in ['sdna', 'mapclassif', 'anteater']):
                    del sys.modules[y]
        
        
                
        print('sDNA_GH imported == %s' % is_imported('sDNA_GH'))
        print('sDNA_GH.tools imported == %s' % is_imported('sDNA_GH.tools'))
        print('sDNAUISpec imported == %s' % is_imported('sDNAUISpec'))
        print('runsdnacommand == %s' % is_imported('runsdnacommand'))

        
        return
# ---------- end unload_sdna ----------
panel = Panel("sDNA_GH_API_test_all")

# ---- group: Recolour objects helpers
dom = ConstructDomain(DomainStart=0, DomainEnd=1)
gradient = Gradient(
    LowerLimit=0,
    UpperLimit=1,
    stops=[0: RGB(243, 57, 0), 0.1: RGB(236, 27, 60), 0.2: RGB(210, 0, 118), 0.3: RGB(103, 0, 120), 0.4: RGB(39, 72, 161), 0.5: RGB(1, 192, 229), 0.6: RGB(18, 178, 90), 0.7: RGB(79, 186, 8), 0.8: RGB(220, 237, 32), 0.9: RGB(247, 159, 20), 1: RGB(243, 57, 0)])
random = Random(Range=Domain(0, 1), Number=1, Seed=2)

# ----
read_geom = Read_Geom()  # -> out
# ---------- read_geom: Python ----------
#! /usr/bin/awk NR==3
# -*- coding: utf-8 -*-
# This module requires Grasshopper Python (Rhino3D)

# MIT License

# Copyright (c) [2021] [Cardiff University, a body incorporated
# by Royal Charter and a registered charity (number:
# 1136855) whose administrative offices are at 7th floor 30-
# 36 Newport Road, University CF24 0DE, Wales, UK]

# Permission is hereby granted, free of charge, to any person obtaining a copy
# of this software and associated documentation files (the "Software"), to deal
# in the Software without restriction, including without limitation the rights
# to use, copy, modify, merge, publish, distribute, sublicense, and/or sell
# copies of the Software, and to permit persons to whom the Software is
# furnished to do so, subject to the following conditions:

# The above copyright notice and this permission notice shall be included in all
# copies or substantial portions of the Software.

# THE SOFTWARE IS PROVIDED "AS IS", WITHOUT WARRANTY OF ANY KIND, EXPRESS OR
# IMPLIED, INCLUDING BUT NOT LIMITED TO THE WARRANTIES OF MERCHANTABILITY,
# FITNESS FOR A PARTICULAR PURPOSE AND NONINFRINGEMENT. IN NO EVENT SHALL THE
# AUTHORS OR COPYRIGHT HOLDERS BE LIABLE FOR ANY CLAIM, DAMAGES OR OTHER
# LIABILITY, WHETHER IN AN ACTION OF CONTRACT, TORT OR OTHERWISE, ARISING FROM,
# OUT OF OR IN CONNECTION WITH THE SOFTWARE OR THE USE OR OTHER DEALINGS IN THE
# SOFTWARE.



"""Gets real strings of the uuid references to Rhino polylines and degree-1 Nurbs curves for subsequent sDNA_GH tools.  Grasshopper Geom and Curve params create Grasshopper references to Rhino objects.  The actual Rhino uuid is required to read and write User Text on a
Rhino object.

Set `selected` to true, to only read objects that are selected.  Similarly, specify `layer` to the name of a layer, to only read objects from that layer.  

Note, if `sync = True` it will remember its previous setting, in which case to go back to selecting all layers, `layer` must be set to any value that is not the name of a layer.  Similarly, to go back to selecting everything (not just selected geometry) set `selected = false`.  If the component has `sync = false`, an input Params that has had its value set, when subsequently disconnected will fallback to whatever its previous value was. 
"""

__authors__ = {'James Parrott', 'Crispin Cooper'}
__version__ = '3.0.0.alpha_4'



import sys
import os
import functools
import importlib

from ghpythonlib.componentbase import executingcomponent as component
import Grasshopper
import scriptcontext as sc

import_module = importlib.import_module
try:
    reload #type: ignore
except NameError:
    reload = importlib.reload

try:
    basestring #type: ignore
except NameError:
    basestring = str

try:
    ghdoc #type: ignore
except NameError:
    from .skel.basic.ghdoc import ghdoc

ZIP_FILE_NAME = 'sdna-gh'
PACKAGE_NAME = 'sDNA_GH'
PLUG_IN_NAME = 'sDNA'               
RELOAD_IF_ALREADY_IMPORTED = False
REPOSITORY = os.path.dirname(os.path.dirname(ghdoc.Path)) if ghdoc.Path else None
# Assume we are in repo_folder/dev/sDNA_build_components.gh

SELFTEST = 'selftest'
APITEST_PREFIX = 'sDNA_GH_API_test_'
DEPS = ['toml_tools', 'shapefile', 'mapclassif_Iron']

def get_dir_of_python_package_containing_ghuser():
    # This could be foiled by multiple sDNA_GH installations.

    gh_comp_server = Grasshopper.Kernel.GH_ComponentServer()

    for file_ in gh_comp_server.ExternalFiles(True, True):
        path = file_.FilePath
        if PACKAGE_NAME in path:
            break
        #
    else: # for loop did not break
        return None

    dir_ = os.path.dirname(path)

    while PACKAGE_NAME in dir_:
        dir_ = os.path.dirname(dir_)

    return dir_



class Output(object): 

    def set_logger(self, logger, flush = True):
        self.logger = logger
        if flush and self.tmp_logs:
            self.flush()

    def __init__(self
                ,tmp_logs = None
                ,logger = None
                ):
        if not isinstance(tmp_logs, list): #assert not isinstance(None, list)
            tmp_logs = []
        self.tmp_logs = tmp_logs
        self.set_logger(logger, flush = False)



    def store(self, message, logging_level):
        self.tmp_logs.append( (message, logging_level) )

    def __call__(self, message, logging_level = "INFO", logging_dict = {}):
        #type: (str, str, dict, list) -> str
        
        #logger.debug(s)

        if logging_dict == {} and self.logger is not None: 
            logging_dict = dict( DEBUG = self.logger.debug
                                ,INFO = self.logger.info
                                ,WARNING = self.logger.warning
                                ,ERROR = self.logger.error
                                ,CRITICAL = self.logger.critical
                                )

        logging_level = logging_level.upper()
        if logging_level in logging_dict:
            logging_dict[logging_level](message)
        else:
            self.store(message, logging_level)

        return '%s : %s ' % (logging_level, message)

    def __getattr__(self, attr):
        return functools.partial(self.__call__, logging_level = attr.upper())

    def flush(self):
        tmp_logs = self.tmp_logs[:] # __call__ might cache back to tmp_logs
        self.tmp_logs[:] = [] # Mutate list initialised with.  Avoid double 
                              # logging in case re - stored in tmp_logs
        for tmp_log_message, tmp_log_level in tmp_logs:
            self.__call__(tmp_log_message, tmp_log_level)

output = Output()


class InvalidArgsError(Exception):
    
    """Custom exception to log the error message, and to at least allow 
       attempts to give users actionable advice to fix the issue, in 
       the event of a problem.  
    """
    message_fmt = 'Invalid import args: %s'
    def __init__(self
                ,message_fmt = ''
                ,message = ''
                ,logger = output
                , **kwargs
                ):
        if message_fmt and isinstance(message_fmt, basestring):
            self.message_fmt = message_fmt
        if kwargs and (not message or not isinstance(message, basestring)):
            message = self.message_fmt % kwargs
        logger.error(message)
        self.kwargs = kwargs
        super(InvalidArgsError, self).__init__(message)    


class ModuleNameError(InvalidArgsError):
    message_fmt = 'Invalid module name: %s'


class FilePathError(InvalidArgsError):
    message_fmt = 'Invalid path to import module from: %s'


# We only know the sDNA version to import as a string.  This is more secure too.
def strict_import(module_name = ''
                 ,folder = ''
                 ,sub_folder = ''
                 ,logger = output
                 ,reload_already_imported = RELOAD_IF_ALREADY_IMPORTED
                 ):

    # type: (str, str, str, type[any], bool) -> type[any]
    """ Imports the named module from the specified folder\subfolder only, 
        and returns it.
        
        Avoids name clashes and casual hijack attempts.  In some 
        environments supporting a Python implementation (such as 
        GhPython in Grasshopper) it may not be desirable to ask the user 
        to set PYTHONPATH.  Hence here, we insert the specified folder
        into sys.path (if they are not already in there).
    """
    if not module_name or not isinstance(module_name, basestring):
        raise ModuleNameError(module_name = module_name
                             ,folder = folder
                             ,sub_folder = sub_folder
                             ,logger = logger
                             )
    logger.debug(module_name)
    if module_name in sys.modules:   # sys.modules is also shared between GHPython components 
                                     # (and is even saved until Rhino is closed).
        logger.debug('Module %s already in sys.modules' % module_name)
        if reload_already_imported:
            logger.debug('Reloading %s.... ' % module_name)
            reload(sys.modules[module_name]) # type: ignore
        return sys.modules[module_name]
    #
    #
    # Load module_name for first time:
    #
    #
    search_path = os.path.join(folder, sub_folder)

    if (search_path 
        and isinstance(search_path, basestring) 
        and os.path.isdir(search_path)):
        #
        logger.debug('Search path == %s' % search_path)
        #if search_folder_only:
        #    sys.path = [search_path]
        if search_path not in sys.path:
            logger.warning('Prepending sys.path with: %s' % search_path)
            sys.path.insert(0, search_path)
    else:
        raise FilePathError(module_name = module_name
                           ,search_path = search_path
                           ,logger = logger
                           )

    logger.debug('Trying import... ')
    module = import_module(module_name, '')           

    return module       


class ModulesNotFoundError(InvalidArgsError):
    message_fmt = 'Modules not found in any location %s'


def load_modules(m_names
                ,folders
                ,logger = output
                ,module_name_error_msg = 'Please supply valid names of modules to import, %s'
                ,folders_error_msg = 'Please supply valid folders to import from. %s'
                ,modules_not_found_msg = 'Specified modules not found in any folder, %s'
                ):
    #type(str/ Iterable, list, type[any], str, str) -> tuple / None
    """ Tries to import all modules in m_names, from the first folder in 
        folders to contain a .py or .pyc files with the same name as each 
        module.

        Returns a tuple of all the modules and the path they were found in.  Else 
        raises a ModulesNotFoundError.
    """
    if not m_names:
        raise ModuleNameError(message_fmt = 'No module names supplied, m_names = %s'
                             ,m_names = m_names
                             ,logger = logger
                             )

    if any( not isinstance(m_name, basestring) for m_name in m_names ):
        # if m_names is a basestring, the error is not raised 
        raise ModuleNameError(message_fmt = module_name_error_msg
                             ,m_names = m_names
                             ,logger = logger
                             )
    
    if isinstance(m_names, basestring):
        m_names = [m_names] 

    logger.debug('m_names == %s of type : %s' % (m_names, type(m_names).__name__))

    logger.debug('Testing paths : %s ' % folders)
    
    if isinstance(folders, basestring):
        folders = [folders]

    if not any(os.path.isdir(folder) or os.path.isdir(os.path.dirname(folder)) 
               for folder in folders
              ):
        raise FilePathError(message_fmt = folders_error_msg
                           ,m_names = m_names
                           ,logger = logger
                           )

    for folder in folders:
        logger.debug('Type(folder) : %s' % type(folder).__name__)
        logger.debug('Type(path) : %s path == %s' %(type(folder).__name__, folder))

        if os.path.isfile(folder):
            folder = os.path.dirname(folder)
        if all( any(os.path.isfile(os.path.join(folder, name.replace('.', os.sep) + ending)) 
                    for ending in ['.py','.pyc', '%s__init__.py' % os.sep ] 
                   )
                for name in m_names
              ):
            #
            logger.debug('Importing %s' % repr(m_names))

            return tuple(strict_import(name, folder, '', logger = logger) 
                         for name in m_names
                        ) + (folder,)
                   
            # tuple of modules, followed by the path to them
    raise ModulesNotFoundError(message_fmt = modules_not_found_msg
                              ,m_names = m_names
                              ,folders = folders
                              ,logger = logger
                              )




if __name__ == '__main__': # False in a compiled component.  But then the user
                           # can't add or remove Params to the component.  
    
    # Grasshopper will look for class MyComponent(component) in global scope
    # so a main() guard function is a little tricky to define.






    nick_name = ghenv.Component.NickName #type: ignore

    main_sDNA_GH_module = '%s.main' % PACKAGE_NAME

    # builder can only load sDNA_GH from its parent directory, 
    # e.g. if in a dir one level up in the main repo
    # such as sDNA_build_components.gh.
    if (REPOSITORY and 
        nick_name == 'Build_components'):
        #
        build_env_custom_deps = os.getenv('SDNA_GH_BUILD_DEPS')
        #
        load_modules(
             m_names = DEPS
            ,folders = build_env_custom_deps
            ,folders_error_msg = ('Could not find deps: %s in folder: %s'
                                 % (DEPS, build_env_custom_deps)
                                 )
            ,modules_not_found_msg = (
                                 'Failed to import deps: %s from folder: %s'
                                 % (DEPS, build_env_custom_deps)
                                 )
            )
        sDNA_GH_search_paths = [os.path.join(REPOSITORY, 'src')]
    else:
        sDNA_GH_search_paths = [get_dir_of_python_package_containing_ghuser()]
    


    sc.doc = ghdoc #type: ignore

    output.debug(sDNA_GH_search_paths)

    class sDNA_GH(object):
        pass


    if main_sDNA_GH_module in sys.modules:
        sDNA_GH.main = sys.modules[main_sDNA_GH_module]

        # Our fake module class sDNA_GH has no .__path__
        sDNA_GH_path = os.path.dirname(os.path.dirname(sDNA_GH.main.__file__))
    else:
        sDNA_GH.main, sDNA_GH_path = load_modules(
             m_names = main_sDNA_GH_module
            ,folders = sDNA_GH_search_paths
            ,folders_error_msg = ('Please unzip %s.zip '
                                 +' in the folder %s '
                                 +'and ensure a subfolder called %s is created '
                                 +'inside it, containing main.py ' 
                                 +'and all the sDNA_GH python files '
                                 +'including those within other subfolders. '
                                 ) % (ZIP_FILE_NAME
                                     ,Grasshopper.Folders.DefaultUserObjectFolder
                                     ,os.path.join(ZIP_FILE_NAME, PACKAGE_NAME)
                                     )
            ,modules_not_found_msg = ('Some sDNA_GH files may be missing.  '
                                     +'Please: 1) Copy %s.zip into: %s '
                                     +'2) Unblock it if necessary. '
                                     +'3) Right click '
                                     +'it, select Extract All... and click Extract, '
                                     +'to extract it to that location. '
                                     +'4) Ensure that main.py and all sDNA_GH python' 
                                     +' files and subfolders are inside: %s '
                                     +'5) Reinitialise the component or restart Rhino.'
                                     ) % (ZIP_FILE_NAME
                                         ,Grasshopper.Folders.DefaultUserObjectFolder
                                         ,os.path.join(Grasshopper.Folders.DefaultUserObjectFolder
                                                      ,ZIP_FILE_NAME  
                                                      ,PACKAGE_NAME
                                                      )
                                         )
            )


    logger = sDNA_GH.main.logger.getChild('launcher')
    output.set_logger(logger, flush = True)


    class MyComponent(component):
        pass  # Required.  Idiomatic to Grasshopper.  Must be called "MyComponent"  
            # too (it is looked for by the parser or scope checker?) otherwise 
            # Grasshopper may not find the subclass of on 
            # component.  Even though we overwrite this class on the next line
            # immediately below.  

    
    test_runners, __ = load_modules('%s.tests.test_running_component_classes' % PACKAGE_NAME
                                   ,sDNA_GH_path
                                   )
    log_file_dir = os.path.dirname(checkers.get_path(fallback = sDNA_GH_path))

    if nick_name.replace(' ','').replace('_','').lower() == SELFTEST:  
        MyComponent = test_runners.make_test_running_component_class(
                                            log_file_dir = log_file_dir
                                            )
    elif nick_name.startswith(APITEST_PREFIX):

        if not os.getenv('NUM_TESTS'):
            raise Exception('The environment variable: NUM_TESTS must be set. ')

        checkers, __ = load_modules('%s.skel.tools.helpers.checkers' % PACKAGE_NAME
                                   ,sDNA_GH_path
                                   )

        MyComponent = test_runners.make_noninteractive_api_test_running_component_class(
                 test_name = nick_name.partition(APITEST_PREFIX)[2]
                ,log_file_dir = log_file_dir
                )
    else:
        MyComponent = sDNA_GH.main.sDNA_GH_Component
        # Grasshopper calls MyComponent.RunScript automatically (in SDK mode GhPython components).
# ---------- end read_geom ----------
self_test = Self_test()  # -> out
# ---------- self_test: Python ----------
#! /usr/bin/awk NR==3
# -*- coding: utf-8 -*-
# This module requires Grasshopper Python (Rhino3D)

# MIT License

# Copyright (c) [2021] [Cardiff University, a body incorporated
# by Royal Charter and a registered charity (number:
# 1136855) whose administrative offices are at 7th floor 30-
# 36 Newport Road, University CF24 0DE, Wales, UK]

# Permission is hereby granted, free of charge, to any person obtaining a copy
# of this software and associated documentation files (the "Software"), to deal
# in the Software without restriction, including without limitation the rights
# to use, copy, modify, merge, publish, distribute, sublicense, and/or sell
# copies of the Software, and to permit persons to whom the Software is
# furnished to do so, subject to the following conditions:

# The above copyright notice and this permission notice shall be included in all
# copies or substantial portions of the Software.

# THE SOFTWARE IS PROVIDED "AS IS", WITHOUT WARRANTY OF ANY KIND, EXPRESS OR
# IMPLIED, INCLUDING BUT NOT LIMITED TO THE WARRANTIES OF MERCHANTABILITY,
# FITNESS FOR A PARTICULAR PURPOSE AND NONINFRINGEMENT. IN NO EVENT SHALL THE
# AUTHORS OR COPYRIGHT HOLDERS BE LIABLE FOR ANY CLAIM, DAMAGES OR OTHER
# LIABILITY, WHETHER IN AN ACTION OF CONTRACT, TORT OR OTHERWISE, ARISING FROM,
# OUT OF OR IN CONNECTION WITH THE SOFTWARE OR THE USE OR OTHER DEALINGS IN THE
# SOFTWARE.



""" Main entry point to launch sDNA_GH if run as a script from an sDNA_GH GhPython component.

    Imports the python package sDNA_GH and (re)defines the MyComponent(component) 
    class.  Grasshopper instantiates this class in each such GhPython
    component (set to SDK mode which the builder has done), then calls its 
    RunScript method. (This RunScript method is also called subsequently
    on each Param update / Grasshopper canvas recalculation).

    There may be multiple components, all running this same launcher code.
    Therefore we want the root logger to live in the sDNA_GH.main module
    that they each import.  The logging system is configurable by the user,
    but only through the options that are read in during the main package
    import, and we want to create logs before this too, in this module.  So 
    before a component has imported sDNA_GH.main, logging is routed through output, 
    a callable instance of Output, with a cache, defined below.  After a logger has 
    been set up according to the user's configuration, after the main package import,
    output's cache is flushed through the normal logging system, 

    Also, the Output class is used to define two Classes from this single 
    code definition.  Python scripts can happily import themselves, but here
    this is because launcher.py is itself part of the imported sDNA_GH python
    package, imported by launcher.py in a GhPython component.  To achieve this, the 
    code in this file needs to be copied into the sDNA_GH GhPython components 
    during building of the components (e.g. via the code input Param), 

    The behaviours can be different of course if changes are made to one and not
    the other. e.g. if updated code is forgotten to be copied into the component.

    A dummy MyComponent(component) class is defined in the script to appease
    GhPython's parser, even though the definition we use is imported from the package

    launcher.py can also run unit tests in a component named "selftest" 
"""

__authors__ = {'James Parrott', 'Crispin Cooper'}
__version__ = '3.0.0.alpha_4'



import sys
import os
import functools
import importlib

from ghpythonlib.componentbase import executingcomponent as component
import Grasshopper
import scriptcontext as sc

import_module = importlib.import_module
try:
    reload #type: ignore
except NameError:
    reload = importlib.reload

try:
    basestring #type: ignore
except NameError:
    basestring = str

try:
    ghdoc #type: ignore
except NameError:
    from .skel.basic.ghdoc import ghdoc

ZIP_FILE_NAME = 'sdna-gh'
PACKAGE_NAME = 'sDNA_GH'
PLUG_IN_NAME = 'sDNA'               
RELOAD_IF_ALREADY_IMPORTED = False
REPOSITORY = os.path.dirname(os.path.dirname(ghdoc.Path)) if ghdoc.Path else None
# Assume we are in repo_folder/dev/sDNA_build_components.gh

SELFTEST = 'selftest'
APITEST_PREFIX = 'sDNA_GH_API_test_'
DEPS = ['toml_tools', 'shapefile', 'mapclassif_Iron']

def get_dir_of_python_package_containing_ghuser():
    # This could be foiled by multiple sDNA_GH installations.

    gh_comp_server = Grasshopper.Kernel.GH_ComponentServer()

    for file_ in gh_comp_server.ExternalFiles(True, True):
        path = file_.FilePath
        if PACKAGE_NAME in path:
            break
        #
    else: # for loop did not break
        return None

    dir_ = os.path.dirname(path)

    while PACKAGE_NAME in dir_:
        dir_ = os.path.dirname(dir_)

    return dir_



class Output(object): 

    def set_logger(self, logger, flush = True):
        self.logger = logger
        if flush and self.tmp_logs:
            self.flush()

    def __init__(self
                ,tmp_logs = None
                ,logger = None
                ):
        if not isinstance(tmp_logs, list): #assert not isinstance(None, list)
            tmp_logs = []
        self.tmp_logs = tmp_logs
        self.set_logger(logger, flush = False)



    def store(self, message, logging_level):
        self.tmp_logs.append( (message, logging_level) )

    def __call__(self, message, logging_level = "INFO", logging_dict = {}):
        #type: (str, str, dict, list) -> str
        
        #logger.debug(s)

        if logging_dict == {} and self.logger is not None: 
            logging_dict = dict( DEBUG = self.logger.debug
                                ,INFO = self.logger.info
                                ,WARNING = self.logger.warning
                                ,ERROR = self.logger.error
                                ,CRITICAL = self.logger.critical
                                )

        logging_level = logging_level.upper()
        if logging_level in logging_dict:
            logging_dict[logging_level](message)
        else:
            self.store(message, logging_level)

        return '%s : %s ' % (logging_level, message)

    def __getattr__(self, attr):
        return functools.partial(self.__call__, logging_level = attr.upper())

    def flush(self):
        tmp_logs = self.tmp_logs[:] # __call__ might cache back to tmp_logs
        self.tmp_logs[:] = [] # Mutate list initialised with.  Avoid double 
                              # logging in case re - stored in tmp_logs
        for tmp_log_message, tmp_log_level in tmp_logs:
            self.__call__(tmp_log_message, tmp_log_level)

output = Output()


class InvalidArgsError(Exception):
    
    """Custom exception to log the error message, and to at least allow 
       attempts to give users actionable advice to fix the issue, in 
       the event of a problem.  
    """
    message_fmt = 'Invalid import args: %s'
    def __init__(self
                ,message_fmt = ''
                ,message = ''
                ,logger = output
                , **kwargs
                ):
        if message_fmt and isinstance(message_fmt, basestring):
            self.message_fmt = message_fmt
        if kwargs and (not message or not isinstance(message, basestring)):
            message = self.message_fmt % kwargs
        logger.error(message)
        self.kwargs = kwargs
        super(InvalidArgsError, self).__init__(message)    


class ModuleNameError(InvalidArgsError):
    message_fmt = 'Invalid module name: %s'


class FilePathError(InvalidArgsError):
    message_fmt = 'Invalid path to import module from: %s'


# We only know the sDNA version to import as a string.  This is more secure too.
def strict_import(module_name = ''
                 ,folder = ''
                 ,sub_folder = ''
                 ,logger = output
                 ,reload_already_imported = RELOAD_IF_ALREADY_IMPORTED
                 ):

    # type: (str, str, str, type[any], bool) -> type[any]
    """ Imports the named module from the specified folder\subfolder only, 
        and returns it.
        
        Avoids name clashes and casual hijack attempts.  In some 
        environments supporting a Python implementation (such as 
        GhPython in Grasshopper) it may not be desirable to ask the user 
        to set PYTHONPATH.  Hence here, we insert the specified folder
        into sys.path (if they are not already in there).
    """
    if not module_name or not isinstance(module_name, basestring):
        raise ModuleNameError(module_name = module_name
                             ,folder = folder
                             ,sub_folder = sub_folder
                             ,logger = logger
                             )
    logger.debug(module_name)
    if module_name in sys.modules:   # sys.modules is also shared between GHPython components 
                                     # (and is even saved until Rhino is closed).
        logger.debug('Module %s already in sys.modules' % module_name)
        if reload_already_imported:
            logger.debug('Reloading %s.... ' % module_name)
            reload(sys.modules[module_name]) # type: ignore
        return sys.modules[module_name]
    #
    #
    # Load module_name for first time:
    #
    #
    search_path = os.path.join(folder, sub_folder)

    if (search_path 
        and isinstance(search_path, basestring) 
        and os.path.isdir(search_path)):
        #
        logger.debug('Search path == %s' % search_path)
        #if search_folder_only:
        #    sys.path = [search_path]
        if search_path not in sys.path:
            logger.warning('Prepending sys.path with: %s' % search_path)
            sys.path.insert(0, search_path)
    else:
        raise FilePathError(module_name = module_name
                           ,search_path = search_path
                           ,logger = logger
                           )

    logger.debug('Trying import... ')
    module = import_module(module_name, '')           

    return module       


class ModulesNotFoundError(InvalidArgsError):
    message_fmt = 'Modules not found in any location %s'


def load_modules(m_names
                ,folders
                ,logger = output
                ,module_name_error_msg = 'Please supply valid names of modules to import, %s'
                ,folders_error_msg = 'Please supply valid folders to import from. %s'
                ,modules_not_found_msg = 'Specified modules not found in any folder, %s'
                ):
    #type(str/ Iterable, list, type[any], str, str) -> tuple / None
    """ Tries to import all modules in m_names, from the first folder in 
        folders to contain a .py or .pyc files with the same name as each 
        module.

        Returns a tuple of all the modules and the path they were found in.  Else 
        raises a ModulesNotFoundError.
    """
    if not m_names:
        raise ModuleNameError(message_fmt = 'No module names supplied, m_names = %s'
                             ,m_names = m_names
                             ,logger = logger
                             )

    if any( not isinstance(m_name, basestring) for m_name in m_names ):
        # if m_names is a basestring, the error is not raised 
        raise ModuleNameError(message_fmt = module_name_error_msg
                             ,m_names = m_names
                             ,logger = logger
                             )
    
    if isinstance(m_names, basestring):
        m_names = [m_names] 

    logger.debug('m_names == %s of type : %s' % (m_names, type(m_names).__name__))

    logger.debug('Testing paths : %s ' % folders)
    
    if isinstance(folders, basestring):
        folders = [folders]

    if not any(os.path.isdir(folder) or os.path.isdir(os.path.dirname(folder)) 
               for folder in folders
              ):
        raise FilePathError(message_fmt = folders_error_msg
                           ,m_names = m_names
                           ,logger = logger
                           )

    for folder in folders:
        logger.debug('Type(folder) : %s' % type(folder).__name__)
        logger.debug('Type(path) : %s path == %s' %(type(folder).__name__, folder))

        if os.path.isfile(folder):
            folder = os.path.dirname(folder)
        if all( any(os.path.isfile(os.path.join(folder, name.replace('.', os.sep) + ending)) 
                    for ending in ['.py','.pyc', '%s__init__.py' % os.sep ] 
                   )
                for name in m_names
              ):
            #
            logger.debug('Importing %s' % repr(m_names))

            return tuple(strict_import(name, folder, '', logger = logger) 
                         for name in m_names
                        ) + (folder,)
                   
            # tuple of modules, followed by the path to them
    raise ModulesNotFoundError(message_fmt = modules_not_found_msg
                              ,m_names = m_names
                              ,folders = folders
                              ,logger = logger
                              )




if __name__ == '__main__': # False in a compiled component.  But then the user
                           # can't add or remove Params to the component.  
    
    # Grasshopper will look for class MyComponent(component) in global scope
    # so a main() guard function is a little tricky to define.






    nick_name = ghenv.Component.NickName #type: ignore

    main_sDNA_GH_module = '%s.main' % PACKAGE_NAME

    # builder can only load sDNA_GH from its parent directory, 
    # e.g. if in a dir one level up in the main repo
    # such as sDNA_build_components.gh.
    if (REPOSITORY and 
        nick_name == 'Build_components'):
        #
        build_env_custom_deps = os.getenv('SDNA_GH_BUILD_DEPS')
        #
        load_modules(
             m_names = DEPS
            ,folders = build_env_custom_deps
            ,folders_error_msg = ('Could not find deps: %s in folder: %s'
                                 % (DEPS, build_env_custom_deps)
                                 )
            ,modules_not_found_msg = (
                                 'Failed to import deps: %s from folder: %s'
                                 % (DEPS, build_env_custom_deps)
                                 )
            )
        sDNA_GH_search_paths = [os.path.join(REPOSITORY, 'src')]
    else:
        sDNA_GH_search_paths = [get_dir_of_python_package_containing_ghuser()]
    


    sc.doc = ghdoc #type: ignore

    output.debug(sDNA_GH_search_paths)

    class sDNA_GH(object):
        pass


    if main_sDNA_GH_module in sys.modules:
        sDNA_GH.main = sys.modules[main_sDNA_GH_module]

        # Our fake module class sDNA_GH has no .__path__
        sDNA_GH_path = os.path.dirname(os.path.dirname(sDNA_GH.main.__file__))
    else:
        sDNA_GH.main, sDNA_GH_path = load_modules(
             m_names = main_sDNA_GH_module
            ,folders = sDNA_GH_search_paths
            ,folders_error_msg = ('Please unzip %s.zip '
                                 +' in the folder %s '
                                 +'and ensure a subfolder called %s is created '
                                 +'inside it, containing main.py ' 
                                 +'and all the sDNA_GH python files '
                                 +'including those within other subfolders. '
                                 ) % (ZIP_FILE_NAME
                                     ,Grasshopper.Folders.DefaultUserObjectFolder
                                     ,os.path.join(ZIP_FILE_NAME, PACKAGE_NAME)
                                     )
            ,modules_not_found_msg = ('Some sDNA_GH files may be missing.  '
                                     +'Please: 1) Copy %s.zip into: %s '
                                     +'2) Unblock it if necessary. '
                                     +'3) Right click '
                                     +'it, select Extract All... and click Extract, '
                                     +'to extract it to that location. '
                                     +'4) Ensure that main.py and all sDNA_GH python' 
                                     +' files and subfolders are inside: %s '
                                     +'5) Reinitialise the component or restart Rhino.'
                                     ) % (ZIP_FILE_NAME
                                         ,Grasshopper.Folders.DefaultUserObjectFolder
                                         ,os.path.join(Grasshopper.Folders.DefaultUserObjectFolder
                                                      ,ZIP_FILE_NAME  
                                                      ,PACKAGE_NAME
                                                      )
                                         )
            )


    logger = sDNA_GH.main.logger.getChild('launcher')
    output.set_logger(logger, flush = True)


    class MyComponent(component):
        pass  # Required.  Idiomatic to Grasshopper.  Must be called "MyComponent"  
            # too (it is looked for by the parser or scope checker?) otherwise 
            # Grasshopper may not find the subclass of on 
            # component.  Even though we overwrite this class on the next line
            # immediately below.  

    
    test_runners, __ = load_modules('%s.tests.test_running_component_classes' % PACKAGE_NAME
                                   ,sDNA_GH_path
                                   )
    checkers, __ = load_modules('%s.skel.tools.helpers.checkers' % PACKAGE_NAME
                               ,sDNA_GH_path
                               )
    log_file_dir = os.path.dirname(checkers.get_path(fallback = sDNA_GH_path))

    if nick_name.replace(' ','').replace('_','').lower() == SELFTEST:  
        MyComponent = test_runners.make_test_running_component_class(
                                             log_file_dir = log_file_dir
                                            ,start_dir = sDNA_GH_path
                                            )
    elif nick_name.startswith(APITEST_PREFIX):

        if not os.getenv('NUM_TESTS'):
            raise Exception('The environment variable: NUM_TESTS must be set. ')

        checkers, __ = load_modules('%s.skel.tools.helpers.checkers' % PACKAGE_NAME
                                   ,sDNA_GH_path
                                   )

        MyComponent = test_runners.make_noninteractive_api_test_running_component_class(
                 test_name = nick_name.partition(APITEST_PREFIX)[2]
                ,log_file_dir = log_file_dir
                )
    else:
        MyComponent = sDNA_GH.main.sDNA_GH_Component
        # Grasshopper calls MyComponent.RunScript automatically (in SDK mode GhPython components).
# ---------- end self_test ----------

# ----
# This component needs an env var set.
# It is best run via the command line:
#  python run_api_tests.py (this script
# will start Rhino and Grasshopper,
# open this file,
# and close everything automatically).
sdna_gh_api_test_all = Self_test()  # -> out; same code as self_test

parse_data = Parse_Data()  # -> out
# ---------- parse_data: Python ----------
#! /usr/bin/awk NR==3
# -*- coding: utf-8 -*-
# This module requires Grasshopper Python (Rhino3D)

# MIT License

# Copyright (c) [2021] [Cardiff University, a body incorporated
# by Royal Charter and a registered charity (number:
# 1136855) whose administrative offices are at 7th floor 30-
# 36 Newport Road, University CF24 0DE, Wales, UK]

# Permission is hereby granted, free of charge, to any person obtaining a copy
# of this software and associated documentation files (the "Software"), to deal
# in the Software without restriction, including without limitation the rights
# to use, copy, modify, merge, publish, distribute, sublicense, and/or sell
# copies of the Software, and to permit persons to whom the Software is
# furnished to do so, subject to the following conditions:

# The above copyright notice and this permission notice shall be included in all
# copies or substantial portions of the Software.

# THE SOFTWARE IS PROVIDED "AS IS", WITHOUT WARRANTY OF ANY KIND, EXPRESS OR
# IMPLIED, INCLUDING BUT NOT LIMITED TO THE WARRANTIES OF MERCHANTABILITY,
# FITNESS FOR A PARTICULAR PURPOSE AND NONINFRINGEMENT. IN NO EVENT SHALL THE
# AUTHORS OR COPYRIGHT HOLDERS BE LIABLE FOR ANY CLAIM, DAMAGES OR OTHER
# LIABILITY, WHETHER IN AN ACTION OF CONTRACT, TORT OR OTHERWISE, ARISING FROM,
# OUT OF OR IN CONNECTION WITH THE SOFTWARE OR THE USE OR OTHER DEALINGS IN THE
# SOFTWARE.



"""Parse the data in a Data Tree of numerical data (in `Data`) from a specified `field`, for subsequent colouring and plotting.  If browsing different results fields, to reset `plot_max` and `plot_min` between different data sets, set `sync` to false on a Parse_Data component.
Be sure to supply the list of the data's associated geometric objects (in `Geom`), as legend tags and class midpoint values are appended to the outputted `Geom` and `Data` lists respectively.  Some classifiers sort the data into ascending order (if supplied, the geometry objects will then be reordered too, preserving their correspondence).  To force a sort, according to `field` regardless, set `sort_data` to true.  To make each parsed data point, take the same value as its class midpoint, set `colour_as_class` to true.  Use this component separately from Recolour_Objects to calculate colours with a visible Grasshopper Colour Gradient component.  Max and Min bounds can be overridden (in `plot_max` and `plot_min`).  
**WARNING!  Parsing is for the purpose of colourisation, e.g. in order to produce the desired result from Recolour_Objects.  Therefore, although the inputted Data is not changed, the Data outputted almost certainly will be changed, so should be assumed to be false.**  
After parsing, the legend tags are the definitive reference for what each colour means, not the outputted data values. In particular, if `colour_as_class` = true, the parsed data will take far fewer distinct values than the number of polylines in a large network.  To parse numerical data that uses a numerical format different to your system's normal setting (e.g. with a different radix character: ',' or '.' or thousands separator: ',' or '_'), set `locale` to the corresponding IETF RFC1766,  ISO 3166 Alpha-2 code (e.g. `fr`, `cn`, `pl`).  
"""

__authors__ = {'James Parrott', 'Crispin Cooper'}
__version__ = '3.0.0.alpha_4'



import sys
import os
import functools
import importlib

from ghpythonlib.componentbase import executingcomponent as component
import Grasshopper
import scriptcontext as sc

import_module = importlib.import_module
try:
    reload #type: ignore
except NameError:
    reload = importlib.reload

try:
    basestring #type: ignore
except NameError:
    basestring = str

try:
    ghdoc #type: ignore
except NameError:
    from .skel.basic.ghdoc import ghdoc

ZIP_FILE_NAME = 'sdna-gh'
PACKAGE_NAME = 'sDNA_GH'
PLUG_IN_NAME = 'sDNA'               
RELOAD_IF_ALREADY_IMPORTED = False
REPOSITORY = os.path.dirname(os.path.dirname(ghdoc.Path)) if ghdoc.Path else None
# Assume we are in repo_folder/dev/sDNA_build_components.gh

SELFTEST = 'selftest'
APITEST_PREFIX = 'sDNA_GH_API_test_'
DEPS = ['toml_tools', 'shapefile', 'mapclassif_Iron']

def get_dir_of_python_package_containing_ghuser():
    # This could be foiled by multiple sDNA_GH installations.

    gh_comp_server = Grasshopper.Kernel.GH_ComponentServer()

    for file_ in gh_comp_server.ExternalFiles(True, True):
        path = file_.FilePath
        if PACKAGE_NAME in path:
            break
        #
    else: # for loop did not break
        return None

    dir_ = os.path.dirname(path)

    while PACKAGE_NAME in dir_:
        dir_ = os.path.dirname(dir_)

    return dir_



class Output(object): 

    def set_logger(self, logger, flush = True):
        self.logger = logger
        if flush and self.tmp_logs:
            self.flush()

    def __init__(self
                ,tmp_logs = None
                ,logger = None
                ):
        if not isinstance(tmp_logs, list): #assert not isinstance(None, list)
            tmp_logs = []
        self.tmp_logs = tmp_logs
        self.set_logger(logger, flush = False)



    def store(self, message, logging_level):
        self.tmp_logs.append( (message, logging_level) )

    def __call__(self, message, logging_level = "INFO", logging_dict = {}):
        #type: (str, str, dict, list) -> str
        
        #logger.debug(s)

        if logging_dict == {} and self.logger is not None: 
            logging_dict = dict( DEBUG = self.logger.debug
                                ,INFO = self.logger.info
                                ,WARNING = self.logger.warning
                                ,ERROR = self.logger.error
                                ,CRITICAL = self.logger.critical
                                )

        logging_level = logging_level.upper()
        if logging_level in logging_dict:
            logging_dict[logging_level](message)
        else:
            self.store(message, logging_level)

        return '%s : %s ' % (logging_level, message)

    def __getattr__(self, attr):
        return functools.partial(self.__call__, logging_level = attr.upper())

    def flush(self):
        tmp_logs = self.tmp_logs[:] # __call__ might cache back to tmp_logs
        self.tmp_logs[:] = [] # Mutate list initialised with.  Avoid double 
                              # logging in case re - stored in tmp_logs
        for tmp_log_message, tmp_log_level in tmp_logs:
            self.__call__(tmp_log_message, tmp_log_level)

output = Output()


class InvalidArgsError(Exception):
    
    """Custom exception to log the error message, and to at least allow 
       attempts to give users actionable advice to fix the issue, in 
       the event of a problem.  
    """
    message_fmt = 'Invalid import args: %s'
    def __init__(self
                ,message_fmt = ''
                ,message = ''
                ,logger = output
                , **kwargs
                ):
        if message_fmt and isinstance(message_fmt, basestring):
            self.message_fmt = message_fmt
        if kwargs and (not message or not isinstance(message, basestring)):
            message = self.message_fmt % kwargs
        logger.error(message)
        self.kwargs = kwargs
        super(InvalidArgsError, self).__init__(message)    


class ModuleNameError(InvalidArgsError):
    message_fmt = 'Invalid module name: %s'


class FilePathError(InvalidArgsError):
    message_fmt = 'Invalid path to import module from: %s'


# We only know the sDNA version to import as a string.  This is more secure too.
def strict_import(module_name = ''
                 ,folder = ''
                 ,sub_folder = ''
                 ,logger = output
                 ,reload_already_imported = RELOAD_IF_ALREADY_IMPORTED
                 ):

    # type: (str, str, str, type[any], bool) -> type[any]
    """ Imports the named module from the specified folder\subfolder only, 
        and returns it.
        
        Avoids name clashes and casual hijack attempts.  In some 
        environments supporting a Python implementation (such as 
        GhPython in Grasshopper) it may not be desirable to ask the user 
        to set PYTHONPATH.  Hence here, we insert the specified folder
        into sys.path (if they are not already in there).
    """
    if not module_name or not isinstance(module_name, basestring):
        raise ModuleNameError(module_name = module_name
                             ,folder = folder
                             ,sub_folder = sub_folder
                             ,logger = logger
                             )
    logger.debug(module_name)
    if module_name in sys.modules:   # sys.modules is also shared between GHPython components 
                                     # (and is even saved until Rhino is closed).
        logger.debug('Module %s already in sys.modules' % module_name)
        if reload_already_imported:
            logger.debug('Reloading %s.... ' % module_name)
            reload(sys.modules[module_name]) # type: ignore
        return sys.modules[module_name]
    #
    #
    # Load module_name for first time:
    #
    #
    search_path = os.path.join(folder, sub_folder)

    if (search_path 
        and isinstance(search_path, basestring) 
        and os.path.isdir(search_path)):
        #
        logger.debug('Search path == %s' % search_path)
        #if search_folder_only:
        #    sys.path = [search_path]
        if search_path not in sys.path:
            logger.warning('Prepending sys.path with: %s' % search_path)
            sys.path.insert(0, search_path)
    else:
        raise FilePathError(module_name = module_name
                           ,search_path = search_path
                           ,logger = logger
                           )

    logger.debug('Trying import... ')
    module = import_module(module_name, '')           

    return module       


class ModulesNotFoundError(InvalidArgsError):
    message_fmt = 'Modules not found in any location %s'


def load_modules(m_names
                ,folders
                ,logger = output
                ,module_name_error_msg = 'Please supply valid names of modules to import, %s'
                ,folders_error_msg = 'Please supply valid folders to import from. %s'
                ,modules_not_found_msg = 'Specified modules not found in any folder, %s'
                ):
    #type(str/ Iterable, list, type[any], str, str) -> tuple / None
    """ Tries to import all modules in m_names, from the first folder in 
        folders to contain a .py or .pyc files with the same name as each 
        module.

        Returns a tuple of all the modules and the path they were found in.  Else 
        raises a ModulesNotFoundError.
    """
    if not m_names:
        raise ModuleNameError(message_fmt = 'No module names supplied, m_names = %s'
                             ,m_names = m_names
                             ,logger = logger
                             )

    if any( not isinstance(m_name, basestring) for m_name in m_names ):
        # if m_names is a basestring, the error is not raised 
        raise ModuleNameError(message_fmt = module_name_error_msg
                             ,m_names = m_names
                             ,logger = logger
                             )
    
    if isinstance(m_names, basestring):
        m_names = [m_names] 

    logger.debug('m_names == %s of type : %s' % (m_names, type(m_names).__name__))

    logger.debug('Testing paths : %s ' % folders)
    
    if isinstance(folders, basestring):
        folders = [folders]

    if not any(os.path.isdir(folder) or os.path.isdir(os.path.dirname(folder)) 
               for folder in folders
              ):
        raise FilePathError(message_fmt = folders_error_msg
                           ,m_names = m_names
                           ,logger = logger
                           )

    for folder in folders:
        logger.debug('Type(folder) : %s' % type(folder).__name__)
        logger.debug('Type(path) : %s path == %s' %(type(folder).__name__, folder))

        if os.path.isfile(folder):
            folder = os.path.dirname(folder)
        if all( any(os.path.isfile(os.path.join(folder, name.replace('.', os.sep) + ending)) 
                    for ending in ['.py','.pyc', '%s__init__.py' % os.sep ] 
                   )
                for name in m_names
              ):
            #
            logger.debug('Importing %s' % repr(m_names))

            return tuple(strict_import(name, folder, '', logger = logger) 
                         for name in m_names
                        ) + (folder,)
                   
            # tuple of modules, followed by the path to them
    raise ModulesNotFoundError(message_fmt = modules_not_found_msg
                              ,m_names = m_names
                              ,folders = folders
                              ,logger = logger
                              )




if __name__ == '__main__': # False in a compiled component.  But then the user
                           # can't add or remove Params to the component.  
    
    # Grasshopper will look for class MyComponent(component) in global scope
    # so a main() guard function is a little tricky to define.






    nick_name = ghenv.Component.NickName #type: ignore

    main_sDNA_GH_module = '%s.main' % PACKAGE_NAME

    # builder can only load sDNA_GH from its parent directory, 
    # e.g. if in a dir one level up in the main repo
    # such as sDNA_build_components.gh.
    if (REPOSITORY and 
        nick_name == 'Build_components'):
        #
        build_env_custom_deps = os.getenv('SDNA_GH_BUILD_DEPS')
        #
        load_modules(
             m_names = DEPS
            ,folders = build_env_custom_deps
            ,folders_error_msg = ('Could not find deps: %s in folder: %s'
                                 % (DEPS, build_env_custom_deps)
                                 )
            ,modules_not_found_msg = (
                                 'Failed to import deps: %s from folder: %s'
                                 % (DEPS, build_env_custom_deps)
                                 )
            )
        sDNA_GH_search_paths = [os.path.join(REPOSITORY, 'src')]
    else:
        sDNA_GH_search_paths = [get_dir_of_python_package_containing_ghuser()]
    


    sc.doc = ghdoc #type: ignore

    output.debug(sDNA_GH_search_paths)

    class sDNA_GH(object):
        pass


    if main_sDNA_GH_module in sys.modules:
        sDNA_GH.main = sys.modules[main_sDNA_GH_module]

        # Our fake module class sDNA_GH has no .__path__
        sDNA_GH_path = os.path.dirname(os.path.dirname(sDNA_GH.main.__file__))
    else:
        sDNA_GH.main, sDNA_GH_path = load_modules(
             m_names = main_sDNA_GH_module
            ,folders = sDNA_GH_search_paths
            ,folders_error_msg = ('Please unzip %s.zip '
                                 +' in the folder %s '
                                 +'and ensure a subfolder called %s is created '
                                 +'inside it, containing main.py ' 
                                 +'and all the sDNA_GH python files '
                                 +'including those within other subfolders. '
                                 ) % (ZIP_FILE_NAME
                                     ,Grasshopper.Folders.DefaultUserObjectFolder
                                     ,os.path.join(ZIP_FILE_NAME, PACKAGE_NAME)
                                     )
            ,modules_not_found_msg = ('Some sDNA_GH files may be missing.  '
                                     +'Please: 1) Copy %s.zip into: %s '
                                     +'2) Unblock it if necessary. '
                                     +'3) Right click '
                                     +'it, select Extract All... and click Extract, '
                                     +'to extract it to that location. '
                                     +'4) Ensure that main.py and all sDNA_GH python' 
                                     +' files and subfolders are inside: %s '
                                     +'5) Reinitialise the component or restart Rhino.'
                                     ) % (ZIP_FILE_NAME
                                         ,Grasshopper.Folders.DefaultUserObjectFolder
                                         ,os.path.join(Grasshopper.Folders.DefaultUserObjectFolder
                                                      ,ZIP_FILE_NAME  
                                                      ,PACKAGE_NAME
                                                      )
                                         )
            )


    logger = sDNA_GH.main.logger.getChild('launcher')
    output.set_logger(logger, flush = True)


    class MyComponent(component):
        pass  # Required.  Idiomatic to Grasshopper.  Must be called "MyComponent"  
            # too (it is looked for by the parser or scope checker?) otherwise 
            # Grasshopper may not find the subclass of on 
            # component.  Even though we overwrite this class on the next line
            # immediately below.  

    
    test_runners, __ = load_modules('%s.tests.test_running_component_classes' % PACKAGE_NAME
                                   ,sDNA_GH_path
                                   )
    log_file_dir = os.path.dirname(checkers.get_path(fallback = sDNA_GH_path))

    if nick_name.replace(' ','').replace('_','').lower() == SELFTEST:  
        MyComponent = test_runners.make_test_running_component_class(
                                            log_file_dir = log_file_dir
                                            )
    elif nick_name.startswith(APITEST_PREFIX):

        if not os.getenv('NUM_TESTS'):
            raise Exception('The environment variable: NUM_TESTS must be set. ')

        checkers, __ = load_modules('%s.skel.tools.helpers.checkers' % PACKAGE_NAME
                                   ,sDNA_GH_path
                                   )

        MyComponent = test_runners.make_noninteractive_api_test_running_component_class(
                 test_name = nick_name.partition(APITEST_PREFIX)[2]
                ,log_file_dir = log_file_dir
                )
    else:
        MyComponent = sDNA_GH.main.sDNA_GH_Component
        # Grasshopper calls MyComponent.RunScript automatically (in SDK mode GhPython components).
# ---------- end parse_data ----------
read_usertext = Read_Usertext()  # -> out
# ---------- read_usertext: Python ----------
#! /usr/bin/awk NR==3
# -*- coding: utf-8 -*-
# This module requires Grasshopper Python (Rhino3D)

# MIT License

# Copyright (c) [2021] [Cardiff University, a body incorporated
# by Royal Charter and a registered charity (number:
# 1136855) whose administrative offices are at 7th floor 30-
# 36 Newport Road, University CF24 0DE, Wales, UK]

# Permission is hereby granted, free of charge, to any person obtaining a copy
# of this software and associated documentation files (the "Software"), to deal
# in the Software without restriction, including without limitation the rights
# to use, copy, modify, merge, publish, distribute, sublicense, and/or sell
# copies of the Software, and to permit persons to whom the Software is
# furnished to do so, subject to the following conditions:

# The above copyright notice and this permission notice shall be included in all
# copies or substantial portions of the Software.

# THE SOFTWARE IS PROVIDED "AS IS", WITHOUT WARRANTY OF ANY KIND, EXPRESS OR
# IMPLIED, INCLUDING BUT NOT LIMITED TO THE WARRANTIES OF MERCHANTABILITY,
# FITNESS FOR A PARTICULAR PURPOSE AND NONINFRINGEMENT. IN NO EVENT SHALL THE
# AUTHORS OR COPYRIGHT HOLDERS BE LIABLE FOR ANY CLAIM, DAMAGES OR OTHER
# LIABILITY, WHETHER IN AN ACTION OF CONTRACT, TORT OR OTHERWISE, ARISING FROM,
# OUT OF OR IN CONNECTION WITH THE SOFTWARE OR THE USE OR OTHER DEALINGS IN THE
# SOFTWARE.



"""Reads all User Text from the list of Rhino objects in `Geom` - these must be Rhino objects from Read_Geom (Grasshopper references to Rhino objects, e.g. from a geom Param will not work).  If `auto_get_Geom` = true and if no Read_Geom component is connected to its inputs, Read_Geom is first called.  If `compute_vals` = true, values starting and ending in `%` referring to a Rhino object's UUID (e.g. `%<CurveLength("ac4669e5-53a6-4c2b-9080-bbc67129d93e")>%`) are computed using Rhino.RhinoApp.ParseTextField.
"""

__authors__ = {'James Parrott', 'Crispin Cooper'}
__version__ = '3.0.0.alpha_4'



import sys
import os
import functools
import importlib

from ghpythonlib.componentbase import executingcomponent as component
import Grasshopper
import scriptcontext as sc

import_module = importlib.import_module
try:
    reload #type: ignore
except NameError:
    reload = importlib.reload

try:
    basestring #type: ignore
except NameError:
    basestring = str

try:
    ghdoc #type: ignore
except NameError:
    from .skel.basic.ghdoc import ghdoc

ZIP_FILE_NAME = 'sdna-gh'
PACKAGE_NAME = 'sDNA_GH'
PLUG_IN_NAME = 'sDNA'               
RELOAD_IF_ALREADY_IMPORTED = False
REPOSITORY = os.path.dirname(os.path.dirname(ghdoc.Path)) if ghdoc.Path else None
# Assume we are in repo_folder/dev/sDNA_build_components.gh

SELFTEST = 'selftest'
APITEST_PREFIX = 'sDNA_GH_API_test_'
DEPS = ['toml_tools', 'shapefile', 'mapclassif_Iron']

def get_dir_of_python_package_containing_ghuser():
    # This could be foiled by multiple sDNA_GH installations.

    gh_comp_server = Grasshopper.Kernel.GH_ComponentServer()

    for file_ in gh_comp_server.ExternalFiles(True, True):
        path = file_.FilePath
        if PACKAGE_NAME in path:
            break
        #
    else: # for loop did not break
        return None

    dir_ = os.path.dirname(path)

    while PACKAGE_NAME in dir_:
        dir_ = os.path.dirname(dir_)

    return dir_



class Output(object): 

    def set_logger(self, logger, flush = True):
        self.logger = logger
        if flush and self.tmp_logs:
            self.flush()

    def __init__(self
                ,tmp_logs = None
                ,logger = None
                ):
        if not isinstance(tmp_logs, list): #assert not isinstance(None, list)
            tmp_logs = []
        self.tmp_logs = tmp_logs
        self.set_logger(logger, flush = False)



    def store(self, message, logging_level):
        self.tmp_logs.append( (message, logging_level) )

    def __call__(self, message, logging_level = "INFO", logging_dict = {}):
        #type: (str, str, dict, list) -> str
        
        #logger.debug(s)

        if logging_dict == {} and self.logger is not None: 
            logging_dict = dict( DEBUG = self.logger.debug
                                ,INFO = self.logger.info
                                ,WARNING = self.logger.warning
                                ,ERROR = self.logger.error
                                ,CRITICAL = self.logger.critical
                                )

        logging_level = logging_level.upper()
        if logging_level in logging_dict:
            logging_dict[logging_level](message)
        else:
            self.store(message, logging_level)

        return '%s : %s ' % (logging_level, message)

    def __getattr__(self, attr):
        return functools.partial(self.__call__, logging_level = attr.upper())

    def flush(self):
        tmp_logs = self.tmp_logs[:] # __call__ might cache back to tmp_logs
        self.tmp_logs[:] = [] # Mutate list initialised with.  Avoid double 
                              # logging in case re - stored in tmp_logs
        for tmp_log_message, tmp_log_level in tmp_logs:
            self.__call__(tmp_log_message, tmp_log_level)

output = Output()


class InvalidArgsError(Exception):
    
    """Custom exception to log the error message, and to at least allow 
       attempts to give users actionable advice to fix the issue, in 
       the event of a problem.  
    """
    message_fmt = 'Invalid import args: %s'
    def __init__(self
                ,message_fmt = ''
                ,message = ''
                ,logger = output
                , **kwargs
                ):
        if message_fmt and isinstance(message_fmt, basestring):
            self.message_fmt = message_fmt
        if kwargs and (not message or not isinstance(message, basestring)):
            message = self.message_fmt % kwargs
        logger.error(message)
        self.kwargs = kwargs
        super(InvalidArgsError, self).__init__(message)    


class ModuleNameError(InvalidArgsError):
    message_fmt = 'Invalid module name: %s'


class FilePathError(InvalidArgsError):
    message_fmt = 'Invalid path to import module from: %s'


# We only know the sDNA version to import as a string.  This is more secure too.
def strict_import(module_name = ''
                 ,folder = ''
                 ,sub_folder = ''
                 ,logger = output
                 ,reload_already_imported = RELOAD_IF_ALREADY_IMPORTED
                 ):

    # type: (str, str, str, type[any], bool) -> type[any]
    """ Imports the named module from the specified folder\subfolder only, 
        and returns it.
        
        Avoids name clashes and casual hijack attempts.  In some 
        environments supporting a Python implementation (such as 
        GhPython in Grasshopper) it may not be desirable to ask the user 
        to set PYTHONPATH.  Hence here, we insert the specified folder
        into sys.path (if they are not already in there).
    """
    if not module_name or not isinstance(module_name, basestring):
        raise ModuleNameError(module_name = module_name
                             ,folder = folder
                             ,sub_folder = sub_folder
                             ,logger = logger
                             )
    logger.debug(module_name)
    if module_name in sys.modules:   # sys.modules is also shared between GHPython components 
                                     # (and is even saved until Rhino is closed).
        logger.debug('Module %s already in sys.modules' % module_name)
        if reload_already_imported:
            logger.debug('Reloading %s.... ' % module_name)
            reload(sys.modules[module_name]) # type: ignore
        return sys.modules[module_name]
    #
    #
    # Load module_name for first time:
    #
    #
    search_path = os.path.join(folder, sub_folder)

    if (search_path 
        and isinstance(search_path, basestring) 
        and os.path.isdir(search_path)):
        #
        logger.debug('Search path == %s' % search_path)
        #if search_folder_only:
        #    sys.path = [search_path]
        if search_path not in sys.path:
            logger.warning('Prepending sys.path with: %s' % search_path)
            sys.path.insert(0, search_path)
    else:
        raise FilePathError(module_name = module_name
                           ,search_path = search_path
                           ,logger = logger
                           )

    logger.debug('Trying import... ')
    module = import_module(module_name, '')           

    return module       


class ModulesNotFoundError(InvalidArgsError):
    message_fmt = 'Modules not found in any location %s'


def load_modules(m_names
                ,folders
                ,logger = output
                ,module_name_error_msg = 'Please supply valid names of modules to import, %s'
                ,folders_error_msg = 'Please supply valid folders to import from. %s'
                ,modules_not_found_msg = 'Specified modules not found in any folder, %s'
                ):
    #type(str/ Iterable, list, type[any], str, str) -> tuple / None
    """ Tries to import all modules in m_names, from the first folder in 
        folders to contain a .py or .pyc files with the same name as each 
        module.

        Returns a tuple of all the modules and the path they were found in.  Else 
        raises a ModulesNotFoundError.
    """
    if not m_names:
        raise ModuleNameError(message_fmt = 'No module names supplied, m_names = %s'
                             ,m_names = m_names
                             ,logger = logger
                             )

    if any( not isinstance(m_name, basestring) for m_name in m_names ):
        # if m_names is a basestring, the error is not raised 
        raise ModuleNameError(message_fmt = module_name_error_msg
                             ,m_names = m_names
                             ,logger = logger
                             )
    
    if isinstance(m_names, basestring):
        m_names = [m_names] 

    logger.debug('m_names == %s of type : %s' % (m_names, type(m_names).__name__))

    logger.debug('Testing paths : %s ' % folders)
    
    if isinstance(folders, basestring):
        folders = [folders]

    if not any(os.path.isdir(folder) or os.path.isdir(os.path.dirname(folder)) 
               for folder in folders
              ):
        raise FilePathError(message_fmt = folders_error_msg
                           ,m_names = m_names
                           ,logger = logger
                           )

    for folder in folders:
        logger.debug('Type(folder) : %s' % type(folder).__name__)
        logger.debug('Type(path) : %s path == %s' %(type(folder).__name__, folder))

        if os.path.isfile(folder):
            folder = os.path.dirname(folder)
        if all( any(os.path.isfile(os.path.join(folder, name.replace('.', os.sep) + ending)) 
                    for ending in ['.py','.pyc', '%s__init__.py' % os.sep ] 
                   )
                for name in m_names
              ):
            #
            logger.debug('Importing %s' % repr(m_names))

            return tuple(strict_import(name, folder, '', logger = logger) 
                         for name in m_names
                        ) + (folder,)
                   
            # tuple of modules, followed by the path to them
    raise ModulesNotFoundError(message_fmt = modules_not_found_msg
                              ,m_names = m_names
                              ,folders = folders
                              ,logger = logger
                              )




if __name__ == '__main__': # False in a compiled component.  But then the user
                           # can't add or remove Params to the component.  
    
    # Grasshopper will look for class MyComponent(component) in global scope
    # so a main() guard function is a little tricky to define.






    nick_name = ghenv.Component.NickName #type: ignore

    main_sDNA_GH_module = '%s.main' % PACKAGE_NAME

    # builder can only load sDNA_GH from its parent directory, 
    # e.g. if in a dir one level up in the main repo
    # such as sDNA_build_components.gh.
    if (REPOSITORY and 
        nick_name == 'Build_components'):
        #
        build_env_custom_deps = os.getenv('SDNA_GH_BUILD_DEPS')
        #
        load_modules(
             m_names = DEPS
            ,folders = build_env_custom_deps
            ,folders_error_msg = ('Could not find deps: %s in folder: %s'
                                 % (DEPS, build_env_custom_deps)
                                 )
            ,modules_not_found_msg = (
                                 'Failed to import deps: %s from folder: %s'
                                 % (DEPS, build_env_custom_deps)
                                 )
            )
        sDNA_GH_search_paths = [os.path.join(REPOSITORY, 'src')]
    else:
        sDNA_GH_search_paths = [get_dir_of_python_package_containing_ghuser()]
    


    sc.doc = ghdoc #type: ignore

    output.debug(sDNA_GH_search_paths)

    class sDNA_GH(object):
        pass


    if main_sDNA_GH_module in sys.modules:
        sDNA_GH.main = sys.modules[main_sDNA_GH_module]

        # Our fake module class sDNA_GH has no .__path__
        sDNA_GH_path = os.path.dirname(os.path.dirname(sDNA_GH.main.__file__))
    else:
        sDNA_GH.main, sDNA_GH_path = load_modules(
             m_names = main_sDNA_GH_module
            ,folders = sDNA_GH_search_paths
            ,folders_error_msg = ('Please unzip %s.zip '
                                 +' in the folder %s '
                                 +'and ensure a subfolder called %s is created '
                                 +'inside it, containing main.py ' 
                                 +'and all the sDNA_GH python files '
                                 +'including those within other subfolders. '
                                 ) % (ZIP_FILE_NAME
                                     ,Grasshopper.Folders.DefaultUserObjectFolder
                                     ,os.path.join(ZIP_FILE_NAME, PACKAGE_NAME)
                                     )
            ,modules_not_found_msg = ('Some sDNA_GH files may be missing.  '
                                     +'Please: 1) Copy %s.zip into: %s '
                                     +'2) Unblock it if necessary. '
                                     +'3) Right click '
                                     +'it, select Extract All... and click Extract, '
                                     +'to extract it to that location. '
                                     +'4) Ensure that main.py and all sDNA_GH python' 
                                     +' files and subfolders are inside: %s '
                                     +'5) Reinitialise the component or restart Rhino.'
                                     ) % (ZIP_FILE_NAME
                                         ,Grasshopper.Folders.DefaultUserObjectFolder
                                         ,os.path.join(Grasshopper.Folders.DefaultUserObjectFolder
                                                      ,ZIP_FILE_NAME  
                                                      ,PACKAGE_NAME
                                                      )
                                         )
            )


    logger = sDNA_GH.main.logger.getChild('launcher')
    output.set_logger(logger, flush = True)


    class MyComponent(component):
        pass  # Required.  Idiomatic to Grasshopper.  Must be called "MyComponent"  
            # too (it is looked for by the parser or scope checker?) otherwise 
            # Grasshopper may not find the subclass of on 
            # component.  Even though we overwrite this class on the next line
            # immediately below.  

    
    test_runners, __ = load_modules('%s.tests.test_running_component_classes' % PACKAGE_NAME
                                   ,sDNA_GH_path
                                   )
    log_file_dir = os.path.dirname(checkers.get_path(fallback = sDNA_GH_path))

    if nick_name.replace(' ','').replace('_','').lower() == SELFTEST:  
        MyComponent = test_runners.make_test_running_component_class(
                                            log_file_dir = log_file_dir
                                            )
    elif nick_name.startswith(APITEST_PREFIX):

        if not os.getenv('NUM_TESTS'):
            raise Exception('The environment variable: NUM_TESTS must be set. ')

        checkers, __ = load_modules('%s.skel.tools.helpers.checkers' % PACKAGE_NAME
                                   ,sDNA_GH_path
                                   )

        MyComponent = test_runners.make_noninteractive_api_test_running_component_class(
                 test_name = nick_name.partition(APITEST_PREFIX)[2]
                ,log_file_dir = log_file_dir
                )
    else:
        MyComponent = sDNA_GH.main.sDNA_GH_Component
        # Grasshopper calls MyComponent.RunScript automatically (in SDK mode GhPython components).
# ---------- end read_usertext ----------
write_shp = Write_Shp()  # -> out
# ---------- write_shp: Python ----------
#! /usr/bin/awk NR==3
# -*- coding: utf-8 -*-
# This module requires Grasshopper Python (Rhino3D)

# MIT License

# Copyright (c) [2021] [Cardiff University, a body incorporated
# by Royal Charter and a registered charity (number:
# 1136855) whose administrative offices are at 7th floor 30-
# 36 Newport Road, University CF24 0DE, Wales, UK]

# Permission is hereby granted, free of charge, to any person obtaining a copy
# of this software and associated documentation files (the "Software"), to deal
# in the Software without restriction, including without limitation the rights
# to use, copy, modify, merge, publish, distribute, sublicense, and/or sell
# copies of the Software, and to permit persons to whom the Software is
# furnished to do so, subject to the following conditions:

# The above copyright notice and this permission notice shall be included in all
# copies or substantial portions of the Software.

# THE SOFTWARE IS PROVIDED "AS IS", WITHOUT WARRANTY OF ANY KIND, EXPRESS OR
# IMPLIED, INCLUDING BUT NOT LIMITED TO THE WARRANTIES OF MERCHANTABILITY,
# FITNESS FOR A PARTICULAR PURPOSE AND NONINFRINGEMENT. IN NO EVENT SHALL THE
# AUTHORS OR COPYRIGHT HOLDERS BE LIABLE FOR ANY CLAIM, DAMAGES OR OTHER
# LIABILITY, WHETHER IN AN ACTION OF CONTRACT, TORT OR OTHERWISE, ARISING FROM,
# OUT OF OR IN CONNECTION WITH THE SOFTWARE OR THE USE OR OTHER DEALINGS IN THE
# SOFTWARE.



"""Writes a DataTree in `Data` and a list of polylines in `Geom` to a shapefile.  If not specified in `file`, a default file name based on the Rhino doc or Grasshopper doc name is used (unless `auto_update_Rhino_doc_path = false`).  `overwrite_shp` = true overwrites existing files, otherwise if it is false Write_Shp creates new automatically named files up to a maximum of `max_new_files` (20 by default).  **WARNING!  Shapefiles created with default names (due to no valid file path being specified in `file` by the user) will be deleted by subsequent sDNA tools if `strict_no_del` = false, `overwrite_shp` = false, and `del_after_sDNA` = true.**  

To create a projection (.prj) file for the new shapefile, specify the path of an existing .prj file in `prj`.  

If no Data is supplied, if no read_User_Text component is connected to its input, and if `auto_read_User_Text` is true, this tool will first call read_User_Text.  

To work with sDNA, data records are only written to the Shapefile (associated with a shape corresponding to a Rhino / GH polyline) if its field matches the template string specified in `input_key_str`.  The field name has a maximum of 10 characters long, and is taken from the `{name}` value (in the key name if it originated as User Text). To write all data with any key name (shorter then 11 characters) to the Shapefile, set `input_key_str` to `{name}`.  

Shapefile data entries (records) only allow a maximum width of 254 Ascii characters, or 254 bytes for Unicode strings.  Encodings can require more than one byte per code point.  So some UTF-8 and UTF-16 encoded Unicode strings may only be 120 code points long, or even shorter.  
This is an intrinsic limitation of the shapefile format [https://en.wikipedia.org/wiki/Shapefile#Data_storage].  

Rhino and Grasshopper shapes must support certain methods (to retrieve the points list of their vertices) to be written to shp files of the following types: `PolylineVertices` for `POLYLINE`s and `POLYGON`s, `PointCoordinates` for `POINT`s, `PointCloudPoints` for `MULTIPOINT`, and `MeshVertices` for `MULTIPATCH`.  Please note:  `MULTIPATCH`s are not supported, and `POINT`s and `MULTIPOINT`s are experimental and untested.

Write_Shp attempts to coerce data types to set the Shapefile field type and size correctly.  The full coercion order is bool -> int -> (float / Decimal) -> Date -> string (Shapefile field types L -> N -> F -> D -> C respectively).  If attempts at boolean and integer conversion fail, by default the data is then coerced to a Decimal.  The number of significant figures for 
Decimals is 12 by default.  This can be altered in `precision`.  If `decimal` is set to 
false, Write_Shp coerces the value to a float instead of a Decimal object.  The maximum number of decimal places is `max_dp`.
Dates are attempted to be built using Python's `datetime.date` object.  If a datetime.date cannot be built, if `yyyy_mm_dd` is true, a date must be in yyyy mm dd format.  Otherwise if `yyyy_mm_dd` is false as it is by default, dd mm yyyy and mm dd yyyy are also supported.  In both cases, the supported separators are one of: -.,:/\ or a single space.
"""

__authors__ = {'James Parrott', 'Crispin Cooper'}
__version__ = '3.0.0.alpha_4'



import sys
import os
import functools
import importlib

from ghpythonlib.componentbase import executingcomponent as component
import Grasshopper
import scriptcontext as sc

import_module = importlib.import_module
try:
    reload #type: ignore
except NameError:
    reload = importlib.reload

try:
    basestring #type: ignore
except NameError:
    basestring = str

try:
    ghdoc #type: ignore
except NameError:
    from .skel.basic.ghdoc import ghdoc

ZIP_FILE_NAME = 'sdna-gh'
PACKAGE_NAME = 'sDNA_GH'
PLUG_IN_NAME = 'sDNA'               
RELOAD_IF_ALREADY_IMPORTED = False
REPOSITORY = os.path.dirname(os.path.dirname(ghdoc.Path)) if ghdoc.Path else None
# Assume we are in repo_folder/dev/sDNA_build_components.gh

SELFTEST = 'selftest'
APITEST_PREFIX = 'sDNA_GH_API_test_'
DEPS = ['toml_tools', 'shapefile', 'mapclassif_Iron']

def get_dir_of_python_package_containing_ghuser():
    # This could be foiled by multiple sDNA_GH installations.

    gh_comp_server = Grasshopper.Kernel.GH_ComponentServer()

    for file_ in gh_comp_server.ExternalFiles(True, True):
        path = file_.FilePath
        if PACKAGE_NAME in path:
            break
        #
    else: # for loop did not break
        return None

    dir_ = os.path.dirname(path)

    while PACKAGE_NAME in dir_:
        dir_ = os.path.dirname(dir_)

    return dir_



class Output(object): 

    def set_logger(self, logger, flush = True):
        self.logger = logger
        if flush and self.tmp_logs:
            self.flush()

    def __init__(self
                ,tmp_logs = None
                ,logger = None
                ):
        if not isinstance(tmp_logs, list): #assert not isinstance(None, list)
            tmp_logs = []
        self.tmp_logs = tmp_logs
        self.set_logger(logger, flush = False)



    def store(self, message, logging_level):
        self.tmp_logs.append( (message, logging_level) )

    def __call__(self, message, logging_level = "INFO", logging_dict = {}):
        #type: (str, str, dict, list) -> str
        
        #logger.debug(s)

        if logging_dict == {} and self.logger is not None: 
            logging_dict = dict( DEBUG = self.logger.debug
                                ,INFO = self.logger.info
                                ,WARNING = self.logger.warning
                                ,ERROR = self.logger.error
                                ,CRITICAL = self.logger.critical
                                )

        logging_level = logging_level.upper()
        if logging_level in logging_dict:
            logging_dict[logging_level](message)
        else:
            self.store(message, logging_level)

        return '%s : %s ' % (logging_level, message)

    def __getattr__(self, attr):
        return functools.partial(self.__call__, logging_level = attr.upper())

    def flush(self):
        tmp_logs = self.tmp_logs[:] # __call__ might cache back to tmp_logs
        self.tmp_logs[:] = [] # Mutate list initialised with.  Avoid double 
                              # logging in case re - stored in tmp_logs
        for tmp_log_message, tmp_log_level in tmp_logs:
            self.__call__(tmp_log_message, tmp_log_level)

output = Output()


class InvalidArgsError(Exception):
    
    """Custom exception to log the error message, and to at least allow 
       attempts to give users actionable advice to fix the issue, in 
       the event of a problem.  
    """
    message_fmt = 'Invalid import args: %s'
    def __init__(self
                ,message_fmt = ''
                ,message = ''
                ,logger = output
                , **kwargs
                ):
        if message_fmt and isinstance(message_fmt, basestring):
            self.message_fmt = message_fmt
        if kwargs and (not message or not isinstance(message, basestring)):
            message = self.message_fmt % kwargs
        logger.error(message)
        self.kwargs = kwargs
        super(InvalidArgsError, self).__init__(message)    


class ModuleNameError(InvalidArgsError):
    message_fmt = 'Invalid module name: %s'


class FilePathError(InvalidArgsError):
    message_fmt = 'Invalid path to import module from: %s'


# We only know the sDNA version to import as a string.  This is more secure too.
def strict_import(module_name = ''
                 ,folder = ''
                 ,sub_folder = ''
                 ,logger = output
                 ,reload_already_imported = RELOAD_IF_ALREADY_IMPORTED
                 ):

    # type: (str, str, str, type[any], bool) -> type[any]
    """ Imports the named module from the specified folder\subfolder only, 
        and returns it.
        
        Avoids name clashes and casual hijack attempts.  In some 
        environments supporting a Python implementation (such as 
        GhPython in Grasshopper) it may not be desirable to ask the user 
        to set PYTHONPATH.  Hence here, we insert the specified folder
        into sys.path (if they are not already in there).
    """
    if not module_name or not isinstance(module_name, basestring):
        raise ModuleNameError(module_name = module_name
                             ,folder = folder
                             ,sub_folder = sub_folder
                             ,logger = logger
                             )
    logger.debug(module_name)
    if module_name in sys.modules:   # sys.modules is also shared between GHPython components 
                                     # (and is even saved until Rhino is closed).
        logger.debug('Module %s already in sys.modules' % module_name)
        if reload_already_imported:
            logger.debug('Reloading %s.... ' % module_name)
            reload(sys.modules[module_name]) # type: ignore
        return sys.modules[module_name]
    #
    #
    # Load module_name for first time:
    #
    #
    search_path = os.path.join(folder, sub_folder)

    if (search_path 
        and isinstance(search_path, basestring) 
        and os.path.isdir(search_path)):
        #
        logger.debug('Search path == %s' % search_path)
        #if search_folder_only:
        #    sys.path = [search_path]
        if search_path not in sys.path:
            logger.warning('Prepending sys.path with: %s' % search_path)
            sys.path.insert(0, search_path)
    else:
        raise FilePathError(module_name = module_name
                           ,search_path = search_path
                           ,logger = logger
                           )

    logger.debug('Trying import... ')
    module = import_module(module_name, '')           

    return module       


class ModulesNotFoundError(InvalidArgsError):
    message_fmt = 'Modules not found in any location %s'


def load_modules(m_names
                ,folders
                ,logger = output
                ,module_name_error_msg = 'Please supply valid names of modules to import, %s'
                ,folders_error_msg = 'Please supply valid folders to import from. %s'
                ,modules_not_found_msg = 'Specified modules not found in any folder, %s'
                ):
    #type(str/ Iterable, list, type[any], str, str) -> tuple / None
    """ Tries to import all modules in m_names, from the first folder in 
        folders to contain a .py or .pyc files with the same name as each 
        module.

        Returns a tuple of all the modules and the path they were found in.  Else 
        raises a ModulesNotFoundError.
    """
    if not m_names:
        raise ModuleNameError(message_fmt = 'No module names supplied, m_names = %s'
                             ,m_names = m_names
                             ,logger = logger
                             )

    if any( not isinstance(m_name, basestring) for m_name in m_names ):
        # if m_names is a basestring, the error is not raised 
        raise ModuleNameError(message_fmt = module_name_error_msg
                             ,m_names = m_names
                             ,logger = logger
                             )
    
    if isinstance(m_names, basestring):
        m_names = [m_names] 

    logger.debug('m_names == %s of type : %s' % (m_names, type(m_names).__name__))

    logger.debug('Testing paths : %s ' % folders)
    
    if isinstance(folders, basestring):
        folders = [folders]

    if not any(os.path.isdir(folder) or os.path.isdir(os.path.dirname(folder)) 
               for folder in folders
              ):
        raise FilePathError(message_fmt = folders_error_msg
                           ,m_names = m_names
                           ,logger = logger
                           )

    for folder in folders:
        logger.debug('Type(folder) : %s' % type(folder).__name__)
        logger.debug('Type(path) : %s path == %s' %(type(folder).__name__, folder))

        if os.path.isfile(folder):
            folder = os.path.dirname(folder)
        if all( any(os.path.isfile(os.path.join(folder, name.replace('.', os.sep) + ending)) 
                    for ending in ['.py','.pyc', '%s__init__.py' % os.sep ] 
                   )
                for name in m_names
              ):
            #
            logger.debug('Importing %s' % repr(m_names))

            return tuple(strict_import(name, folder, '', logger = logger) 
                         for name in m_names
                        ) + (folder,)
                   
            # tuple of modules, followed by the path to them
    raise ModulesNotFoundError(message_fmt = modules_not_found_msg
                              ,m_names = m_names
                              ,folders = folders
                              ,logger = logger
                              )




if __name__ == '__main__': # False in a compiled component.  But then the user
                           # can't add or remove Params to the component.  
    
    # Grasshopper will look for class MyComponent(component) in global scope
    # so a main() guard function is a little tricky to define.






    nick_name = ghenv.Component.NickName #type: ignore

    main_sDNA_GH_module = '%s.main' % PACKAGE_NAME

    # builder can only load sDNA_GH from its parent directory, 
    # e.g. if in a dir one level up in the main repo
    # such as sDNA_build_components.gh.
    if (REPOSITORY and 
        nick_name == 'Build_components'):
        #
        build_env_custom_deps = os.getenv('SDNA_GH_BUILD_DEPS')
        #
        load_modules(
             m_names = DEPS
            ,folders = build_env_custom_deps
            ,folders_error_msg = ('Could not find deps: %s in folder: %s'
                                 % (DEPS, build_env_custom_deps)
                                 )
            ,modules_not_found_msg = (
                                 'Failed to import deps: %s from folder: %s'
                                 % (DEPS, build_env_custom_deps)
                                 )
            )
        sDNA_GH_search_paths = [os.path.join(REPOSITORY, 'src')]
    else:
        sDNA_GH_search_paths = [get_dir_of_python_package_containing_ghuser()]
    


    sc.doc = ghdoc #type: ignore

    output.debug(sDNA_GH_search_paths)

    class sDNA_GH(object):
        pass


    if main_sDNA_GH_module in sys.modules:
        sDNA_GH.main = sys.modules[main_sDNA_GH_module]

        # Our fake module class sDNA_GH has no .__path__
        sDNA_GH_path = os.path.dirname(os.path.dirname(sDNA_GH.main.__file__))
    else:
        sDNA_GH.main, sDNA_GH_path = load_modules(
             m_names = main_sDNA_GH_module
            ,folders = sDNA_GH_search_paths
            ,folders_error_msg = ('Please unzip %s.zip '
                                 +' in the folder %s '
                                 +'and ensure a subfolder called %s is created '
                                 +'inside it, containing main.py ' 
                                 +'and all the sDNA_GH python files '
                                 +'including those within other subfolders. '
                                 ) % (ZIP_FILE_NAME
                                     ,Grasshopper.Folders.DefaultUserObjectFolder
                                     ,os.path.join(ZIP_FILE_NAME, PACKAGE_NAME)
                                     )
            ,modules_not_found_msg = ('Some sDNA_GH files may be missing.  '
                                     +'Please: 1) Copy %s.zip into: %s '
                                     +'2) Unblock it if necessary. '
                                     +'3) Right click '
                                     +'it, select Extract All... and click Extract, '
                                     +'to extract it to that location. '
                                     +'4) Ensure that main.py and all sDNA_GH python' 
                                     +' files and subfolders are inside: %s '
                                     +'5) Reinitialise the component or restart Rhino.'
                                     ) % (ZIP_FILE_NAME
                                         ,Grasshopper.Folders.DefaultUserObjectFolder
                                         ,os.path.join(Grasshopper.Folders.DefaultUserObjectFolder
                                                      ,ZIP_FILE_NAME  
                                                      ,PACKAGE_NAME
                                                      )
                                         )
            )


    logger = sDNA_GH.main.logger.getChild('launcher')
    output.set_logger(logger, flush = True)


    class MyComponent(component):
        pass  # Required.  Idiomatic to Grasshopper.  Must be called "MyComponent"  
            # too (it is looked for by the parser or scope checker?) otherwise 
            # Grasshopper may not find the subclass of on 
            # component.  Even though we overwrite this class on the next line
            # immediately below.  

    
    test_runners, __ = load_modules('%s.tests.test_running_component_classes' % PACKAGE_NAME
                                   ,sDNA_GH_path
                                   )
    log_file_dir = os.path.dirname(checkers.get_path(fallback = sDNA_GH_path))

    if nick_name.replace(' ','').replace('_','').lower() == SELFTEST:  
        MyComponent = test_runners.make_test_running_component_class(
                                            log_file_dir = log_file_dir
                                            )
    elif nick_name.startswith(APITEST_PREFIX):

        if not os.getenv('NUM_TESTS'):
            raise Exception('The environment variable: NUM_TESTS must be set. ')

        checkers, __ = load_modules('%s.skel.tools.helpers.checkers' % PACKAGE_NAME
                                   ,sDNA_GH_path
                                   )

        MyComponent = test_runners.make_noninteractive_api_test_running_component_class(
                 test_name = nick_name.partition(APITEST_PREFIX)[2]
                ,log_file_dir = log_file_dir
                )
    else:
        MyComponent = sDNA_GH.main.sDNA_GH_Component
        # Grasshopper calls MyComponent.RunScript automatically (in SDK mode GhPython components).
# ---------- end write_shp ----------
panel_2 = Panel(self_test)
panel_3 = Panel(sdna_gh_api_test_all)
read_shp = Read_Shp()  # -> out
# ---------- read_shp: Python ----------
#! /usr/bin/awk NR==3
# -*- coding: utf-8 -*-
# This module requires Grasshopper Python (Rhino3D)

# MIT License

# Copyright (c) [2021] [Cardiff University, a body incorporated
# by Royal Charter and a registered charity (number:
# 1136855) whose administrative offices are at 7th floor 30-
# 36 Newport Road, University CF24 0DE, Wales, UK]

# Permission is hereby granted, free of charge, to any person obtaining a copy
# of this software and associated documentation files (the "Software"), to deal
# in the Software without restriction, including without limitation the rights
# to use, copy, modify, merge, publish, distribute, sublicense, and/or sell
# copies of the Software, and to permit persons to whom the Software is
# furnished to do so, subject to the following conditions:

# The above copyright notice and this permission notice shall be included in all
# copies or substantial portions of the Software.

# THE SOFTWARE IS PROVIDED "AS IS", WITHOUT WARRANTY OF ANY KIND, EXPRESS OR
# IMPLIED, INCLUDING BUT NOT LIMITED TO THE WARRANTIES OF MERCHANTABILITY,
# FITNESS FOR A PARTICULAR PURPOSE AND NONINFRINGEMENT. IN NO EVENT SHALL THE
# AUTHORS OR COPYRIGHT HOLDERS BE LIABLE FOR ANY CLAIM, DAMAGES OR OTHER
# LIABILITY, WHETHER IN AN ACTION OF CONTRACT, TORT OR OTHERWISE, ARISING FROM,
# OUT OF OR IN CONNECTION WITH THE SOFTWARE OR THE USE OR OTHER DEALINGS IN THE
# SOFTWARE.



"""Reads in polylines and associated data records from a shapefile of polylines.  Creates new objects if `new_geom` = true or no objects corresponding to the shapefile are specified in `Geom`.  Specify the path of the .shp file to read in `file`.  **WARNING!  If a valid file path was not specified in `file` on a preceding Write_Shp component, and that file was used by an sDNA tool, Read_Shp deletes sDNA output shapefiles with default names if `strict_no_del` = false, `overwrite_shp` = false, and `del_after_read` = true.**  If a list of existing geometry is provided in `Geom` that corresponds to (is the same length as) the data records in the shapefile, and if new_geom = false, only the data is read from the shapefile.  Otherwise the polylines in the shapefile are added as new Rhino Polyline objects if bake = true; otherwise as Grasshopper Polyline objects.  

If an attempt to add a polyline fails due to Rhino's validity rules, a degree-1 Nurbs curve is added instead.  If this fails, error handling according to Rhino's validity rules is carried out, to inform the user which shape is not valid.  A list of the shape numbers, and any known reason they are invalid (if any) is outputted in `invalid`, if the user wishes to fix their data.  Alternatively, invalid shapes can simply be skipped by setting `ignore_invalid` to true (but in this case data associated with these shapes is lost).

The bounding box output `bbox` is provided to create a legend frame within Recolour_Objects (its value is calculated from the shape file).  The abbreviations and field names from an sDNA results field file (if a file with the same name ending in .names.csv exists) are also read in, and supplied on `abbrevs` so that a drop-down list may be created, for easy selection of the data field for subsequent parsing and plotting.  If no separate Recolour_Objects Component is detected connected to the component's outputs downstream and `auto_plot_data = true`, Recolour_Objects is called afterwards.  
"""

__authors__ = {'James Parrott', 'Crispin Cooper'}
__version__ = '3.0.0.alpha_4'



import sys
import os
import functools
import importlib

from ghpythonlib.componentbase import executingcomponent as component
import Grasshopper
import scriptcontext as sc

import_module = importlib.import_module
try:
    reload #type: ignore
except NameError:
    reload = importlib.reload

try:
    basestring #type: ignore
except NameError:
    basestring = str

try:
    ghdoc #type: ignore
except NameError:
    from .skel.basic.ghdoc import ghdoc

ZIP_FILE_NAME = 'sdna-gh'
PACKAGE_NAME = 'sDNA_GH'
PLUG_IN_NAME = 'sDNA'               
RELOAD_IF_ALREADY_IMPORTED = False
REPOSITORY = os.path.dirname(os.path.dirname(ghdoc.Path)) if ghdoc.Path else None
# Assume we are in repo_folder/dev/sDNA_build_components.gh

SELFTEST = 'selftest'
APITEST_PREFIX = 'sDNA_GH_API_test_'
DEPS = ['toml_tools', 'shapefile', 'mapclassif_Iron']

def get_dir_of_python_package_containing_ghuser():
    # This could be foiled by multiple sDNA_GH installations.

    gh_comp_server = Grasshopper.Kernel.GH_ComponentServer()

    for file_ in gh_comp_server.ExternalFiles(True, True):
        path = file_.FilePath
        if PACKAGE_NAME in path:
            break
        #
    else: # for loop did not break
        return None

    dir_ = os.path.dirname(path)

    while PACKAGE_NAME in dir_:
        dir_ = os.path.dirname(dir_)

    return dir_



class Output(object): 

    def set_logger(self, logger, flush = True):
        self.logger = logger
        if flush and self.tmp_logs:
            self.flush()

    def __init__(self
                ,tmp_logs = None
                ,logger = None
                ):
        if not isinstance(tmp_logs, list): #assert not isinstance(None, list)
            tmp_logs = []
        self.tmp_logs = tmp_logs
        self.set_logger(logger, flush = False)



    def store(self, message, logging_level):
        self.tmp_logs.append( (message, logging_level) )

    def __call__(self, message, logging_level = "INFO", logging_dict = {}):
        #type: (str, str, dict, list) -> str
        
        #logger.debug(s)

        if logging_dict == {} and self.logger is not None: 
            logging_dict = dict( DEBUG = self.logger.debug
                                ,INFO = self.logger.info
                                ,WARNING = self.logger.warning
                                ,ERROR = self.logger.error
                                ,CRITICAL = self.logger.critical
                                )

        logging_level = logging_level.upper()
        if logging_level in logging_dict:
            logging_dict[logging_level](message)
        else:
            self.store(message, logging_level)

        return '%s : %s ' % (logging_level, message)

    def __getattr__(self, attr):
        return functools.partial(self.__call__, logging_level = attr.upper())

    def flush(self):
        tmp_logs = self.tmp_logs[:] # __call__ might cache back to tmp_logs
        self.tmp_logs[:] = [] # Mutate list initialised with.  Avoid double 
                              # logging in case re - stored in tmp_logs
        for tmp_log_message, tmp_log_level in tmp_logs:
            self.__call__(tmp_log_message, tmp_log_level)

output = Output()


class InvalidArgsError(Exception):
    
    """Custom exception to log the error message, and to at least allow 
       attempts to give users actionable advice to fix the issue, in 
       the event of a problem.  
    """
    message_fmt = 'Invalid import args: %s'
    def __init__(self
                ,message_fmt = ''
                ,message = ''
                ,logger = output
                , **kwargs
                ):
        if message_fmt and isinstance(message_fmt, basestring):
            self.message_fmt = message_fmt
        if kwargs and (not message or not isinstance(message, basestring)):
            message = self.message_fmt % kwargs
        logger.error(message)
        self.kwargs = kwargs
        super(InvalidArgsError, self).__init__(message)    


class ModuleNameError(InvalidArgsError):
    message_fmt = 'Invalid module name: %s'


class FilePathError(InvalidArgsError):
    message_fmt = 'Invalid path to import module from: %s'


# We only know the sDNA version to import as a string.  This is more secure too.
def strict_import(module_name = ''
                 ,folder = ''
                 ,sub_folder = ''
                 ,logger = output
                 ,reload_already_imported = RELOAD_IF_ALREADY_IMPORTED
                 ):

    # type: (str, str, str, type[any], bool) -> type[any]
    """ Imports the named module from the specified folder\subfolder only, 
        and returns it.
        
        Avoids name clashes and casual hijack attempts.  In some 
        environments supporting a Python implementation (such as 
        GhPython in Grasshopper) it may not be desirable to ask the user 
        to set PYTHONPATH.  Hence here, we insert the specified folder
        into sys.path (if they are not already in there).
    """
    if not module_name or not isinstance(module_name, basestring):
        raise ModuleNameError(module_name = module_name
                             ,folder = folder
                             ,sub_folder = sub_folder
                             ,logger = logger
                             )
    logger.debug(module_name)
    if module_name in sys.modules:   # sys.modules is also shared between GHPython components 
                                     # (and is even saved until Rhino is closed).
        logger.debug('Module %s already in sys.modules' % module_name)
        if reload_already_imported:
            logger.debug('Reloading %s.... ' % module_name)
            reload(sys.modules[module_name]) # type: ignore
        return sys.modules[module_name]
    #
    #
    # Load module_name for first time:
    #
    #
    search_path = os.path.join(folder, sub_folder)

    if (search_path 
        and isinstance(search_path, basestring) 
        and os.path.isdir(search_path)):
        #
        logger.debug('Search path == %s' % search_path)
        #if search_folder_only:
        #    sys.path = [search_path]
        if search_path not in sys.path:
            logger.warning('Prepending sys.path with: %s' % search_path)
            sys.path.insert(0, search_path)
    else:
        raise FilePathError(module_name = module_name
                           ,search_path = search_path
                           ,logger = logger
                           )

    logger.debug('Trying import... ')
    module = import_module(module_name, '')           

    return module       


class ModulesNotFoundError(InvalidArgsError):
    message_fmt = 'Modules not found in any location %s'


def load_modules(m_names
                ,folders
                ,logger = output
                ,module_name_error_msg = 'Please supply valid names of modules to import, %s'
                ,folders_error_msg = 'Please supply valid folders to import from. %s'
                ,modules_not_found_msg = 'Specified modules not found in any folder, %s'
                ):
    #type(str/ Iterable, list, type[any], str, str) -> tuple / None
    """ Tries to import all modules in m_names, from the first folder in 
        folders to contain a .py or .pyc files with the same name as each 
        module.

        Returns a tuple of all the modules and the path they were found in.  Else 
        raises a ModulesNotFoundError.
    """
    if not m_names:
        raise ModuleNameError(message_fmt = 'No module names supplied, m_names = %s'
                             ,m_names = m_names
                             ,logger = logger
                             )

    if any( not isinstance(m_name, basestring) for m_name in m_names ):
        # if m_names is a basestring, the error is not raised 
        raise ModuleNameError(message_fmt = module_name_error_msg
                             ,m_names = m_names
                             ,logger = logger
                             )
    
    if isinstance(m_names, basestring):
        m_names = [m_names] 

    logger.debug('m_names == %s of type : %s' % (m_names, type(m_names).__name__))

    logger.debug('Testing paths : %s ' % folders)
    
    if isinstance(folders, basestring):
        folders = [folders]

    if not any(os.path.isdir(folder) or os.path.isdir(os.path.dirname(folder)) 
               for folder in folders
              ):
        raise FilePathError(message_fmt = folders_error_msg
                           ,m_names = m_names
                           ,logger = logger
                           )

    for folder in folders:
        logger.debug('Type(folder) : %s' % type(folder).__name__)
        logger.debug('Type(path) : %s path == %s' %(type(folder).__name__, folder))

        if os.path.isfile(folder):
            folder = os.path.dirname(folder)
        if all( any(os.path.isfile(os.path.join(folder, name.replace('.', os.sep) + ending)) 
                    for ending in ['.py','.pyc', '%s__init__.py' % os.sep ] 
                   )
                for name in m_names
              ):
            #
            logger.debug('Importing %s' % repr(m_names))

            return tuple(strict_import(name, folder, '', logger = logger) 
                         for name in m_names
                        ) + (folder,)
                   
            # tuple of modules, followed by the path to them
    raise ModulesNotFoundError(message_fmt = modules_not_found_msg
                              ,m_names = m_names
                              ,folders = folders
                              ,logger = logger
                              )




if __name__ == '__main__': # False in a compiled component.  But then the user
                           # can't add or remove Params to the component.  
    
    # Grasshopper will look for class MyComponent(component) in global scope
    # so a main() guard function is a little tricky to define.






    nick_name = ghenv.Component.NickName #type: ignore

    main_sDNA_GH_module = '%s.main' % PACKAGE_NAME

    # builder can only load sDNA_GH from its parent directory, 
    # e.g. if in a dir one level up in the main repo
    # such as sDNA_build_components.gh.
    if (REPOSITORY and 
        nick_name == 'Build_components'):
        #
        build_env_custom_deps = os.getenv('SDNA_GH_BUILD_DEPS')
        #
        load_modules(
             m_names = DEPS
            ,folders = build_env_custom_deps
            ,folders_error_msg = ('Could not find deps: %s in folder: %s'
                                 % (DEPS, build_env_custom_deps)
                                 )
            ,modules_not_found_msg = (
                                 'Failed to import deps: %s from folder: %s'
                                 % (DEPS, build_env_custom_deps)
                                 )
            )
        sDNA_GH_search_paths = [os.path.join(REPOSITORY, 'src')]
    else:
        sDNA_GH_search_paths = [get_dir_of_python_package_containing_ghuser()]
    


    sc.doc = ghdoc #type: ignore

    output.debug(sDNA_GH_search_paths)

    class sDNA_GH(object):
        pass


    if main_sDNA_GH_module in sys.modules:
        sDNA_GH.main = sys.modules[main_sDNA_GH_module]

        # Our fake module class sDNA_GH has no .__path__
        sDNA_GH_path = os.path.dirname(os.path.dirname(sDNA_GH.main.__file__))
    else:
        sDNA_GH.main, sDNA_GH_path = load_modules(
             m_names = main_sDNA_GH_module
            ,folders = sDNA_GH_search_paths
            ,folders_error_msg = ('Please unzip %s.zip '
                                 +' in the folder %s '
                                 +'and ensure a subfolder called %s is created '
                                 +'inside it, containing main.py ' 
                                 +'and all the sDNA_GH python files '
                                 +'including those within other subfolders. '
                                 ) % (ZIP_FILE_NAME
                                     ,Grasshopper.Folders.DefaultUserObjectFolder
                                     ,os.path.join(ZIP_FILE_NAME, PACKAGE_NAME)
                                     )
            ,modules_not_found_msg = ('Some sDNA_GH files may be missing.  '
                                     +'Please: 1) Copy %s.zip into: %s '
                                     +'2) Unblock it if necessary. '
                                     +'3) Right click '
                                     +'it, select Extract All... and click Extract, '
                                     +'to extract it to that location. '
                                     +'4) Ensure that main.py and all sDNA_GH python' 
                                     +' files and subfolders are inside: %s '
                                     +'5) Reinitialise the component or restart Rhino.'
                                     ) % (ZIP_FILE_NAME
                                         ,Grasshopper.Folders.DefaultUserObjectFolder
                                         ,os.path.join(Grasshopper.Folders.DefaultUserObjectFolder
                                                      ,ZIP_FILE_NAME  
                                                      ,PACKAGE_NAME
                                                      )
                                         )
            )


    logger = sDNA_GH.main.logger.getChild('launcher')
    output.set_logger(logger, flush = True)


    class MyComponent(component):
        pass  # Required.  Idiomatic to Grasshopper.  Must be called "MyComponent"  
            # too (it is looked for by the parser or scope checker?) otherwise 
            # Grasshopper may not find the subclass of on 
            # component.  Even though we overwrite this class on the next line
            # immediately below.  

    
    test_runners, __ = load_modules('%s.tests.test_running_component_classes' % PACKAGE_NAME
                                   ,sDNA_GH_path
                                   )
    log_file_dir = os.path.dirname(checkers.get_path(fallback = sDNA_GH_path))

    if nick_name.replace(' ','').replace('_','').lower() == SELFTEST:  
        MyComponent = test_runners.make_test_running_component_class(
                                            log_file_dir = log_file_dir
                                            )
    elif nick_name.startswith(APITEST_PREFIX):

        if not os.getenv('NUM_TESTS'):
            raise Exception('The environment variable: NUM_TESTS must be set. ')

        checkers, __ = load_modules('%s.skel.tools.helpers.checkers' % PACKAGE_NAME
                                   ,sDNA_GH_path
                                   )

        MyComponent = test_runners.make_noninteractive_api_test_running_component_class(
                 test_name = nick_name.partition(APITEST_PREFIX)[2]
                ,log_file_dir = log_file_dir
                )
    else:
        MyComponent = sDNA_GH.main.sDNA_GH_Component
        # Grasshopper calls MyComponent.RunScript automatically (in SDK mode GhPython components).
# ---------- end read_shp ----------
recolour_objects = Recolour_Objects()  # -> out
# ---------- recolour_objects: Python ----------
#! /usr/bin/awk NR==3
# -*- coding: utf-8 -*-
# This module requires Grasshopper Python (Rhino3D)

# MIT License

# Copyright (c) [2021] [Cardiff University, a body incorporated
# by Royal Charter and a registered charity (number:
# 1136855) whose administrative offices are at 7th floor 30-
# 36 Newport Road, University CF24 0DE, Wales, UK]

# Permission is hereby granted, free of charge, to any person obtaining a copy
# of this software and associated documentation files (the "Software"), to deal
# in the Software without restriction, including without limitation the rights
# to use, copy, modify, merge, publish, distribute, sublicense, and/or sell
# copies of the Software, and to permit persons to whom the Software is
# furnished to do so, subject to the following conditions:

# The above copyright notice and this permission notice shall be included in all
# copies or substantial portions of the Software.

# THE SOFTWARE IS PROVIDED "AS IS", WITHOUT WARRANTY OF ANY KIND, EXPRESS OR
# IMPLIED, INCLUDING BUT NOT LIMITED TO THE WARRANTIES OF MERCHANTABILITY,
# FITNESS FOR A PARTICULAR PURPOSE AND NONINFRINGEMENT. IN NO EVENT SHALL THE
# AUTHORS OR COPYRIGHT HOLDERS BE LIABLE FOR ANY CLAIM, DAMAGES OR OTHER
# LIABILITY, WHETHER IN AN ACTION OF CONTRACT, TORT OR OTHERWISE, ARISING FROM,
# OUT OF OR IN CONNECTION WITH THE SOFTWARE OR THE USE OR OTHER DEALINGS IN THE
# SOFTWARE.



"""Recolour objects (and legend tags) based on pre-parsed and pre-normalised data, or already calculated colours (as RGB triples).  Recolouring Rhino Geometry can be much slower than recolouring Grasshopper Geometry (the latter via a custom preview component connected to Geom and Data).  Nonetheless, to recolour Rhino objects from Grasshopper Referenced Curves (instead of their actual Grasshopper copies, which may be obscured unless the overlying Rhino geometry is set to Hidden), connect the Referenced Curves to a Guid (ID) parameter object first.  

If unparsed data is inputted, Parse_Data is first called.  Custom colour curves are supported using a 3D quadratic spline between the triples of numbers: `rgb_min`, `rgb_mid` and `rgb_max`.  Otherwise, use the Grasshopper Colour Gradient internally (via Node In Code) by setting `Col_Grad` to true and picking a setting from 0 to 7 for `Col_Grad_num` (0 : 'EarthlyBrown', 1 : 'Forest', 2 : 'GreyScale', 3 : 'Heat', 4 : 'Pink', 5 : 'Spectrum', 6 : 'Traffic', 7 : 'Zebra').  Set `line_width` to control the width of the line of Rhino geom objects  (the default is 4).

Create a legend by connecting `leg_cols`, `leg_tags` and `leg_frame` to a Grasshopper Legend component.  The coordinates of the corners of the Rectangle provided in `leg_frame` may be overridden by specifying `leg_extent` (xmin, ymin, xmax, ymax); alternatively any rectangle object can be passed into `leg_frame` on the GH Legend component itself.  Custom legend tag templates and class boundaries are supported via four format strings (`first_leg_tag_str`, `gen_leg_tag_str`, `last_leg_tag_str` and `num_format`) as per Parse_Data.  

To recolour Grasshopper geometry instead of Rhino Geometry (i.e. unbaked objects), connect the `Data` and `Geom` outputs to a Grasshopper Custom Preview component (line widths of GH objects cannot be increased).  
"""

__authors__ = {'James Parrott', 'Crispin Cooper'}
__version__ = '3.0.0.alpha_4'



import sys
import os
import functools
import importlib

from ghpythonlib.componentbase import executingcomponent as component
import Grasshopper
import scriptcontext as sc

import_module = importlib.import_module
try:
    reload #type: ignore
except NameError:
    reload = importlib.reload

try:
    basestring #type: ignore
except NameError:
    basestring = str

try:
    ghdoc #type: ignore
except NameError:
    from .skel.basic.ghdoc import ghdoc

ZIP_FILE_NAME = 'sdna-gh'
PACKAGE_NAME = 'sDNA_GH'
PLUG_IN_NAME = 'sDNA'               
RELOAD_IF_ALREADY_IMPORTED = False
REPOSITORY = os.path.dirname(os.path.dirname(ghdoc.Path)) if ghdoc.Path else None
# Assume we are in repo_folder/dev/sDNA_build_components.gh

SELFTEST = 'selftest'
APITEST_PREFIX = 'sDNA_GH_API_test_'
DEPS = ['toml_tools', 'shapefile', 'mapclassif_Iron']

def get_dir_of_python_package_containing_ghuser():
    # This could be foiled by multiple sDNA_GH installations.

    gh_comp_server = Grasshopper.Kernel.GH_ComponentServer()

    for file_ in gh_comp_server.ExternalFiles(True, True):
        path = file_.FilePath
        if PACKAGE_NAME in path:
            break
        #
    else: # for loop did not break
        return None

    dir_ = os.path.dirname(path)

    while PACKAGE_NAME in dir_:
        dir_ = os.path.dirname(dir_)

    return dir_



class Output(object): 

    def set_logger(self, logger, flush = True):
        self.logger = logger
        if flush and self.tmp_logs:
            self.flush()

    def __init__(self
                ,tmp_logs = None
                ,logger = None
                ):
        if not isinstance(tmp_logs, list): #assert not isinstance(None, list)
            tmp_logs = []
        self.tmp_logs = tmp_logs
        self.set_logger(logger, flush = False)



    def store(self, message, logging_level):
        self.tmp_logs.append( (message, logging_level) )

    def __call__(self, message, logging_level = "INFO", logging_dict = {}):
        #type: (str, str, dict, list) -> str
        
        #logger.debug(s)

        if logging_dict == {} and self.logger is not None: 
            logging_dict = dict( DEBUG = self.logger.debug
                                ,INFO = self.logger.info
                                ,WARNING = self.logger.warning
                                ,ERROR = self.logger.error
                                ,CRITICAL = self.logger.critical
                                )

        logging_level = logging_level.upper()
        if logging_level in logging_dict:
            logging_dict[logging_level](message)
        else:
            self.store(message, logging_level)

        return '%s : %s ' % (logging_level, message)

    def __getattr__(self, attr):
        return functools.partial(self.__call__, logging_level = attr.upper())

    def flush(self):
        tmp_logs = self.tmp_logs[:] # __call__ might cache back to tmp_logs
        self.tmp_logs[:] = [] # Mutate list initialised with.  Avoid double 
                              # logging in case re - stored in tmp_logs
        for tmp_log_message, tmp_log_level in tmp_logs:
            self.__call__(tmp_log_message, tmp_log_level)

output = Output()


class InvalidArgsError(Exception):
    
    """Custom exception to log the error message, and to at least allow 
       attempts to give users actionable advice to fix the issue, in 
       the event of a problem.  
    """
    message_fmt = 'Invalid import args: %s'
    def __init__(self
                ,message_fmt = ''
                ,message = ''
                ,logger = output
                , **kwargs
                ):
        if message_fmt and isinstance(message_fmt, basestring):
            self.message_fmt = message_fmt
        if kwargs and (not message or not isinstance(message, basestring)):
            message = self.message_fmt % kwargs
        logger.error(message)
        self.kwargs = kwargs
        super(InvalidArgsError, self).__init__(message)    


class ModuleNameError(InvalidArgsError):
    message_fmt = 'Invalid module name: %s'


class FilePathError(InvalidArgsError):
    message_fmt = 'Invalid path to import module from: %s'


# We only know the sDNA version to import as a string.  This is more secure too.
def strict_import(module_name = ''
                 ,folder = ''
                 ,sub_folder = ''
                 ,logger = output
                 ,reload_already_imported = RELOAD_IF_ALREADY_IMPORTED
                 ):

    # type: (str, str, str, type[any], bool) -> type[any]
    """ Imports the named module from the specified folder\subfolder only, 
        and returns it.
        
        Avoids name clashes and casual hijack attempts.  In some 
        environments supporting a Python implementation (such as 
        GhPython in Grasshopper) it may not be desirable to ask the user 
        to set PYTHONPATH.  Hence here, we insert the specified folder
        into sys.path (if they are not already in there).
    """
    if not module_name or not isinstance(module_name, basestring):
        raise ModuleNameError(module_name = module_name
                             ,folder = folder
                             ,sub_folder = sub_folder
                             ,logger = logger
                             )
    logger.debug(module_name)
    if module_name in sys.modules:   # sys.modules is also shared between GHPython components 
                                     # (and is even saved until Rhino is closed).
        logger.debug('Module %s already in sys.modules' % module_name)
        if reload_already_imported:
            logger.debug('Reloading %s.... ' % module_name)
            reload(sys.modules[module_name]) # type: ignore
        return sys.modules[module_name]
    #
    #
    # Load module_name for first time:
    #
    #
    search_path = os.path.join(folder, sub_folder)

    if (search_path 
        and isinstance(search_path, basestring) 
        and os.path.isdir(search_path)):
        #
        logger.debug('Search path == %s' % search_path)
        #if search_folder_only:
        #    sys.path = [search_path]
        if search_path not in sys.path:
            logger.warning('Prepending sys.path with: %s' % search_path)
            sys.path.insert(0, search_path)
    else:
        raise FilePathError(module_name = module_name
                           ,search_path = search_path
                           ,logger = logger
                           )

    logger.debug('Trying import... ')
    module = import_module(module_name, '')           

    return module       


class ModulesNotFoundError(InvalidArgsError):
    message_fmt = 'Modules not found in any location %s'


def load_modules(m_names
                ,folders
                ,logger = output
                ,module_name_error_msg = 'Please supply valid names of modules to import, %s'
                ,folders_error_msg = 'Please supply valid folders to import from. %s'
                ,modules_not_found_msg = 'Specified modules not found in any folder, %s'
                ):
    #type(str/ Iterable, list, type[any], str, str) -> tuple / None
    """ Tries to import all modules in m_names, from the first folder in 
        folders to contain a .py or .pyc files with the same name as each 
        module.

        Returns a tuple of all the modules and the path they were found in.  Else 
        raises a ModulesNotFoundError.
    """
    if not m_names:
        raise ModuleNameError(message_fmt = 'No module names supplied, m_names = %s'
                             ,m_names = m_names
                             ,logger = logger
                             )

    if any( not isinstance(m_name, basestring) for m_name in m_names ):
        # if m_names is a basestring, the error is not raised 
        raise ModuleNameError(message_fmt = module_name_error_msg
                             ,m_names = m_names
                             ,logger = logger
                             )
    
    if isinstance(m_names, basestring):
        m_names = [m_names] 

    logger.debug('m_names == %s of type : %s' % (m_names, type(m_names).__name__))

    logger.debug('Testing paths : %s ' % folders)
    
    if isinstance(folders, basestring):
        folders = [folders]

    if not any(os.path.isdir(folder) or os.path.isdir(os.path.dirname(folder)) 
               for folder in folders
              ):
        raise FilePathError(message_fmt = folders_error_msg
                           ,m_names = m_names
                           ,logger = logger
                           )

    for folder in folders:
        logger.debug('Type(folder) : %s' % type(folder).__name__)
        logger.debug('Type(path) : %s path == %s' %(type(folder).__name__, folder))

        if os.path.isfile(folder):
            folder = os.path.dirname(folder)
        if all( any(os.path.isfile(os.path.join(folder, name.replace('.', os.sep) + ending)) 
                    for ending in ['.py','.pyc', '%s__init__.py' % os.sep ] 
                   )
                for name in m_names
              ):
            #
            logger.debug('Importing %s' % repr(m_names))

            return tuple(strict_import(name, folder, '', logger = logger) 
                         for name in m_names
                        ) + (folder,)
                   
            # tuple of modules, followed by the path to them
    raise ModulesNotFoundError(message_fmt = modules_not_found_msg
                              ,m_names = m_names
                              ,folders = folders
                              ,logger = logger
                              )




if __name__ == '__main__': # False in a compiled component.  But then the user
                           # can't add or remove Params to the component.  
    
    # Grasshopper will look for class MyComponent(component) in global scope
    # so a main() guard function is a little tricky to define.






    nick_name = ghenv.Component.NickName #type: ignore

    main_sDNA_GH_module = '%s.main' % PACKAGE_NAME

    # builder can only load sDNA_GH from its parent directory, 
    # e.g. if in a dir one level up in the main repo
    # such as sDNA_build_components.gh.
    if (REPOSITORY and 
        nick_name == 'Build_components'):
        #
        build_env_custom_deps = os.getenv('SDNA_GH_BUILD_DEPS')
        #
        load_modules(
             m_names = DEPS
            ,folders = build_env_custom_deps
            ,folders_error_msg = ('Could not find deps: %s in folder: %s'
                                 % (DEPS, build_env_custom_deps)
                                 )
            ,modules_not_found_msg = (
                                 'Failed to import deps: %s from folder: %s'
                                 % (DEPS, build_env_custom_deps)
                                 )
            )
        sDNA_GH_search_paths = [os.path.join(REPOSITORY, 'src')]
    else:
        sDNA_GH_search_paths = [get_dir_of_python_package_containing_ghuser()]
    


    sc.doc = ghdoc #type: ignore

    output.debug(sDNA_GH_search_paths)

    class sDNA_GH(object):
        pass


    if main_sDNA_GH_module in sys.modules:
        sDNA_GH.main = sys.modules[main_sDNA_GH_module]

        # Our fake module class sDNA_GH has no .__path__
        sDNA_GH_path = os.path.dirname(os.path.dirname(sDNA_GH.main.__file__))
    else:
        sDNA_GH.main, sDNA_GH_path = load_modules(
             m_names = main_sDNA_GH_module
            ,folders = sDNA_GH_search_paths
            ,folders_error_msg = ('Please unzip %s.zip '
                                 +' in the folder %s '
                                 +'and ensure a subfolder called %s is created '
                                 +'inside it, containing main.py ' 
                                 +'and all the sDNA_GH python files '
                                 +'including those within other subfolders. '
                                 ) % (ZIP_FILE_NAME
                                     ,Grasshopper.Folders.DefaultUserObjectFolder
                                     ,os.path.join(ZIP_FILE_NAME, PACKAGE_NAME)
                                     )
            ,modules_not_found_msg = ('Some sDNA_GH files may be missing.  '
                                     +'Please: 1) Copy %s.zip into: %s '
                                     +'2) Unblock it if necessary. '
                                     +'3) Right click '
                                     +'it, select Extract All... and click Extract, '
                                     +'to extract it to that location. '
                                     +'4) Ensure that main.py and all sDNA_GH python' 
                                     +' files and subfolders are inside: %s '
                                     +'5) Reinitialise the component or restart Rhino.'
                                     ) % (ZIP_FILE_NAME
                                         ,Grasshopper.Folders.DefaultUserObjectFolder
                                         ,os.path.join(Grasshopper.Folders.DefaultUserObjectFolder
                                                      ,ZIP_FILE_NAME  
                                                      ,PACKAGE_NAME
                                                      )
                                         )
            )


    logger = sDNA_GH.main.logger.getChild('launcher')
    output.set_logger(logger, flush = True)


    class MyComponent(component):
        pass  # Required.  Idiomatic to Grasshopper.  Must be called "MyComponent"  
            # too (it is looked for by the parser or scope checker?) otherwise 
            # Grasshopper may not find the subclass of on 
            # component.  Even though we overwrite this class on the next line
            # immediately below.  

    
    test_runners, __ = load_modules('%s.tests.test_running_component_classes' % PACKAGE_NAME
                                   ,sDNA_GH_path
                                   )
    log_file_dir = os.path.dirname(checkers.get_path(fallback = sDNA_GH_path))

    if nick_name.replace(' ','').replace('_','').lower() == SELFTEST:  
        MyComponent = test_runners.make_test_running_component_class(
                                            log_file_dir = log_file_dir
                                            )
    elif nick_name.startswith(APITEST_PREFIX):

        if not os.getenv('NUM_TESTS'):
            raise Exception('The environment variable: NUM_TESTS must be set. ')

        checkers, __ = load_modules('%s.skel.tools.helpers.checkers' % PACKAGE_NAME
                                   ,sDNA_GH_path
                                   )

        MyComponent = test_runners.make_noninteractive_api_test_running_component_class(
                 test_name = nick_name.partition(APITEST_PREFIX)[2]
                ,log_file_dir = log_file_dir
                )
    else:
        MyComponent = sDNA_GH.main.sDNA_GH_Component
        # Grasshopper calls MyComponent.RunScript automatically (in SDK mode GhPython components).
# ---------- end recolour_objects ----------
write_usertext = Write_Usertext()  # -> out
# ---------- write_usertext: Python ----------
#! /usr/bin/awk NR==3
# -*- coding: utf-8 -*-
# This module requires Grasshopper Python (Rhino3D)

# MIT License

# Copyright (c) [2021] [Cardiff University, a body incorporated
# by Royal Charter and a registered charity (number:
# 1136855) whose administrative offices are at 7th floor 30-
# 36 Newport Road, University CF24 0DE, Wales, UK]

# Permission is hereby granted, free of charge, to any person obtaining a copy
# of this software and associated documentation files (the "Software"), to deal
# in the Software without restriction, including without limitation the rights
# to use, copy, modify, merge, publish, distribute, sublicense, and/or sell
# copies of the Software, and to permit persons to whom the Software is
# furnished to do so, subject to the following conditions:

# The above copyright notice and this permission notice shall be included in all
# copies or substantial portions of the Software.

# THE SOFTWARE IS PROVIDED "AS IS", WITHOUT WARRANTY OF ANY KIND, EXPRESS OR
# IMPLIED, INCLUDING BUT NOT LIMITED TO THE WARRANTIES OF MERCHANTABILITY,
# FITNESS FOR A PARTICULAR PURPOSE AND NONINFRINGEMENT. IN NO EVENT SHALL THE
# AUTHORS OR COPYRIGHT HOLDERS BE LIABLE FOR ANY CLAIM, DAMAGES OR OTHER
# LIABILITY, WHETHER IN AN ACTION OF CONTRACT, TORT OR OTHERWISE, ARISING FROM,
# OUT OF OR IN CONNECTION WITH THE SOFTWARE OR THE USE OR OTHER DEALINGS IN THE
# SOFTWARE.



"""Writes User Text to Rhino objects, using a specified pattern for the keys.  Specify the data tree to write in `Data`, and the list of Rhino objects to write to in `Geom`.  The format of the User Text key can be customised in the Python format string `output_key_str`, accepting two named fields (e.g. = `sDNA output={name} run time={datetime}`).  

A field specifying an originating Rhino object's UUID `uuid_field` will be omitted.  If a key of that name already exists, it will be overwritten if `overwrite_UserText` is true.  Otherwise a suffix will be appended to it, based on an integer counter and the format string in `dupe_key_suffix`, until a unique key name is found, up to a limit of `max_new_keys` (overwrite warnings can be suppressed by setting `suppress_overwrite_warning` to true).
"""

__authors__ = {'James Parrott', 'Crispin Cooper'}
__version__ = '3.0.0.alpha_4'



import sys
import os
import functools
import importlib

from ghpythonlib.componentbase import executingcomponent as component
import Grasshopper
import scriptcontext as sc

import_module = importlib.import_module
try:
    reload #type: ignore
except NameError:
    reload = importlib.reload

try:
    basestring #type: ignore
except NameError:
    basestring = str

try:
    ghdoc #type: ignore
except NameError:
    from .skel.basic.ghdoc import ghdoc

ZIP_FILE_NAME = 'sdna-gh'
PACKAGE_NAME = 'sDNA_GH'
PLUG_IN_NAME = 'sDNA'               
RELOAD_IF_ALREADY_IMPORTED = False
REPOSITORY = os.path.dirname(os.path.dirname(ghdoc.Path)) if ghdoc.Path else None
# Assume we are in repo_folder/dev/sDNA_build_components.gh

SELFTEST = 'selftest'
APITEST_PREFIX = 'sDNA_GH_API_test_'
DEPS = ['toml_tools', 'shapefile', 'mapclassif_Iron']

def get_dir_of_python_package_containing_ghuser():
    # This could be foiled by multiple sDNA_GH installations.

    gh_comp_server = Grasshopper.Kernel.GH_ComponentServer()

    for file_ in gh_comp_server.ExternalFiles(True, True):
        path = file_.FilePath
        if PACKAGE_NAME in path:
            break
        #
    else: # for loop did not break
        return None

    dir_ = os.path.dirname(path)

    while PACKAGE_NAME in dir_:
        dir_ = os.path.dirname(dir_)

    return dir_



class Output(object): 

    def set_logger(self, logger, flush = True):
        self.logger = logger
        if flush and self.tmp_logs:
            self.flush()

    def __init__(self
                ,tmp_logs = None
                ,logger = None
                ):
        if not isinstance(tmp_logs, list): #assert not isinstance(None, list)
            tmp_logs = []
        self.tmp_logs = tmp_logs
        self.set_logger(logger, flush = False)



    def store(self, message, logging_level):
        self.tmp_logs.append( (message, logging_level) )

    def __call__(self, message, logging_level = "INFO", logging_dict = {}):
        #type: (str, str, dict, list) -> str
        
        #logger.debug(s)

        if logging_dict == {} and self.logger is not None: 
            logging_dict = dict( DEBUG = self.logger.debug
                                ,INFO = self.logger.info
                                ,WARNING = self.logger.warning
                                ,ERROR = self.logger.error
                                ,CRITICAL = self.logger.critical
                                )

        logging_level = logging_level.upper()
        if logging_level in logging_dict:
            logging_dict[logging_level](message)
        else:
            self.store(message, logging_level)

        return '%s : %s ' % (logging_level, message)

    def __getattr__(self, attr):
        return functools.partial(self.__call__, logging_level = attr.upper())

    def flush(self):
        tmp_logs = self.tmp_logs[:] # __call__ might cache back to tmp_logs
        self.tmp_logs[:] = [] # Mutate list initialised with.  Avoid double 
                              # logging in case re - stored in tmp_logs
        for tmp_log_message, tmp_log_level in tmp_logs:
            self.__call__(tmp_log_message, tmp_log_level)

output = Output()


class InvalidArgsError(Exception):
    
    """Custom exception to log the error message, and to at least allow 
       attempts to give users actionable advice to fix the issue, in 
       the event of a problem.  
    """
    message_fmt = 'Invalid import args: %s'
    def __init__(self
                ,message_fmt = ''
                ,message = ''
                ,logger = output
                , **kwargs
                ):
        if message_fmt and isinstance(message_fmt, basestring):
            self.message_fmt = message_fmt
        if kwargs and (not message or not isinstance(message, basestring)):
            message = self.message_fmt % kwargs
        logger.error(message)
        self.kwargs = kwargs
        super(InvalidArgsError, self).__init__(message)    


class ModuleNameError(InvalidArgsError):
    message_fmt = 'Invalid module name: %s'


class FilePathError(InvalidArgsError):
    message_fmt = 'Invalid path to import module from: %s'


# We only know the sDNA version to import as a string.  This is more secure too.
def strict_import(module_name = ''
                 ,folder = ''
                 ,sub_folder = ''
                 ,logger = output
                 ,reload_already_imported = RELOAD_IF_ALREADY_IMPORTED
                 ):

    # type: (str, str, str, type[any], bool) -> type[any]
    """ Imports the named module from the specified folder\subfolder only, 
        and returns it.
        
        Avoids name clashes and casual hijack attempts.  In some 
        environments supporting a Python implementation (such as 
        GhPython in Grasshopper) it may not be desirable to ask the user 
        to set PYTHONPATH.  Hence here, we insert the specified folder
        into sys.path (if they are not already in there).
    """
    if not module_name or not isinstance(module_name, basestring):
        raise ModuleNameError(module_name = module_name
                             ,folder = folder
                             ,sub_folder = sub_folder
                             ,logger = logger
                             )
    logger.debug(module_name)
    if module_name in sys.modules:   # sys.modules is also shared between GHPython components 
                                     # (and is even saved until Rhino is closed).
        logger.debug('Module %s already in sys.modules' % module_name)
        if reload_already_imported:
            logger.debug('Reloading %s.... ' % module_name)
            reload(sys.modules[module_name]) # type: ignore
        return sys.modules[module_name]
    #
    #
    # Load module_name for first time:
    #
    #
    search_path = os.path.join(folder, sub_folder)

    if (search_path 
        and isinstance(search_path, basestring) 
        and os.path.isdir(search_path)):
        #
        logger.debug('Search path == %s' % search_path)
        #if search_folder_only:
        #    sys.path = [search_path]
        if search_path not in sys.path:
            logger.warning('Prepending sys.path with: %s' % search_path)
            sys.path.insert(0, search_path)
    else:
        raise FilePathError(module_name = module_name
                           ,search_path = search_path
                           ,logger = logger
                           )

    logger.debug('Trying import... ')
    module = import_module(module_name, '')           

    return module       


class ModulesNotFoundError(InvalidArgsError):
    message_fmt = 'Modules not found in any location %s'


def load_modules(m_names
                ,folders
                ,logger = output
                ,module_name_error_msg = 'Please supply valid names of modules to import, %s'
                ,folders_error_msg = 'Please supply valid folders to import from. %s'
                ,modules_not_found_msg = 'Specified modules not found in any folder, %s'
                ):
    #type(str/ Iterable, list, type[any], str, str) -> tuple / None
    """ Tries to import all modules in m_names, from the first folder in 
        folders to contain a .py or .pyc files with the same name as each 
        module.

        Returns a tuple of all the modules and the path they were found in.  Else 
        raises a ModulesNotFoundError.
    """
    if not m_names:
        raise ModuleNameError(message_fmt = 'No module names supplied, m_names = %s'
                             ,m_names = m_names
                             ,logger = logger
                             )

    if any( not isinstance(m_name, basestring) for m_name in m_names ):
        # if m_names is a basestring, the error is not raised 
        raise ModuleNameError(message_fmt = module_name_error_msg
                             ,m_names = m_names
                             ,logger = logger
                             )
    
    if isinstance(m_names, basestring):
        m_names = [m_names] 

    logger.debug('m_names == %s of type : %s' % (m_names, type(m_names).__name__))

    logger.debug('Testing paths : %s ' % folders)
    
    if isinstance(folders, basestring):
        folders = [folders]

    if not any(os.path.isdir(folder) or os.path.isdir(os.path.dirname(folder)) 
               for folder in folders
              ):
        raise FilePathError(message_fmt = folders_error_msg
                           ,m_names = m_names
                           ,logger = logger
                           )

    for folder in folders:
        logger.debug('Type(folder) : %s' % type(folder).__name__)
        logger.debug('Type(path) : %s path == %s' %(type(folder).__name__, folder))

        if os.path.isfile(folder):
            folder = os.path.dirname(folder)
        if all( any(os.path.isfile(os.path.join(folder, name.replace('.', os.sep) + ending)) 
                    for ending in ['.py','.pyc', '%s__init__.py' % os.sep ] 
                   )
                for name in m_names
              ):
            #
            logger.debug('Importing %s' % repr(m_names))

            return tuple(strict_import(name, folder, '', logger = logger) 
                         for name in m_names
                        ) + (folder,)
                   
            # tuple of modules, followed by the path to them
    raise ModulesNotFoundError(message_fmt = modules_not_found_msg
                              ,m_names = m_names
                              ,folders = folders
                              ,logger = logger
                              )




if __name__ == '__main__': # False in a compiled component.  But then the user
                           # can't add or remove Params to the component.  
    
    # Grasshopper will look for class MyComponent(component) in global scope
    # so a main() guard function is a little tricky to define.






    nick_name = ghenv.Component.NickName #type: ignore

    main_sDNA_GH_module = '%s.main' % PACKAGE_NAME

    # builder can only load sDNA_GH from its parent directory, 
    # e.g. if in a dir one level up in the main repo
    # such as sDNA_build_components.gh.
    if (REPOSITORY and 
        nick_name == 'Build_components'):
        #
        build_env_custom_deps = os.getenv('SDNA_GH_BUILD_DEPS')
        #
        load_modules(
             m_names = DEPS
            ,folders = build_env_custom_deps
            ,folders_error_msg = ('Could not find deps: %s in folder: %s'
                                 % (DEPS, build_env_custom_deps)
                                 )
            ,modules_not_found_msg = (
                                 'Failed to import deps: %s from folder: %s'
                                 % (DEPS, build_env_custom_deps)
                                 )
            )
        sDNA_GH_search_paths = [os.path.join(REPOSITORY, 'src')]
    else:
        sDNA_GH_search_paths = [get_dir_of_python_package_containing_ghuser()]
    


    sc.doc = ghdoc #type: ignore

    output.debug(sDNA_GH_search_paths)

    class sDNA_GH(object):
        pass


    if main_sDNA_GH_module in sys.modules:
        sDNA_GH.main = sys.modules[main_sDNA_GH_module]

        # Our fake module class sDNA_GH has no .__path__
        sDNA_GH_path = os.path.dirname(os.path.dirname(sDNA_GH.main.__file__))
    else:
        sDNA_GH.main, sDNA_GH_path = load_modules(
             m_names = main_sDNA_GH_module
            ,folders = sDNA_GH_search_paths
            ,folders_error_msg = ('Please unzip %s.zip '
                                 +' in the folder %s '
                                 +'and ensure a subfolder called %s is created '
                                 +'inside it, containing main.py ' 
                                 +'and all the sDNA_GH python files '
                                 +'including those within other subfolders. '
                                 ) % (ZIP_FILE_NAME
                                     ,Grasshopper.Folders.DefaultUserObjectFolder
                                     ,os.path.join(ZIP_FILE_NAME, PACKAGE_NAME)
                                     )
            ,modules_not_found_msg = ('Some sDNA_GH files may be missing.  '
                                     +'Please: 1) Copy %s.zip into: %s '
                                     +'2) Unblock it if necessary. '
                                     +'3) Right click '
                                     +'it, select Extract All... and click Extract, '
                                     +'to extract it to that location. '
                                     +'4) Ensure that main.py and all sDNA_GH python' 
                                     +' files and subfolders are inside: %s '
                                     +'5) Reinitialise the component or restart Rhino.'
                                     ) % (ZIP_FILE_NAME
                                         ,Grasshopper.Folders.DefaultUserObjectFolder
                                         ,os.path.join(Grasshopper.Folders.DefaultUserObjectFolder
                                                      ,ZIP_FILE_NAME  
                                                      ,PACKAGE_NAME
                                                      )
                                         )
            )


    logger = sDNA_GH.main.logger.getChild('launcher')
    output.set_logger(logger, flush = True)


    class MyComponent(component):
        pass  # Required.  Idiomatic to Grasshopper.  Must be called "MyComponent"  
            # too (it is looked for by the parser or scope checker?) otherwise 
            # Grasshopper may not find the subclass of on 
            # component.  Even though we overwrite this class on the next line
            # immediately below.  

    
    test_runners, __ = load_modules('%s.tests.test_running_component_classes' % PACKAGE_NAME
                                   ,sDNA_GH_path
                                   )
    log_file_dir = os.path.dirname(checkers.get_path(fallback = sDNA_GH_path))

    if nick_name.replace(' ','').replace('_','').lower() == SELFTEST:  
        MyComponent = test_runners.make_test_running_component_class(
                                            log_file_dir = log_file_dir
                                            )
    elif nick_name.startswith(APITEST_PREFIX):

        if not os.getenv('NUM_TESTS'):
            raise Exception('The environment variable: NUM_TESTS must be set. ')

        checkers, __ = load_modules('%s.skel.tools.helpers.checkers' % PACKAGE_NAME
                                   ,sDNA_GH_path
                                   )

        MyComponent = test_runners.make_noninteractive_api_test_running_component_class(
                 test_name = nick_name.partition(APITEST_PREFIX)[2]
                ,log_file_dir = log_file_dir
                )
    else:
        MyComponent = sDNA_GH.main.sDNA_GH_Component
        # Grasshopper calls MyComponent.RunScript automatically (in SDK mode GhPython components).
# ---------- end write_usertext ----------
