# Grasshopper definition CreateRandom_GH_GridNetwork.gh (Grasshopper 1.0.7)

M = Slider(6, range=0..50)
N = Slider(6, range=0..50)
go = Button()
python = GhPythonScript(
    Go=Toggle(False),
    N=N,
    M=M,
    p=Slider(0.227, range=0..1),
    L="RandomGridNetwork",
    x=Slider(0, range=-50..50),
    y=Slider(0, range=-50..50))  # -> out, a
# ---------- python: Python ----------
__author__ = "James"
__version__ = "2021.11.04"

import rhinoscriptsyntax as rs
from random import random as random_num
from math import trunc as floor
import scriptcontext
import Rhino
#        https://developer.rhino3d.com/guides/rhinopython/ghpython-bake/

def grid_point_coords(n,m):
    for y in range(n):
        for x in range(m):
            yield x,y

def make_poly_line(x1,y1,x2,y2,store,offset=[x,y]):
    if random_num() > p:
        x1 +=offset[0]; x2 += offset[0];
        y1 += offset[1]; y2 += offset[1];
        #p1 = rs.AddPoint([x1,y1,0])
        store += [rs.AddPolyline([[x1,y1,0],[x2,y2,0]])]
        #rs.DeleteObject(p1)

scriptcontext.doc = ghdoc
#scriptcontext.doc = Rhino.RhinoDoc.ActiveDoc

if Go==True:  #if Go: is canonical in Rhino. 
    M,N=map(floor,[M,N])
    geometries = []
    rhino_brep = []
    for col,row in grid_point_coords(N,M):
            if col < M-1:
                make_poly_line(col,row,col+1,row,geometries)
            if row < N-1:
                make_poly_line(col,row,col,row+1,geometries)
    a=geometries                
    # Baking geometry 
    #ghdoc = scriptcontext.doc
    #scriptcontext.doc = Rhino.RhinoDoc.ActiveDoc
    i=0
    print (" a = "+str(len(a)) )
    #for geometry in geometries:
    #   i+=1
    #   doc_object = scriptcontext.doc.Objects.Find(geometry)
    #   if 1: 
    #   #try:
    #       b=scriptcontext.doc.Objects.Add(doc_object)
    #       rhino_brep += [b]
    #   else: #
    #   #except:
    #       print(doc_object)
    #   #if b:
    #   #    rhino_brep += [b]           
    #   #except:
    #   #    pass
    # Baking:
    #print(len(rhino_brep))
    #if not rs.IsLayer(L):
    #    rs.AddLayer(L)
    #rs.ObjectLayer(rhino_brep, L)
    
    

scriptcontext.doc = ghdoc
# ---------- end python ----------
panel = Panel(python.out)
panel_2 = Panel(python.a)
