# Grasshopper definition get_geom_and_write_to_shp_file.gh (Grasshopper 1.0.8)

py3 = Python3Script()  # -> out, a; disabled
# ---------- py3: Python ----------
import pathlib

print(ghdoc.Path)
# ---------- end py3 ----------
py3_2 = Python3Script()  # -> out, a
# ---------- py3_2: Python ----------
import sys
import pathlib
# del sys.modules['sDNA_GH.main']

IMPORTS_TO_UNLOAD = ['sDNA_GH']

shared_cached_modules_etc = sys.modules.copy().keys()
for y in shared_cached_modules_etc:
    if any(s.lower() in y.lower() for s in IMPORTS_TO_UNLOAD):
        del sys.modules[y]

import sDNA_GH.main as main
# print(sys.modules)
gdm = main.get_Geom()


print(f'{gdm=}')

result = main.write_shapefile(
    gdm=gdm,
    f_name=str(pathlib.Path(ghdoc.Path).parent / 'Blibble.shp'),
    )

print(f'{result=}')
# ---------- end py3_2 ----------
