# Grasshopper definition single_components_test_predict_auto_name_files_GH_geom.gh (Grasshopper 1.0.7)

toggle = BooleanToggle(False)
toggle_2 = BooleanToggle(False)
geo = Geometry([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])
config = Config(
    auto_get_Geom=toggle_2,
    auto_read_User_Text=toggle_2,
    auto_write_Shp=toggle_2,
    auto_read_Shp=toggle,
    auto_plot_data=toggle,
    show_all=Toggle(True))  # -> out, OK, opts; inputs go: list, opts: list, save_to: list, python: list, sDNA_paths: list, auto_get_Geom: list, auto_read_User_Text: list, auto_write_Shp: list, auto_read_Shp: list, auto_plot_data: list, show_all: list, sync: list
#   port go: true: runs tools. false: do not run tools but still read other Params.
#   port opts: sDNA_GH options data structure. Python dictionary.
#   port save_to: The field name / key value of the results field to parse and/or plot. Default: C:\Users\James\AppData\Roaming\Grasshopper\UserObjects\sDNA_GH\config.toml
#   port python: Maximum data value to parse. Higher values (and their objects) are omitted. Automatically calculated if unset.
#   port sDNA_paths: Minimum data value to parse. Lower values (and their objects) are omitted. Automatically calculated if unset.
#   port auto_get_Geom: true: Run Read Rhino geometry before Read User Text. false: don't. Default: True
#   port auto_read_User_Text: true: Run Read User Text before Write shapefile. false: don't. Default: True
#   port auto_write_Shp: true: Run Write shapefile before sDNA tools. false: don't. Default: True
#   port auto_read_Shp: true: Run Read shapefile after sDNA tools. false: don't. Default: True
#   port auto_plot_data: true: Run Recolour objects after Read shapefile. false: don't. Default: True
#   port show_all: true: show all possible input Params on sDNA tools. false: only show required Params. Default: True
#   port sync: false: desynchronise from other components' options. true: synchronise with other synchronised components, sharing the global sDNA_GH options. Default: False
#   port OK: true: tools ran successfully. false: tools did not run, or there was an error.
#   port opts: sDNA_GH options data structure. Python dictionary.
# ---------- config: Python ----------
#! /usr/bin/awk NR==3
# -*- coding: utf-8 -*-
# This module requires Grasshopper Python (Rhino3D)

# MIT License

# Copyright (c) [2021] [Cardiff University, a body incorporated
# by Royal Charter and a registered charity (number:
# 1136855) whose administrative offices are at 7th floor 30-
# 36 Newport Road, University CF24 0DE, Wales, UK]

# Permission is hereby granted, free of charge, to any person obtaining a copy
# of this software and associated documentation files (the "Software"), to deal
# in the Software without restriction, including without limitation the rights
# to use, copy, modify, merge, publish, distribute, sublicense, and/or sell
# copies of the Software, and to permit persons to whom the Software is
# furnished to do so, subject to the following conditions:

# The above copyright notice and this permission notice shall be included in all
# copies or substantial portions of the Software.

# THE SOFTWARE IS PROVIDED "AS IS", WITHOUT WARRANTY OF ANY KIND, EXPRESS OR
# IMPLIED, INCLUDING BUT NOT LIMITED TO THE WARRANTIES OF MERCHANTABILITY,
# FITNESS FOR A PARTICULAR PURPOSE AND NONINFRINGEMENT. IN NO EVENT SHALL THE
# AUTHORS OR COPYRIGHT HOLDERS BE LIABLE FOR ANY CLAIM, DAMAGES OR OTHER
# LIABILITY, WHETHER IN AN ACTION OF CONTRACT, TORT OR OTHERWISE, ARISING FROM,
# OUT OF OR IN CONNECTION WITH THE SOFTWARE OR THE USE OR OTHER DEALINGS IN THE
# SOFTWARE.



"""To guarantee this component runs before all others when your .gh file is loaded, ensuring your options are loaded, select it and press Ctrl + B before saving.
Loads custom user options and configuration files (`.toml`).  Saves options to a `.toml` file if go is true.  If a `.toml` file is specified in `save_to`, it is saved to.  Otherwise the default value of `save_to` is the installation-wide user options file.  One is created if it does not already exist.  This will overwrite existing files.
"""

__author__ = 'James Parrott'
__version__ = '2.0'



import sys
import os
import functools
import importlib

from ghpythonlib.componentbase import executingcomponent as component
import Grasshopper
import scriptcontext as sc

import_module = importlib.import_module
try:
    reload #type: ignore
except NameError:
    reload = importlib.reload

try:
    basestring #type: ignore
except NameError:
    basestring = str

try:
    ghdoc #type: ignore
except NameError:
    from .custom.skel.basic.ghdoc import ghdoc

ZIP_FILE_NAME = 'sdna-gh'
PACKAGE_NAME = 'sDNA_GH'
PLUG_IN_NAME = 'sDNA'               
RELOAD_IF_ALREADY_IMPORTED = False
REPOSITORY = os.path.dirname(os.path.dirname(ghdoc.Path)) if ghdoc.Path else None
# Assume we are in repo_folder/dev/sDNA_build_components.gh

USER_INSTALLATION_FOLDER = os.path.join(
                                    Grasshopper.Folders.DefaultUserObjectFolder
                                   ,ZIP_FILE_NAME
                                   )
SELFTEST = 'selftest'




class Output(object): 

    def set_logger(self, logger, flush = True):
        self.logger = logger
        if flush and self.tmp_logs:
            self.flush()

    def __init__(self
                ,tmp_logs = None
                ,logger = None
                ):
        if not isinstance(tmp_logs, list): #assert not isinstance(None, list)
            tmp_logs = []
        self.tmp_logs = tmp_logs
        self.set_logger(logger, flush = False)



    def store(self, message, logging_level):
        self.tmp_logs.append( (message, logging_level) )

    def __call__(self, message, logging_level = "INFO", logging_dict = {}):
        #type: (str, str, dict, list) -> str
        
        #logger.debug(s)

        if logging_dict == {} and self.logger is not None: 
            logging_dict = dict( DEBUG = self.logger.debug
                                ,INFO = self.logger.info
                                ,WARNING = self.logger.warning
                                ,ERROR = self.logger.error
                                ,CRITICAL = self.logger.critical
                                )

        logging_level = logging_level.upper()
        if logging_level in logging_dict:
            logging_dict[logging_level](message)
        else:
            self.store(message, logging_level)

        return '%s : %s ' % (logging_level, message)

    def __getattr__(self, attr):
        return functools.partial(self.__call__, logging_level = attr.upper())

    def flush(self):
        tmp_logs = self.tmp_logs[:] # __call__ might cache back to tmp_logs
        self.tmp_logs[:] = [] # Mutate list initialised with.  Avoid double 
                              # logging in case re - stored in tmp_logs
        for tmp_log_message, tmp_log_level in tmp_logs:
            self.__call__(tmp_log_message, tmp_log_level)

output = Output()


class InvalidArgsError(Exception):
    
    """Custom exception to log the error message, and to at least allow 
       attempts to give users actionable advice to fix the issue, in 
       the event of a problem.  
    """
    message_fmt = 'Invalid import args: %s'
    def __init__(self
                ,message_fmt = ''
                ,message = ''
                ,logger = output
                , **kwargs
                ):
        if message_fmt and isinstance(message_fmt, basestring):
            self.message_fmt = message_fmt
        if kwargs and (not message or not isinstance(message, basestring)):
            message = self.message_fmt % kwargs
        logger.error(message)
        self.kwargs = kwargs
        super(InvalidArgsError, self).__init__(message)    


class ModuleNameError(InvalidArgsError):
    message_fmt = 'Invalid module name: %s'


class FilePathError(InvalidArgsError):
    message_fmt = 'Invalid path to import module from: %s'


# We only know the sDNA version to import as a string.  This is more secure too.
def strict_import(module_name = ''
                 ,folder = ''
                 ,sub_folder = ''
                 ,logger = output
                 ,reload_already_imported = RELOAD_IF_ALREADY_IMPORTED
                 ):

    # type: (str, str, str, type[any], bool) -> type[any]
    """ Imports the named module from the specified folder\subfolder only, 
        and returns it.
        
        Avoids name clashes and casual hijack attempts.  In some 
        environments supporting a Python implementation (such as 
        GhPython in Grasshopper) it may not be desirable to ask the user 
        to set PYTHONPATH.  Hence here, we save sys.path to a tmp 
        variable, set sys.path to the specified folders, attempt the 
        import in a try: block, and restore sys.path in a finally: block
    """
    if not module_name or not isinstance(module_name, basestring):
        raise ModuleNameError(module_name = module_name
                             ,folder = folder
                             ,sub_folder = sub_folder
                             ,logger = logger
                             )
    logger.debug(module_name)
    if module_name in sys.modules:   # sys.modules is also shared between GHPython components 
                                     # (and is even saved until Rhino is closed).
        logger.debug('Module %s already in sys.modules' % module_name)
        if reload_already_imported:
            logger.debug('Reloading %s.... ' % module_name)
            reload(sys.modules[module_name]) # type: ignore
        return sys.modules[module_name]
    #
    #
    # Load module_name for first time:
    #
    #
    search_path = os.path.join(folder, sub_folder)

    if (search_path 
        and isinstance(search_path, basestring) 
        and os.path.isdir(search_path)):
        #
        logger.debug('Search path == %s' % search_path)
        #if search_folder_only:
        #    sys.path = [search_path]
        if search_path not in sys.path:
            sys.path.insert(0, search_path)
    else:
        raise FilePathError(module_name = module_name
                           ,search_path = search_path
                           ,logger = logger
                           )

    logger.debug('Trying import... ')
    module = import_module(module_name, '')           

    return module       


class ModulesNotFoundError(InvalidArgsError):
    message_fmt = 'Modules not found in any location %s'


def load_modules(m_names
                ,folders
                ,logger = output
                ,module_name_error_msg = 'Please supply valid names of modules to import, %s'
                ,folders_error_msg = 'Please supply valid folders to import from. %s'
                ,modules_not_found_msg = 'Specified modules not found in any folder, %s'):
    #type(str/ Iterable, list, type[any], str, str) -> tuple / None
    """ Tries to import all modules in m_names, from the first folder in 
        folders to contain a .py or .pyc files with the same name as each 
        module.

        Returns a tuple of all the modules and the path they were found in.  Else 
        raises a ModulesNotFoundError.
    """
    if not m_names:
        raise ModuleNameError(message_fmt = 'No module names supplied, m_names = %s'
                             ,m_names = m_names
                             ,logger = logger
                             )

    if any( not isinstance(m_name, basestring) for m_name in m_names ):
        # if m_names is a basestring, the error is not raised 
        raise ModuleNameError(message_fmt = module_name_error_msg
                             ,m_names = m_names
                             ,logger = logger
                             )
    
    if isinstance(m_names, basestring):
        m_names = [m_names] 

    logger.debug('m_names == %s of type : %s' % (m_names, type(m_names).__name__))

    logger.debug('Testing paths : %s ' % folders)
    
    if isinstance(folders, basestring):
        folders = [folders]

    if not any(os.path.isdir(folder) or os.path.isdir(os.path.dirname(folder)) 
               for folder in folders
              ):
        raise FilePathError(message_fmt = folders_error_msg
                           ,m_names = m_names
                           ,logger = logger
                           )

    for folder in folders:
        logger.debug('Type(folder) : %s' % type(folder).__name__)
        logger.debug('Type(path) : %s path == %s' %(type(folder).__name__, folder))

        if os.path.isfile(folder):
            folder = os.path.dirname(folder)
        if all( any(os.path.isfile(os.path.join(folder, name.replace('.', os.sep) + ending)) 
                    for ending in ['.py','.pyc'] 
                   )
                for name in m_names
              ):
            #
            logger.debug('Importing %s' % repr(m_names))

            return tuple(strict_import(name, folder, '', logger = logger) 
                         for name in m_names
                        ) + (folder,)
            # tuple of modules, followed by the path to them
    raise ModulesNotFoundError(message_fmt = modules_not_found_msg
                              ,m_names = m_names
                              ,folders = folders
                              ,logger = logger
                              )




if __name__ == '__main__': # False in a compiled component.  But then the user
                           # can't add or remove Params to the component.  
    
    # Grasshopper will look for class MyComponent(component) in global scope
    # so a main function is a little tricky to define.

    nick_name = ghenv.Component.NickName #type: ignore


    if (REPOSITORY and 
        nick_name == 'Build_components'):
        #
        sDNA_GH_search_path = REPOSITORY 
        # builder can only load sDNA_GH from its parent directory, 
        # e.g. if in a dir one level up in the main repo
        # such as sDNA_build_components.gh.
    else:
        sDNA_GH_search_path = USER_INSTALLATION_FOLDER


    sc.doc = ghdoc #type: ignore

    output.debug(sDNA_GH_search_path)

    class sDNA_GH(object):
        pass

    if 'sDNA_GH.main' in sys.modules:
        sDNA_GH.main = sys.modules['sDNA_GH.main']
    else:
        sDNA_GH.main, _ = load_modules(m_names = PACKAGE_NAME + '.main'
                                      ,folders = sDNA_GH_search_path
                                      ,folders_error_msg = 'Please unzip %s.zip '
                                                           %ZIP_FILE_NAME
                                                           +' in the folder %s '
                                                           %Grasshopper.Folders.DefaultUserObjectFolder
                                                           +'and ensure a subfolder called %s is created '
                                                           %os.path.join(ZIP_FILE_NAME, PACKAGE_NAME)
                                                           +'inside it, containing main.py ' 
                                                           +'and all the sDNA_GH python files '
                                                           +'including those within other subfolders. ' 
                                      ,modules_not_found_msg = 'Some sDNA_GH files may be missing.  '
                                                              +'Please: 1) Copy %s.zip into: %s '
                                                              %(ZIP_FILE_NAME
                                                               ,Grasshopper.Folders.DefaultUserObjectFolder
                                                               )
                                                              +'2) Unblock it if necessary. '
                                                              +'3) Right click '
                                                              +'it, select Extract All... and click Extract, '
                                                              +'to extract it to that location. '
                                                              +'4) Ensure that main.py and all sDNA_GH python' 
                                                              +' files and subfolders are inside: %s '
                                                              %os.path.join(USER_INSTALLATION_FOLDER
                                                                           ,PACKAGE_NAME
                                                                           )
                                                              +'5) Reinitialise the component or restart Rhino.'
                                      )         


    logger = sDNA_GH.main.logger.getChild('launcher')
    output.set_logger(logger, flush = True)


    class MyComponent(component):
        pass  # Required.  Idiomatic to Grasshopper.  Must be called "MyComponent"  
            # too (it is looked for by the parser or scope checker?) otherwise 
            # Grasshopper may not find the subclass of on 
            # component.  Even though we overwrite this class on the next line
            # immediately below.  

    MyComponent = sDNA_GH.main.sDNA_GH_Component
    # Grasshopper calls MyComponent.RunScript automatically.


    if nick_name.replace(' ','').replace('_','').lower() == SELFTEST:  


        unit_tests, _ = load_modules('%s.tests.unit_tests.%s_unit_tests' % ((PACKAGE_NAME,)*2)
                                    ,sDNA_GH_search_path
                                    )

        
        MyComponent = unit_tests.make_test_running_component_class(
                                         MyComponent
                                        ,package_location = sDNA_GH_search_path
                                        )
        # Grasshopper calls MyComponent.RunScript automatically.
# ---------- end config ----------
write_shp = Write_Shp(go=Toggle(False), Geom=geo)  # -> out, OK, opts, file; inputs go: list, opts: list, Geom: list, Data: tree, file: list, prj: list, input_key_str: list, config: list
#   port go: true: runs tools. false: do not run tools but still read other Params.
#   port opts: sDNA_GH options data structure. Python dictionary.
#   port Geom: A list of geometric objects, that must all be polylines for sDNA tools, read_Shp and write_Shp
#   port Data: A Data Tree of a list of keys and list of corresponding values for each object in Geom.
#   port file: File path of the shape file.
#   port prj: File path of the projection file (.prj) to use for the new shapefile.
#   port input_key_str: Format string containing a prefix, a {name} field, and a postfix, to enable more descriptive User Text key names. Default: {name} Only User Text key names matching this pattern will have their values written to shape files by Write_Shp,under the field name in {name}, which can have a max of 10 chars in Write_Shp. The actual values of name in User Text keys must also be specified to the sDNA tools that use them.
#   port config: File path to sDNA_GH options file, e.g. config.toml
#   port OK: true: tools ran successfully. false: tools did not run, or there was an error.
#   port opts: sDNA_GH options data structure. Python dictionary.
#   port file: File path of the shape file.
# ---------- write_shp: Python ----------
#! /usr/bin/awk NR==3
# -*- coding: utf-8 -*-
# This module requires Grasshopper Python (Rhino3D)

# MIT License

# Copyright (c) [2021] [Cardiff University, a body incorporated
# by Royal Charter and a registered charity (number:
# 1136855) whose administrative offices are at 7th floor 30-
# 36 Newport Road, University CF24 0DE, Wales, UK]

# Permission is hereby granted, free of charge, to any person obtaining a copy
# of this software and associated documentation files (the "Software"), to deal
# in the Software without restriction, including without limitation the rights
# to use, copy, modify, merge, publish, distribute, sublicense, and/or sell
# copies of the Software, and to permit persons to whom the Software is
# furnished to do so, subject to the following conditions:

# The above copyright notice and this permission notice shall be included in all
# copies or substantial portions of the Software.

# THE SOFTWARE IS PROVIDED "AS IS", WITHOUT WARRANTY OF ANY KIND, EXPRESS OR
# IMPLIED, INCLUDING BUT NOT LIMITED TO THE WARRANTIES OF MERCHANTABILITY,
# FITNESS FOR A PARTICULAR PURPOSE AND NONINFRINGEMENT. IN NO EVENT SHALL THE
# AUTHORS OR COPYRIGHT HOLDERS BE LIABLE FOR ANY CLAIM, DAMAGES OR OTHER
# LIABILITY, WHETHER IN AN ACTION OF CONTRACT, TORT OR OTHERWISE, ARISING FROM,
# OUT OF OR IN CONNECTION WITH THE SOFTWARE OR THE USE OR OTHER DEALINGS IN THE
# SOFTWARE.



"""Writes the DataTree in `Data` and list of objects (polylines) in `Geom` to a shapefile.  If not specified in `file`, a default file name based on the Rhino doc or Grasshopper doc name is used (unless `auto_update_Rhino_doc_path = false`).  `overwrite_shp` = true overwrites existing files; false or creates new files up to a maximum of `max_new_files`.  **WARNING!  Shapefiles created with default names (due to no valid file path being specified in `file` by the user) will be deleted by subsequent sDNA tools if `strict_no_del` = false, `overwrite_shp` = false, and `del_after_sDNA` = true.**  To create a projection (.prj) file for the new shapefile, specify the path of an existing .prj file in `prj`.  If no Data is supplied and `auto_read_User_Text` is true, this tool will first call read_User_Text.  To work with sDNA, data records are only written to the Shapefile (associated with a shape corresponding to a Rhino / GH polyline) if its field matches the template string specified in `input_key_str`.  The field name has a maximum of 10 characters long, and is taken from the `{name}` value (in the key name if it originated as User Text). To write all data with any key name (shorter then 11 characters) to the Shapefile, set `input_key_str` to `{name}`.
"""

__author__ = 'James Parrott'
__version__ = '2.0'



import sys
import os
import functools
import importlib

from ghpythonlib.componentbase import executingcomponent as component
import Grasshopper
import scriptcontext as sc

import_module = importlib.import_module
try:
    reload #type: ignore
except NameError:
    reload = importlib.reload

try:
    basestring #type: ignore
except NameError:
    basestring = str

try:
    ghdoc #type: ignore
except NameError:
    from .custom.skel.basic.ghdoc import ghdoc

ZIP_FILE_NAME = 'sdna-gh'
PACKAGE_NAME = 'sDNA_GH'
PLUG_IN_NAME = 'sDNA'               
RELOAD_IF_ALREADY_IMPORTED = False
REPOSITORY = os.path.dirname(os.path.dirname(ghdoc.Path)) if ghdoc.Path else None
# Assume we are in repo_folder/dev/sDNA_build_components.gh

USER_INSTALLATION_FOLDER = os.path.join(
                                    Grasshopper.Folders.DefaultUserObjectFolder
                                   ,ZIP_FILE_NAME
                                   )
SELFTEST = 'selftest'




class Output(object): 

    def set_logger(self, logger, flush = True):
        self.logger = logger
        if flush and self.tmp_logs:
            self.flush()

    def __init__(self
                ,tmp_logs = None
                ,logger = None
                ):
        if not isinstance(tmp_logs, list): #assert not isinstance(None, list)
            tmp_logs = []
        self.tmp_logs = tmp_logs
        self.set_logger(logger, flush = False)



    def store(self, message, logging_level):
        self.tmp_logs.append( (message, logging_level) )

    def __call__(self, message, logging_level = "INFO", logging_dict = {}):
        #type: (str, str, dict, list) -> str
        
        #logger.debug(s)

        if logging_dict == {} and self.logger is not None: 
            logging_dict = dict( DEBUG = self.logger.debug
                                ,INFO = self.logger.info
                                ,WARNING = self.logger.warning
                                ,ERROR = self.logger.error
                                ,CRITICAL = self.logger.critical
                                )

        logging_level = logging_level.upper()
        if logging_level in logging_dict:
            logging_dict[logging_level](message)
        else:
            self.store(message, logging_level)

        return '%s : %s ' % (logging_level, message)

    def __getattr__(self, attr):
        return functools.partial(self.__call__, logging_level = attr.upper())

    def flush(self):
        tmp_logs = self.tmp_logs[:] # __call__ might cache back to tmp_logs
        self.tmp_logs[:] = [] # Mutate list initialised with.  Avoid double 
                              # logging in case re - stored in tmp_logs
        for tmp_log_message, tmp_log_level in tmp_logs:
            self.__call__(tmp_log_message, tmp_log_level)

output = Output()


class InvalidArgsError(Exception):
    
    """Custom exception to log the error message, and to at least allow 
       attempts to give users actionable advice to fix the issue, in 
       the event of a problem.  
    """
    message_fmt = 'Invalid import args: %s'
    def __init__(self
                ,message_fmt = ''
                ,message = ''
                ,logger = output
                , **kwargs
                ):
        if message_fmt and isinstance(message_fmt, basestring):
            self.message_fmt = message_fmt
        if kwargs and (not message or not isinstance(message, basestring)):
            message = self.message_fmt % kwargs
        logger.error(message)
        self.kwargs = kwargs
        super(InvalidArgsError, self).__init__(message)    


class ModuleNameError(InvalidArgsError):
    message_fmt = 'Invalid module name: %s'


class FilePathError(InvalidArgsError):
    message_fmt = 'Invalid path to import module from: %s'


# We only know the sDNA version to import as a string.  This is more secure too.
def strict_import(module_name = ''
                 ,folder = ''
                 ,sub_folder = ''
                 ,logger = output
                 ,reload_already_imported = RELOAD_IF_ALREADY_IMPORTED
                 ):

    # type: (str, str, str, type[any], bool) -> type[any]
    """ Imports the named module from the specified folder\subfolder only, 
        and returns it.
        
        Avoids name clashes and casual hijack attempts.  In some 
        environments supporting a Python implementation (such as 
        GhPython in Grasshopper) it may not be desirable to ask the user 
        to set PYTHONPATH.  Hence here, we save sys.path to a tmp 
        variable, set sys.path to the specified folders, attempt the 
        import in a try: block, and restore sys.path in a finally: block
    """
    if not module_name or not isinstance(module_name, basestring):
        raise ModuleNameError(module_name = module_name
                             ,folder = folder
                             ,sub_folder = sub_folder
                             ,logger = logger
                             )
    logger.debug(module_name)
    if module_name in sys.modules:   # sys.modules is also shared between GHPython components 
                                     # (and is even saved until Rhino is closed).
        logger.debug('Module %s already in sys.modules' % module_name)
        if reload_already_imported:
            logger.debug('Reloading %s.... ' % module_name)
            reload(sys.modules[module_name]) # type: ignore
        return sys.modules[module_name]
    #
    #
    # Load module_name for first time:
    #
    #
    search_path = os.path.join(folder, sub_folder)

    if (search_path 
        and isinstance(search_path, basestring) 
        and os.path.isdir(search_path)):
        #
        logger.debug('Search path == %s' % search_path)
        #if search_folder_only:
        #    sys.path = [search_path]
        if search_path not in sys.path:
            sys.path.insert(0, search_path)
    else:
        raise FilePathError(module_name = module_name
                           ,search_path = search_path
                           ,logger = logger
                           )

    logger.debug('Trying import... ')
    module = import_module(module_name, '')           

    return module       


class ModulesNotFoundError(InvalidArgsError):
    message_fmt = 'Modules not found in any location %s'


def load_modules(m_names
                ,folders
                ,logger = output
                ,module_name_error_msg = 'Please supply valid names of modules to import, %s'
                ,folders_error_msg = 'Please supply valid folders to import from. %s'
                ,modules_not_found_msg = 'Specified modules not found in any folder, %s'):
    #type(str/ Iterable, list, type[any], str, str) -> tuple / None
    """ Tries to import all modules in m_names, from the first folder in 
        folders to contain a .py or .pyc files with the same name as each 
        module.

        Returns a tuple of all the modules and the path they were found in.  Else 
        raises a ModulesNotFoundError.
    """
    if not m_names:
        raise ModuleNameError(message_fmt = 'No module names supplied, m_names = %s'
                             ,m_names = m_names
                             ,logger = logger
                             )

    if any( not isinstance(m_name, basestring) for m_name in m_names ):
        # if m_names is a basestring, the error is not raised 
        raise ModuleNameError(message_fmt = module_name_error_msg
                             ,m_names = m_names
                             ,logger = logger
                             )
    
    if isinstance(m_names, basestring):
        m_names = [m_names] 

    logger.debug('m_names == %s of type : %s' % (m_names, type(m_names).__name__))

    logger.debug('Testing paths : %s ' % folders)
    
    if isinstance(folders, basestring):
        folders = [folders]

    if not any(os.path.isdir(folder) or os.path.isdir(os.path.dirname(folder)) 
               for folder in folders
              ):
        raise FilePathError(message_fmt = folders_error_msg
                           ,m_names = m_names
                           ,logger = logger
                           )

    for folder in folders:
        logger.debug('Type(folder) : %s' % type(folder).__name__)
        logger.debug('Type(path) : %s path == %s' %(type(folder).__name__, folder))

        if os.path.isfile(folder):
            folder = os.path.dirname(folder)
        if all( any(os.path.isfile(os.path.join(folder, name.replace('.', os.sep) + ending)) 
                    for ending in ['.py','.pyc'] 
                   )
                for name in m_names
              ):
            #
            logger.debug('Importing %s' % repr(m_names))

            return tuple(strict_import(name, folder, '', logger = logger) 
                         for name in m_names
                        ) + (folder,)
            # tuple of modules, followed by the path to them
    raise ModulesNotFoundError(message_fmt = modules_not_found_msg
                              ,m_names = m_names
                              ,folders = folders
                              ,logger = logger
                              )




if __name__ == '__main__': # False in a compiled component.  But then the user
                           # can't add or remove Params to the component.  
    
    # Grasshopper will look for class MyComponent(component) in global scope
    # so a main function is a little tricky to define.

    nick_name = ghenv.Component.NickName #type: ignore


    if (REPOSITORY and 
        nick_name == 'Build_components'):
        #
        sDNA_GH_search_path = REPOSITORY 
        # builder can only load sDNA_GH from its parent directory, 
        # e.g. if in a dir one level up in the main repo
        # such as sDNA_build_components.gh.
    else:
        sDNA_GH_search_path = USER_INSTALLATION_FOLDER


    sc.doc = ghdoc #type: ignore

    output.debug(sDNA_GH_search_path)

    class sDNA_GH(object):
        pass

    if 'sDNA_GH.main' in sys.modules:
        sDNA_GH.main = sys.modules['sDNA_GH.main']
    else:
        sDNA_GH.main, _ = load_modules(m_names = PACKAGE_NAME + '.main'
                                      ,folders = sDNA_GH_search_path
                                      ,folders_error_msg = 'Please unzip %s.zip '
                                                           %ZIP_FILE_NAME
                                                           +' in the folder %s '
                                                           %Grasshopper.Folders.DefaultUserObjectFolder
                                                           +'and ensure a subfolder called %s is created '
                                                           %os.path.join(ZIP_FILE_NAME, PACKAGE_NAME)
                                                           +'inside it, containing main.py ' 
                                                           +'and all the sDNA_GH python files '
                                                           +'including those within other subfolders. ' 
                                      ,modules_not_found_msg = 'Some sDNA_GH files may be missing.  '
                                                              +'Please: 1) Copy %s.zip into: %s '
                                                              %(ZIP_FILE_NAME
                                                               ,Grasshopper.Folders.DefaultUserObjectFolder
                                                               )
                                                              +'2) Unblock it if necessary. '
                                                              +'3) Right click '
                                                              +'it, select Extract All... and click Extract, '
                                                              +'to extract it to that location. '
                                                              +'4) Ensure that main.py and all sDNA_GH python' 
                                                              +' files and subfolders are inside: %s '
                                                              %os.path.join(USER_INSTALLATION_FOLDER
                                                                           ,PACKAGE_NAME
                                                                           )
                                                              +'5) Reinitialise the component or restart Rhino.'
                                      )         


    logger = sDNA_GH.main.logger.getChild('launcher')
    output.set_logger(logger, flush = True)


    class MyComponent(component):
        pass  # Required.  Idiomatic to Grasshopper.  Must be called "MyComponent"  
            # too (it is looked for by the parser or scope checker?) otherwise 
            # Grasshopper may not find the subclass of on 
            # component.  Even though we overwrite this class on the next line
            # immediately below.  

    MyComponent = sDNA_GH.main.sDNA_GH_Component
    # Grasshopper calls MyComponent.RunScript automatically.


    if nick_name.replace(' ','').replace('_','').lower() == SELFTEST:  


        unit_tests, _ = load_modules('%s.tests.unit_tests.%s_unit_tests' % ((PACKAGE_NAME,)*2)
                                    ,sDNA_GH_search_path
                                    )

        
        MyComponent = unit_tests.make_test_running_component_class(
                                         MyComponent
                                        ,package_location = sDNA_GH_search_path
                                        )
        # Grasshopper calls MyComponent.RunScript automatically.
# ---------- end write_shp ----------
toggle_3 = BooleanToggle(False)
sdna_integral = SDNA_Integral(go=write_shp.OK, file=write_shp.file, auto_read_Shp=toggle_3, auto_write_Shp=toggle_3)  # -> out, OK, opts, file, Geom, Data, abbrevs, fields, bbox; inputs go: list, opts: list, file: list, config: list, input: list, output: list, betweenness: list, bidir: list, junctions: list, hull: list, start_gs: list, end_gs: list, analmet: list, radii: list, bandedradii: list, cont: list, radmet: list, weighting: list, origweight: list, destweight: list, zonefiles: list, odfile: list, custommetric: list, disable: list, oneway: list, intermediates: list, advanced: list, Geom: list, Data: tree, prj: list, input_key_str: list, bake: list
#   port go: true: runs tools. false: do not run tools but still read other Params.
#   port opts: sDNA_GH options data structure. Python dictionary.
#   port file: File path of the shape file.
#   port config: File path to sDNA_GH options file, e.g. config.toml
#   port input: Input polyline features. Default value == .Type: File path.
#   port output: Output features. Default value == .Type: File path.
#   port betweenness: Compute betweenness. Default value == True.Type: Boolean.
#   port bidir: Betweenness is bidirectional. Default value == False.Type: Boolean.
#   port junctions: Compute junction counts. Default value == False.Type: Boolean.
#   port hull: Compute convex hull statistics. Default value == False.Type: Boolean.
#   port start_gs: Start grade separation. Default value == .. Allowed values: Numeric, input. Type: Text.
#   port end_gs: End grade separation. Default value == .. Allowed values: Numeric, input. Type: Text.
#   port analmet: Routing and analysis metric. Default value == EUCLIDEAN.. Allowed values: EUCLIDEAN, ANGULAR, HYBRID, CUSTOM, CYCLE, CYCLE_ROUNDTRIP, PEDESTRIAN, VEHICLE, PUBLIC_TRANSPORT, EUCLIDEAN_ANGULAR. Type: Text.
#   port radii: Radii (in units of radial metric or source data projection). Default value == n.Type: Text.
#   port bandedradii: Banded radius. Default value == False.Type: Boolean.
#   port cont: Continuous Space. Default value == False.Type: Boolean.
#   port radmet: Radial metric. Default value == EUCLIDEAN.. Allowed values: EUCLIDEAN, MATCH_ANALYTICAL, ANGULAR, HYBRID, CUSTOM, CYCLE, CYCLE_ROUNDTRIP, PEDESTRIAN, VEHICLE, PUBLIC_TRANSPORT, EUCLIDEAN_ANGULAR. Type: Text.
#   port weighting: Weighting. Default value == Link.. Allowed values: Link, Length, Polyline. Type: Text.
#   port origweight: Origin weight. Default value == .. Allowed values: Numeric, input. Type: Text.
#   port destweight: Destination weight. Default value == .. Allowed values: Numeric, input. Type: Text.
#   port zonefiles: Zone table input csv files. Default value == .Type: File path.
#   port odfile: Origin Destination Matrix input file. Default value == .Type: File path.
#   port custommetric: Custom metric field. Default value == .. Allowed values: Numeric, input. Type: Text.
#   port disable: Disable lines (field name or expression). Default value == .Type: Text.
#   port oneway: One way restrictions. Default value == .. Allowed values: Numeric, input. Type: Text.
#   port intermediates: Intermediate link filter (field name or expression). Default value == .Type: Text.
#   port advanced: Advanced config. Default value == .Type: Text.
#   port Geom: A list of geometric objects. Requires GUIDs of Rhino objects or native/embedded Grasshopper geometry. To use Rhino objects referenced from Grasshopper parameter objects (instead of their Grasshopper versions which are often obscured unless the Rhino shapes are set to Hidden) run the output of the Geometry (Geo) or Curve (Crv) through a Guid (ID) parameter object first. Note: For sDNA tools all the geometric objects must all be polylines. For write_Shp all the objects must be of the type in shp_type (default: POLYLINEZ).
#   port Data: A Data Tree of a list of keys and list of corresponding values for each object in Geom.
#   port prj: File path of the projection file (.prj) to use for the new shapefile. Default :
#   port input_key_str: Format string containing a prefix, a {name} field, and a postfix, to enable more descriptive User Text key names. Default: {name} Only User Text key names matching this pattern will have their values written to shape files by Write_Shp,under the field name in {name}, which can have a max of 10 chars in Write_Shp. The actual values of name in User Text keys must also be specified to the sDNA tools that use them.
#   port bake: If new shapes are created, thentrue: bakes the shapefile polylines to Rhino. false: creates Grasshopper polylines only. Default: False
#   port OK: true: tools ran successfully. false: tools did not run, or there was an error.
#   port opts: sDNA_GH options data structure. Python dictionary.
#   port file: File path of the shape file.
#   port Geom: A list of geometric objects. Requires GUIDs of Rhino objects or native/embedded Grasshopper geometry. To use Rhino objects referenced from Grasshopper parameter objects (instead of their Grasshopper versions which are often obscured unless the Rhino shapes are set to Hidden) run the output of the Geometry (Geo) or Curve (Crv) through a Guid (ID) parameter object first. Note: For sDNA tools all the geometric objects must all be polylines. For write_Shp all the objects must be of the type in shp_type (default: POLYLINEZ).
#   port Data: A Data Tree of a list of keys and list of corresponding values for each object in Geom.
#   port abbrevs: Abbreviations of sDNA results from the ...names.csv file.
#   port fields: Field names from the Shapefile. Set field to one of these values to parse and/or plot it.
#   port bbox: Bounding box from the Shapefile. Used to calculate leg_frame by the Recolour_objects component. [x_min, y_min, x_max, y_max]. All Numbers.
# ---------- sdna_integral: Python ----------
#! /usr/bin/awk NR==3
# -*- coding: utf-8 -*-
# This module requires Grasshopper Python (Rhino3D)

# MIT License

# Copyright (c) [2021] [Cardiff University, a body incorporated
# by Royal Charter and a registered charity (number:
# 1136855) whose administrative offices are at 7th floor 30-
# 36 Newport Road, University CF24 0DE, Wales, UK]

# Permission is hereby granted, free of charge, to any person obtaining a copy
# of this software and associated documentation files (the "Software"), to deal
# in the Software without restriction, including without limitation the rights
# to use, copy, modify, merge, publish, distribute, sublicense, and/or sell
# copies of the Software, and to permit persons to whom the Software is
# furnished to do so, subject to the following conditions:

# The above copyright notice and this permission notice shall be included in all
# copies or substantial portions of the Software.

# THE SOFTWARE IS PROVIDED "AS IS", WITHOUT WARRANTY OF ANY KIND, EXPRESS OR
# IMPLIED, INCLUDING BUT NOT LIMITED TO THE WARRANTIES OF MERCHANTABILITY,
# FITNESS FOR A PARTICULAR PURPOSE AND NONINFRINGEMENT. IN NO EVENT SHALL THE
# AUTHORS OR COPYRIGHT HOLDERS BE LIABLE FOR ANY CLAIM, DAMAGES OR OTHER
# LIABILITY, WHETHER IN AN ACTION OF CONTRACT, TORT OR OTHERWISE, ARISING FROM,
# OUT OF OR IN CONNECTION WITH THE SOFTWARE OR THE USE OR OTHER DEALINGS IN THE
# SOFTWARE.



"""sDNA Integral is the core analysis tool of sDNA. It computes several flow, accessibility, severance and efficiency measures on networks. 

This automatically calls other support tools, handling an entire Rhino geometry workflow from this one component, additionally running Read_Geom and Write_Shp before the sDNA tool itself, and then Read_Shp and Recolour_Objects afterwards  (unless `auto_write_Shp` = false or `auto_read_Shp` = false respectively).   **WARNING!  All sDNA tools will delete the shapefile named in input after it has been read in, if `del_after_sDNA` = true and `strict_no_del` = false (as they are by default).**  

To add or remove existing `Geom`etry before the results file is read in (to control creation of new geometry objects), set `auto_read_Shp` = false and connect a Read_Shp component.  To analyse a network of Grasshopper Geometry set `auto_get_Geom` and `auto_read_User_Text` to false.  To access the data and geom objects before parsing and recolouring, `auto_plot_data` = false (and connect Parse_Data and Recolour_Objects components).  This allows picking a results field from `abbrevs` to parse without repeating the whole analysis, and using a Grasshopper Colour Gradient component on the canvas to generate colours.  Connect a Grasshopper Legend component to plot a legend. To recolour Grasshopper geometry instead of Rhino Geometry (i.e. unbaked objects), connect the `Data` and `Geom` outputs to a Grasshopper Custom Preview component.

To use sDNA's advanced config options in sDNA_GH, add in an input Param to an sDNA component with the same name as each advanced config option you wish to include (omitting a trailing equals sign and leaving the Param unconnected, unless you wish to provide a value for it); the `advanced` config string can then be saved to a `config.toml` file with an sDNA_GH Config component).  Alternatively create an `advanced` config string manually.  The sDNA tools in that component will gather all user-specified input Params and construct the `advanced` config string from them.  Alternatively, prepare the and connect it to `advanced`.  See the readme for the list of supported advanced config options.
"""

__author__ = 'James Parrott'
__version__ = '2.0'



import sys
import os
import functools
import importlib

from ghpythonlib.componentbase import executingcomponent as component
import Grasshopper
import scriptcontext as sc

import_module = importlib.import_module
try:
    reload #type: ignore
except NameError:
    reload = importlib.reload

try:
    basestring #type: ignore
except NameError:
    basestring = str

try:
    ghdoc #type: ignore
except NameError:
    from .custom.skel.basic.ghdoc import ghdoc

ZIP_FILE_NAME = 'sdna-gh'
PACKAGE_NAME = 'sDNA_GH'
PLUG_IN_NAME = 'sDNA'               
RELOAD_IF_ALREADY_IMPORTED = False
REPOSITORY = os.path.dirname(os.path.dirname(ghdoc.Path)) if ghdoc.Path else None
# Assume we are in repo_folder/dev/sDNA_build_components.gh

USER_INSTALLATION_FOLDER = os.path.join(
                                    Grasshopper.Folders.DefaultUserObjectFolder
                                   ,ZIP_FILE_NAME
                                   )
SELFTEST = 'selftest'




class Output(object): 

    def set_logger(self, logger, flush = True):
        self.logger = logger
        if flush and self.tmp_logs:
            self.flush()

    def __init__(self
                ,tmp_logs = None
                ,logger = None
                ):
        if not isinstance(tmp_logs, list): #assert not isinstance(None, list)
            tmp_logs = []
        self.tmp_logs = tmp_logs
        self.set_logger(logger, flush = False)



    def store(self, message, logging_level):
        self.tmp_logs.append( (message, logging_level) )

    def __call__(self, message, logging_level = "INFO", logging_dict = {}):
        #type: (str, str, dict, list) -> str
        
        #logger.debug(s)

        if logging_dict == {} and self.logger is not None: 
            logging_dict = dict( DEBUG = self.logger.debug
                                ,INFO = self.logger.info
                                ,WARNING = self.logger.warning
                                ,ERROR = self.logger.error
                                ,CRITICAL = self.logger.critical
                                )

        logging_level = logging_level.upper()
        if logging_level in logging_dict:
            logging_dict[logging_level](message)
        else:
            self.store(message, logging_level)

        return '%s : %s ' % (logging_level, message)

    def __getattr__(self, attr):
        return functools.partial(self.__call__, logging_level = attr.upper())

    def flush(self):
        tmp_logs = self.tmp_logs[:] # __call__ might cache back to tmp_logs
        self.tmp_logs[:] = [] # Mutate list initialised with.  Avoid double 
                              # logging in case re - stored in tmp_logs
        for tmp_log_message, tmp_log_level in tmp_logs:
            self.__call__(tmp_log_message, tmp_log_level)

output = Output()


class InvalidArgsError(Exception):
    
    """Custom exception to log the error message, and to at least allow 
       attempts to give users actionable advice to fix the issue, in 
       the event of a problem.  
    """
    message_fmt = 'Invalid import args: %s'
    def __init__(self
                ,message_fmt = ''
                ,message = ''
                ,logger = output
                , **kwargs
                ):
        if message_fmt and isinstance(message_fmt, basestring):
            self.message_fmt = message_fmt
        if kwargs and (not message or not isinstance(message, basestring)):
            message = self.message_fmt % kwargs
        logger.error(message)
        self.kwargs = kwargs
        super(InvalidArgsError, self).__init__(message)    


class ModuleNameError(InvalidArgsError):
    message_fmt = 'Invalid module name: %s'


class FilePathError(InvalidArgsError):
    message_fmt = 'Invalid path to import module from: %s'


# We only know the sDNA version to import as a string.  This is more secure too.
def strict_import(module_name = ''
                 ,folder = ''
                 ,sub_folder = ''
                 ,logger = output
                 ,reload_already_imported = RELOAD_IF_ALREADY_IMPORTED
                 ):

    # type: (str, str, str, type[any], bool) -> type[any]
    """ Imports the named module from the specified folder\subfolder only, 
        and returns it.
        
        Avoids name clashes and casual hijack attempts.  In some 
        environments supporting a Python implementation (such as 
        GhPython in Grasshopper) it may not be desirable to ask the user 
        to set PYTHONPATH.  Hence here, we save sys.path to a tmp 
        variable, set sys.path to the specified folders, attempt the 
        import in a try: block, and restore sys.path in a finally: block
    """
    if not module_name or not isinstance(module_name, basestring):
        raise ModuleNameError(module_name = module_name
                             ,folder = folder
                             ,sub_folder = sub_folder
                             ,logger = logger
                             )
    logger.debug(module_name)
    if module_name in sys.modules:   # sys.modules is also shared between GHPython components 
                                     # (and is even saved until Rhino is closed).
        logger.debug('Module %s already in sys.modules' % module_name)
        if reload_already_imported:
            logger.debug('Reloading %s.... ' % module_name)
            reload(sys.modules[module_name]) # type: ignore
        return sys.modules[module_name]
    #
    #
    # Load module_name for first time:
    #
    #
    search_path = os.path.join(folder, sub_folder)

    if (search_path 
        and isinstance(search_path, basestring) 
        and os.path.isdir(search_path)):
        #
        logger.debug('Search path == %s' % search_path)
        #if search_folder_only:
        #    sys.path = [search_path]
        if search_path not in sys.path:
            sys.path.insert(0, search_path)
    else:
        raise FilePathError(module_name = module_name
                           ,search_path = search_path
                           ,logger = logger
                           )

    logger.debug('Trying import... ')
    module = import_module(module_name, '')           

    return module       


class ModulesNotFoundError(InvalidArgsError):
    message_fmt = 'Modules not found in any location %s'


def load_modules(m_names
                ,folders
                ,logger = output
                ,module_name_error_msg = 'Please supply valid names of modules to import, %s'
                ,folders_error_msg = 'Please supply valid folders to import from. %s'
                ,modules_not_found_msg = 'Specified modules not found in any folder, %s'):
    #type(str/ Iterable, list, type[any], str, str) -> tuple / None
    """ Tries to import all modules in m_names, from the first folder in 
        folders to contain a .py or .pyc files with the same name as each 
        module.

        Returns a tuple of all the modules and the path they were found in.  Else 
        raises a ModulesNotFoundError.
    """
    if not m_names:
        raise ModuleNameError(message_fmt = 'No module names supplied, m_names = %s'
                             ,m_names = m_names
                             ,logger = logger
                             )

    if any( not isinstance(m_name, basestring) for m_name in m_names ):
        # if m_names is a basestring, the error is not raised 
        raise ModuleNameError(message_fmt = module_name_error_msg
                             ,m_names = m_names
                             ,logger = logger
                             )
    
    if isinstance(m_names, basestring):
        m_names = [m_names] 

    logger.debug('m_names == %s of type : %s' % (m_names, type(m_names).__name__))

    logger.debug('Testing paths : %s ' % folders)
    
    if isinstance(folders, basestring):
        folders = [folders]

    if not any(os.path.isdir(folder) or os.path.isdir(os.path.dirname(folder)) 
               for folder in folders
              ):
        raise FilePathError(message_fmt = folders_error_msg
                           ,m_names = m_names
                           ,logger = logger
                           )

    for folder in folders:
        logger.debug('Type(folder) : %s' % type(folder).__name__)
        logger.debug('Type(path) : %s path == %s' %(type(folder).__name__, folder))

        if os.path.isfile(folder):
            folder = os.path.dirname(folder)
        if all( any(os.path.isfile(os.path.join(folder, name.replace('.', os.sep) + ending)) 
                    for ending in ['.py','.pyc'] 
                   )
                for name in m_names
              ):
            #
            logger.debug('Importing %s' % repr(m_names))

            return tuple(strict_import(name, folder, '', logger = logger) 
                         for name in m_names
                        ) + (folder,)
            # tuple of modules, followed by the path to them
    raise ModulesNotFoundError(message_fmt = modules_not_found_msg
                              ,m_names = m_names
                              ,folders = folders
                              ,logger = logger
                              )




if __name__ == '__main__': # False in a compiled component.  But then the user
                           # can't add or remove Params to the component.  
    
    # Grasshopper will look for class MyComponent(component) in global scope
    # so a main function is a little tricky to define.

    nick_name = ghenv.Component.NickName #type: ignore


    if (REPOSITORY and 
        nick_name == 'Build_components'):
        #
        sDNA_GH_search_path = REPOSITORY 
        # builder can only load sDNA_GH from its parent directory, 
        # e.g. if in a dir one level up in the main repo
        # such as sDNA_build_components.gh.
    else:
        sDNA_GH_search_path = USER_INSTALLATION_FOLDER


    sc.doc = ghdoc #type: ignore

    output.debug(sDNA_GH_search_path)

    class sDNA_GH(object):
        pass

    if 'sDNA_GH.main' in sys.modules:
        sDNA_GH.main = sys.modules['sDNA_GH.main']
    else:
        sDNA_GH.main, _ = load_modules(m_names = PACKAGE_NAME + '.main'
                                      ,folders = sDNA_GH_search_path
                                      ,folders_error_msg = 'Please unzip %s.zip '
                                                           %ZIP_FILE_NAME
                                                           +' in the folder %s '
                                                           %Grasshopper.Folders.DefaultUserObjectFolder
                                                           +'and ensure a subfolder called %s is created '
                                                           %os.path.join(ZIP_FILE_NAME, PACKAGE_NAME)
                                                           +'inside it, containing main.py ' 
                                                           +'and all the sDNA_GH python files '
                                                           +'including those within other subfolders. ' 
                                      ,modules_not_found_msg = 'Some sDNA_GH files may be missing.  '
                                                              +'Please: 1) Copy %s.zip into: %s '
                                                              %(ZIP_FILE_NAME
                                                               ,Grasshopper.Folders.DefaultUserObjectFolder
                                                               )
                                                              +'2) Unblock it if necessary. '
                                                              +'3) Right click '
                                                              +'it, select Extract All... and click Extract, '
                                                              +'to extract it to that location. '
                                                              +'4) Ensure that main.py and all sDNA_GH python' 
                                                              +' files and subfolders are inside: %s '
                                                              %os.path.join(USER_INSTALLATION_FOLDER
                                                                           ,PACKAGE_NAME
                                                                           )
                                                              +'5) Reinitialise the component or restart Rhino.'
                                      )         


    logger = sDNA_GH.main.logger.getChild('launcher')
    output.set_logger(logger, flush = True)


    class MyComponent(component):
        pass  # Required.  Idiomatic to Grasshopper.  Must be called "MyComponent"  
            # too (it is looked for by the parser or scope checker?) otherwise 
            # Grasshopper may not find the subclass of on 
            # component.  Even though we overwrite this class on the next line
            # immediately below.  

    MyComponent = sDNA_GH.main.sDNA_GH_Component
    # Grasshopper calls MyComponent.RunScript automatically.


    if nick_name.replace(' ','').replace('_','').lower() == SELFTEST:  


        unit_tests, _ = load_modules('%s.tests.unit_tests.%s_unit_tests' % ((PACKAGE_NAME,)*2)
                                    ,sDNA_GH_search_path
                                    )

        
        MyComponent = unit_tests.make_test_running_component_class(
                                         MyComponent
                                        ,package_location = sDNA_GH_search_path
                                        )
        # Grasshopper calls MyComponent.RunScript automatically.
# ---------- end sdna_integral ----------
# Set resids to local file (no ext)
panel = Panel("C:\Users\James\Documents\Rhino\Grasshopper\sDNA\source\repos\GHsDNAv0.01\test_cases\sDNA_tool_tests\Learn\resids")
merge = Merge(Data1=panel, Data2=".names.csv")
join = TextJoin(Text=merge)
file = ReadFile(File=join, PerLineParse=False)
toggle_4 = BooleanToggle(False)
list = ValueList({"ID", "LConn", "LLen", "LFrac", "LAC", "LSin", "LBear", "MEDn", "NQPDEn", "BtEn", "TPBtEn", "TPDn", "Lnkn", "Lenn", "AngDn", "Wtn", "MGLEn", "MCFn", "DivEn"}, selected="BtEn")
list_2 = ValueList({"ID", "LConn", "LLen", "LFrac", "LAC", "LSin", "LBear", "MEDn", "NQPDEn", "BtEn", "TPBtEn", "TPDn", "Lnkn", "Lenn", "AngDn", "Wtn", "MGLEn", "MCFn", "DivEn"}, selected="TPBtEn")
sdna_learn = SDNA_Learn(
    go=sdna_integral.OK,
    file=sdna_integral.file,
    resids=panel,
    target=list,
    predictors=list_2,
    auto_write_Shp=toggle_4,
    auto_read_Shp=toggle_4)  # -> out, OK, opts, file, Geom, Data, abbrevs, fields, bbox; inputs go: list, opts: list, file: list, config: list, input: list, output: list, resids: list, target: list, predictors: list, regex: list, algorithm: list, intercept: list, bctarget: list, bcregex: list, weightlambda: list, nfolds: list, reps: list, gehtime: list, reglambda: list, Geom: list, bake: list, Data: tree, prj: list, input_key_str: list
#   port go: true: runs tools. false: do not run tools but still read other Params.
#   port opts: sDNA_GH options data structure. Python dictionary.
#   port file: File path of the shape file.
#   port config: File path to sDNA_GH options file, e.g. config.toml
#   port input: Input features. Default value == .Type: File path.
#   port output: Output model file. Default value == .Type: File path.
#   port resids: Output residual features. Default value == .Type: File path.
#   port target: Target variable. Default value == .. Allowed values: Numeric, input. Type: Text.
#   port predictors: Predictor variables. Default value == .. Allowed values: Numeric, input.
#   port regex: Predictor variable regex. Default value == .Type: Text.
#   port algorithm: Learning algorithm. Default value == Single_best_variable.. Allowed values: Single_best_variable, Multiple_variables, All_variables. Type: Text.
#   port intercept: Use intercept in multivariate models. Default value == False.Type: Boolean.
#   port bctarget: Box-Cox transform target variable. Default value == False.Type: Boolean.
#   port bcregex: Regex for predictor variables to Box-Cox transform. Default value == .Type: Text.
#   port weightlambda: Weighting lambda. Default value == 1.Type: Text.
#   port nfolds: Number of folds for cross-validation. Default value == 7.Type: Text.
#   port reps: Number of repetitions for bootstrapping. Default value == 50.Type: Text.
#   port gehtime: Time interval for measurements (in hours, for computing GEH). Default value == 1.Type: Text.
#   port reglambda: Regularization lambda min,max. Default value == .Type: Text.
#   port Geom: A list of geometric objects. Requires GUIDs of Rhino objects or native/embedded Grasshopper geometry. To use Rhino objects referenced from Grasshopper parameter objects (instead of their Grasshopper versions which are often obscured unless the Rhino shapes are set to Hidden) run the output of the Geometry (Geo) or Curve (Crv) through a Guid (ID) parameter object first. Note: For sDNA tools all the geometric objects must all be polylines. For write_Shp all the objects must be of the type in shp_type (default: POLYLINEZ).
#   port bake: If new shapes are created, thentrue: bakes the shapefile polylines to Rhino. false: creates Grasshopper polylines only. Default: False
#   port Data: A Data Tree of a list of keys and list of corresponding values for each object in Geom.
#   port prj: File path of the projection file (.prj) to use for the new shapefile. Default :
#   port input_key_str: Format string containing a prefix, a {name} field, and a postfix, to enable more descriptive User Text key names. Default: {name} Only User Text key names matching this pattern will have their values written to shape files by Write_Shp,under the field name in {name}, which can have a max of 10 chars in Write_Shp. The actual values of name in User Text keys must also be specified to the sDNA tools that use them.
#   port OK: true: tools ran successfully. false: tools did not run, or there was an error.
#   port opts: sDNA_GH options data structure. Python dictionary.
#   port file: File path of the shape file.
#   port Geom: A list of geometric objects. Requires GUIDs of Rhino objects or native/embedded Grasshopper geometry. To use Rhino objects referenced from Grasshopper parameter objects (instead of their Grasshopper versions which are often obscured unless the Rhino shapes are set to Hidden) run the output of the Geometry (Geo) or Curve (Crv) through a Guid (ID) parameter object first. Note: For sDNA tools all the geometric objects must all be polylines. For write_Shp all the objects must be of the type in shp_type (default: POLYLINEZ).
#   port Data: A Data Tree of a list of keys and list of corresponding values for each object in Geom.
#   port abbrevs: Abbreviations of sDNA results from the ...names.csv file.
#   port fields: Field names from the Shapefile. Set field to one of these values to parse and/or plot it.
#   port bbox: Bounding box from the Shapefile. Used to calculate leg_frame by the Recolour_objects component. [x_min, y_min, x_max, y_max]. All Numbers.
# ---------- sdna_learn: Python ----------
#! /usr/bin/awk NR==3
# -*- coding: utf-8 -*-
# This module requires Grasshopper Python (Rhino3D)

# MIT License

# Copyright (c) [2021] [Cardiff University, a body incorporated
# by Royal Charter and a registered charity (number:
# 1136855) whose administrative offices are at 7th floor 30-
# 36 Newport Road, University CF24 0DE, Wales, UK]

# Permission is hereby granted, free of charge, to any person obtaining a copy
# of this software and associated documentation files (the "Software"), to deal
# in the Software without restriction, including without limitation the rights
# to use, copy, modify, merge, publish, distribute, sublicense, and/or sell
# copies of the Software, and to permit persons to whom the Software is
# furnished to do so, subject to the following conditions:

# The above copyright notice and this permission notice shall be included in all
# copies or substantial portions of the Software.

# THE SOFTWARE IS PROVIDED "AS IS", WITHOUT WARRANTY OF ANY KIND, EXPRESS OR
# IMPLIED, INCLUDING BUT NOT LIMITED TO THE WARRANTIES OF MERCHANTABILITY,
# FITNESS FOR A PARTICULAR PURPOSE AND NONINFRINGEMENT. IN NO EVENT SHALL THE
# AUTHORS OR COPYRIGHT HOLDERS BE LIABLE FOR ANY CLAIM, DAMAGES OR OTHER
# LIABILITY, WHETHER IN AN ACTION OF CONTRACT, TORT OR OTHERWISE, ARISING FROM,
# OUT OF OR IN CONNECTION WITH THE SOFTWARE OR THE USE OR OTHER DEALINGS IN THE
# SOFTWARE.



"""sDNA Learn selects the best model for predicting a target variable, then computes GEH and cross-validated *R²*.  If an output model file is set, the best model is saved and can be applied to fresh data using sDNA Predict. 

Available methods for finding models are (valid options for `algorithm`): 
- `Single best variable` - performs bivariate regression of target against all variables and picks single predictor with best cross-validated fit
- `Multiple variables` - regularized multivariate lasso regression
- `All variables` - regularized multivariate ridge regression (may not use all variables, but will usually use more than lasso regression) 

Candidate predictor variables can either be entered as field names separated by commas, or alternatively as a *regular expression*. The latter follows Python regex syntax. A wildcard is expressed as `.*`, thus, `Bt.*` would test all Betweenness variables (which in abbreviated form begin with `Bt`) for correlation with the target.  

Box-Cox transformations can be disabled, and the parameters for cross-validation can be changed.  

*Weighting lambda* (`weightlambda`) weights data points by *y<sup>λ-1</sup>*, where *y* is the target variable. Setting to 1 gives unweighted regression. Setting to around 0.7 can encourage selection of a model with better GEH statistic, when used with traffic count data. Setting to 0 is somewhat analogous to using a log link function to handle Poisson distributed residuals, while preserving the model structure as a linear sum of predictors. Depending on what you read, the literature can treat traffic count data as either normally or Poisson distributed, so something in between the two is probably safest.  

Ridge and Lasso regression can cope with multicollinear predictor variables, as is common in spatial network models. The techniques can be interpreted as frequentist (adding a penalty term to prevent overfit); Bayesian (imposing a hyperprior on coefficient values); or a mild form of entropy maximization (that limits itself in the case of overspecified models). More generally it's a machine learning technique that is tuned using cross-validation. The *r²* values reported by learn are always cross-validated, giving a built-in test of effectiveness in making predictions.  

*Regularization Lambda* allows manual input of the minimum and maximum values for regularization parameter *λ* in ridge and lasso regression. Enter two values separated by a comma. If this field is left blank, the software attempts to guess a suitable range, but is not always correct. If you are familiar with the theory of regularized regression you may wish to inspect a plot of cross validated *r²* against *λ* to see what is going on. The data to do this is saved with the output model file (if specified), with extension `.regcurve.csv`.
"""

__author__ = 'James Parrott'
__version__ = '2.0'



import sys
import os
import functools
import importlib

from ghpythonlib.componentbase import executingcomponent as component
import Grasshopper
import scriptcontext as sc

import_module = importlib.import_module
try:
    reload #type: ignore
except NameError:
    reload = importlib.reload

try:
    basestring #type: ignore
except NameError:
    basestring = str

try:
    ghdoc #type: ignore
except NameError:
    from .custom.skel.basic.ghdoc import ghdoc

ZIP_FILE_NAME = 'sdna-gh'
PACKAGE_NAME = 'sDNA_GH'
PLUG_IN_NAME = 'sDNA'               
RELOAD_IF_ALREADY_IMPORTED = False
REPOSITORY = os.path.dirname(os.path.dirname(ghdoc.Path)) if ghdoc.Path else None
# Assume we are in repo_folder/dev/sDNA_build_components.gh

USER_INSTALLATION_FOLDER = os.path.join(
                                    Grasshopper.Folders.DefaultUserObjectFolder
                                   ,ZIP_FILE_NAME
                                   )
SELFTEST = 'selftest'




class Output(object): 

    def set_logger(self, logger, flush = True):
        self.logger = logger
        if flush and self.tmp_logs:
            self.flush()

    def __init__(self
                ,tmp_logs = None
                ,logger = None
                ):
        if not isinstance(tmp_logs, list): #assert not isinstance(None, list)
            tmp_logs = []
        self.tmp_logs = tmp_logs
        self.set_logger(logger, flush = False)



    def store(self, message, logging_level):
        self.tmp_logs.append( (message, logging_level) )

    def __call__(self, message, logging_level = "INFO", logging_dict = {}):
        #type: (str, str, dict, list) -> str
        
        #logger.debug(s)

        if logging_dict == {} and self.logger is not None: 
            logging_dict = dict( DEBUG = self.logger.debug
                                ,INFO = self.logger.info
                                ,WARNING = self.logger.warning
                                ,ERROR = self.logger.error
                                ,CRITICAL = self.logger.critical
                                )

        logging_level = logging_level.upper()
        if logging_level in logging_dict:
            logging_dict[logging_level](message)
        else:
            self.store(message, logging_level)

        return '%s : %s ' % (logging_level, message)

    def __getattr__(self, attr):
        return functools.partial(self.__call__, logging_level = attr.upper())

    def flush(self):
        tmp_logs = self.tmp_logs[:] # __call__ might cache back to tmp_logs
        self.tmp_logs[:] = [] # Mutate list initialised with.  Avoid double 
                              # logging in case re - stored in tmp_logs
        for tmp_log_message, tmp_log_level in tmp_logs:
            self.__call__(tmp_log_message, tmp_log_level)

output = Output()


class InvalidArgsError(Exception):
    
    """Custom exception to log the error message, and to at least allow 
       attempts to give users actionable advice to fix the issue, in 
       the event of a problem.  
    """
    message_fmt = 'Invalid import args: %s'
    def __init__(self
                ,message_fmt = ''
                ,message = ''
                ,logger = output
                , **kwargs
                ):
        if message_fmt and isinstance(message_fmt, basestring):
            self.message_fmt = message_fmt
        if kwargs and (not message or not isinstance(message, basestring)):
            message = self.message_fmt % kwargs
        logger.error(message)
        self.kwargs = kwargs
        super(InvalidArgsError, self).__init__(message)    


class ModuleNameError(InvalidArgsError):
    message_fmt = 'Invalid module name: %s'


class FilePathError(InvalidArgsError):
    message_fmt = 'Invalid path to import module from: %s'


# We only know the sDNA version to import as a string.  This is more secure too.
def strict_import(module_name = ''
                 ,folder = ''
                 ,sub_folder = ''
                 ,logger = output
                 ,reload_already_imported = RELOAD_IF_ALREADY_IMPORTED
                 ):

    # type: (str, str, str, type[any], bool) -> type[any]
    """ Imports the named module from the specified folder\subfolder only, 
        and returns it.
        
        Avoids name clashes and casual hijack attempts.  In some 
        environments supporting a Python implementation (such as 
        GhPython in Grasshopper) it may not be desirable to ask the user 
        to set PYTHONPATH.  Hence here, we save sys.path to a tmp 
        variable, set sys.path to the specified folders, attempt the 
        import in a try: block, and restore sys.path in a finally: block
    """
    if not module_name or not isinstance(module_name, basestring):
        raise ModuleNameError(module_name = module_name
                             ,folder = folder
                             ,sub_folder = sub_folder
                             ,logger = logger
                             )
    logger.debug(module_name)
    if module_name in sys.modules:   # sys.modules is also shared between GHPython components 
                                     # (and is even saved until Rhino is closed).
        logger.debug('Module %s already in sys.modules' % module_name)
        if reload_already_imported:
            logger.debug('Reloading %s.... ' % module_name)
            reload(sys.modules[module_name]) # type: ignore
        return sys.modules[module_name]
    #
    #
    # Load module_name for first time:
    #
    #
    search_path = os.path.join(folder, sub_folder)

    if (search_path 
        and isinstance(search_path, basestring) 
        and os.path.isdir(search_path)):
        #
        logger.debug('Search path == %s' % search_path)
        #if search_folder_only:
        #    sys.path = [search_path]
        if search_path not in sys.path:
            sys.path.insert(0, search_path)
    else:
        raise FilePathError(module_name = module_name
                           ,search_path = search_path
                           ,logger = logger
                           )

    logger.debug('Trying import... ')
    module = import_module(module_name, '')           

    return module       


class ModulesNotFoundError(InvalidArgsError):
    message_fmt = 'Modules not found in any location %s'


def load_modules(m_names
                ,folders
                ,logger = output
                ,module_name_error_msg = 'Please supply valid names of modules to import, %s'
                ,folders_error_msg = 'Please supply valid folders to import from. %s'
                ,modules_not_found_msg = 'Specified modules not found in any folder, %s'):
    #type(str/ Iterable, list, type[any], str, str) -> tuple / None
    """ Tries to import all modules in m_names, from the first folder in 
        folders to contain a .py or .pyc files with the same name as each 
        module.

        Returns a tuple of all the modules and the path they were found in.  Else 
        raises a ModulesNotFoundError.
    """
    if not m_names:
        raise ModuleNameError(message_fmt = 'No module names supplied, m_names = %s'
                             ,m_names = m_names
                             ,logger = logger
                             )

    if any( not isinstance(m_name, basestring) for m_name in m_names ):
        # if m_names is a basestring, the error is not raised 
        raise ModuleNameError(message_fmt = module_name_error_msg
                             ,m_names = m_names
                             ,logger = logger
                             )
    
    if isinstance(m_names, basestring):
        m_names = [m_names] 

    logger.debug('m_names == %s of type : %s' % (m_names, type(m_names).__name__))

    logger.debug('Testing paths : %s ' % folders)
    
    if isinstance(folders, basestring):
        folders = [folders]

    if not any(os.path.isdir(folder) or os.path.isdir(os.path.dirname(folder)) 
               for folder in folders
              ):
        raise FilePathError(message_fmt = folders_error_msg
                           ,m_names = m_names
                           ,logger = logger
                           )

    for folder in folders:
        logger.debug('Type(folder) : %s' % type(folder).__name__)
        logger.debug('Type(path) : %s path == %s' %(type(folder).__name__, folder))

        if os.path.isfile(folder):
            folder = os.path.dirname(folder)
        if all( any(os.path.isfile(os.path.join(folder, name.replace('.', os.sep) + ending)) 
                    for ending in ['.py','.pyc'] 
                   )
                for name in m_names
              ):
            #
            logger.debug('Importing %s' % repr(m_names))

            return tuple(strict_import(name, folder, '', logger = logger) 
                         for name in m_names
                        ) + (folder,)
            # tuple of modules, followed by the path to them
    raise ModulesNotFoundError(message_fmt = modules_not_found_msg
                              ,m_names = m_names
                              ,folders = folders
                              ,logger = logger
                              )




if __name__ == '__main__': # False in a compiled component.  But then the user
                           # can't add or remove Params to the component.  
    
    # Grasshopper will look for class MyComponent(component) in global scope
    # so a main function is a little tricky to define.

    nick_name = ghenv.Component.NickName #type: ignore


    if (REPOSITORY and 
        nick_name == 'Build_components'):
        #
        sDNA_GH_search_path = REPOSITORY 
        # builder can only load sDNA_GH from its parent directory, 
        # e.g. if in a dir one level up in the main repo
        # such as sDNA_build_components.gh.
    else:
        sDNA_GH_search_path = USER_INSTALLATION_FOLDER


    sc.doc = ghdoc #type: ignore

    output.debug(sDNA_GH_search_path)

    class sDNA_GH(object):
        pass

    if 'sDNA_GH.main' in sys.modules:
        sDNA_GH.main = sys.modules['sDNA_GH.main']
    else:
        sDNA_GH.main, _ = load_modules(m_names = PACKAGE_NAME + '.main'
                                      ,folders = sDNA_GH_search_path
                                      ,folders_error_msg = 'Please unzip %s.zip '
                                                           %ZIP_FILE_NAME
                                                           +' in the folder %s '
                                                           %Grasshopper.Folders.DefaultUserObjectFolder
                                                           +'and ensure a subfolder called %s is created '
                                                           %os.path.join(ZIP_FILE_NAME, PACKAGE_NAME)
                                                           +'inside it, containing main.py ' 
                                                           +'and all the sDNA_GH python files '
                                                           +'including those within other subfolders. ' 
                                      ,modules_not_found_msg = 'Some sDNA_GH files may be missing.  '
                                                              +'Please: 1) Copy %s.zip into: %s '
                                                              %(ZIP_FILE_NAME
                                                               ,Grasshopper.Folders.DefaultUserObjectFolder
                                                               )
                                                              +'2) Unblock it if necessary. '
                                                              +'3) Right click '
                                                              +'it, select Extract All... and click Extract, '
                                                              +'to extract it to that location. '
                                                              +'4) Ensure that main.py and all sDNA_GH python' 
                                                              +' files and subfolders are inside: %s '
                                                              %os.path.join(USER_INSTALLATION_FOLDER
                                                                           ,PACKAGE_NAME
                                                                           )
                                                              +'5) Reinitialise the component or restart Rhino.'
                                      )         


    logger = sDNA_GH.main.logger.getChild('launcher')
    output.set_logger(logger, flush = True)


    class MyComponent(component):
        pass  # Required.  Idiomatic to Grasshopper.  Must be called "MyComponent"  
            # too (it is looked for by the parser or scope checker?) otherwise 
            # Grasshopper may not find the subclass of on 
            # component.  Even though we overwrite this class on the next line
            # immediately below.  

    MyComponent = sDNA_GH.main.sDNA_GH_Component
    # Grasshopper calls MyComponent.RunScript automatically.


    if nick_name.replace(' ','').replace('_','').lower() == SELFTEST:  


        unit_tests, _ = load_modules('%s.tests.unit_tests.%s_unit_tests' % ((PACKAGE_NAME,)*2)
                                    ,sDNA_GH_search_path
                                    )

        
        MyComponent = unit_tests.make_test_running_component_class(
                                         MyComponent
                                        ,package_location = sDNA_GH_search_path
                                        )
        # Grasshopper calls MyComponent.RunScript automatically.
# ---------- end sdna_learn ----------
file_2 = ReadFile(File=sdna_learn.file, PerLineParse=False)
resids = Panel(file)
unload_sdna = Unload_sDNA(unload=Button(), update=Button())  # -> out, a
# ---------- unload_sdna: Python ----------
#! /usr/bin/awk NR==3
# -*- coding: utf-8 -*-
# This module requires Grasshopper Python (Rhino3D)

# MIT License

# Copyright (c) [2021] [Cardiff University, a body incorporated
# by Royal Charter and a registered charity (number:
# 1136855) whose administrative offices are at 7th floor 30-
# 36 Newport Road, UniversityCF24 0DE, Wales, UK]

# Permission is hereby granted, free of charge, to any person obtaining a copy
# of this software and associated documentation files (the "Software"), to deal
# in the Software without restriction, including without limitation the rights
# to use, copy, modify, merge, publish, distribute, sublicense, and/or sell
# copies of the Software, and to permit persons to whom the Software is
# furnished to do so, subject to the following conditions:

# The above copyright notice and this permission notice shall be included in all
# copies or substantial portions of the Software.

# THE SOFTWARE IS PROVIDED "AS IS", WITHOUT WARRANTY OF ANY KIND, EXPRESS OR
# IMPLIED, INCLUDING BUT NOT LIMITED TO THE WARRANTIES OF MERCHANTABILITY,
# FITNESS FOR A PARTICULAR PURPOSE AND NONINFRINGEMENT. IN NO EVENT SHALL THE
# AUTHORS OR COPYRIGHT HOLDERS BE LIABLE FOR ANY CLAIM, DAMAGES OR OTHER
# LIABILITY, WHETHER IN AN ACTION OF CONTRACT, TORT OR OTHERWISE, ARISING FROM,
# OUT OF OR IN CONNECTION WITH THE SOFTWARE OR THE USE OR OTHER DEALINGS IN THE
# SOFTWARE.

""" Unload the sDNA_GH Python package and all sDNA modules, by removing them from GhPython's shared cache (sys.modules).  The 
    next sDNA_GH component to run will then reload the package and installation-wide options file (config.toml), and any specified 
    options including a project specific config.toml, without otherwise having to restart Rhino to clear its cache.
"""

__author__ = 'James Parrott'
__version__ = '2.0'


from ghpythonlib.componentbase import executingcomponent as component

class MyComponent(component):
    
    def RunScript(self, unload, update):
        import sys  #Imported here to avoid weird bug 
                    # (unloading/forgetting of sys - IronPython only?)
        #https://discourse.mcneel.com/t/failed-import-of-sys-library-in-ghpython/98696


        print('sDNA_GH packages and modules in sys.modules:')
        print('\n'.join([key for key in sys.modules if 'sdna' in key.lower()]))
        def is_imported(s):
            return s in sys.modules
        if unload is True:
            if 'logging' in sys.modules:
                sys.modules['logging'].shutdown()
            shared_cached_modules_etc = sys.modules.copy().keys()
            for y in shared_cached_modules_etc:
                if 'sdna' in y.lower():
                    del sys.modules[y]
        
        
                
        print('sDNA_GH imported == %s' % is_imported('sDNA_GH'))
        print('sDNA_GH.tools imported == %s' % is_imported('sDNA_GH.tools'))
        print('sDNAUISpec imported == %s' % is_imported('sDNAUISpec'))
        print('runsdnacommand == %s' % is_imported('runsdnacommand'))

        
        return
# ---------- end unload_sdna ----------
panel_2 = Panel(unload_sdna.out)
model = Panel(file_2)
toggle_5 = BooleanToggle(False)
sdna_predict = SDNA_Predict(
    go=sdna_learn.OK,
    file=sdna_integral.file,
    predvar=list,
    modelfile=sdna_learn.file,
    auto_write_Shp=toggle_5,
    auto_read_Shp=toggle_5)  # -> out, OK, opts, file, Geom, Data, abbrevs, fields, bbox; inputs go: list, opts: list, file: list, config: list, input: list, output: list, predvar: list, modelfile: list, Geom: list, bake: list, Data: tree, prj: list, input_key_str: list
#   port go: true: runs tools. false: do not run tools but still read other Params.
#   port opts: sDNA_GH options data structure. Python dictionary.
#   port file: File path of the shape file.
#   port config: File path to sDNA_GH options file, e.g. config.toml
#   port input: Input features. Default value == .Type: File path.
#   port output: Output features. Default value == .Type: File path.
#   port predvar: Prediction variable name. Default value == prediction.Type: Text.
#   port modelfile: Model file from sDNA Learn. Default value == .Type: File path.
#   port Geom: A list of geometric objects. Requires GUIDs of Rhino objects or native/embedded Grasshopper geometry. To use Rhino objects referenced from Grasshopper parameter objects (instead of their Grasshopper versions which are often obscured unless the Rhino shapes are set to Hidden) run the output of the Geometry (Geo) or Curve (Crv) through a Guid (ID) parameter object first. Note: For sDNA tools all the geometric objects must all be polylines. For write_Shp all the objects must be of the type in shp_type (default: POLYLINEZ).
#   port bake: If new shapes are created, thentrue: bakes the shapefile polylines to Rhino. false: creates Grasshopper polylines only. Default: False
#   port Data: A Data Tree of a list of keys and list of corresponding values for each object in Geom.
#   port prj: File path of the projection file (.prj) to use for the new shapefile. Default :
#   port input_key_str: Format string containing a prefix, a {name} field, and a postfix, to enable more descriptive User Text key names. Default: {name} Only User Text key names matching this pattern will have their values written to shape files by Write_Shp,under the field name in {name}, which can have a max of 10 chars in Write_Shp. The actual values of name in User Text keys must also be specified to the sDNA tools that use them.
#   port OK: true: tools ran successfully. false: tools did not run, or there was an error.
#   port opts: sDNA_GH options data structure. Python dictionary.
#   port file: File path of the shape file.
#   port Geom: A list of geometric objects. Requires GUIDs of Rhino objects or native/embedded Grasshopper geometry. To use Rhino objects referenced from Grasshopper parameter objects (instead of their Grasshopper versions which are often obscured unless the Rhino shapes are set to Hidden) run the output of the Geometry (Geo) or Curve (Crv) through a Guid (ID) parameter object first. Note: For sDNA tools all the geometric objects must all be polylines. For write_Shp all the objects must be of the type in shp_type (default: POLYLINEZ).
#   port Data: A Data Tree of a list of keys and list of corresponding values for each object in Geom.
#   port abbrevs: Abbreviations of sDNA results from the ...names.csv file.
#   port fields: Field names from the Shapefile. Set field to one of these values to parse and/or plot it.
#   port bbox: Bounding box from the Shapefile. Used to calculate leg_frame by the Recolour_objects component. [x_min, y_min, x_max, y_max]. All Numbers.
# ---------- sdna_predict: Python ----------
#! /usr/bin/awk NR==3
# -*- coding: utf-8 -*-
# This module requires Grasshopper Python (Rhino3D)

# MIT License

# Copyright (c) [2021] [Cardiff University, a body incorporated
# by Royal Charter and a registered charity (number:
# 1136855) whose administrative offices are at 7th floor 30-
# 36 Newport Road, University CF24 0DE, Wales, UK]

# Permission is hereby granted, free of charge, to any person obtaining a copy
# of this software and associated documentation files (the "Software"), to deal
# in the Software without restriction, including without limitation the rights
# to use, copy, modify, merge, publish, distribute, sublicense, and/or sell
# copies of the Software, and to permit persons to whom the Software is
# furnished to do so, subject to the following conditions:

# The above copyright notice and this permission notice shall be included in all
# copies or substantial portions of the Software.

# THE SOFTWARE IS PROVIDED "AS IS", WITHOUT WARRANTY OF ANY KIND, EXPRESS OR
# IMPLIED, INCLUDING BUT NOT LIMITED TO THE WARRANTIES OF MERCHANTABILITY,
# FITNESS FOR A PARTICULAR PURPOSE AND NONINFRINGEMENT. IN NO EVENT SHALL THE
# AUTHORS OR COPYRIGHT HOLDERS BE LIABLE FOR ANY CLAIM, DAMAGES OR OTHER
# LIABILITY, WHETHER IN AN ACTION OF CONTRACT, TORT OR OTHERWISE, ARISING FROM,
# OUT OF OR IN CONNECTION WITH THE SOFTWARE OR THE USE OR OTHER DEALINGS IN THE
# SOFTWARE.



"""Predict takes an output model file from sDNA Learn, and applies it to fresh data. 

For example, suppose we wish to calibrate a traffic model, using measured traffic flows at a small number of points on the network: 
- First run a Betweenness analysis at a number of radii using Integral Analysis. 
- Use a GIS spatial join to join Betweenness variables (the output of Integral) to the measured traffic flows. 
- Run Learn on the joined data to select the best variable for predicting flows (where measured). 
- Run Predict on the output of Integral to estimate traffic flow for all unmeasured polylines. 
"""

__author__ = 'James Parrott'
__version__ = '2.0'



import sys
import os
import functools
import importlib

from ghpythonlib.componentbase import executingcomponent as component
import Grasshopper
import scriptcontext as sc

import_module = importlib.import_module
try:
    reload #type: ignore
except NameError:
    reload = importlib.reload

try:
    basestring #type: ignore
except NameError:
    basestring = str

try:
    ghdoc #type: ignore
except NameError:
    from .custom.skel.basic.ghdoc import ghdoc

ZIP_FILE_NAME = 'sdna-gh'
PACKAGE_NAME = 'sDNA_GH'
PLUG_IN_NAME = 'sDNA'               
RELOAD_IF_ALREADY_IMPORTED = False
REPOSITORY = os.path.dirname(os.path.dirname(ghdoc.Path)) if ghdoc.Path else None
# Assume we are in repo_folder/dev/sDNA_build_components.gh

USER_INSTALLATION_FOLDER = os.path.join(
                                    Grasshopper.Folders.DefaultUserObjectFolder
                                   ,ZIP_FILE_NAME
                                   )
SELFTEST = 'selftest'




class Output(object): 

    def set_logger(self, logger, flush = True):
        self.logger = logger
        if flush and self.tmp_logs:
            self.flush()

    def __init__(self
                ,tmp_logs = None
                ,logger = None
                ):
        if not isinstance(tmp_logs, list): #assert not isinstance(None, list)
            tmp_logs = []
        self.tmp_logs = tmp_logs
        self.set_logger(logger, flush = False)



    def store(self, message, logging_level):
        self.tmp_logs.append( (message, logging_level) )

    def __call__(self, message, logging_level = "INFO", logging_dict = {}):
        #type: (str, str, dict, list) -> str
        
        #logger.debug(s)

        if logging_dict == {} and self.logger is not None: 
            logging_dict = dict( DEBUG = self.logger.debug
                                ,INFO = self.logger.info
                                ,WARNING = self.logger.warning
                                ,ERROR = self.logger.error
                                ,CRITICAL = self.logger.critical
                                )

        logging_level = logging_level.upper()
        if logging_level in logging_dict:
            logging_dict[logging_level](message)
        else:
            self.store(message, logging_level)

        return '%s : %s ' % (logging_level, message)

    def __getattr__(self, attr):
        return functools.partial(self.__call__, logging_level = attr.upper())

    def flush(self):
        tmp_logs = self.tmp_logs[:] # __call__ might cache back to tmp_logs
        self.tmp_logs[:] = [] # Mutate list initialised with.  Avoid double 
                              # logging in case re - stored in tmp_logs
        for tmp_log_message, tmp_log_level in tmp_logs:
            self.__call__(tmp_log_message, tmp_log_level)

output = Output()


class InvalidArgsError(Exception):
    
    """Custom exception to log the error message, and to at least allow 
       attempts to give users actionable advice to fix the issue, in 
       the event of a problem.  
    """
    message_fmt = 'Invalid import args: %s'
    def __init__(self
                ,message_fmt = ''
                ,message = ''
                ,logger = output
                , **kwargs
                ):
        if message_fmt and isinstance(message_fmt, basestring):
            self.message_fmt = message_fmt
        if kwargs and (not message or not isinstance(message, basestring)):
            message = self.message_fmt % kwargs
        logger.error(message)
        self.kwargs = kwargs
        super(InvalidArgsError, self).__init__(message)    


class ModuleNameError(InvalidArgsError):
    message_fmt = 'Invalid module name: %s'


class FilePathError(InvalidArgsError):
    message_fmt = 'Invalid path to import module from: %s'


# We only know the sDNA version to import as a string.  This is more secure too.
def strict_import(module_name = ''
                 ,folder = ''
                 ,sub_folder = ''
                 ,logger = output
                 ,reload_already_imported = RELOAD_IF_ALREADY_IMPORTED
                 ):

    # type: (str, str, str, type[any], bool) -> type[any]
    """ Imports the named module from the specified folder\subfolder only, 
        and returns it.
        
        Avoids name clashes and casual hijack attempts.  In some 
        environments supporting a Python implementation (such as 
        GhPython in Grasshopper) it may not be desirable to ask the user 
        to set PYTHONPATH.  Hence here, we save sys.path to a tmp 
        variable, set sys.path to the specified folders, attempt the 
        import in a try: block, and restore sys.path in a finally: block
    """
    if not module_name or not isinstance(module_name, basestring):
        raise ModuleNameError(module_name = module_name
                             ,folder = folder
                             ,sub_folder = sub_folder
                             ,logger = logger
                             )
    logger.debug(module_name)
    if module_name in sys.modules:   # sys.modules is also shared between GHPython components 
                                     # (and is even saved until Rhino is closed).
        logger.debug('Module %s already in sys.modules' % module_name)
        if reload_already_imported:
            logger.debug('Reloading %s.... ' % module_name)
            reload(sys.modules[module_name]) # type: ignore
        return sys.modules[module_name]
    #
    #
    # Load module_name for first time:
    #
    #
    search_path = os.path.join(folder, sub_folder)

    if (search_path 
        and isinstance(search_path, basestring) 
        and os.path.isdir(search_path)):
        #
        logger.debug('Search path == %s' % search_path)
        #if search_folder_only:
        #    sys.path = [search_path]
        if search_path not in sys.path:
            sys.path.insert(0, search_path)
    else:
        raise FilePathError(module_name = module_name
                           ,search_path = search_path
                           ,logger = logger
                           )

    logger.debug('Trying import... ')
    module = import_module(module_name, '')           

    return module       


class ModulesNotFoundError(InvalidArgsError):
    message_fmt = 'Modules not found in any location %s'


def load_modules(m_names
                ,folders
                ,logger = output
                ,module_name_error_msg = 'Please supply valid names of modules to import, %s'
                ,folders_error_msg = 'Please supply valid folders to import from. %s'
                ,modules_not_found_msg = 'Specified modules not found in any folder, %s'):
    #type(str/ Iterable, list, type[any], str, str) -> tuple / None
    """ Tries to import all modules in m_names, from the first folder in 
        folders to contain a .py or .pyc files with the same name as each 
        module.

        Returns a tuple of all the modules and the path they were found in.  Else 
        raises a ModulesNotFoundError.
    """
    if not m_names:
        raise ModuleNameError(message_fmt = 'No module names supplied, m_names = %s'
                             ,m_names = m_names
                             ,logger = logger
                             )

    if any( not isinstance(m_name, basestring) for m_name in m_names ):
        # if m_names is a basestring, the error is not raised 
        raise ModuleNameError(message_fmt = module_name_error_msg
                             ,m_names = m_names
                             ,logger = logger
                             )
    
    if isinstance(m_names, basestring):
        m_names = [m_names] 

    logger.debug('m_names == %s of type : %s' % (m_names, type(m_names).__name__))

    logger.debug('Testing paths : %s ' % folders)
    
    if isinstance(folders, basestring):
        folders = [folders]

    if not any(os.path.isdir(folder) or os.path.isdir(os.path.dirname(folder)) 
               for folder in folders
              ):
        raise FilePathError(message_fmt = folders_error_msg
                           ,m_names = m_names
                           ,logger = logger
                           )

    for folder in folders:
        logger.debug('Type(folder) : %s' % type(folder).__name__)
        logger.debug('Type(path) : %s path == %s' %(type(folder).__name__, folder))

        if os.path.isfile(folder):
            folder = os.path.dirname(folder)
        if all( any(os.path.isfile(os.path.join(folder, name.replace('.', os.sep) + ending)) 
                    for ending in ['.py','.pyc'] 
                   )
                for name in m_names
              ):
            #
            logger.debug('Importing %s' % repr(m_names))

            return tuple(strict_import(name, folder, '', logger = logger) 
                         for name in m_names
                        ) + (folder,)
            # tuple of modules, followed by the path to them
    raise ModulesNotFoundError(message_fmt = modules_not_found_msg
                              ,m_names = m_names
                              ,folders = folders
                              ,logger = logger
                              )




if __name__ == '__main__': # False in a compiled component.  But then the user
                           # can't add or remove Params to the component.  
    
    # Grasshopper will look for class MyComponent(component) in global scope
    # so a main function is a little tricky to define.

    nick_name = ghenv.Component.NickName #type: ignore


    if (REPOSITORY and 
        nick_name == 'Build_components'):
        #
        sDNA_GH_search_path = REPOSITORY 
        # builder can only load sDNA_GH from its parent directory, 
        # e.g. if in a dir one level up in the main repo
        # such as sDNA_build_components.gh.
    else:
        sDNA_GH_search_path = USER_INSTALLATION_FOLDER


    sc.doc = ghdoc #type: ignore

    output.debug(sDNA_GH_search_path)

    class sDNA_GH(object):
        pass

    if 'sDNA_GH.main' in sys.modules:
        sDNA_GH.main = sys.modules['sDNA_GH.main']
    else:
        sDNA_GH.main, _ = load_modules(m_names = PACKAGE_NAME + '.main'
                                      ,folders = sDNA_GH_search_path
                                      ,folders_error_msg = 'Please unzip %s.zip '
                                                           %ZIP_FILE_NAME
                                                           +' in the folder %s '
                                                           %Grasshopper.Folders.DefaultUserObjectFolder
                                                           +'and ensure a subfolder called %s is created '
                                                           %os.path.join(ZIP_FILE_NAME, PACKAGE_NAME)
                                                           +'inside it, containing main.py ' 
                                                           +'and all the sDNA_GH python files '
                                                           +'including those within other subfolders. ' 
                                      ,modules_not_found_msg = 'Some sDNA_GH files may be missing.  '
                                                              +'Please: 1) Copy %s.zip into: %s '
                                                              %(ZIP_FILE_NAME
                                                               ,Grasshopper.Folders.DefaultUserObjectFolder
                                                               )
                                                              +'2) Unblock it if necessary. '
                                                              +'3) Right click '
                                                              +'it, select Extract All... and click Extract, '
                                                              +'to extract it to that location. '
                                                              +'4) Ensure that main.py and all sDNA_GH python' 
                                                              +' files and subfolders are inside: %s '
                                                              %os.path.join(USER_INSTALLATION_FOLDER
                                                                           ,PACKAGE_NAME
                                                                           )
                                                              +'5) Reinitialise the component or restart Rhino.'
                                      )         


    logger = sDNA_GH.main.logger.getChild('launcher')
    output.set_logger(logger, flush = True)


    class MyComponent(component):
        pass  # Required.  Idiomatic to Grasshopper.  Must be called "MyComponent"  
            # too (it is looked for by the parser or scope checker?) otherwise 
            # Grasshopper may not find the subclass of on 
            # component.  Even though we overwrite this class on the next line
            # immediately below.  

    MyComponent = sDNA_GH.main.sDNA_GH_Component
    # Grasshopper calls MyComponent.RunScript automatically.


    if nick_name.replace(' ','').replace('_','').lower() == SELFTEST:  


        unit_tests, _ = load_modules('%s.tests.unit_tests.%s_unit_tests' % ((PACKAGE_NAME,)*2)
                                    ,sDNA_GH_search_path
                                    )

        
        MyComponent = unit_tests.make_test_running_component_class(
                                         MyComponent
                                        ,package_location = sDNA_GH_search_path
                                        )
        # Grasshopper calls MyComponent.RunScript automatically.
# ---------- end sdna_predict ----------
read_shp = Read_Shp(go=sdna_predict.OK, file=sdna_predict.file)  # -> out, OK, opts, Geom, Data, abbrevs, fields, bbox; inputs go: list, opts: list, file: list, Geom: list, bake: list
#   port go: true: runs tools. false: do not run tools but still read other Params.
#   port opts: sDNA_GH options data structure. Python dictionary.
#   port file: File path of the shape file.
#   port Geom: A list of geometric objects, that must all be polylines for sDNA tools, read_Shp and write_Shp
#   port bake: If Geom is connected, does nothing. Otherwise, true: bakes the shapefile polylines to Rhino. false: creates Grasshopper polylines only. Default: False
#   port OK: true: tools ran successfully. false: tools did not run, or there was an error.
#   port opts: sDNA_GH options data structure. Python dictionary.
#   port Geom: A list of geometric objects, that must all be polylines for sDNA tools, read_Shp and write_Shp
#   port Data: A Data Tree of a list of keys and list of corresponding values for each object in Geom.
#   port abbrevs: Abbreviations of sDNA results from the ...names.csv file.
#   port fields: Field names from the Shapefile. Set field to one of these values to parse and/or plot it.
#   port bbox: Bounding box from the Shapefile. Used to calculate leg_frame by the Recolour_objects component. [x_min, y_min, x_max, y_max]. All Numbers.
# ---------- read_shp: Python ----------
#! /usr/bin/awk NR==3
# -*- coding: utf-8 -*-
# This module requires Grasshopper Python (Rhino3D)

# MIT License

# Copyright (c) [2021] [Cardiff University, a body incorporated
# by Royal Charter and a registered charity (number:
# 1136855) whose administrative offices are at 7th floor 30-
# 36 Newport Road, University CF24 0DE, Wales, UK]

# Permission is hereby granted, free of charge, to any person obtaining a copy
# of this software and associated documentation files (the "Software"), to deal
# in the Software without restriction, including without limitation the rights
# to use, copy, modify, merge, publish, distribute, sublicense, and/or sell
# copies of the Software, and to permit persons to whom the Software is
# furnished to do so, subject to the following conditions:

# The above copyright notice and this permission notice shall be included in all
# copies or substantial portions of the Software.

# THE SOFTWARE IS PROVIDED "AS IS", WITHOUT WARRANTY OF ANY KIND, EXPRESS OR
# IMPLIED, INCLUDING BUT NOT LIMITED TO THE WARRANTIES OF MERCHANTABILITY,
# FITNESS FOR A PARTICULAR PURPOSE AND NONINFRINGEMENT. IN NO EVENT SHALL THE
# AUTHORS OR COPYRIGHT HOLDERS BE LIABLE FOR ANY CLAIM, DAMAGES OR OTHER
# LIABILITY, WHETHER IN AN ACTION OF CONTRACT, TORT OR OTHERWISE, ARISING FROM,
# OUT OF OR IN CONNECTION WITH THE SOFTWARE OR THE USE OR OTHER DEALINGS IN THE
# SOFTWARE.



"""Reads in polylines and associated data records from a shapefile.  Creates new objects if `new_geom` = true or no objects corresponding to the shapefile are specified in `Geom`.  Specify the path of the .shp file to read in `file`.  **WARNING!  If a valid file path was not specified in `file` on a preceding Write_Shp component, and that file was used by an sDNA tool, Read_Shp deletes sDNA output shapefiles with default names if `strict_no_del` = false, `overwrite_shp` = false, and `del_after_read` = true.**  If a list of existing geometry is provided in `Geom` that corresponds to (is the same length as) the data records in the shapefile, only the data is read from the shapefile.  Otherwise the shapes in the shapefile are outputted as new Grasshopper Geometry objects.  The bounding box output `bbox` is provided to create a legend frame within Recolour_Objects (its value is calculated from the shape file).  The abbreviations and field names from an sDNA results field file (if a file with the same name ending in .names.csv exists) are also read in, and supplied on `abbrevs` so that a drop-down list may be created, for easy selection of the data field for subsequent parsing and plotting.  If no separate Recolour_Objects Component is detected connected to the component's outputs downstream and `auto_plot_data = true`, Recolour_Objects is called afterwards.  
"""

__author__ = 'James Parrott'
__version__ = '2.0'



import sys
import os
import functools
import importlib

from ghpythonlib.componentbase import executingcomponent as component
import Grasshopper
import scriptcontext as sc

import_module = importlib.import_module
try:
    reload #type: ignore
except NameError:
    reload = importlib.reload

try:
    basestring #type: ignore
except NameError:
    basestring = str

try:
    ghdoc #type: ignore
except NameError:
    from .custom.skel.basic.ghdoc import ghdoc

ZIP_FILE_NAME = 'sdna-gh'
PACKAGE_NAME = 'sDNA_GH'
PLUG_IN_NAME = 'sDNA'               
RELOAD_IF_ALREADY_IMPORTED = False
REPOSITORY = os.path.dirname(os.path.dirname(ghdoc.Path)) if ghdoc.Path else None
# Assume we are in repo_folder/dev/sDNA_build_components.gh

USER_INSTALLATION_FOLDER = os.path.join(
                                    Grasshopper.Folders.DefaultUserObjectFolder
                                   ,ZIP_FILE_NAME
                                   )
SELFTEST = 'selftest'




class Output(object): 

    def set_logger(self, logger, flush = True):
        self.logger = logger
        if flush and self.tmp_logs:
            self.flush()

    def __init__(self
                ,tmp_logs = None
                ,logger = None
                ):
        if not isinstance(tmp_logs, list): #assert not isinstance(None, list)
            tmp_logs = []
        self.tmp_logs = tmp_logs
        self.set_logger(logger, flush = False)



    def store(self, message, logging_level):
        self.tmp_logs.append( (message, logging_level) )

    def __call__(self, message, logging_level = "INFO", logging_dict = {}):
        #type: (str, str, dict, list) -> str
        
        #logger.debug(s)

        if logging_dict == {} and self.logger is not None: 
            logging_dict = dict( DEBUG = self.logger.debug
                                ,INFO = self.logger.info
                                ,WARNING = self.logger.warning
                                ,ERROR = self.logger.error
                                ,CRITICAL = self.logger.critical
                                )

        logging_level = logging_level.upper()
        if logging_level in logging_dict:
            logging_dict[logging_level](message)
        else:
            self.store(message, logging_level)

        return '%s : %s ' % (logging_level, message)

    def __getattr__(self, attr):
        return functools.partial(self.__call__, logging_level = attr.upper())

    def flush(self):
        tmp_logs = self.tmp_logs[:] # __call__ might cache back to tmp_logs
        self.tmp_logs[:] = [] # Mutate list initialised with.  Avoid double 
                              # logging in case re - stored in tmp_logs
        for tmp_log_message, tmp_log_level in tmp_logs:
            self.__call__(tmp_log_message, tmp_log_level)

output = Output()


class InvalidArgsError(Exception):
    
    """Custom exception to log the error message, and to at least allow 
       attempts to give users actionable advice to fix the issue, in 
       the event of a problem.  
    """
    message_fmt = 'Invalid import args: %s'
    def __init__(self
                ,message_fmt = ''
                ,message = ''
                ,logger = output
                , **kwargs
                ):
        if message_fmt and isinstance(message_fmt, basestring):
            self.message_fmt = message_fmt
        if kwargs and (not message or not isinstance(message, basestring)):
            message = self.message_fmt % kwargs
        logger.error(message)
        self.kwargs = kwargs
        super(InvalidArgsError, self).__init__(message)    


class ModuleNameError(InvalidArgsError):
    message_fmt = 'Invalid module name: %s'


class FilePathError(InvalidArgsError):
    message_fmt = 'Invalid path to import module from: %s'


# We only know the sDNA version to import as a string.  This is more secure too.
def strict_import(module_name = ''
                 ,folder = ''
                 ,sub_folder = ''
                 ,logger = output
                 ,reload_already_imported = RELOAD_IF_ALREADY_IMPORTED
                 ):

    # type: (str, str, str, type[any], bool) -> type[any]
    """ Imports the named module from the specified folder\subfolder only, 
        and returns it.
        
        Avoids name clashes and casual hijack attempts.  In some 
        environments supporting a Python implementation (such as 
        GhPython in Grasshopper) it may not be desirable to ask the user 
        to set PYTHONPATH.  Hence here, we save sys.path to a tmp 
        variable, set sys.path to the specified folders, attempt the 
        import in a try: block, and restore sys.path in a finally: block
    """
    if not module_name or not isinstance(module_name, basestring):
        raise ModuleNameError(module_name = module_name
                             ,folder = folder
                             ,sub_folder = sub_folder
                             ,logger = logger
                             )
    logger.debug(module_name)
    if module_name in sys.modules:   # sys.modules is also shared between GHPython components 
                                     # (and is even saved until Rhino is closed).
        logger.debug('Module %s already in sys.modules' % module_name)
        if reload_already_imported:
            logger.debug('Reloading %s.... ' % module_name)
            reload(sys.modules[module_name]) # type: ignore
        return sys.modules[module_name]
    #
    #
    # Load module_name for first time:
    #
    #
    search_path = os.path.join(folder, sub_folder)

    if (search_path 
        and isinstance(search_path, basestring) 
        and os.path.isdir(search_path)):
        #
        logger.debug('Search path == %s' % search_path)
        #if search_folder_only:
        #    sys.path = [search_path]
        if search_path not in sys.path:
            sys.path.insert(0, search_path)
    else:
        raise FilePathError(module_name = module_name
                           ,search_path = search_path
                           ,logger = logger
                           )

    logger.debug('Trying import... ')
    module = import_module(module_name, '')           

    return module       


class ModulesNotFoundError(InvalidArgsError):
    message_fmt = 'Modules not found in any location %s'


def load_modules(m_names
                ,folders
                ,logger = output
                ,module_name_error_msg = 'Please supply valid names of modules to import, %s'
                ,folders_error_msg = 'Please supply valid folders to import from. %s'
                ,modules_not_found_msg = 'Specified modules not found in any folder, %s'):
    #type(str/ Iterable, list, type[any], str, str) -> tuple / None
    """ Tries to import all modules in m_names, from the first folder in 
        folders to contain a .py or .pyc files with the same name as each 
        module.

        Returns a tuple of all the modules and the path they were found in.  Else 
        raises a ModulesNotFoundError.
    """
    if not m_names:
        raise ModuleNameError(message_fmt = 'No module names supplied, m_names = %s'
                             ,m_names = m_names
                             ,logger = logger
                             )

    if any( not isinstance(m_name, basestring) for m_name in m_names ):
        # if m_names is a basestring, the error is not raised 
        raise ModuleNameError(message_fmt = module_name_error_msg
                             ,m_names = m_names
                             ,logger = logger
                             )
    
    if isinstance(m_names, basestring):
        m_names = [m_names] 

    logger.debug('m_names == %s of type : %s' % (m_names, type(m_names).__name__))

    logger.debug('Testing paths : %s ' % folders)
    
    if isinstance(folders, basestring):
        folders = [folders]

    if not any(os.path.isdir(folder) or os.path.isdir(os.path.dirname(folder)) 
               for folder in folders
              ):
        raise FilePathError(message_fmt = folders_error_msg
                           ,m_names = m_names
                           ,logger = logger
                           )

    for folder in folders:
        logger.debug('Type(folder) : %s' % type(folder).__name__)
        logger.debug('Type(path) : %s path == %s' %(type(folder).__name__, folder))

        if os.path.isfile(folder):
            folder = os.path.dirname(folder)
        if all( any(os.path.isfile(os.path.join(folder, name.replace('.', os.sep) + ending)) 
                    for ending in ['.py','.pyc'] 
                   )
                for name in m_names
              ):
            #
            logger.debug('Importing %s' % repr(m_names))

            return tuple(strict_import(name, folder, '', logger = logger) 
                         for name in m_names
                        ) + (folder,)
            # tuple of modules, followed by the path to them
    raise ModulesNotFoundError(message_fmt = modules_not_found_msg
                              ,m_names = m_names
                              ,folders = folders
                              ,logger = logger
                              )




if __name__ == '__main__': # False in a compiled component.  But then the user
                           # can't add or remove Params to the component.  
    
    # Grasshopper will look for class MyComponent(component) in global scope
    # so a main function is a little tricky to define.

    nick_name = ghenv.Component.NickName #type: ignore


    if (REPOSITORY and 
        nick_name == 'Build_components'):
        #
        sDNA_GH_search_path = REPOSITORY 
        # builder can only load sDNA_GH from its parent directory, 
        # e.g. if in a dir one level up in the main repo
        # such as sDNA_build_components.gh.
    else:
        sDNA_GH_search_path = USER_INSTALLATION_FOLDER


    sc.doc = ghdoc #type: ignore

    output.debug(sDNA_GH_search_path)

    class sDNA_GH(object):
        pass

    if 'sDNA_GH.main' in sys.modules:
        sDNA_GH.main = sys.modules['sDNA_GH.main']
    else:
        sDNA_GH.main, _ = load_modules(m_names = PACKAGE_NAME + '.main'
                                      ,folders = sDNA_GH_search_path
                                      ,folders_error_msg = 'Please unzip %s.zip '
                                                           %ZIP_FILE_NAME
                                                           +' in the folder %s '
                                                           %Grasshopper.Folders.DefaultUserObjectFolder
                                                           +'and ensure a subfolder called %s is created '
                                                           %os.path.join(ZIP_FILE_NAME, PACKAGE_NAME)
                                                           +'inside it, containing main.py ' 
                                                           +'and all the sDNA_GH python files '
                                                           +'including those within other subfolders. ' 
                                      ,modules_not_found_msg = 'Some sDNA_GH files may be missing.  '
                                                              +'Please: 1) Copy %s.zip into: %s '
                                                              %(ZIP_FILE_NAME
                                                               ,Grasshopper.Folders.DefaultUserObjectFolder
                                                               )
                                                              +'2) Unblock it if necessary. '
                                                              +'3) Right click '
                                                              +'it, select Extract All... and click Extract, '
                                                              +'to extract it to that location. '
                                                              +'4) Ensure that main.py and all sDNA_GH python' 
                                                              +' files and subfolders are inside: %s '
                                                              %os.path.join(USER_INSTALLATION_FOLDER
                                                                           ,PACKAGE_NAME
                                                                           )
                                                              +'5) Reinitialise the component or restart Rhino.'
                                      )         


    logger = sDNA_GH.main.logger.getChild('launcher')
    output.set_logger(logger, flush = True)


    class MyComponent(component):
        pass  # Required.  Idiomatic to Grasshopper.  Must be called "MyComponent"  
            # too (it is looked for by the parser or scope checker?) otherwise 
            # Grasshopper may not find the subclass of on 
            # component.  Even though we overwrite this class on the next line
            # immediately below.  

    MyComponent = sDNA_GH.main.sDNA_GH_Component
    # Grasshopper calls MyComponent.RunScript automatically.


    if nick_name.replace(' ','').replace('_','').lower() == SELFTEST:  


        unit_tests, _ = load_modules('%s.tests.unit_tests.%s_unit_tests' % ((PACKAGE_NAME,)*2)
                                    ,sDNA_GH_search_path
                                    )

        
        MyComponent = unit_tests.make_test_running_component_class(
                                         MyComponent
                                        ,package_location = sDNA_GH_search_path
                                        )
        # Grasshopper calls MyComponent.RunScript automatically.
# ---------- end read_shp ----------
recolour_objects = Recolour_Objects(go=read_shp.OK, Data=read_shp.Data, Geom=read_shp.Geom, bbox=read_shp.bbox)  # -> out, OK, opts, Geom, Data, leg_cols, leg_tags, leg_frame; inputs go: list, opts: list, plot_min: list, plot_max: list, Data: tree, Geom: list, bbox: list, field: list
#   port go: true: runs tools. false: do not run tools but still read other Params.
#   port opts: sDNA_GH options data structure. Python dictionary.
#   port plot_min: Minimum data value to parse. Lower values (and their objects) are omitted. Automatically calculated if unset.
#   port plot_max: Maximum data value to parse. Higher values (and their objects) are omitted. Automatically calculated if unset.
#   port Data: A Data Tree of a list of keys and list of corresponding values for each object in Geom.
#   port Geom: A list of geometric objects, that must all be polylines for sDNA tools, read_Shp and write_Shp
#   port bbox: Bounding box of geometry. Used to calculate extent of leg_frame.Calculated from shapefiles by the Read_shapefile component. [x_min, y_min, x_max, y_max], all Numbers.
#   port field: The field name / key value of the results field to parse and/or plot. Default: BtEn
#   port OK: true: tools ran successfully. false: tools did not run, or there was an error.
#   port opts: sDNA_GH options data structure. Python dictionary.
#   port Geom: A list of geometric objects, that must all be polylines for sDNA tools, read_Shp and write_Shp
#   port Data: A Data Tree of a list of keys and list of corresponding values for each object in Geom.
#   port leg_cols: Colour values for a legend.
#   port leg_tags: Tag names, for a legend.
#   port leg_frame: A Rectangle, suitable for a legend frame.
# ---------- recolour_objects: Python ----------
#! /usr/bin/awk NR==3
# -*- coding: utf-8 -*-
# This module requires Grasshopper Python (Rhino3D)

# MIT License

# Copyright (c) [2021] [Cardiff University, a body incorporated
# by Royal Charter and a registered charity (number:
# 1136855) whose administrative offices are at 7th floor 30-
# 36 Newport Road, University CF24 0DE, Wales, UK]

# Permission is hereby granted, free of charge, to any person obtaining a copy
# of this software and associated documentation files (the "Software"), to deal
# in the Software without restriction, including without limitation the rights
# to use, copy, modify, merge, publish, distribute, sublicense, and/or sell
# copies of the Software, and to permit persons to whom the Software is
# furnished to do so, subject to the following conditions:

# The above copyright notice and this permission notice shall be included in all
# copies or substantial portions of the Software.

# THE SOFTWARE IS PROVIDED "AS IS", WITHOUT WARRANTY OF ANY KIND, EXPRESS OR
# IMPLIED, INCLUDING BUT NOT LIMITED TO THE WARRANTIES OF MERCHANTABILITY,
# FITNESS FOR A PARTICULAR PURPOSE AND NONINFRINGEMENT. IN NO EVENT SHALL THE
# AUTHORS OR COPYRIGHT HOLDERS BE LIABLE FOR ANY CLAIM, DAMAGES OR OTHER
# LIABILITY, WHETHER IN AN ACTION OF CONTRACT, TORT OR OTHERWISE, ARISING FROM,
# OUT OF OR IN CONNECTION WITH THE SOFTWARE OR THE USE OR OTHER DEALINGS IN THE
# SOFTWARE.



"""Recolour objects (and legend tags) based on pre-parsed and pre-normalised data, or already calculated colours (as RGB triples).  If unparsed data is inputted, Parse_Data is first called.  Custom colour curves are supported using a 3D quadratic spline between the triples of numbers: `rgb_min`, `rgb_mid` and `rgb_max`.  Otherwise, use the Grasshopper Colour Gradient internally (via Node In Code) by setting `Col_Grad` to true and picking a setting from 0 to 7 for `Col_Grad_num` (0 : 'EarthlyBrown', 1 : 'Forest', 2 : 'GreyScale', 3 : 'Heat', 4 : 'Pink', 5 : 'Spectrum', 6 : 'Traffic', 7 : 'Zebra').  Set `line_width` to control the width of the line of Rhino geom objects  (the default is 4).

Create a legend by connecting `leg_cols`, `leg_tags` and `leg_frame` to a Grasshopper Legend component.  The coordinates of the corners of the Rectangle provided in `leg_frame` may be overridden by specifying `leg_extent` (xmin, ymin, xmax, ymax); alternatively any rectangle object can be passed into `leg_frame` on the GH Legend component itself.  Custom legend tag templates and class boundaries are supported via four format strings (`first_leg_tag_str`, `gen_leg_tag_str`, `last_leg_tag_str` and `num_format`) as per Parse_Data.  

To recolour Grasshopper geometry instead of Rhino Geometry (i.e. unbaked objects), connect the `Data` and `Geom` outputs to a Grasshopper Custom Preview component (line widths of GH objects cannot be increased).  
"""

__author__ = 'James Parrott'
__version__ = '2.0'



import sys
import os
import functools
import importlib

from ghpythonlib.componentbase import executingcomponent as component
import Grasshopper
import scriptcontext as sc

import_module = importlib.import_module
try:
    reload #type: ignore
except NameError:
    reload = importlib.reload

try:
    basestring #type: ignore
except NameError:
    basestring = str

try:
    ghdoc #type: ignore
except NameError:
    from .custom.skel.basic.ghdoc import ghdoc

ZIP_FILE_NAME = 'sdna-gh'
PACKAGE_NAME = 'sDNA_GH'
PLUG_IN_NAME = 'sDNA'               
RELOAD_IF_ALREADY_IMPORTED = False
REPOSITORY = os.path.dirname(os.path.dirname(ghdoc.Path)) if ghdoc.Path else None
# Assume we are in repo_folder/dev/sDNA_build_components.gh

USER_INSTALLATION_FOLDER = os.path.join(
                                    Grasshopper.Folders.DefaultUserObjectFolder
                                   ,ZIP_FILE_NAME
                                   )
SELFTEST = 'selftest'




class Output(object): 

    def set_logger(self, logger, flush = True):
        self.logger = logger
        if flush and self.tmp_logs:
            self.flush()

    def __init__(self
                ,tmp_logs = None
                ,logger = None
                ):
        if not isinstance(tmp_logs, list): #assert not isinstance(None, list)
            tmp_logs = []
        self.tmp_logs = tmp_logs
        self.set_logger(logger, flush = False)



    def store(self, message, logging_level):
        self.tmp_logs.append( (message, logging_level) )

    def __call__(self, message, logging_level = "INFO", logging_dict = {}):
        #type: (str, str, dict, list) -> str
        
        #logger.debug(s)

        if logging_dict == {} and self.logger is not None: 
            logging_dict = dict( DEBUG = self.logger.debug
                                ,INFO = self.logger.info
                                ,WARNING = self.logger.warning
                                ,ERROR = self.logger.error
                                ,CRITICAL = self.logger.critical
                                )

        logging_level = logging_level.upper()
        if logging_level in logging_dict:
            logging_dict[logging_level](message)
        else:
            self.store(message, logging_level)

        return '%s : %s ' % (logging_level, message)

    def __getattr__(self, attr):
        return functools.partial(self.__call__, logging_level = attr.upper())

    def flush(self):
        tmp_logs = self.tmp_logs[:] # __call__ might cache back to tmp_logs
        self.tmp_logs[:] = [] # Mutate list initialised with.  Avoid double 
                              # logging in case re - stored in tmp_logs
        for tmp_log_message, tmp_log_level in tmp_logs:
            self.__call__(tmp_log_message, tmp_log_level)

output = Output()


class InvalidArgsError(Exception):
    
    """Custom exception to log the error message, and to at least allow 
       attempts to give users actionable advice to fix the issue, in 
       the event of a problem.  
    """
    message_fmt = 'Invalid import args: %s'
    def __init__(self
                ,message_fmt = ''
                ,message = ''
                ,logger = output
                , **kwargs
                ):
        if message_fmt and isinstance(message_fmt, basestring):
            self.message_fmt = message_fmt
        if kwargs and (not message or not isinstance(message, basestring)):
            message = self.message_fmt % kwargs
        logger.error(message)
        self.kwargs = kwargs
        super(InvalidArgsError, self).__init__(message)    


class ModuleNameError(InvalidArgsError):
    message_fmt = 'Invalid module name: %s'


class FilePathError(InvalidArgsError):
    message_fmt = 'Invalid path to import module from: %s'


# We only know the sDNA version to import as a string.  This is more secure too.
def strict_import(module_name = ''
                 ,folder = ''
                 ,sub_folder = ''
                 ,logger = output
                 ,reload_already_imported = RELOAD_IF_ALREADY_IMPORTED
                 ):

    # type: (str, str, str, type[any], bool) -> type[any]
    """ Imports the named module from the specified folder\subfolder only, 
        and returns it.
        
        Avoids name clashes and casual hijack attempts.  In some 
        environments supporting a Python implementation (such as 
        GhPython in Grasshopper) it may not be desirable to ask the user 
        to set PYTHONPATH.  Hence here, we save sys.path to a tmp 
        variable, set sys.path to the specified folders, attempt the 
        import in a try: block, and restore sys.path in a finally: block
    """
    if not module_name or not isinstance(module_name, basestring):
        raise ModuleNameError(module_name = module_name
                             ,folder = folder
                             ,sub_folder = sub_folder
                             ,logger = logger
                             )
    logger.debug(module_name)
    if module_name in sys.modules:   # sys.modules is also shared between GHPython components 
                                     # (and is even saved until Rhino is closed).
        logger.debug('Module %s already in sys.modules' % module_name)
        if reload_already_imported:
            logger.debug('Reloading %s.... ' % module_name)
            reload(sys.modules[module_name]) # type: ignore
        return sys.modules[module_name]
    #
    #
    # Load module_name for first time:
    #
    #
    search_path = os.path.join(folder, sub_folder)

    if (search_path 
        and isinstance(search_path, basestring) 
        and os.path.isdir(search_path)):
        #
        logger.debug('Search path == %s' % search_path)
        #if search_folder_only:
        #    sys.path = [search_path]
        if search_path not in sys.path:
            sys.path.insert(0, search_path)
    else:
        raise FilePathError(module_name = module_name
                           ,search_path = search_path
                           ,logger = logger
                           )

    logger.debug('Trying import... ')
    module = import_module(module_name, '')           

    return module       


class ModulesNotFoundError(InvalidArgsError):
    message_fmt = 'Modules not found in any location %s'


def load_modules(m_names
                ,folders
                ,logger = output
                ,module_name_error_msg = 'Please supply valid names of modules to import, %s'
                ,folders_error_msg = 'Please supply valid folders to import from. %s'
                ,modules_not_found_msg = 'Specified modules not found in any folder, %s'):
    #type(str/ Iterable, list, type[any], str, str) -> tuple / None
    """ Tries to import all modules in m_names, from the first folder in 
        folders to contain a .py or .pyc files with the same name as each 
        module.

        Returns a tuple of all the modules and the path they were found in.  Else 
        raises a ModulesNotFoundError.
    """
    if not m_names:
        raise ModuleNameError(message_fmt = 'No module names supplied, m_names = %s'
                             ,m_names = m_names
                             ,logger = logger
                             )

    if any( not isinstance(m_name, basestring) for m_name in m_names ):
        # if m_names is a basestring, the error is not raised 
        raise ModuleNameError(message_fmt = module_name_error_msg
                             ,m_names = m_names
                             ,logger = logger
                             )
    
    if isinstance(m_names, basestring):
        m_names = [m_names] 

    logger.debug('m_names == %s of type : %s' % (m_names, type(m_names).__name__))

    logger.debug('Testing paths : %s ' % folders)
    
    if isinstance(folders, basestring):
        folders = [folders]

    if not any(os.path.isdir(folder) or os.path.isdir(os.path.dirname(folder)) 
               for folder in folders
              ):
        raise FilePathError(message_fmt = folders_error_msg
                           ,m_names = m_names
                           ,logger = logger
                           )

    for folder in folders:
        logger.debug('Type(folder) : %s' % type(folder).__name__)
        logger.debug('Type(path) : %s path == %s' %(type(folder).__name__, folder))

        if os.path.isfile(folder):
            folder = os.path.dirname(folder)
        if all( any(os.path.isfile(os.path.join(folder, name.replace('.', os.sep) + ending)) 
                    for ending in ['.py','.pyc'] 
                   )
                for name in m_names
              ):
            #
            logger.debug('Importing %s' % repr(m_names))

            return tuple(strict_import(name, folder, '', logger = logger) 
                         for name in m_names
                        ) + (folder,)
            # tuple of modules, followed by the path to them
    raise ModulesNotFoundError(message_fmt = modules_not_found_msg
                              ,m_names = m_names
                              ,folders = folders
                              ,logger = logger
                              )




if __name__ == '__main__': # False in a compiled component.  But then the user
                           # can't add or remove Params to the component.  
    
    # Grasshopper will look for class MyComponent(component) in global scope
    # so a main function is a little tricky to define.

    nick_name = ghenv.Component.NickName #type: ignore


    if (REPOSITORY and 
        nick_name == 'Build_components'):
        #
        sDNA_GH_search_path = REPOSITORY 
        # builder can only load sDNA_GH from its parent directory, 
        # e.g. if in a dir one level up in the main repo
        # such as sDNA_build_components.gh.
    else:
        sDNA_GH_search_path = USER_INSTALLATION_FOLDER


    sc.doc = ghdoc #type: ignore

    output.debug(sDNA_GH_search_path)

    class sDNA_GH(object):
        pass

    if 'sDNA_GH.main' in sys.modules:
        sDNA_GH.main = sys.modules['sDNA_GH.main']
    else:
        sDNA_GH.main, _ = load_modules(m_names = PACKAGE_NAME + '.main'
                                      ,folders = sDNA_GH_search_path
                                      ,folders_error_msg = 'Please unzip %s.zip '
                                                           %ZIP_FILE_NAME
                                                           +' in the folder %s '
                                                           %Grasshopper.Folders.DefaultUserObjectFolder
                                                           +'and ensure a subfolder called %s is created '
                                                           %os.path.join(ZIP_FILE_NAME, PACKAGE_NAME)
                                                           +'inside it, containing main.py ' 
                                                           +'and all the sDNA_GH python files '
                                                           +'including those within other subfolders. ' 
                                      ,modules_not_found_msg = 'Some sDNA_GH files may be missing.  '
                                                              +'Please: 1) Copy %s.zip into: %s '
                                                              %(ZIP_FILE_NAME
                                                               ,Grasshopper.Folders.DefaultUserObjectFolder
                                                               )
                                                              +'2) Unblock it if necessary. '
                                                              +'3) Right click '
                                                              +'it, select Extract All... and click Extract, '
                                                              +'to extract it to that location. '
                                                              +'4) Ensure that main.py and all sDNA_GH python' 
                                                              +' files and subfolders are inside: %s '
                                                              %os.path.join(USER_INSTALLATION_FOLDER
                                                                           ,PACKAGE_NAME
                                                                           )
                                                              +'5) Reinitialise the component or restart Rhino.'
                                      )         


    logger = sDNA_GH.main.logger.getChild('launcher')
    output.set_logger(logger, flush = True)


    class MyComponent(component):
        pass  # Required.  Idiomatic to Grasshopper.  Must be called "MyComponent"  
            # too (it is looked for by the parser or scope checker?) otherwise 
            # Grasshopper may not find the subclass of on 
            # component.  Even though we overwrite this class on the next line
            # immediately below.  

    MyComponent = sDNA_GH.main.sDNA_GH_Component
    # Grasshopper calls MyComponent.RunScript automatically.


    if nick_name.replace(' ','').replace('_','').lower() == SELFTEST:  


        unit_tests, _ = load_modules('%s.tests.unit_tests.%s_unit_tests' % ((PACKAGE_NAME,)*2)
                                    ,sDNA_GH_search_path
                                    )

        
        MyComponent = unit_tests.make_test_running_component_class(
                                         MyComponent
                                        ,package_location = sDNA_GH_search_path
                                        )
        # Grasshopper calls MyComponent.RunScript automatically.
# ---------- end recolour_objects ----------
legend = Legend(Colour=recolour_objects.leg_cols, Tags=recolour_objects.leg_tags, Rectangle=recolour_objects.leg_frame, LegendType=1)
preview = CustomPreview(Geometry=recolour_objects.Geom, Material=recolour_objects.Data)
panel_3 = Panel(sdna_learn.out)
