# Grasshopper definition test_Python_3_sDNA_prepare.gh (Grasshopper 1.0.7)

geo = Geometry([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])
sdna_prepare = SDNA_Prepare(go=Toggle(False), Geom=geo)  # -> out, OK, opts, file, Geom, Data, abbrevs, fields, bbox; inputs go: list, opts: list, Geom: list, Data: tree, file: list, prj: list, input_key_str: list, config: list, input: list, output: list, start_gs: list, end_gs: list, action: list, nearmisses: list, trafficislands: list, duplicates: list, isolated: list, splitlinks: list, tifield: list, preserve_absolute: list, preserve_unitlength: list, preserve_text: list, xytol: list, ztol: list, bake: list
#   port go: true: runs tools. false: do not run tools but still read other Params.
#   port opts: sDNA_GH options data structure. Python dictionary.
#   port Geom: A list of geometric objects. Requires GUIDs of Rhino objects or native/embedded Grasshopper geometry. To use Rhino objects referenced from Grasshopper parameter objects (instead of their Grasshopper versions which are often obscured unless the Rhino shapes are set to Hidden) run the output of the Geometry (Geo) or Curve (Crv) through a Guid (ID) parameter object first. Note: For sDNA tools all the geometric objects must all be polylines. For write_Shp all the objects must be of the type in shp_type (default: POLYLINEZ).
#   port Data: A Data Tree of a list of keys and list of corresponding values for each object in Geom.
#   port file: File path of the shape file.
#   port prj: File path of the projection file (.prj) to use for the new shapefile. Default :
#   port input_key_str: Format string containing a prefix, a {name} field, and a postfix, to enable more descriptive User Text key names. Default: {name} Only User Text key names matching this pattern will have their values written to shape files by Write_Shp,under the field name in {name}, which can have a max of 10 chars in Write_Shp. The actual values of name in User Text keys must also be specified to the sDNA tools that use them.
#   port config: File path to sDNA_GH options file. Default: C:\Users\James\AppData\Roaming\Grasshopper\UserObjects\sdna-gh\sDNA_GH\config.toml
#   port input: Input polyline features. Default value == .Type: File path.
#   port output: Output polyline features. Default value == .Type: File path.
#   port start_gs: Start grade separation. Default value == .. Allowed values: Numeric, input. Type: Text.
#   port end_gs: End grade separation. Default value == .. Allowed values: Numeric, input. Type: Text.
#   port action: Action. Default value == REPAIR.. Allowed values: DETECT, REPAIR. Type: Text.
#   port nearmisses: Endpoint near misses. Default value == True.Type: Boolean.
#   port trafficislands: Traffic islands. Default value == False.Type: Boolean.
#   port duplicates: Duplicate polylines. Default value == True.Type: Boolean.
#   port isolated: Isolated systems. Default value == True.Type: Boolean.
#   port splitlinks: Split links. Default value == False.Type: Boolean.
#   port tifield: Traffic island field. Default value == .. Allowed values: Numeric, input. Type: Text.
#   port preserve_absolute: Absolute data to preserve (numeric field names separated by commas). Default value == .Type: Text.
#   port preserve_unitlength: Unit length data to preserve (numeric field names separated by commas). Default value == .Type: Text.
#   port preserve_text: Text data to preserve (text field names separated by commas). Default value == .Type: Text.
#   port xytol: Custom XY Tolerance. Default value == .Type: Text.
#   port ztol: Custom Z Tolerance. Default value == .Type: Text.
#   port bake: If new shapes are created, thentrue: bakes the shapefile polylines to Rhino. false: creates Grasshopper polylines only. Default: False
#   port OK: true: tools ran successfully. false: tools did not run, or there was an error.
#   port opts: sDNA_GH options data structure. Python dictionary.
#   port file: File path of the shape file.
#   port Geom: A list of geometric objects. Requires GUIDs of Rhino objects or native/embedded Grasshopper geometry. To use Rhino objects referenced from Grasshopper parameter objects (instead of their Grasshopper versions which are often obscured unless the Rhino shapes are set to Hidden) run the output of the Geometry (Geo) or Curve (Crv) through a Guid (ID) parameter object first. Note: For sDNA tools all the geometric objects must all be polylines. For write_Shp all the objects must be of the type in shp_type (default: POLYLINEZ).
#   port Data: A Data Tree of a list of keys and list of corresponding values for each object in Geom.
#   port abbrevs: Abbreviations of sDNA results from the ...names.csv file.
#   port fields: Field names from the Shapefile. Set field to one of these values to parse and/or plot it.
#   port bbox: Bounding box from the Shapefile. Used to calculate leg_frame by the Recolour_objects component. [x_min, y_min, x_max, y_max]. All Numbers.
# ---------- sdna_prepare: Python ----------
#! /usr/bin/awk NR==3
# -*- coding: utf-8 -*-
# This module requires Grasshopper Python (Rhino3D)

# MIT License

# Copyright (c) [2021] [Cardiff University, a body incorporated
# by Royal Charter and a registered charity (number:
# 1136855) whose administrative offices are at 7th floor 30-
# 36 Newport Road, University CF24 0DE, Wales, UK]

# Permission is hereby granted, free of charge, to any person obtaining a copy
# of this software and associated documentation files (the "Software"), to deal
# in the Software without restriction, including without limitation the rights
# to use, copy, modify, merge, publish, distribute, sublicense, and/or sell
# copies of the Software, and to permit persons to whom the Software is
# furnished to do so, subject to the following conditions:

# The above copyright notice and this permission notice shall be included in all
# copies or substantial portions of the Software.

# THE SOFTWARE IS PROVIDED "AS IS", WITHOUT WARRANTY OF ANY KIND, EXPRESS OR
# IMPLIED, INCLUDING BUT NOT LIMITED TO THE WARRANTIES OF MERCHANTABILITY,
# FITNESS FOR A PARTICULAR PURPOSE AND NONINFRINGEMENT. IN NO EVENT SHALL THE
# AUTHORS OR COPYRIGHT HOLDERS BE LIABLE FOR ANY CLAIM, DAMAGES OR OTHER
# LIABILITY, WHETHER IN AN ACTION OF CONTRACT, TORT OR OTHERWISE, ARISING FROM,
# OUT OF OR IN CONNECTION WITH THE SOFTWARE OR THE USE OR OTHER DEALINGS IN THE
# SOFTWARE.



"""Prepares spatial networks for analysis by checking and optionally repairing various kinds of error.  Note that the functions offered by sDNA prepare are only a small subset of those needed for preparing networks. A good understanding of Network Preparation is needed, and other (free) tools can complement sDNA Prepare. 

The errors fixed by sDNA Prepare are: 
- endpoint near misses (XY and Z tolerance specify how close a near miss) 
- duplicate lines 
- traffic islands (requires traffic island field set to 0 for no island and 1 for island). Traffic island lines are straightened; if doing so creates duplicate lines then these are removed. 
- split links. Note that fixing split links is no longer necessary as of sDNA 3.0 so this is not done by default. 
- isolated systems. 

To use sDNA's advanced config options in sDNA_GH, add in an input Param to an sDNA component with the same name as each advanced config option you wish to include (omitting a trailing equals sign and leaving the Param unconnected, unless you wish to provide a value for it).  The sDNA tools in that component will gather all user-specified input Params and construct the `advanced` config string from them.  Alternatively, prepare the `advanced` config string manually and connect it to `advanced`. See the readme for the list of supported advanced config options.
"""

__author__ = 'James Parrott'
__version__ = '2.0'



import sys
import os
import functools
import importlib

from ghpythonlib.componentbase import executingcomponent as component
import Grasshopper
import scriptcontext as sc

import_module = importlib.import_module
try:
    reload #type: ignore
except NameError:
    reload = importlib.reload

try:
    basestring #type: ignore
except NameError:
    basestring = str

try:
    ghdoc #type: ignore
except NameError:
    from .custom.skel.basic.ghdoc import ghdoc

ZIP_FILE_NAME = 'sdna-gh'
PACKAGE_NAME = 'sDNA_GH'
PLUG_IN_NAME = 'sDNA'               
RELOAD_IF_ALREADY_IMPORTED = False
REPOSITORY = os.path.dirname(os.path.dirname(ghdoc.Path)) if ghdoc.Path else None
# Assume we are in repo_folder/dev/sDNA_build_components.gh

USER_INSTALLATION_FOLDER = os.path.join(
                                    Grasshopper.Folders.DefaultUserObjectFolder
                                   ,ZIP_FILE_NAME
                                   )
SELFTEST = 'selftest'




class Output(object): 

    def set_logger(self, logger, flush = True):
        self.logger = logger
        if flush and self.tmp_logs:
            self.flush()

    def __init__(self
                ,tmp_logs = None
                ,logger = None
                ):
        if not isinstance(tmp_logs, list): #assert not isinstance(None, list)
            tmp_logs = []
        self.tmp_logs = tmp_logs
        self.set_logger(logger, flush = False)



    def store(self, message, logging_level):
        self.tmp_logs.append( (message, logging_level) )

    def __call__(self, message, logging_level = "INFO", logging_dict = {}):
        #type: (str, str, dict, list) -> str
        
        #logger.debug(s)

        if logging_dict == {} and self.logger is not None: 
            logging_dict = dict( DEBUG = self.logger.debug
                                ,INFO = self.logger.info
                                ,WARNING = self.logger.warning
                                ,ERROR = self.logger.error
                                ,CRITICAL = self.logger.critical
                                )

        logging_level = logging_level.upper()
        if logging_level in logging_dict:
            logging_dict[logging_level](message)
        else:
            self.store(message, logging_level)

        return '%s : %s ' % (logging_level, message)

    def __getattr__(self, attr):
        return functools.partial(self.__call__, logging_level = attr.upper())

    def flush(self):
        tmp_logs = self.tmp_logs[:] # __call__ might cache back to tmp_logs
        self.tmp_logs[:] = [] # Mutate list initialised with.  Avoid double 
                              # logging in case re - stored in tmp_logs
        for tmp_log_message, tmp_log_level in tmp_logs:
            self.__call__(tmp_log_message, tmp_log_level)

output = Output()


class InvalidArgsError(Exception):
    
    """Custom exception to log the error message, and to at least allow 
       attempts to give users actionable advice to fix the issue, in 
       the event of a problem.  
    """
    message_fmt = 'Invalid import args: %s'
    def __init__(self
                ,message_fmt = ''
                ,message = ''
                ,logger = output
                , **kwargs
                ):
        if message_fmt and isinstance(message_fmt, basestring):
            self.message_fmt = message_fmt
        if kwargs and (not message or not isinstance(message, basestring)):
            message = self.message_fmt % kwargs
        logger.error(message)
        self.kwargs = kwargs
        super(InvalidArgsError, self).__init__(message)    


class ModuleNameError(InvalidArgsError):
    message_fmt = 'Invalid module name: %s'


class FilePathError(InvalidArgsError):
    message_fmt = 'Invalid path to import module from: %s'


# We only know the sDNA version to import as a string.  This is more secure too.
def strict_import(module_name = ''
                 ,folder = ''
                 ,sub_folder = ''
                 ,logger = output
                 ,reload_already_imported = RELOAD_IF_ALREADY_IMPORTED
                 ):

    # type: (str, str, str, type[any], bool) -> type[any]
    """ Imports the named module from the specified folder\subfolder only, 
        and returns it.
        
        Avoids name clashes and casual hijack attempts.  In some 
        environments supporting a Python implementation (such as 
        GhPython in Grasshopper) it may not be desirable to ask the user 
        to set PYTHONPATH.  Hence here, we save sys.path to a tmp 
        variable, set sys.path to the specified folders, attempt the 
        import in a try: block, and restore sys.path in a finally: block
    """
    if not module_name or not isinstance(module_name, basestring):
        raise ModuleNameError(module_name = module_name
                             ,folder = folder
                             ,sub_folder = sub_folder
                             ,logger = logger
                             )
    logger.debug(module_name)
    if module_name in sys.modules:   # sys.modules is also shared between GHPython components 
                                     # (and is even saved until Rhino is closed).
        logger.debug('Module %s already in sys.modules' % module_name)
        if reload_already_imported:
            logger.debug('Reloading %s.... ' % module_name)
            reload(sys.modules[module_name]) # type: ignore
        return sys.modules[module_name]
    #
    #
    # Load module_name for first time:
    #
    #
    search_path = os.path.join(folder, sub_folder)

    if (search_path 
        and isinstance(search_path, basestring) 
        and os.path.isdir(search_path)):
        #
        logger.debug('Search path == %s' % search_path)
        #if search_folder_only:
        #    sys.path = [search_path]
        if search_path not in sys.path:
            sys.path.insert(0, search_path)
    else:
        raise FilePathError(module_name = module_name
                           ,search_path = search_path
                           ,logger = logger
                           )

    logger.debug('Trying import... ')
    module = import_module(module_name, '')           

    return module       


class ModulesNotFoundError(InvalidArgsError):
    message_fmt = 'Modules not found in any location %s'


def load_modules(m_names
                ,folders
                ,logger = output
                ,module_name_error_msg = 'Please supply valid names of modules to import, %s'
                ,folders_error_msg = 'Please supply valid folders to import from. %s'
                ,modules_not_found_msg = 'Specified modules not found in any folder, %s'):
    #type(str/ Iterable, list, type[any], str, str) -> tuple / None
    """ Tries to import all modules in m_names, from the first folder in 
        folders to contain a .py or .pyc files with the same name as each 
        module.

        Returns a tuple of all the modules and the path they were found in.  Else 
        raises a ModulesNotFoundError.
    """
    if not m_names:
        raise ModuleNameError(message_fmt = 'No module names supplied, m_names = %s'
                             ,m_names = m_names
                             ,logger = logger
                             )

    if any( not isinstance(m_name, basestring) for m_name in m_names ):
        # if m_names is a basestring, the error is not raised 
        raise ModuleNameError(message_fmt = module_name_error_msg
                             ,m_names = m_names
                             ,logger = logger
                             )
    
    if isinstance(m_names, basestring):
        m_names = [m_names] 

    logger.debug('m_names == %s of type : %s' % (m_names, type(m_names).__name__))

    logger.debug('Testing paths : %s ' % folders)
    
    if isinstance(folders, basestring):
        folders = [folders]

    if not any(os.path.isdir(folder) or os.path.isdir(os.path.dirname(folder)) 
               for folder in folders
              ):
        raise FilePathError(message_fmt = folders_error_msg
                           ,m_names = m_names
                           ,logger = logger
                           )

    for folder in folders:
        logger.debug('Type(folder) : %s' % type(folder).__name__)
        logger.debug('Type(path) : %s path == %s' %(type(folder).__name__, folder))

        if os.path.isfile(folder):
            folder = os.path.dirname(folder)
        if all( any(os.path.isfile(os.path.join(folder, name.replace('.', os.sep) + ending)) 
                    for ending in ['.py','.pyc'] 
                   )
                for name in m_names
              ):
            #
            logger.debug('Importing %s' % repr(m_names))

            return tuple(strict_import(name, folder, '', logger = logger) 
                         for name in m_names
                        ) + (folder,)
            # tuple of modules, followed by the path to them
    raise ModulesNotFoundError(message_fmt = modules_not_found_msg
                              ,m_names = m_names
                              ,folders = folders
                              ,logger = logger
                              )




if __name__ == '__main__': # False in a compiled component.  But then the user
                           # can't add or remove Params to the component.  
    
    # Grasshopper will look for class MyComponent(component) in global scope
    # so a main function is a little tricky to define.

    nick_name = ghenv.Component.NickName #type: ignore


    if (REPOSITORY and 
        nick_name == 'Build_components'):
        #
        sDNA_GH_search_path = REPOSITORY 
        # builder can only load sDNA_GH from its parent directory, 
        # e.g. if in a dir one level up in the main repo
        # such as sDNA_build_components.gh.
    else:
        sDNA_GH_search_path = USER_INSTALLATION_FOLDER


    sc.doc = ghdoc #type: ignore

    output.debug(sDNA_GH_search_path)

    class sDNA_GH(object):
        pass

    if 'sDNA_GH.main' in sys.modules:
        sDNA_GH.main = sys.modules['sDNA_GH.main']
    else:
        sDNA_GH.main, _ = load_modules(m_names = PACKAGE_NAME + '.main'
                                      ,folders = sDNA_GH_search_path
                                      ,folders_error_msg = 'Please unzip %s.zip '
                                                           %ZIP_FILE_NAME
                                                           +' in the folder %s '
                                                           %Grasshopper.Folders.DefaultUserObjectFolder
                                                           +'and ensure a subfolder called %s is created '
                                                           %os.path.join(ZIP_FILE_NAME, PACKAGE_NAME)
                                                           +'inside it, containing main.py ' 
                                                           +'and all the sDNA_GH python files '
                                                           +'including those within other subfolders. ' 
                                      ,modules_not_found_msg = 'Some sDNA_GH files may be missing.  '
                                                              +'Please: 1) Copy %s.zip into: %s '
                                                              %(ZIP_FILE_NAME
                                                               ,Grasshopper.Folders.DefaultUserObjectFolder
                                                               )
                                                              +'2) Unblock it if necessary. '
                                                              +'3) Right click '
                                                              +'it, select Extract All... and click Extract, '
                                                              +'to extract it to that location. '
                                                              +'4) Ensure that main.py and all sDNA_GH python' 
                                                              +' files and subfolders are inside: %s '
                                                              %os.path.join(USER_INSTALLATION_FOLDER
                                                                           ,PACKAGE_NAME
                                                                           )
                                                              +'5) Reinitialise the component or restart Rhino.'
                                      )         


    logger = sDNA_GH.main.logger.getChild('launcher')
    output.set_logger(logger, flush = True)


    class MyComponent(component):
        pass  # Required.  Idiomatic to Grasshopper.  Must be called "MyComponent"  
            # too (it is looked for by the parser or scope checker?) otherwise 
            # Grasshopper may not find the subclass of on 
            # component.  Even though we overwrite this class on the next line
            # immediately below.  

    MyComponent = sDNA_GH.main.sDNA_GH_Component
    # Grasshopper calls MyComponent.RunScript automatically.


    if nick_name.replace(' ','').replace('_','').lower() == SELFTEST:  


        unit_tests, _ = load_modules('%s.tests.unit_tests.%s_unit_tests' % ((PACKAGE_NAME,)*2)
                                    ,sDNA_GH_search_path
                                    )

        
        MyComponent = unit_tests.make_test_running_component_class(
                                         MyComponent
                                        ,package_location = sDNA_GH_search_path
                                        )
        # Grasshopper calls MyComponent.RunScript automatically.
# ---------- end sdna_prepare ----------
panel = Panel(sdna_prepare.fields)
list = ValueList({"ID"}, selected="ID")
panel_2 = Panel(sdna_prepare.out)
recolour_objects = Recolour_Objects(go=sdna_prepare.OK, Data=sdna_prepare.Data, Geom=sdna_prepare.Geom, bbox=sdna_prepare.bbox, field=list)  # -> out, OK, opts, Geom, Data, leg_cols, leg_tags, leg_frame; inputs go: list, opts: list, plot_min: list, plot_max: list, Data: tree, Geom: list, bbox: list, field: list
#   port go: true: runs tools. false: do not run tools but still read other Params.
#   port opts: sDNA_GH options data structure. Python dictionary.
#   port plot_min: Minimum data value to parse. Lower values (and their objects) are omitted. Automatically calculated if unset.
#   port plot_max: Maximum data value to parse. Higher values (and their objects) are omitted. Automatically calculated if unset.
#   port Data: A Data Tree of a list of keys and list of corresponding values for each object in Geom.
#   port Geom: A list of geometric objects. Requires GUIDs of Rhino objects or native/embedded Grasshopper geometry. To use Rhino objects referenced from Grasshopper parameter objects (instead of their Grasshopper versions which are often obscured unless the Rhino shapes are set to Hidden) run the output of the Geometry (Geo) or Curve (Crv) through a Guid (ID) parameter object first. Note: For sDNA tools all the geometric objects must all be polylines. For write_Shp all the objects must be of the type in shp_type (default: POLYLINEZ).
#   port bbox: Bounding box of geometry. Used to calculate extent of leg_frame.Calculated from shapefiles by the Read_shapefile component. [x_min, y_min, x_max, y_max], all Numbers.
#   port field: The field name / key value of the results field to parse and/or plot. Default: BtEn
#   port OK: true: tools ran successfully. false: tools did not run, or there was an error.
#   port opts: sDNA_GH options data structure. Python dictionary.
#   port Geom: A list of geometric objects. Requires GUIDs of Rhino objects or native/embedded Grasshopper geometry. To use Rhino objects referenced from Grasshopper parameter objects (instead of their Grasshopper versions which are often obscured unless the Rhino shapes are set to Hidden) run the output of the Geometry (Geo) or Curve (Crv) through a Guid (ID) parameter object first. Note: For sDNA tools all the geometric objects must all be polylines. For write_Shp all the objects must be of the type in shp_type (default: POLYLINEZ).
#   port Data: A Data Tree of a list of keys and list of corresponding values for each object in Geom.
#   port leg_cols: Colour values for a legend.
#   port leg_tags: Tag names, for a legend.
#   port leg_frame: A Rectangle, suitable for a legend frame.
# ---------- recolour_objects: Python ----------
#! /usr/bin/awk NR==3
# -*- coding: utf-8 -*-
# This module requires Grasshopper Python (Rhino3D)

# MIT License

# Copyright (c) [2021] [Cardiff University, a body incorporated
# by Royal Charter and a registered charity (number:
# 1136855) whose administrative offices are at 7th floor 30-
# 36 Newport Road, University CF24 0DE, Wales, UK]

# Permission is hereby granted, free of charge, to any person obtaining a copy
# of this software and associated documentation files (the "Software"), to deal
# in the Software without restriction, including without limitation the rights
# to use, copy, modify, merge, publish, distribute, sublicense, and/or sell
# copies of the Software, and to permit persons to whom the Software is
# furnished to do so, subject to the following conditions:

# The above copyright notice and this permission notice shall be included in all
# copies or substantial portions of the Software.

# THE SOFTWARE IS PROVIDED "AS IS", WITHOUT WARRANTY OF ANY KIND, EXPRESS OR
# IMPLIED, INCLUDING BUT NOT LIMITED TO THE WARRANTIES OF MERCHANTABILITY,
# FITNESS FOR A PARTICULAR PURPOSE AND NONINFRINGEMENT. IN NO EVENT SHALL THE
# AUTHORS OR COPYRIGHT HOLDERS BE LIABLE FOR ANY CLAIM, DAMAGES OR OTHER
# LIABILITY, WHETHER IN AN ACTION OF CONTRACT, TORT OR OTHERWISE, ARISING FROM,
# OUT OF OR IN CONNECTION WITH THE SOFTWARE OR THE USE OR OTHER DEALINGS IN THE
# SOFTWARE.



"""Recolour objects (and legend tags) based on pre-parsed and pre-normalised data, or already calculated colours (as RGB triples).  Recolouring Rhino Geometry can be much slower than recolouring Grasshopper Geometry (the latter via a custom preview component connected to Geom and Data).  Nonetheless, to recolour Rhino objects from Grasshopper Referenced Curves (instead of their actual Grasshopper copies, which may be obscured unless the overlying Rhino geometry is set to Hidden), connect the Referenced Curves to a Guid (ID) parameter object first.  

If unparsed data is inputted, Parse_Data is first called.  Custom colour curves are supported using a 3D quadratic spline between the triples of numbers: `rgb_min`, `rgb_mid` and `rgb_max`.  Otherwise, use the Grasshopper Colour Gradient internally (via Node In Code) by setting `Col_Grad` to true and picking a setting from 0 to 7 for `Col_Grad_num` (0 : 'EarthlyBrown', 1 : 'Forest', 2 : 'GreyScale', 3 : 'Heat', 4 : 'Pink', 5 : 'Spectrum', 6 : 'Traffic', 7 : 'Zebra').  Set `line_width` to control the width of the line of Rhino geom objects  (the default is 4).

Create a legend by connecting `leg_cols`, `leg_tags` and `leg_frame` to a Grasshopper Legend component.  The coordinates of the corners of the Rectangle provided in `leg_frame` may be overridden by specifying `leg_extent` (xmin, ymin, xmax, ymax); alternatively any rectangle object can be passed into `leg_frame` on the GH Legend component itself.  Custom legend tag templates and class boundaries are supported via four format strings (`first_leg_tag_str`, `gen_leg_tag_str`, `last_leg_tag_str` and `num_format`) as per Parse_Data.  

To recolour Grasshopper geometry instead of Rhino Geometry (i.e. unbaked objects), connect the `Data` and `Geom` outputs to a Grasshopper Custom Preview component (line widths of GH objects cannot be increased).  
"""

__author__ = 'James Parrott'
__version__ = '2.0'



import sys
import os
import functools
import importlib

from ghpythonlib.componentbase import executingcomponent as component
import Grasshopper
import scriptcontext as sc

import_module = importlib.import_module
try:
    reload #type: ignore
except NameError:
    reload = importlib.reload

try:
    basestring #type: ignore
except NameError:
    basestring = str

try:
    ghdoc #type: ignore
except NameError:
    from .custom.skel.basic.ghdoc import ghdoc

ZIP_FILE_NAME = 'sdna-gh'
PACKAGE_NAME = 'sDNA_GH'
PLUG_IN_NAME = 'sDNA'               
RELOAD_IF_ALREADY_IMPORTED = False
REPOSITORY = os.path.dirname(os.path.dirname(ghdoc.Path)) if ghdoc.Path else None
# Assume we are in repo_folder/dev/sDNA_build_components.gh

USER_INSTALLATION_FOLDER = os.path.join(
                                    Grasshopper.Folders.DefaultUserObjectFolder
                                   ,ZIP_FILE_NAME
                                   )
SELFTEST = 'selftest'




class Output(object): 

    def set_logger(self, logger, flush = True):
        self.logger = logger
        if flush and self.tmp_logs:
            self.flush()

    def __init__(self
                ,tmp_logs = None
                ,logger = None
                ):
        if not isinstance(tmp_logs, list): #assert not isinstance(None, list)
            tmp_logs = []
        self.tmp_logs = tmp_logs
        self.set_logger(logger, flush = False)



    def store(self, message, logging_level):
        self.tmp_logs.append( (message, logging_level) )

    def __call__(self, message, logging_level = "INFO", logging_dict = {}):
        #type: (str, str, dict, list) -> str
        
        #logger.debug(s)

        if logging_dict == {} and self.logger is not None: 
            logging_dict = dict( DEBUG = self.logger.debug
                                ,INFO = self.logger.info
                                ,WARNING = self.logger.warning
                                ,ERROR = self.logger.error
                                ,CRITICAL = self.logger.critical
                                )

        logging_level = logging_level.upper()
        if logging_level in logging_dict:
            logging_dict[logging_level](message)
        else:
            self.store(message, logging_level)

        return '%s : %s ' % (logging_level, message)

    def __getattr__(self, attr):
        return functools.partial(self.__call__, logging_level = attr.upper())

    def flush(self):
        tmp_logs = self.tmp_logs[:] # __call__ might cache back to tmp_logs
        self.tmp_logs[:] = [] # Mutate list initialised with.  Avoid double 
                              # logging in case re - stored in tmp_logs
        for tmp_log_message, tmp_log_level in tmp_logs:
            self.__call__(tmp_log_message, tmp_log_level)

output = Output()


class InvalidArgsError(Exception):
    
    """Custom exception to log the error message, and to at least allow 
       attempts to give users actionable advice to fix the issue, in 
       the event of a problem.  
    """
    message_fmt = 'Invalid import args: %s'
    def __init__(self
                ,message_fmt = ''
                ,message = ''
                ,logger = output
                , **kwargs
                ):
        if message_fmt and isinstance(message_fmt, basestring):
            self.message_fmt = message_fmt
        if kwargs and (not message or not isinstance(message, basestring)):
            message = self.message_fmt % kwargs
        logger.error(message)
        self.kwargs = kwargs
        super(InvalidArgsError, self).__init__(message)    


class ModuleNameError(InvalidArgsError):
    message_fmt = 'Invalid module name: %s'


class FilePathError(InvalidArgsError):
    message_fmt = 'Invalid path to import module from: %s'


# We only know the sDNA version to import as a string.  This is more secure too.
def strict_import(module_name = ''
                 ,folder = ''
                 ,sub_folder = ''
                 ,logger = output
                 ,reload_already_imported = RELOAD_IF_ALREADY_IMPORTED
                 ):

    # type: (str, str, str, type[any], bool) -> type[any]
    """ Imports the named module from the specified folder\subfolder only, 
        and returns it.
        
        Avoids name clashes and casual hijack attempts.  In some 
        environments supporting a Python implementation (such as 
        GhPython in Grasshopper) it may not be desirable to ask the user 
        to set PYTHONPATH.  Hence here, we save sys.path to a tmp 
        variable, set sys.path to the specified folders, attempt the 
        import in a try: block, and restore sys.path in a finally: block
    """
    if not module_name or not isinstance(module_name, basestring):
        raise ModuleNameError(module_name = module_name
                             ,folder = folder
                             ,sub_folder = sub_folder
                             ,logger = logger
                             )
    logger.debug(module_name)
    if module_name in sys.modules:   # sys.modules is also shared between GHPython components 
                                     # (and is even saved until Rhino is closed).
        logger.debug('Module %s already in sys.modules' % module_name)
        if reload_already_imported:
            logger.debug('Reloading %s.... ' % module_name)
            reload(sys.modules[module_name]) # type: ignore
        return sys.modules[module_name]
    #
    #
    # Load module_name for first time:
    #
    #
    search_path = os.path.join(folder, sub_folder)

    if (search_path 
        and isinstance(search_path, basestring) 
        and os.path.isdir(search_path)):
        #
        logger.debug('Search path == %s' % search_path)
        #if search_folder_only:
        #    sys.path = [search_path]
        if search_path not in sys.path:
            sys.path.insert(0, search_path)
    else:
        raise FilePathError(module_name = module_name
                           ,search_path = search_path
                           ,logger = logger
                           )

    logger.debug('Trying import... ')
    module = import_module(module_name, '')           

    return module       


class ModulesNotFoundError(InvalidArgsError):
    message_fmt = 'Modules not found in any location %s'


def load_modules(m_names
                ,folders
                ,logger = output
                ,module_name_error_msg = 'Please supply valid names of modules to import, %s'
                ,folders_error_msg = 'Please supply valid folders to import from. %s'
                ,modules_not_found_msg = 'Specified modules not found in any folder, %s'):
    #type(str/ Iterable, list, type[any], str, str) -> tuple / None
    """ Tries to import all modules in m_names, from the first folder in 
        folders to contain a .py or .pyc files with the same name as each 
        module.

        Returns a tuple of all the modules and the path they were found in.  Else 
        raises a ModulesNotFoundError.
    """
    if not m_names:
        raise ModuleNameError(message_fmt = 'No module names supplied, m_names = %s'
                             ,m_names = m_names
                             ,logger = logger
                             )

    if any( not isinstance(m_name, basestring) for m_name in m_names ):
        # if m_names is a basestring, the error is not raised 
        raise ModuleNameError(message_fmt = module_name_error_msg
                             ,m_names = m_names
                             ,logger = logger
                             )
    
    if isinstance(m_names, basestring):
        m_names = [m_names] 

    logger.debug('m_names == %s of type : %s' % (m_names, type(m_names).__name__))

    logger.debug('Testing paths : %s ' % folders)
    
    if isinstance(folders, basestring):
        folders = [folders]

    if not any(os.path.isdir(folder) or os.path.isdir(os.path.dirname(folder)) 
               for folder in folders
              ):
        raise FilePathError(message_fmt = folders_error_msg
                           ,m_names = m_names
                           ,logger = logger
                           )

    for folder in folders:
        logger.debug('Type(folder) : %s' % type(folder).__name__)
        logger.debug('Type(path) : %s path == %s' %(type(folder).__name__, folder))

        if os.path.isfile(folder):
            folder = os.path.dirname(folder)
        if all( any(os.path.isfile(os.path.join(folder, name.replace('.', os.sep) + ending)) 
                    for ending in ['.py','.pyc'] 
                   )
                for name in m_names
              ):
            #
            logger.debug('Importing %s' % repr(m_names))

            return tuple(strict_import(name, folder, '', logger = logger) 
                         for name in m_names
                        ) + (folder,)
            # tuple of modules, followed by the path to them
    raise ModulesNotFoundError(message_fmt = modules_not_found_msg
                              ,m_names = m_names
                              ,folders = folders
                              ,logger = logger
                              )




if __name__ == '__main__': # False in a compiled component.  But then the user
                           # can't add or remove Params to the component.  
    
    # Grasshopper will look for class MyComponent(component) in global scope
    # so a main function is a little tricky to define.

    nick_name = ghenv.Component.NickName #type: ignore


    if (REPOSITORY and 
        nick_name == 'Build_components'):
        #
        sDNA_GH_search_path = REPOSITORY 
        # builder can only load sDNA_GH from its parent directory, 
        # e.g. if in a dir one level up in the main repo
        # such as sDNA_build_components.gh.
    else:
        sDNA_GH_search_path = USER_INSTALLATION_FOLDER


    sc.doc = ghdoc #type: ignore

    output.debug(sDNA_GH_search_path)

    class sDNA_GH(object):
        pass

    if 'sDNA_GH.main' in sys.modules:
        sDNA_GH.main = sys.modules['sDNA_GH.main']
    else:
        sDNA_GH.main, _ = load_modules(m_names = PACKAGE_NAME + '.main'
                                      ,folders = sDNA_GH_search_path
                                      ,folders_error_msg = 'Please unzip %s.zip '
                                                           %ZIP_FILE_NAME
                                                           +' in the folder %s '
                                                           %Grasshopper.Folders.DefaultUserObjectFolder
                                                           +'and ensure a subfolder called %s is created '
                                                           %os.path.join(ZIP_FILE_NAME, PACKAGE_NAME)
                                                           +'inside it, containing main.py ' 
                                                           +'and all the sDNA_GH python files '
                                                           +'including those within other subfolders. ' 
                                      ,modules_not_found_msg = 'Some sDNA_GH files may be missing.  '
                                                              +'Please: 1) Copy %s.zip into: %s '
                                                              %(ZIP_FILE_NAME
                                                               ,Grasshopper.Folders.DefaultUserObjectFolder
                                                               )
                                                              +'2) Unblock it if necessary. '
                                                              +'3) Right click '
                                                              +'it, select Extract All... and click Extract, '
                                                              +'to extract it to that location. '
                                                              +'4) Ensure that main.py and all sDNA_GH python' 
                                                              +' files and subfolders are inside: %s '
                                                              %os.path.join(USER_INSTALLATION_FOLDER
                                                                           ,PACKAGE_NAME
                                                                           )
                                                              +'5) Reinitialise the component or restart Rhino.'
                                      )         


    logger = sDNA_GH.main.logger.getChild('launcher')
    output.set_logger(logger, flush = True)


    class MyComponent(component):
        pass  # Required.  Idiomatic to Grasshopper.  Must be called "MyComponent"  
            # too (it is looked for by the parser or scope checker?) otherwise 
            # Grasshopper may not find the subclass of on 
            # component.  Even though we overwrite this class on the next line
            # immediately below.  

    MyComponent = sDNA_GH.main.sDNA_GH_Component
    # Grasshopper calls MyComponent.RunScript automatically.


    if nick_name.replace(' ','').replace('_','').lower() == SELFTEST:  


        unit_tests, _ = load_modules('%s.tests.unit_tests.%s_unit_tests' % ((PACKAGE_NAME,)*2)
                                    ,sDNA_GH_search_path
                                    )

        
        MyComponent = unit_tests.make_test_running_component_class(
                                         MyComponent
                                        ,package_location = sDNA_GH_search_path
                                        )
        # Grasshopper calls MyComponent.RunScript automatically.
# ---------- end recolour_objects ----------
preview = CustomPreview(Geometry=recolour_objects.Geom, Material=recolour_objects.Data)
