# Grasshopper definition Test_Roundtrip_Usertext.gh (Grasshopper 1.0.8)

roundtrip_usertext = Unload_sDNA()  # -> out, a; disabled
# ---------- roundtrip_usertext: Python ----------
#! /usr/bin/awk NR==3
# -*- coding: utf-8 -*-
# This module requires Grasshopper Python (Rhino3D)

# MIT License

# Permission is hereby granted, free of charge, to any person obtaining a copy
# of this software and associated documentation files (the "Software"), to deal
# in the Software without restriction, including without limitation the rights
# to use, copy, modify, merge, publish, distribute, sublicense, and/or sell
# copies of the Software, and to permit persons to whom the Software is
# furnished to do so, subject to the following conditions:

# The above copyright notice and this permission notice shall be included in all
# copies or substantial portions of the Software.

# THE SOFTWARE IS PROVIDED "AS IS", WITHOUT WARRANTY OF ANY KIND, EXPRESS OR
# IMPLIED, INCLUDING BUT NOT LIMITED TO THE WARRANTIES OF MERCHANTABILITY,
# FITNESS FOR A PARTICULAR PURPOSE AND NONINFRINGEMENT. IN NO EVENT SHALL THE
# AUTHORS OR COPYRIGHT HOLDERS BE LIABLE FOR ANY CLAIM, DAMAGES OR OTHER
# LIABILITY, WHETHER IN AN ACTION OF CONTRACT, TORT OR OTHERWISE, ARISING FROM,
# OUT OF OR IN CONNECTION WITH THE SOFTWARE OR THE USE OR OTHER DEALINGS IN THE
# SOFTWARE.

__author__ = 'James Parrott'
__version__ = '3.0.0.alpha_3'



import os
import random
import inspect
from collections import OrderedDict

import rhinoscriptsyntax as rs

# random is used here for fuzz testing, not Cryptography.  
# But could Windows OS generated randomness be repeatable
# between instances of the same VM image, e.g. CI runners?  
# If so use:
# random.seed(time.time())
# Otherwise, assuming os.urandom includes the time already:
SEED = os.urandom(10)
random.seed(SEED)

# Extents of viewport
MIN_X, MAX_X, MIN_Y, MAX_Y = -10.0, 110.0, -10.0, 40.0

def random_number(min_ = MIN_X, max_ = MAX_X):
    return random.uniform(min_, max_)

def random_pair():
    return random_number(), random_number()

def random_triple():
    return random_pair() + (random_number(),)

def random_int(min_ = 2, max_ = 17):
    return random.randint(min_, max_)

def random_triples(n = None):
    n = n or random_int(min_ = 3)
    return tuple(random_triple() for __ in range(n))

# def random_point():

def random_nurbs_curve(length = None, degree = None):
    length = length or random_int()

    # The control points are a list of at least degree+1 points.
    # https://developer.rhino3d.com/guides/opennurbs/nurbs-geometry-overview/
    degree = degree or random_int(1, length-1)

    # The knots are a list of degree+N-1 numbers, where N is the number of control points. Sometimes this list of numbers is called the knot vector. In this term, the word vector does not mean 3‑D direction.
    # This list of knot numbers must satisfy several technical conditions. The standard way to ensure that the technical conditions are satisfied is to require the numbers to stay the same or get larger as you go down the list and to limit the number of duplicate values to no more than the degree. For example, for a degree 3 NURBS curve with 11 control points, the list of numbers 0,0,0,1,2,2,2,3,7,7,9,9,9 is a satisfactory list of knots. The list 0,0,0,1,2,2,2,2,7,7,9,9,9 is unacceptable because there are four 2s and four is larger than the degree.
    # The number of times a knot value is duplicated is called the knot’s multiplicity. In the preceding example of a satisfactory list of knots, the knot value 0 has multiplicity three, the knot value 1 has multiplicity one, the knot value 2 has multiplicity three, the knot value 3 has multiplicity one, the knot value 7 has multiplicity two, and the knot value 9 has multiplicity three. A knot value is said to be a full-multiplicity knot if it is duplicated degree many times. In the example, the knot values 0, 2, and 9 have full multiplicity. A knot value that appears only once is called a simple knot. In the example, the knot values 1 and 3 are simple knots.
    # If a list of knots starts with a full multiplicity knot, is followed by simple knots, terminates with a full multiplicity knot, and the values are equally spaced, then the knots are called uniform. For example, if a degree 3 NURBS curve with 7 control points has knots 0,0,0,1,2,3,4,4,4, then the curve has uniform knots. The knots 0,0,0,1,2,5,6,6,6 are not uniform. Knots that are not uniform are called non‑uniform. The N and U in NURBS stand for non‑uniform and indicate that the knots in a NURBS curve are permitted to be non-uniform.
    # Duplicate knot values in the middle of the knot list make a NURBS curve less smooth. At the extreme, a full multiplicity knot in the middle of the knot list means there is a place on the NURBS curve that can be bent into a sharp kink. For this reason, some designers like to add and remove knots and then adjust control points to make curves have smoother or kinkier shapes. Since the number of knots is equal to (N+degree‑1), where N is the number of control points, adding knots also adds control points and removing knots removes control points. Knots can be added without changing the shape of a NURBS curve. In general, removing knots will change the shape of a curve.
    knots = []

    i = 0
    while len(knots) < degree + length -1:
        multiplicity = random_int(1, degree)
        knots.extend([i,] * multiplicity)
        i += 1

    #
    points = random_triples(length)

    return rs.AddNurbsCurve(points, knots, degree) 

try:
    unichr
except NameError:
    unichr = chr

def random_string(length = None):
    length = length or random_int()
    return u''.join(unichr(random_int()) for __ in range(length))


OBJECT_GENERATORS = [rs.AddArc3Pt, rs.AddBox, rs.AddCircle3Pt, 
                     rs.AddCone, rs.AddCurve, rs.AddEllipse3Pt, rs.AddLine,
                     rs.AddPoint, rs.AddPolyline,
                     rs.AddRectangle, rs.AddSphere, rs.AddSpiral, rs.AddTorus,
                     rs.AddTextDot, random_nurbs_curve
                     ]

def needed_args(func):
    arg_spec = inspect.getargspec(func)
    if arg_spec.defaults is None:
        return arg_spec.args
    return arg_spec.args[:-len(arg_spec.defaults)]

#for obj_gen in OBJECT_GENERATORS:
#    break
#    print('%s: %s' % (obj_gen.__name__, needed_args(obj_gen)))

random_funcs = OrderedDict([
                     (('start', 'end', 'first', 'second', 'third', 'center'), random_triple),
                     (('points','corners'), random_triples),
                     (('point', ), random_triple),
                     (('plane','base'), lambda : rs.WorldXYPlane()),
                     (('height', 'width', 'radius', 'pitch'), random_number),
                     (('turns',), random_int),
                     (('text',), random_string),
                     ])


def random_Geometry(gens = None):

    N = random_int(1, 14)

    gens = gens or OBJECT_GENERATORS

    Geom = []
    for __ in range(N):
        obj_gen = random.choice(gens)
        kwargs = {}
        for arg in needed_args(obj_gen):
            names_and_random_funcs = ((name, v) 
                                    for k, v in random_funcs.items()
                                    for name in k)
            for name, random_func in names_and_random_funcs:
                if name in arg:
                    kwargs[arg] = random_func()
                    break
                #
            else: # no break in inner most for loop - no name found
                raise KeyError('No random func found for arg: %s' % arg)
        try:
            geom = obj_gen(**kwargs)        
        except Exception:
            print('Oops! %s ' % [obj_gen.__name__, kwargs])
            continue
        if geom:
            Geom.append(str(geom))
    
    return Geom

import os 
import time
import random
import inspect
import logging
from collections import OrderedDict
import unittest
import ctypes
import socket
import tempfile

import System

import scriptcontext as sc 
import Rhino
import Rhino.NodeInCode.Components
import Grasshopper
import rhinoscriptsyntax as rs
import ghpythonlib.treehelpers as th
from ghpythonlib.componentbase import executingcomponent as component 

#from ..custom.skel.basic.ghdoc import ghdoc


TMP = tempfile.gettempdir()

DIR = TMP

for SUB_DIR in ( 'sDNA_GH', 'tests'):
    DIR = os.path.join(DIR, SUB_DIR)
    if not os.path.isdir(DIR):
        os.mkdir(DIR)

GH_DOC = ghdoc.Component.Attributes.DocObject.OnPingDocument()


def GH_doc_components(doc = GH_DOC):
    return {component.NickName : component
            for component in doc.Objects
           }

GH_DOC_COMPONENTS = GH_doc_components()

def set_data_on(param, val):
    param.ClearData()    

    if str(param.Access) == 'tree' and isinstance(val, Grasshopper.DataTree):
        for path in val.Paths:
            for i, item in enumerate(val.Branch(path)):
                param.AddVolatileData(Grasshopper.Kernel.Data.GH_Path(0), i, item)
    elif isinstance(val, (list, tuple)):
        for i, item in enumerate(val):
            param.AddVolatileData(Grasshopper.Kernel.Data.GH_Path(0), i, item)
    else: 
        param.AddVolatileData(Grasshopper.Kernel.Data.GH_Path(0), 0, val)


def get_data_from(param):

    data_tree = Grasshopper.DataTree[object](param.VolatileData)

    if str(param.Access) == 'tree':
        return data_tree
    if data_tree.DataCount >= 1: # Alternative: param.VolatileDataCount >= 1 
        return list(data_tree.AllData())
    else:
        branch = data_tree.Branch(0)
        return branch[0] if branch else None

    

    raise NotImplementedError('Unsupported Param.Access value %s. '
                             +'Supported: item, list and tree. '
                             % param.Access
                             )
    

    


def all_docs_comps():
   return {os.path.splitext(os.path.basename(doc.FilePath))[0] : (doc, GH_doc_components(doc)) 
           for doc in Grasshopper.Instances.DocumentServer.GetEnumerator() 
          }



def get_plugin_files(plugin = ''):

    gh_comp_server = Grasshopper.Kernel.GH_ComponentServer()
    #print(list(gh_comp_server.FindObjects(guid)))

    return OrderedDict((os.path.splitext(file_.FileName)[0], file_)
                        for file_ in gh_comp_server.ExternalFiles(True, True)
                        if plugin.lower() in file_.FilePath.lower()
                       )


def get_position(comp_number, row_width = 800, row_height = 175, pos = (200, 550)):
    l = comp_number * row_height
    x = pos[0] + (l % row_width)
    y = pos[1] + 220 * (l // row_width)
    return x, y

def add_instance_of_userobject_to_canvas(name, plugin_files = None, comp_number=1, pos = (200, 550)):
    
    plugin_files = plugin_files or get_plugin_files('sDNA_GH')
    
    file_obj = next((v
                     for k, v in plugin_files.items() 
                     if name.lower() in k.lower()
                    )
                    ,None)
                    
    if file_obj is None:
        raise Exception('No user object found called: %s' % name)
    

                    
    user_obj = Grasshopper.Kernel.GH_UserObject(file_obj.FilePath)

    comp_obj = user_obj.InstantiateObject()
    
    comp_obj.Locked = False
    
    
    
    sizeF = System.Drawing.SizeF(*get_position(comp_number, pos=pos))
    
    
    comp_obj.Attributes.Pivot = System.Drawing.PointF.Add(comp_obj.Attributes.Pivot, sizeF)
    
    success = GH_DOC.AddObject(docObject = comp_obj, update = False)
    
    if not success:
        raise Exception('Could not add comp: %s to GH canvas' % comp_obj)
    
    return comp_obj 



def run_comp(comp, **kwargs):
    
    comp.ClearData()
    #    comp.ExpireSolution(False)
    for param in comp.Params.Input:
        if param.NickName in kwargs:
            set_data_on(param, kwargs[param.NickName])
    comp.CollectData()
    comp.ComputeData()

    return {param.NickName : get_data_from(param) 
            for param in comp.Params.Output
           }


def get_user_obj_comp_from_or_add_to_canvas(name):
    
    if name not in GH_DOC_COMPONENTS:
        comp = add_instance_of_userobject_to_canvas(name)
        GH_DOC_COMPONENTS[name] = comp

    return GH_DOC_COMPONENTS[name]


class FileAndStream(object):
    def __init__(self, file, stream, print_too = False):
        self.file = file
        self.stream = stream
        if hasattr(file, 'fileno'):
            self.fileno = file.fileno
        self.print_too = print_too
        
    def write(self, *args):
        self.stream.write(*args)
        self.file.write(*args)
        if self.print_too:
            print(', '.join(args))
        
    def flush(self, *args):
        self.stream.flush()
        self.file.flush()
        
    def __enter__(self):
        self.file.__enter__()
        return self
        
    def __exit__(self, *args):
        return self.file.__exit__(*args)    


class UDPStream(object):
    def __init__(self, port, host):
        self.port = port
        self.host = host
        # SOCK_DGRAM is the socket type to use for UDP sockets
        self.sock = socket.socket(socket.AF_INET, socket.SOCK_DGRAM)
    def write(self, str_):
        # https://docs.python.org/3/library/socketserver.html#socketserver-udpserver-example
        data = str_.encode("utf-8")
        self.sock.sendto(data, (self.host, self.port))

    def flush(self):
        pass






def save_doc_to_DIR(name = 'tmp_sDNA_GH_api_tests_working_file.3dm'):
    # 'Dale Fugier'
    # https://discourse.mcneel.com/t/sys-exit-shows-popup-window-instead-of-just-exiting/163811/7

    path = os.path.join(DIR, name)
    Rhino.RhinoApp.RunScript('_-SaveAs ' + path, True)
    





def exit_Rhino():
    #'Dale Fugier'
    # https://discourse.mcneel.com/t/sys-exit-shows-popup-window-instead-of-just-exiting/163811/7

    save_doc_to_DIR()
    Rhino.RhinoDoc.ActiveDoc.Modified = False

    hWnd = Rhino.RhinoApp.MainWindowHandle()
    ctypes.windll.user32.PostMessageW(hWnd, 0x0010, 0, 0) # - quits but doesn't set return code
    # ctypes.windll.user32.PostQuitMessage(ret_code) # - doesn't quit, even if Rhino doc saved.
    # ctypes.windll.user32.PostMessageW(hWnd, 0x0010, ret_code, 0) # - quits but doesn't set return code
    # ctypes.windll.user32.PostMessageW(hWnd, 0x0012, ret_code, 0) # - makes Rhino hang. ret code 1 is set
    #                                                              # after killing it from Task Manager.






def make_callable_using_node_in_code(name):
    func_info = Rhino.NodeInCode.Components.FindComponent(name);
    
    #    if (func_info == null) { Print("Error finding function"); return; }
    
    func = func_info.Delegate #as dynamic;



Write_Usertext = get_user_obj_comp_from_or_add_to_canvas('Write_Usertext')
Read_Usertext = get_user_obj_comp_from_or_add_to_canvas('Read_Usertext')

# Run now to prevent the first test spuriously failing.
#   
# Most sDNA_GH components need to run RunScript, to 
# add their params etc. before they can be used.  
# 
# This call can be removed if a test fail is needed 
# e.g. in dev, to test the result of a test failure.
run_comp(Write_Usertext)
run_comp(Read_Usertext)



def roundtrip_UserText(self):
    # Can be called with None or used as a unittest.TestCase 
    # method, if dynamically assigned on to an instance at run-time.
    # Allows configurable fuzz testing and parametric testing.
    sc.doc = Rhino.RhinoDoc.ActiveDoc

    Geom = random_Geometry()
    keys_lists, vals_lists = [], []
    Data_list = [keys_lists, vals_lists]
    for __ in range(len(Geom)):

        unique_keys = set((random_string() for ___ in range(random_int())))

        keys = list(unique_keys)
        vals = [random_string() for __ in range(len(keys))]
        
        keys_lists.append(keys)
        vals_lists.append(vals)

    Data = th.list_to_tree(Data_list)
    
    return Data

#
#    write_usertext_retvals = run_comp(Write_Usertext, go = True, Geom = Geom, Data = Data, output_key_str='{name}')
#
#    read_usertext_retvals = run_comp(Read_Usertext, go = True, compute_vals = False, Geom = Geom)

    Data_read_from_geom = read_usertext_retvals['Data']

    Actual_Data_list = th.tree_to_list(Data_read_from_geom)



    for j, ((k_exp, v_exp), (k_act, v_act)) in enumerate(zip(zip(*Data_list), zip(*Actual_Data_list)), start=1):

        for expected, actual, name in ((k_exp, k_act, 'Keys')
                                      ,(v_exp, v_act, 'Vals')):
            msg = ('%s test number: %s. \n Exp - Actual: %s\n Actual - Exp: %s\n' 
                  % (name, j, set(expected) - set(actual), set(actual) - set(expected))
                  )


            if self is not None:
                self.assertEqual(expected
                                ,actual
                                ,msg = msg
                                )
            else:
                print(msg)
      
a = roundtrip_UserText(None)
# ---------- end roundtrip_usertext ----------
write_usertext = Write_Usertext()  # -> out, OK, opts; inputs go: list, opts: list, Geom: list, Data: tree, output_key_str: list
#   port go: true: runs tools. false: do not run tools but still read other Params.
#   port opts: sDNA_GH options data structure. Python dictionary.
#   port Geom: A list of geometric objects. Requires GUIDs of Rhino objects or native/embedded Grasshopper geometry. To use Rhino objects referenced from Grasshopper parameter objects (instead of their Grasshopper versions which are often obscured unless the Rhino shapes are set to Hidden) run the output of the Geometry (Geo) or Curve (Crv) through a Guid (ID) parameter object first. Note: For sDNA tools all the geometric objects must all be polylines. For write_Shp all the objects must be of the type in shp_type (default: POLYLINEZ).
#   port Data: A Data Tree of a list of keys and list of corresponding values for each object in Geom.
#   port output_key_str: The format string of the Usertext keys. Supports "{name}" and "{datetime}" fields. Default: sDNA output={name} run time={datetime}
#   port OK: true: tools ran successfully. false: tools did not run, or there was an error.
#   port opts: sDNA_GH options data structure. Python dictionary.
# ---------- write_usertext: Python ----------
#! /usr/bin/awk NR==3
# -*- coding: utf-8 -*-
# This module requires Grasshopper Python (Rhino3D)

# MIT License

# Copyright (c) [2021] [Cardiff University, a body incorporated
# by Royal Charter and a registered charity (number:
# 1136855) whose administrative offices are at 7th floor 30-
# 36 Newport Road, University CF24 0DE, Wales, UK]

# Permission is hereby granted, free of charge, to any person obtaining a copy
# of this software and associated documentation files (the "Software"), to deal
# in the Software without restriction, including without limitation the rights
# to use, copy, modify, merge, publish, distribute, sublicense, and/or sell
# copies of the Software, and to permit persons to whom the Software is
# furnished to do so, subject to the following conditions:

# The above copyright notice and this permission notice shall be included in all
# copies or substantial portions of the Software.

# THE SOFTWARE IS PROVIDED "AS IS", WITHOUT WARRANTY OF ANY KIND, EXPRESS OR
# IMPLIED, INCLUDING BUT NOT LIMITED TO THE WARRANTIES OF MERCHANTABILITY,
# FITNESS FOR A PARTICULAR PURPOSE AND NONINFRINGEMENT. IN NO EVENT SHALL THE
# AUTHORS OR COPYRIGHT HOLDERS BE LIABLE FOR ANY CLAIM, DAMAGES OR OTHER
# LIABILITY, WHETHER IN AN ACTION OF CONTRACT, TORT OR OTHERWISE, ARISING FROM,
# OUT OF OR IN CONNECTION WITH THE SOFTWARE OR THE USE OR OTHER DEALINGS IN THE
# SOFTWARE.



"""Writes User Text to Rhino objects, using a specified pattern for the keys.  Specify the data tree to write in `Data`, and the list of Rhino objects to write to in `Geom`.  The format of the User Text key can be customised in the Python format string `output_key_str`, accepting two named fields (e.g. = `sDNA output={name} run time={datetime}`).  

A field specifying an originating Rhino object's UUID `uuid_field` will be omitted.  If a key of that name already exists, it will be overwritten if `overwrite_UserText` is true.  Otherwise a suffix will be appended to it, based on an integer counter and the format string in `dupe_key_suffix`, until a unique key name is found, up to a limit of `max_new_keys` (overwrite warnings can be suppressed by setting `suppress_overwrite_warning` to true).
"""

__author__ = 'James Parrott'
__version__ = '3.0.0.alpha_3'



import sys
import os
import functools
import importlib

from ghpythonlib.componentbase import executingcomponent as component
import Grasshopper
import scriptcontext as sc

import_module = importlib.import_module
try:
    reload #type: ignore
except NameError:
    reload = importlib.reload

try:
    basestring #type: ignore
except NameError:
    basestring = str

try:
    ghdoc #type: ignore
except NameError:
    from .custom.skel.basic.ghdoc import ghdoc

ZIP_FILE_NAME = 'sdna-gh'
PACKAGE_NAME = 'sDNA_GH'
PLUG_IN_NAME = 'sDNA'               
RELOAD_IF_ALREADY_IMPORTED = False
REPOSITORY = os.path.dirname(os.path.dirname(ghdoc.Path)) if ghdoc.Path else None
# Assume we are in repo_folder/dev/sDNA_build_components.gh

USER_INSTALLATION_FOLDER = os.path.join(
                                    Grasshopper.Folders.DefaultUserObjectFolder
                                   ,ZIP_FILE_NAME
                                   )
SELFTEST = 'selftest'
APITEST_PREFIX = 'sDNA_GH_API_test_'




class Output(object): 

    def set_logger(self, logger, flush = True):
        self.logger = logger
        if flush and self.tmp_logs:
            self.flush()

    def __init__(self
                ,tmp_logs = None
                ,logger = None
                ):
        if not isinstance(tmp_logs, list): #assert not isinstance(None, list)
            tmp_logs = []
        self.tmp_logs = tmp_logs
        self.set_logger(logger, flush = False)



    def store(self, message, logging_level):
        self.tmp_logs.append( (message, logging_level) )

    def __call__(self, message, logging_level = "INFO", logging_dict = {}):
        #type: (str, str, dict, list) -> str
        
        #logger.debug(s)

        if logging_dict == {} and self.logger is not None: 
            logging_dict = dict( DEBUG = self.logger.debug
                                ,INFO = self.logger.info
                                ,WARNING = self.logger.warning
                                ,ERROR = self.logger.error
                                ,CRITICAL = self.logger.critical
                                )

        logging_level = logging_level.upper()
        if logging_level in logging_dict:
            logging_dict[logging_level](message)
        else:
            self.store(message, logging_level)

        return '%s : %s ' % (logging_level, message)

    def __getattr__(self, attr):
        return functools.partial(self.__call__, logging_level = attr.upper())

    def flush(self):
        tmp_logs = self.tmp_logs[:] # __call__ might cache back to tmp_logs
        self.tmp_logs[:] = [] # Mutate list initialised with.  Avoid double 
                              # logging in case re - stored in tmp_logs
        for tmp_log_message, tmp_log_level in tmp_logs:
            self.__call__(tmp_log_message, tmp_log_level)

output = Output()


class InvalidArgsError(Exception):
    
    """Custom exception to log the error message, and to at least allow 
       attempts to give users actionable advice to fix the issue, in 
       the event of a problem.  
    """
    message_fmt = 'Invalid import args: %s'
    def __init__(self
                ,message_fmt = ''
                ,message = ''
                ,logger = output
                , **kwargs
                ):
        if message_fmt and isinstance(message_fmt, basestring):
            self.message_fmt = message_fmt
        if kwargs and (not message or not isinstance(message, basestring)):
            message = self.message_fmt % kwargs
        logger.error(message)
        self.kwargs = kwargs
        super(InvalidArgsError, self).__init__(message)    


class ModuleNameError(InvalidArgsError):
    message_fmt = 'Invalid module name: %s'


class FilePathError(InvalidArgsError):
    message_fmt = 'Invalid path to import module from: %s'


# We only know the sDNA version to import as a string.  This is more secure too.
def strict_import(module_name = ''
                 ,folder = ''
                 ,sub_folder = ''
                 ,logger = output
                 ,reload_already_imported = RELOAD_IF_ALREADY_IMPORTED
                 ):

    # type: (str, str, str, type[any], bool) -> type[any]
    """ Imports the named module from the specified folder\subfolder only, 
        and returns it.
        
        Avoids name clashes and casual hijack attempts.  In some 
        environments supporting a Python implementation (such as 
        GhPython in Grasshopper) it may not be desirable to ask the user 
        to set PYTHONPATH.  Hence here, we insert the specified folder
        into sys.path (if they are not already in there).
    """
    if not module_name or not isinstance(module_name, basestring):
        raise ModuleNameError(module_name = module_name
                             ,folder = folder
                             ,sub_folder = sub_folder
                             ,logger = logger
                             )
    logger.debug(module_name)
    if module_name in sys.modules:   # sys.modules is also shared between GHPython components 
                                     # (and is even saved until Rhino is closed).
        logger.debug('Module %s already in sys.modules' % module_name)
        if reload_already_imported:
            logger.debug('Reloading %s.... ' % module_name)
            reload(sys.modules[module_name]) # type: ignore
        return sys.modules[module_name]
    #
    #
    # Load module_name for first time:
    #
    #
    search_path = os.path.join(folder, sub_folder)

    if (search_path 
        and isinstance(search_path, basestring) 
        and os.path.isdir(search_path)):
        #
        logger.debug('Search path == %s' % search_path)
        #if search_folder_only:
        #    sys.path = [search_path]
        if search_path not in sys.path:
            sys.path.insert(0, search_path)
    else:
        raise FilePathError(module_name = module_name
                           ,search_path = search_path
                           ,logger = logger
                           )

    logger.debug('Trying import... ')
    module = import_module(module_name, '')           

    return module       


class ModulesNotFoundError(InvalidArgsError):
    message_fmt = 'Modules not found in any location %s'


def load_modules(m_names
                ,folders
                ,logger = output
                ,module_name_error_msg = 'Please supply valid names of modules to import, %s'
                ,folders_error_msg = 'Please supply valid folders to import from. %s'
                ,modules_not_found_msg = 'Specified modules not found in any folder, %s'):
    #type(str/ Iterable, list, type[any], str, str) -> tuple / None
    """ Tries to import all modules in m_names, from the first folder in 
        folders to contain a .py or .pyc files with the same name as each 
        module.

        Returns a tuple of all the modules and the path they were found in.  Else 
        raises a ModulesNotFoundError.
    """
    if not m_names:
        raise ModuleNameError(message_fmt = 'No module names supplied, m_names = %s'
                             ,m_names = m_names
                             ,logger = logger
                             )

    if any( not isinstance(m_name, basestring) for m_name in m_names ):
        # if m_names is a basestring, the error is not raised 
        raise ModuleNameError(message_fmt = module_name_error_msg
                             ,m_names = m_names
                             ,logger = logger
                             )
    
    if isinstance(m_names, basestring):
        m_names = [m_names] 

    logger.debug('m_names == %s of type : %s' % (m_names, type(m_names).__name__))

    logger.debug('Testing paths : %s ' % folders)
    
    if isinstance(folders, basestring):
        folders = [folders]

    if not any(os.path.isdir(folder) or os.path.isdir(os.path.dirname(folder)) 
               for folder in folders
              ):
        raise FilePathError(message_fmt = folders_error_msg
                           ,m_names = m_names
                           ,logger = logger
                           )

    for folder in folders:
        logger.debug('Type(folder) : %s' % type(folder).__name__)
        logger.debug('Type(path) : %s path == %s' %(type(folder).__name__, folder))

        if os.path.isfile(folder):
            folder = os.path.dirname(folder)
        if all( any(os.path.isfile(os.path.join(folder, name.replace('.', os.sep) + ending)) 
                    for ending in ['.py','.pyc'] 
                   )
                for name in m_names
              ):
            #
            logger.debug('Importing %s' % repr(m_names))

            return tuple(strict_import(name, folder, '', logger = logger) 
                         for name in m_names
                        ) + (folder,)
            # tuple of modules, followed by the path to them
    raise ModulesNotFoundError(message_fmt = modules_not_found_msg
                              ,m_names = m_names
                              ,folders = folders
                              ,logger = logger
                              )




if __name__ == '__main__': # False in a compiled component.  But then the user
                           # can't add or remove Params to the component.  
    
    # Grasshopper will look for class MyComponent(component) in global scope
    # so a main function is a little tricky to define.

    nick_name = ghenv.Component.NickName #type: ignore


    if (REPOSITORY and 
        nick_name == 'Build_components'):
        #
        sDNA_GH_search_path = REPOSITORY 
        # builder can only load sDNA_GH from its parent directory, 
        # e.g. if in a dir one level up in the main repo
        # such as sDNA_build_components.gh.
    else:
        sDNA_GH_search_path = USER_INSTALLATION_FOLDER


    sc.doc = ghdoc #type: ignore

    output.debug(sDNA_GH_search_path)

    class sDNA_GH(object):
        pass

    if 'sDNA_GH.main' in sys.modules:
        sDNA_GH.main = sys.modules['sDNA_GH.main']
    else:
        sDNA_GH.main, _ = load_modules(
             m_names = PACKAGE_NAME + '.main'
            ,folders = sDNA_GH_search_path
            ,folders_error_msg = 'Please unzip %s.zip '
                                % ZIP_FILE_NAME
                                +' in the folder %s '
                                % Grasshopper.Folders.DefaultUserObjectFolder
                                +'and ensure a subfolder called %s is created '
                                % os.path.join(ZIP_FILE_NAME, PACKAGE_NAME)
                                +'inside it, containing main.py ' 
                                +'and all the sDNA_GH python files '
                                +'including those within other subfolders. ' 
            ,modules_not_found_msg = 'Some sDNA_GH files may be missing.  '
                                    +('Please: 1) Copy %s.zip into: %s '
                                    % (ZIP_FILE_NAME
                                      ,Grasshopper.Folders.DefaultUserObjectFolder
                                      ))
                                    +'2) Unblock it if necessary. '
                                    +'3) Right click '
                                    +'it, select Extract All... and click Extract, '
                                    +'to extract it to that location. '
                                    +'4) Ensure that main.py and all sDNA_GH python' 
                                    +(' files and subfolders are inside: %s '
                                    % os.path.join(USER_INSTALLATION_FOLDER
                                                  ,PACKAGE_NAME
                                                  ))
                                    +'5) Reinitialise the component or restart Rhino.'
            )         


    logger = sDNA_GH.main.logger.getChild('launcher')
    output.set_logger(logger, flush = True)


    class MyComponent(component):
        pass  # Required.  Idiomatic to Grasshopper.  Must be called "MyComponent"  
            # too (it is looked for by the parser or scope checker?) otherwise 
            # Grasshopper may not find the subclass of on 
            # component.  Even though we overwrite this class on the next line
            # immediately below.  


    
    test_runners, _ = load_modules('%s.tests.test_running_component_classes' % PACKAGE_NAME
                                  ,sDNA_GH_search_path
                                  )

    if nick_name.replace(' ','').replace('_','').lower() == SELFTEST:  
        MyComponent = test_runners.make_test_running_component_class(
                package_location = sDNA_GH_search_path
                )
    elif nick_name.startswith(APITEST_PREFIX) and os.getenv('NUM_SDNA_GH_API_TESTS'):
        MyComponent = test_runners.make_noninteractive_api_test_running_component_class(
                package_location = sDNA_GH_search_path
                ,test_name = nick_name.partition(APITEST_PREFIX)[2]
                )
    else:
        MyComponent = sDNA_GH.main.sDNA_GH_Component
        # Grasshopper calls MyComponent.RunScript automatically (in SDK mode GhPython components).
# ---------- end write_usertext ----------
roundtrip_usertext_2 = Unload_sDNA()  # -> out, a
# ---------- roundtrip_usertext_2: Python ----------
#! /usr/bin/awk NR==3
# -*- coding: utf-8 -*-
# This module requires Grasshopper Python (Rhino3D)

# MIT License

# Permission is hereby granted, free of charge, to any person obtaining a copy
# of this software and associated documentation files (the "Software"), to deal
# in the Software without restriction, including without limitation the rights
# to use, copy, modify, merge, publish, distribute, sublicense, and/or sell
# copies of the Software, and to permit persons to whom the Software is
# furnished to do so, subject to the following conditions:

# The above copyright notice and this permission notice shall be included in all
# copies or substantial portions of the Software.

# THE SOFTWARE IS PROVIDED "AS IS", WITHOUT WARRANTY OF ANY KIND, EXPRESS OR
# IMPLIED, INCLUDING BUT NOT LIMITED TO THE WARRANTIES OF MERCHANTABILITY,
# FITNESS FOR A PARTICULAR PURPOSE AND NONINFRINGEMENT. IN NO EVENT SHALL THE
# AUTHORS OR COPYRIGHT HOLDERS BE LIABLE FOR ANY CLAIM, DAMAGES OR OTHER
# LIABILITY, WHETHER IN AN ACTION OF CONTRACT, TORT OR OTHERWISE, ARISING FROM,
# OUT OF OR IN CONNECTION WITH THE SOFTWARE OR THE USE OR OTHER DEALINGS IN THE
# SOFTWARE.

__author__ = 'James Parrott'
__version__ = '3.0.0.alpha_3'



import os
import random
import inspect
from collections import OrderedDict

import rhinoscriptsyntax as rs

# random is used here for fuzz testing, not Cryptography.  
# But could Windows OS generated randomness be repeatable
# between instances of the same VM image, e.g. CI runners?  
# If so use:
# random.seed(time.time())
# Otherwise, assuming os.urandom includes the time already:
SEED = os.urandom(10)
random.seed(SEED)

# Extents of viewport
MIN_X, MAX_X, MIN_Y, MAX_Y = -10.0, 110.0, -10.0, 40.0

def random_number(min_ = MIN_X, max_ = MAX_X):
    return random.uniform(min_, max_)

def random_pair():
    return random_number(), random_number()

def random_triple():
    return random_pair() + (random_number(),)

def random_int(min_ = 2, max_ = 17):
    return random.randint(min_, max_)

def random_triples(n = None):
    n = n or random_int(min_ = 3)
    return tuple(random_triple() for __ in range(n))

# def random_point():

def random_nurbs_curve(length = None, degree = None):
    length = length or random_int()

    # The control points are a list of at least degree+1 points.
    # https://developer.rhino3d.com/guides/opennurbs/nurbs-geometry-overview/
    degree = degree or random_int(1, length-1)

    # The knots are a list of degree+N-1 numbers, where N is the number of control points. Sometimes this list of numbers is called the knot vector. In this term, the word vector does not mean 3‑D direction.
    # This list of knot numbers must satisfy several technical conditions. The standard way to ensure that the technical conditions are satisfied is to require the numbers to stay the same or get larger as you go down the list and to limit the number of duplicate values to no more than the degree. For example, for a degree 3 NURBS curve with 11 control points, the list of numbers 0,0,0,1,2,2,2,3,7,7,9,9,9 is a satisfactory list of knots. The list 0,0,0,1,2,2,2,2,7,7,9,9,9 is unacceptable because there are four 2s and four is larger than the degree.
    # The number of times a knot value is duplicated is called the knot’s multiplicity. In the preceding example of a satisfactory list of knots, the knot value 0 has multiplicity three, the knot value 1 has multiplicity one, the knot value 2 has multiplicity three, the knot value 3 has multiplicity one, the knot value 7 has multiplicity two, and the knot value 9 has multiplicity three. A knot value is said to be a full-multiplicity knot if it is duplicated degree many times. In the example, the knot values 0, 2, and 9 have full multiplicity. A knot value that appears only once is called a simple knot. In the example, the knot values 1 and 3 are simple knots.
    # If a list of knots starts with a full multiplicity knot, is followed by simple knots, terminates with a full multiplicity knot, and the values are equally spaced, then the knots are called uniform. For example, if a degree 3 NURBS curve with 7 control points has knots 0,0,0,1,2,3,4,4,4, then the curve has uniform knots. The knots 0,0,0,1,2,5,6,6,6 are not uniform. Knots that are not uniform are called non‑uniform. The N and U in NURBS stand for non‑uniform and indicate that the knots in a NURBS curve are permitted to be non-uniform.
    # Duplicate knot values in the middle of the knot list make a NURBS curve less smooth. At the extreme, a full multiplicity knot in the middle of the knot list means there is a place on the NURBS curve that can be bent into a sharp kink. For this reason, some designers like to add and remove knots and then adjust control points to make curves have smoother or kinkier shapes. Since the number of knots is equal to (N+degree‑1), where N is the number of control points, adding knots also adds control points and removing knots removes control points. Knots can be added without changing the shape of a NURBS curve. In general, removing knots will change the shape of a curve.
    knots = []

    i = 0
    while len(knots) < degree + length -1:
        multiplicity = random_int(1, degree)
        knots.extend([i,] * multiplicity)
        i += 1

    #
    points = random_triples(length)

    return rs.AddNurbsCurve(points, knots, degree) 

try:
    unichr
except NameError:
    unichr = chr

def random_string(length = None):
    length = length or random_int()
    return u''.join(unichr(random_int()) for __ in range(length))


OBJECT_GENERATORS = [rs.AddArc3Pt, rs.AddBox, rs.AddCircle3Pt, 
                     rs.AddCone, rs.AddCurve, rs.AddEllipse3Pt, rs.AddLine,
                     rs.AddPoint, rs.AddPolyline,
                     rs.AddRectangle, rs.AddSphere, rs.AddSpiral, rs.AddTorus,
                     rs.AddTextDot, random_nurbs_curve
                     ]

def needed_args(func):
    arg_spec = inspect.getargspec(func)
    if arg_spec.defaults is None:
        return arg_spec.args
    return arg_spec.args[:-len(arg_spec.defaults)]

#for obj_gen in OBJECT_GENERATORS:
#    break
#    print('%s: %s' % (obj_gen.__name__, needed_args(obj_gen)))

random_funcs = OrderedDict([
                     (('start', 'end', 'first', 'second', 'third', 'center'), random_triple),
                     (('points','corners'), random_triples),
                     (('point', ), random_triple),
                     (('plane','base'), lambda : rs.WorldXYPlane()),
                     (('height', 'width', 'radius', 'pitch'), random_number),
                     (('turns',), random_int),
                     (('text',), random_string),
                     ])


def random_Geometry(gens = None):

    N = random_int(1, 14)

    gens = gens or OBJECT_GENERATORS

    Geom = []
    for __ in range(N):
        obj_gen = random.choice(gens)
        kwargs = {}
        for arg in needed_args(obj_gen):
            names_and_random_funcs = ((name, v) 
                                    for k, v in random_funcs.items()
                                    for name in k)
            for name, random_func in names_and_random_funcs:
                if name in arg:
                    kwargs[arg] = random_func()
                    break
                #
            else: # no break in inner most for loop - no name found
                raise KeyError('No random func found for arg: %s' % arg)
        try:
            geom = obj_gen(**kwargs)        
        except Exception:
            print('Oops! %s ' % [obj_gen.__name__, kwargs])
            continue
        if geom:
            Geom.append(str(geom))
    
    return Geom

import os 
import time
import random
import inspect
import logging
from collections import OrderedDict
import unittest
import ctypes
import socket
import tempfile

import System

import scriptcontext as sc 
import Rhino
import Rhino.NodeInCode.Components
import Grasshopper
import rhinoscriptsyntax as rs
import ghpythonlib.treehelpers as th
from ghpythonlib.componentbase import executingcomponent as component 

#from ..custom.skel.basic.ghdoc import ghdoc


TMP = tempfile.gettempdir()

DIR = TMP

for SUB_DIR in ( 'sDNA_GH', 'tests'):
    DIR = os.path.join(DIR, SUB_DIR)
    if not os.path.isdir(DIR):
        os.mkdir(DIR)

GH_DOC = ghdoc.Component.Attributes.DocObject.OnPingDocument()


def GH_doc_components(doc = GH_DOC):
    return {component.NickName : component
            for component in doc.Objects
           }

GH_DOC_COMPONENTS = GH_doc_components()

def set_data_on(param, val):
    param.ClearData()    
    print(param.Access)
    if (param.Access == Grasshopper.Kernel.GH_ParamAccess.tree ):
#        and isinstance(val, Grasshopper.DataTree[object])):
        
        print('Yarp!')
        param.AddVolatileDataTree(val)
#        for path in val.Paths:
#            for i, item in enumerate(val.Branch(path)):
#                param.AddVolatileData(Grasshopper.Kernel.Data.GH_Path(0), i, item)
    elif isinstance(val, (list, tuple)):
        for i, item in enumerate(val):
            param.AddVolatileData(Grasshopper.Kernel.Data.GH_Path(0), i, item)
    else: 
        param.AddVolatileData(Grasshopper.Kernel.Data.GH_Path(0), 0, val)


def get_data_from(param):

    data_tree = Grasshopper.DataTree[object](param.VolatileData)

    if param.Access == Grasshopper.Kernel.GH_ParamAccess.tree:
        return data_tree
    if data_tree.DataCount >= 1: # Alternative: param.VolatileDataCount >= 1 
        return list(data_tree.AllData())
    else:
        branch = data_tree.Branch(0)
        return branch[0] if branch else None

    

    raise NotImplementedError('Unsupported Param.Access value %s. '
                             +'Supported: item, list and tree. '
                             % param.Access
                             )
    

    


def all_docs_comps():
   return {os.path.splitext(os.path.basename(doc.FilePath))[0] : (doc, GH_doc_components(doc)) 
           for doc in Grasshopper.Instances.DocumentServer.GetEnumerator() 
          }



def get_plugin_files(plugin = ''):

    gh_comp_server = Grasshopper.Kernel.GH_ComponentServer()
    #print(list(gh_comp_server.FindObjects(guid)))

    return OrderedDict((os.path.splitext(file_.FileName)[0], file_)
                        for file_ in gh_comp_server.ExternalFiles(True, True)
                        if plugin.lower() in file_.FilePath.lower()
                       )


def get_position(comp_number, row_width = 800, row_height = 175, pos = (200, 550)):
    l = comp_number * row_height
    x = pos[0] + (l % row_width)
    y = pos[1] + 220 * (l // row_width)
    return x, y

def add_instance_of_userobject_to_canvas(name, plugin_files = None, comp_number=1, pos = (200, 550)):
    
    plugin_files = plugin_files or get_plugin_files('sDNA_GH')
    
    file_obj = next((v
                     for k, v in plugin_files.items() 
                     if name.lower() in k.lower()
                    )
                    ,None)
                    
    if file_obj is None:
        raise Exception('No user object found called: %s' % name)
    

                    
    user_obj = Grasshopper.Kernel.GH_UserObject(file_obj.FilePath)

    comp_obj = user_obj.InstantiateObject()
    
    comp_obj.Locked = False
    
    
    
    sizeF = System.Drawing.SizeF(*get_position(comp_number, pos=pos))
    
    
    comp_obj.Attributes.Pivot = System.Drawing.PointF.Add(comp_obj.Attributes.Pivot, sizeF)
    
    success = GH_DOC.AddObject(docObject = comp_obj, update = False)
    
    if not success:
        raise Exception('Could not add comp: %s to GH canvas' % comp_obj)
    
    return comp_obj 



def run_comp(comp, **kwargs):
    
    comp.ClearData()
#    print('kwargs keys: %s' % list(kwargs))
    #    comp.ExpireSolution(False)
    for param in comp.Params.Input:
#        print('Name: %s Access: %s, %s' % (param.NickName, param.Access, type(param.Access)))
        if param.NickName in kwargs:
#            print('Toot')
            set_data_on(param, kwargs[param.NickName])
#        else: print('ert')
    comp.CollectData()
    comp.ComputeData()

    return {param.NickName : get_data_from(param) 
            for param in comp.Params.Output
           }


def get_user_obj_comp_from_or_add_to_canvas(name):
    
    if name not in GH_DOC_COMPONENTS:
        comp = add_instance_of_userobject_to_canvas(name)
        GH_DOC_COMPONENTS[name] = comp

    return GH_DOC_COMPONENTS[name]


class FileAndStream(object):
    def __init__(self, file, stream, print_too = False):
        self.file = file
        self.stream = stream
        if hasattr(file, 'fileno'):
            self.fileno = file.fileno
        self.print_too = print_too
        
    def write(self, *args):
        self.stream.write(*args)
        self.file.write(*args)
        if self.print_too:
            print(', '.join(args))
        
    def flush(self, *args):
        self.stream.flush()
        self.file.flush()
        
    def __enter__(self):
        self.file.__enter__()
        return self
        
    def __exit__(self, *args):
        return self.file.__exit__(*args)    


class UDPStream(object):
    def __init__(self, port, host):
        self.port = port
        self.host = host
        # SOCK_DGRAM is the socket type to use for UDP sockets
        self.sock = socket.socket(socket.AF_INET, socket.SOCK_DGRAM)
    def write(self, str_):
        # https://docs.python.org/3/library/socketserver.html#socketserver-udpserver-example
        data = str_.encode("utf-8")
        self.sock.sendto(data, (self.host, self.port))

    def flush(self):
        pass






def save_doc_to_DIR(name = 'tmp_sDNA_GH_api_tests_working_file.3dm'):
    # 'Dale Fugier'
    # https://discourse.mcneel.com/t/sys-exit-shows-popup-window-instead-of-just-exiting/163811/7

    path = os.path.join(DIR, name)
    Rhino.RhinoApp.RunScript('_-SaveAs ' + path, True)
    





def exit_Rhino():
    #'Dale Fugier'
    # https://discourse.mcneel.com/t/sys-exit-shows-popup-window-instead-of-just-exiting/163811/7

    save_doc_to_DIR()
    Rhino.RhinoDoc.ActiveDoc.Modified = False

    hWnd = Rhino.RhinoApp.MainWindowHandle()
    ctypes.windll.user32.PostMessageW(hWnd, 0x0010, 0, 0) # - quits but doesn't set return code
    # ctypes.windll.user32.PostQuitMessage(ret_code) # - doesn't quit, even if Rhino doc saved.
    # ctypes.windll.user32.PostMessageW(hWnd, 0x0010, ret_code, 0) # - quits but doesn't set return code
    # ctypes.windll.user32.PostMessageW(hWnd, 0x0012, ret_code, 0) # - makes Rhino hang. ret code 1 is set
    #                                                              # after killing it from Task Manager.






def make_callable_using_node_in_code(name):
    func_info = Rhino.NodeInCode.Components.FindComponent(name);
    
    #    if (func_info == null) { Print("Error finding function"); return; }
    
    func = func_info.Delegate #as dynamic;



Write_Usertext = get_user_obj_comp_from_or_add_to_canvas('Write_Usertext')
Read_Usertext = get_user_obj_comp_from_or_add_to_canvas('Read_Usertext')

# Run now to prevent the first test spuriously failing.
#   
# Most sDNA_GH components need to run RunScript, to 
# add their params etc. before they can be used.  
# 
# This call can be removed if a test fail is needed 
# e.g. in dev, to test the result of a test failure.
#run_comp(Write_Usertext)
#run_comp(Read_Usertext)



def roundtrip_UserText(self):
    # Can be called with None or used as a unittest.TestCase 
    # method, if dynamically assigned on to an instance at run-time.
    # Allows configurable fuzz testing and parametric testing.
    sc.doc = Rhino.RhinoDoc.ActiveDoc

    Geom = random_Geometry()
    keys_lists, vals_lists = [], []
    Data_list = [keys_lists, vals_lists]
    for __ in range(len(Geom)):

        unique_keys = set((random_string() for ___ in range(random_int())))

        keys = list(unique_keys)
        vals = [random_string() for __ in range(len(keys))]
        
        keys_lists.append(keys)
        vals_lists.append(vals)

    Data = th.list_to_tree(Data_list)

    gh_struct = Grasshopper.Kernel.Data.GH_Structure[Grasshopper.Kernel.Types.GH_String]()

    for path in Data.Paths:
        for i, item in enumerate(Data.Branch(path)):
            gh_str = Grasshopper.Kernel.Types.GH_String(item)
            gh_struct.Append(gh_str, path)

    write_usertext_retvals = run_comp(Write_Usertext, go = True, Geom = Geom, Data = gh_struct) #, output_key_str='{name}')

#    return

#    Data_Read = next(param
#                     for param in Read_Usertext.Params.Output
#                     if param.NickName == 'Data'
#                    )
#                    
#    print('Badoom')
#    print(dir(Data_Read))
    
    read_usertext_retvals = run_comp(Read_Usertext, go = True, compute_vals = False, Geom = Geom)
    
    Data_Read = next(param
                 for param in Read_Usertext.Params.Output
                 if param.NickName == 'Data'
                )
                
#    Data_read_from_geom = Grasshopper.DataTree[object](Data_Read.VolatileData)
    Data_read_from_geom = Grasshopper.DataTree[object]()
    for path in Data_Read.VolatileData.Paths:
        branch = Data_Read.VolatileData.Branch[path]
        for item in branch:
            Data_read_from_geom.Add(item, path)
#    return Data_Read.GetValue()
                    
#    Data_read_from_geom = read_usertext_retvals['Data']

#    Actual_Data_list = Data_read_from_geom
    Actual_Data_list = th.tree_to_list(Data_read_from_geom)
#    l = []
#    for x in Actual_Data_list:
#        l.append(x)
#        print(x)
#    for x in Data_list:
#        print(x)
#    return l

#    for j, ((k_exp, v_exp), (k_act, v_act)) in enumerate(zip(zip(*Data_list), zip(*Actual_Data_list)), start=1):
    for j, ((k_exp, v_exp), (k_act, v_act)) in enumerate(zip(zip(*Data_list), zip(*Actual_Data_list)), start=1):

        for expected, actual, name in ((k_exp, k_act, 'Keys')
                                      ,(v_exp, v_act, 'Vals')):
            msg = ('%s test number: %s. \n Exp - Actual: %s\n Actual - Exp: %s\n' 
                  % (name, j, set(expected) - set(actual), set(actual) - set(expected))
                  )


            if self is not None:
                self.assertEqual(expected
                                ,actual
                                ,msg = msg
                                )
#            else:
#                assert expected==actual, msg
      
roundtrip_UserText(None)
# ---------- end roundtrip_usertext_2 ----------
read_usertext = Read_Usertext()  # -> out, OK, opts, Data; inputs go: list, opts: list, Geom: list, compute_vals: list
#   port go: true: runs tools. false: do not run tools but still read other Params.
#   port opts: sDNA_GH options data structure. Python dictionary.
#   port Geom: A list of geometric objects. Requires GUIDs of Rhino objects or native/embedded Grasshopper geometry. To use Rhino objects referenced from Grasshopper parameter objects (instead of their Grasshopper versions which are often obscured unless the Rhino shapes are set to Hidden) run the output of the Geometry (Geo) or Curve (Crv) through a Guid (ID) parameter object first. Note: For sDNA tools all the geometric objects must all be polylines. For write_Shp all the objects must be of the type in shp_type (default: POLYLINEZ).
#   port compute_vals: true : apply Rhino.RhinoApp.ParseTextField to vals that are attribute User Text computed fields. false: do nothing. Default: True
#   port OK: true: tools ran successfully. false: tools did not run, or there was an error.
#   port opts: sDNA_GH options data structure. Python dictionary.
#   port Data: A Data Tree of a list of keys and list of corresponding values for each object in Geom.
# ---------- read_usertext: Python ----------
#! /usr/bin/awk NR==3
# -*- coding: utf-8 -*-
# This module requires Grasshopper Python (Rhino3D)

# MIT License

# Copyright (c) [2021] [Cardiff University, a body incorporated
# by Royal Charter and a registered charity (number:
# 1136855) whose administrative offices are at 7th floor 30-
# 36 Newport Road, University CF24 0DE, Wales, UK]

# Permission is hereby granted, free of charge, to any person obtaining a copy
# of this software and associated documentation files (the "Software"), to deal
# in the Software without restriction, including without limitation the rights
# to use, copy, modify, merge, publish, distribute, sublicense, and/or sell
# copies of the Software, and to permit persons to whom the Software is
# furnished to do so, subject to the following conditions:

# The above copyright notice and this permission notice shall be included in all
# copies or substantial portions of the Software.

# THE SOFTWARE IS PROVIDED "AS IS", WITHOUT WARRANTY OF ANY KIND, EXPRESS OR
# IMPLIED, INCLUDING BUT NOT LIMITED TO THE WARRANTIES OF MERCHANTABILITY,
# FITNESS FOR A PARTICULAR PURPOSE AND NONINFRINGEMENT. IN NO EVENT SHALL THE
# AUTHORS OR COPYRIGHT HOLDERS BE LIABLE FOR ANY CLAIM, DAMAGES OR OTHER
# LIABILITY, WHETHER IN AN ACTION OF CONTRACT, TORT OR OTHERWISE, ARISING FROM,
# OUT OF OR IN CONNECTION WITH THE SOFTWARE OR THE USE OR OTHER DEALINGS IN THE
# SOFTWARE.



"""Reads all User Text from the list of Rhino objects in `Geom` - these must be Rhino objects from Read_Geom (Grasshopper references to Rhino objects, e.g. from a geom Param will not work).  If `auto_get_Geom` = true and if no Read_Geom component is connected to its inputs, Read_Geom is first called.  If `compute_vals` = true, values starting and ending in `%` referring to a Rhino object's UUID (e.g. `%<CurveLength("ac4669e5-53a6-4c2b-9080-bbc67129d93e")>%`) are computed using Rhino.RhinoApp.ParseTextField.
"""

__author__ = 'James Parrott'
__version__ = '3.0.0.alpha_3'



import sys
import os
import functools
import importlib

from ghpythonlib.componentbase import executingcomponent as component
import Grasshopper
import scriptcontext as sc

import_module = importlib.import_module
try:
    reload #type: ignore
except NameError:
    reload = importlib.reload

try:
    basestring #type: ignore
except NameError:
    basestring = str

try:
    ghdoc #type: ignore
except NameError:
    from .custom.skel.basic.ghdoc import ghdoc

ZIP_FILE_NAME = 'sdna-gh'
PACKAGE_NAME = 'sDNA_GH'
PLUG_IN_NAME = 'sDNA'               
RELOAD_IF_ALREADY_IMPORTED = False
REPOSITORY = os.path.dirname(os.path.dirname(ghdoc.Path)) if ghdoc.Path else None
# Assume we are in repo_folder/dev/sDNA_build_components.gh

USER_INSTALLATION_FOLDER = os.path.join(
                                    Grasshopper.Folders.DefaultUserObjectFolder
                                   ,ZIP_FILE_NAME
                                   )
SELFTEST = 'selftest'
APITEST_PREFIX = 'sDNA_GH_API_test_'




class Output(object): 

    def set_logger(self, logger, flush = True):
        self.logger = logger
        if flush and self.tmp_logs:
            self.flush()

    def __init__(self
                ,tmp_logs = None
                ,logger = None
                ):
        if not isinstance(tmp_logs, list): #assert not isinstance(None, list)
            tmp_logs = []
        self.tmp_logs = tmp_logs
        self.set_logger(logger, flush = False)



    def store(self, message, logging_level):
        self.tmp_logs.append( (message, logging_level) )

    def __call__(self, message, logging_level = "INFO", logging_dict = {}):
        #type: (str, str, dict, list) -> str
        
        #logger.debug(s)

        if logging_dict == {} and self.logger is not None: 
            logging_dict = dict( DEBUG = self.logger.debug
                                ,INFO = self.logger.info
                                ,WARNING = self.logger.warning
                                ,ERROR = self.logger.error
                                ,CRITICAL = self.logger.critical
                                )

        logging_level = logging_level.upper()
        if logging_level in logging_dict:
            logging_dict[logging_level](message)
        else:
            self.store(message, logging_level)

        return '%s : %s ' % (logging_level, message)

    def __getattr__(self, attr):
        return functools.partial(self.__call__, logging_level = attr.upper())

    def flush(self):
        tmp_logs = self.tmp_logs[:] # __call__ might cache back to tmp_logs
        self.tmp_logs[:] = [] # Mutate list initialised with.  Avoid double 
                              # logging in case re - stored in tmp_logs
        for tmp_log_message, tmp_log_level in tmp_logs:
            self.__call__(tmp_log_message, tmp_log_level)

output = Output()


class InvalidArgsError(Exception):
    
    """Custom exception to log the error message, and to at least allow 
       attempts to give users actionable advice to fix the issue, in 
       the event of a problem.  
    """
    message_fmt = 'Invalid import args: %s'
    def __init__(self
                ,message_fmt = ''
                ,message = ''
                ,logger = output
                , **kwargs
                ):
        if message_fmt and isinstance(message_fmt, basestring):
            self.message_fmt = message_fmt
        if kwargs and (not message or not isinstance(message, basestring)):
            message = self.message_fmt % kwargs
        logger.error(message)
        self.kwargs = kwargs
        super(InvalidArgsError, self).__init__(message)    


class ModuleNameError(InvalidArgsError):
    message_fmt = 'Invalid module name: %s'


class FilePathError(InvalidArgsError):
    message_fmt = 'Invalid path to import module from: %s'


# We only know the sDNA version to import as a string.  This is more secure too.
def strict_import(module_name = ''
                 ,folder = ''
                 ,sub_folder = ''
                 ,logger = output
                 ,reload_already_imported = RELOAD_IF_ALREADY_IMPORTED
                 ):

    # type: (str, str, str, type[any], bool) -> type[any]
    """ Imports the named module from the specified folder\subfolder only, 
        and returns it.
        
        Avoids name clashes and casual hijack attempts.  In some 
        environments supporting a Python implementation (such as 
        GhPython in Grasshopper) it may not be desirable to ask the user 
        to set PYTHONPATH.  Hence here, we insert the specified folder
        into sys.path (if they are not already in there).
    """
    if not module_name or not isinstance(module_name, basestring):
        raise ModuleNameError(module_name = module_name
                             ,folder = folder
                             ,sub_folder = sub_folder
                             ,logger = logger
                             )
    logger.debug(module_name)
    if module_name in sys.modules:   # sys.modules is also shared between GHPython components 
                                     # (and is even saved until Rhino is closed).
        logger.debug('Module %s already in sys.modules' % module_name)
        if reload_already_imported:
            logger.debug('Reloading %s.... ' % module_name)
            reload(sys.modules[module_name]) # type: ignore
        return sys.modules[module_name]
    #
    #
    # Load module_name for first time:
    #
    #
    search_path = os.path.join(folder, sub_folder)

    if (search_path 
        and isinstance(search_path, basestring) 
        and os.path.isdir(search_path)):
        #
        logger.debug('Search path == %s' % search_path)
        #if search_folder_only:
        #    sys.path = [search_path]
        if search_path not in sys.path:
            sys.path.insert(0, search_path)
    else:
        raise FilePathError(module_name = module_name
                           ,search_path = search_path
                           ,logger = logger
                           )

    logger.debug('Trying import... ')
    module = import_module(module_name, '')           

    return module       


class ModulesNotFoundError(InvalidArgsError):
    message_fmt = 'Modules not found in any location %s'


def load_modules(m_names
                ,folders
                ,logger = output
                ,module_name_error_msg = 'Please supply valid names of modules to import, %s'
                ,folders_error_msg = 'Please supply valid folders to import from. %s'
                ,modules_not_found_msg = 'Specified modules not found in any folder, %s'):
    #type(str/ Iterable, list, type[any], str, str) -> tuple / None
    """ Tries to import all modules in m_names, from the first folder in 
        folders to contain a .py or .pyc files with the same name as each 
        module.

        Returns a tuple of all the modules and the path they were found in.  Else 
        raises a ModulesNotFoundError.
    """
    if not m_names:
        raise ModuleNameError(message_fmt = 'No module names supplied, m_names = %s'
                             ,m_names = m_names
                             ,logger = logger
                             )

    if any( not isinstance(m_name, basestring) for m_name in m_names ):
        # if m_names is a basestring, the error is not raised 
        raise ModuleNameError(message_fmt = module_name_error_msg
                             ,m_names = m_names
                             ,logger = logger
                             )
    
    if isinstance(m_names, basestring):
        m_names = [m_names] 

    logger.debug('m_names == %s of type : %s' % (m_names, type(m_names).__name__))

    logger.debug('Testing paths : %s ' % folders)
    
    if isinstance(folders, basestring):
        folders = [folders]

    if not any(os.path.isdir(folder) or os.path.isdir(os.path.dirname(folder)) 
               for folder in folders
              ):
        raise FilePathError(message_fmt = folders_error_msg
                           ,m_names = m_names
                           ,logger = logger
                           )

    for folder in folders:
        logger.debug('Type(folder) : %s' % type(folder).__name__)
        logger.debug('Type(path) : %s path == %s' %(type(folder).__name__, folder))

        if os.path.isfile(folder):
            folder = os.path.dirname(folder)
        if all( any(os.path.isfile(os.path.join(folder, name.replace('.', os.sep) + ending)) 
                    for ending in ['.py','.pyc'] 
                   )
                for name in m_names
              ):
            #
            logger.debug('Importing %s' % repr(m_names))

            return tuple(strict_import(name, folder, '', logger = logger) 
                         for name in m_names
                        ) + (folder,)
            # tuple of modules, followed by the path to them
    raise ModulesNotFoundError(message_fmt = modules_not_found_msg
                              ,m_names = m_names
                              ,folders = folders
                              ,logger = logger
                              )




if __name__ == '__main__': # False in a compiled component.  But then the user
                           # can't add or remove Params to the component.  
    
    # Grasshopper will look for class MyComponent(component) in global scope
    # so a main function is a little tricky to define.

    nick_name = ghenv.Component.NickName #type: ignore


    if (REPOSITORY and 
        nick_name == 'Build_components'):
        #
        sDNA_GH_search_path = REPOSITORY 
        # builder can only load sDNA_GH from its parent directory, 
        # e.g. if in a dir one level up in the main repo
        # such as sDNA_build_components.gh.
    else:
        sDNA_GH_search_path = USER_INSTALLATION_FOLDER


    sc.doc = ghdoc #type: ignore

    output.debug(sDNA_GH_search_path)

    class sDNA_GH(object):
        pass

    if 'sDNA_GH.main' in sys.modules:
        sDNA_GH.main = sys.modules['sDNA_GH.main']
    else:
        sDNA_GH.main, _ = load_modules(
             m_names = PACKAGE_NAME + '.main'
            ,folders = sDNA_GH_search_path
            ,folders_error_msg = 'Please unzip %s.zip '
                                % ZIP_FILE_NAME
                                +' in the folder %s '
                                % Grasshopper.Folders.DefaultUserObjectFolder
                                +'and ensure a subfolder called %s is created '
                                % os.path.join(ZIP_FILE_NAME, PACKAGE_NAME)
                                +'inside it, containing main.py ' 
                                +'and all the sDNA_GH python files '
                                +'including those within other subfolders. ' 
            ,modules_not_found_msg = 'Some sDNA_GH files may be missing.  '
                                    +('Please: 1) Copy %s.zip into: %s '
                                    % (ZIP_FILE_NAME
                                      ,Grasshopper.Folders.DefaultUserObjectFolder
                                      ))
                                    +'2) Unblock it if necessary. '
                                    +'3) Right click '
                                    +'it, select Extract All... and click Extract, '
                                    +'to extract it to that location. '
                                    +'4) Ensure that main.py and all sDNA_GH python' 
                                    +(' files and subfolders are inside: %s '
                                    % os.path.join(USER_INSTALLATION_FOLDER
                                                  ,PACKAGE_NAME
                                                  ))
                                    +'5) Reinitialise the component or restart Rhino.'
            )         


    logger = sDNA_GH.main.logger.getChild('launcher')
    output.set_logger(logger, flush = True)


    class MyComponent(component):
        pass  # Required.  Idiomatic to Grasshopper.  Must be called "MyComponent"  
            # too (it is looked for by the parser or scope checker?) otherwise 
            # Grasshopper may not find the subclass of on 
            # component.  Even though we overwrite this class on the next line
            # immediately below.  


    
    test_runners, _ = load_modules('%s.tests.test_running_component_classes' % PACKAGE_NAME
                                  ,sDNA_GH_search_path
                                  )

    if nick_name.replace(' ','').replace('_','').lower() == SELFTEST:  
        MyComponent = test_runners.make_test_running_component_class(
                package_location = sDNA_GH_search_path
                )
    elif nick_name.startswith(APITEST_PREFIX) and os.getenv('NUM_SDNA_GH_API_TESTS'):
        MyComponent = test_runners.make_noninteractive_api_test_running_component_class(
                package_location = sDNA_GH_search_path
                ,test_name = nick_name.partition(APITEST_PREFIX)[2]
                )
    else:
        MyComponent = sDNA_GH.main.sDNA_GH_Component
        # Grasshopper calls MyComponent.RunScript automatically (in SDK mode GhPython components).
# ---------- end read_usertext ----------
panel = Panel(write_usertext.out)
unload_sdna = Unload_sDNA()  # -> out, a
# ---------- unload_sdna: Python ----------
#! /usr/bin/awk NR==3
# -*- coding: utf-8 -*-
# This module requires Grasshopper Python (Rhino3D)

# MIT License

# Copyright (c) [2021] [Cardiff University, a body incorporated
# by Royal Charter and a registered charity (number:
# 1136855) whose administrative offices are at 7th floor 30-
# 36 Newport Road, UniversityCF24 0DE, Wales, UK]

# Permission is hereby granted, free of charge, to any person obtaining a copy
# of this software and associated documentation files (the "Software"), to deal
# in the Software without restriction, including without limitation the rights
# to use, copy, modify, merge, publish, distribute, sublicense, and/or sell
# copies of the Software, and to permit persons to whom the Software is
# furnished to do so, subject to the following conditions:

# The above copyright notice and this permission notice shall be included in all
# copies or substantial portions of the Software.

# THE SOFTWARE IS PROVIDED "AS IS", WITHOUT WARRANTY OF ANY KIND, EXPRESS OR
# IMPLIED, INCLUDING BUT NOT LIMITED TO THE WARRANTIES OF MERCHANTABILITY,
# FITNESS FOR A PARTICULAR PURPOSE AND NONINFRINGEMENT. IN NO EVENT SHALL THE
# AUTHORS OR COPYRIGHT HOLDERS BE LIABLE FOR ANY CLAIM, DAMAGES OR OTHER
# LIABILITY, WHETHER IN AN ACTION OF CONTRACT, TORT OR OTHERWISE, ARISING FROM,
# OUT OF OR IN CONNECTION WITH THE SOFTWARE OR THE USE OR OTHER DEALINGS IN THE
# SOFTWARE.

""" Unload the sDNA_GH Python package and all sDNA modules, by removing them from GhPython's shared cache (sys.modules).  The 
    next sDNA_GH component to run will then reload the package and installation-wide options file (config.toml), and any specified 
    options including a project specific config.toml, without otherwise having to restart Rhino to clear its cache.
"""

__author__ = 'James Parrott'
__version__ = '2.0'


from ghpythonlib.componentbase import executingcomponent as component

class MyComponent(component):
    
    def RunScript(self, unload, update):
        import sys  #Imported here to avoid weird bug 
                    # (unloading/forgetting of sys - IronPython only?)
        #https://discourse.mcneel.com/t/failed-import-of-sys-library-in-ghpython/98696


        print('sDNA_GH packages and modules in sys.modules:')
        print('\n'.join([key for key in sys.modules if 'sdna' in key.lower()]))
        def is_imported(s):
            return s in sys.modules
        if unload is True:
            if 'logging' in sys.modules:
                sys.modules['logging'].shutdown()
            shared_cached_modules_etc = sys.modules.copy().keys()
            for y in shared_cached_modules_etc:
                if 'sdna' in y.lower():
                    del sys.modules[y]
        
        
                
        print('sDNA_GH imported == %s' % is_imported('sDNA_GH'))
        print('sDNA_GH.tools imported == %s' % is_imported('sDNA_GH.tools'))
        print('sDNAUISpec imported == %s' % is_imported('sDNAUISpec'))
        print('runsdnacommand == %s' % is_imported('runsdnacommand'))

        
        return
# ---------- end unload_sdna ----------
panel_2 = Panel(roundtrip_usertext_2.out)
