# Grasshopper definition test_parse_and_recolour_from_data_param_(and_show_num_classes_must_be_an_int).gh (Grasshopper 1.0.7)

slider_type_int = Slider(11, range=0..18)
slider_type_int_2 = Slider(11, range=0..18)
slider_type_float = Slider(11, range=0..18)
list = ValueList({"0", "1", "2", "3", "4", "5"}, selected="5")
str_11 = Panel("11")
int_11 = Integer(11)
float_11 = Number(11)
int = Integer(slider_type_int_2)
filter = StreamFilter(
    Gate=list,
    Stream0=str_11,
    Stream1=int_11,
    Stream2=float_11,
    Stream3=slider_type_float,
    Stream4=slider_type_int,
    Stream5=int)
list_2 = ValueList({"ID", "LConn", "LLen", "LFrac", "LAC", "LSin", "LBear", "MEDn", "NQPDEn", "BtEn", "TPBtEn", "TPDn", "Lnkn", "Lenn", "AngDn", "Wtn", "MGLEn", "MCFn", "DivEn"}, selected="MGLEn")
geo = Geometry([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])
data = Data(Tree({0;0;0}: ["ID", "LConn", "LLen", "LFrac", "LAC", "LSin", "LBear", "MEDn", "NQPDEn", "BtEn", "TPBtEn", "TPDn", "Lnkn", "Lenn", "AngDn", "Wtn", "MGLEn", "MCFn", "DivEn"], {0;0;1}: ["ID", "LConn", "LLen", "LFrac", "LAC", "LSin", "LBear", "MEDn", "NQPDEn", "BtEn", "TPBtEn", "TPDn", "Lnkn", "Lenn", "AngDn", "Wtn", "MGLEn", "MCFn", "DivEn"], {0;0;2}: ["ID", "LConn", "LLen", "LFrac", "LAC", "LSin", "LBear", "MEDn", "NQPDEn", "BtEn", "TPBtEn", "TPDn", "Lnkn", "Lenn", "AngDn", "Wtn", "MGLEn", "MCFn", "DivEn"], {0;0;3}: ["ID", "LConn", "LLen", "LFrac", "LAC", "LSin", "LBear", "MEDn", "NQPDEn", "BtEn", "TPBtEn", "TPDn", "Lnkn", "Lenn", "AngDn", "Wtn", "MGLEn", "MCFn", "DivEn"], {0;0;4}: ["ID", "LConn", "LLen", "LFrac", "LAC", "LSin", "LBear", "MEDn", "NQPDEn", "BtEn", "TPBtEn", "TPDn", "Lnkn", "Lenn", "AngDn", "Wtn", "MGLEn", "MCFn", "DivEn"], {0;0;5}: ["ID", "LConn", "LLen", "LFrac", "LAC", "LSin", "LBear", "MEDn", "NQPDEn", "BtEn", "TPBtEn", "TPDn", "Lnkn", "Lenn", "AngDn", "Wtn", "MGLEn", "MCFn", "DivEn"]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))
type_x = GhPythonScript(x=filter)  # -> a
# ---------- type_x: Python ----------
a = 'type(x): %s' % type(x)
print(a)
# ---------- end type_x ----------
parse_data = Parse_Data(go=Toggle(True), Geom=geo, Data=data, field=list_2, num_classes=filter)  # -> out, OK, opts, plot_min, plot_max, Data, Geom, field, mid_points, inter_class_bounds; inputs go: list, opts: list, Geom: list, Data: tree, field: list, plot_max: list, plot_min: list, num_classes: list, class_spacing: list, class_bounds: list, inter_class_bounds: list, field_prefix: list
#   port go: true: runs tools. false: do not run tools but still read other Params.
#   port opts: sDNA_GH options data structure. Python dictionary.
#   port Geom: A list of Geometric objects.
#   port Data: A Data Tree of a list of keys and list of corresponding values for each object in Geom.
#   port field: The field name / key value of the results field to parse and/or plot. Default: BtEn
#   port plot_max: Maximum data value to parse. Higher values (and their objects) are omitted. Automatically calculated if unset.
#   port plot_min: Minimum data value to parse. Lower values (and their objects) are omitted. Automatically calculated if unset.
#   port num_classes: Number of classes in the legend. Integer. Default: 7
#   port class_spacing: Name of method to use to classify the data / calculate the classes for the legend. Allowed Values: ['adjuster', 'max_deltas', 'quantile', 'simple']Default: quantile
#   port class_bounds: Inter-class boundaries for the legend. Automatically calculated using the method in class_spacing if unset.
#   port inter_class_bounds: Inter-class boundaries for the legend. Automatically calculated using the method in class_spacing if unset.
#   port field_prefix: If "field" is not set, the field names / key value of the results field are searched for the first one that starts with field_prefix. WARNING: without care, this may allow unfair comparisons and incorrect conclusions to be drawn between different result sets. The search may return BtE10 on one component, and BtE10000000 on another (the two can be very different Network measures). If found, this field is parsed or plotted. and outputted in "field". Default: BtE
#   port OK: true: tools ran successfully. false: tools did not run, or there was an error.
#   port opts: sDNA_GH options data structure. Python dictionary.
#   port plot_min: Minimum data value to parse. Lower values (and their objects) are omitted. Automatically calculated if unset.
#   port plot_max: Maximum data value to parse. Higher values (and their objects) are omitted. Automatically calculated if unset.
#   port Data: A Data Tree of a list of keys and list of corresponding values for each object in Geom.
#   port Geom: A list of Geometric objects.
#   port field: The field name / key value of the results field to parse or plot. Default: None
#   port mid_points: Mid-points of the classes in the legend.
#   port inter_class_bounds: Inter-class boundaries for the legend. Automatically calculated using the method in class_spacing if unset.
# ---------- parse_data: Python ----------
#! /usr/bin/awk NR==3
# -*- coding: utf-8 -*-
# This module requires Grasshopper Python (Rhino3D)

# MIT License

# Copyright (c) [2021] [Cardiff University, a body incorporated
# by Royal Charter and a registered charity (number:
# 1136855) whose administrative offices are at 7th floor 30-
# 36 Newport Road, University CF24 0DE, Wales, UK]

# Permission is hereby granted, free of charge, to any person obtaining a copy
# of this software and associated documentation files (the "Software"), to deal
# in the Software without restriction, including without limitation the rights
# to use, copy, modify, merge, publish, distribute, sublicense, and/or sell
# copies of the Software, and to permit persons to whom the Software is
# furnished to do so, subject to the following conditions:

# The above copyright notice and this permission notice shall be included in all
# copies or substantial portions of the Software.

# THE SOFTWARE IS PROVIDED "AS IS", WITHOUT WARRANTY OF ANY KIND, EXPRESS OR
# IMPLIED, INCLUDING BUT NOT LIMITED TO THE WARRANTIES OF MERCHANTABILITY,
# FITNESS FOR A PARTICULAR PURPOSE AND NONINFRINGEMENT. IN NO EVENT SHALL THE
# AUTHORS OR COPYRIGHT HOLDERS BE LIABLE FOR ANY CLAIM, DAMAGES OR OTHER
# LIABILITY, WHETHER IN AN ACTION OF CONTRACT, TORT OR OTHERWISE, ARISING FROM,
# OUT OF OR IN CONNECTION WITH THE SOFTWARE OR THE USE OR OTHER DEALINGS IN THE
# SOFTWARE.



"""Parse the data in a Data Tree of numerical data (in `Data`) from a specified `field`, for subsequent colouring and plotting.  Be sure to supply the list of the data's associated geometric objects (in `Geom`), as legend tags and parsed values are appended to the output `Data` list and `Geom` list.  Some classifiers sort the data into ascending order (if supplied, the geometry objects will then be reordered too, preserving their correspondence).  To force a sort, according to `field` regardless, set `sort_data` to true.  To make each parsed data point, take the same value as its class midpoint, set `colour_as_class` to true.  Use this component separately from Recolour_Objects to calculate colours with a visible Grasshopper Colour Gradient component.  Max and Min bounds can be overridden (in `plot_max` and `plot_min`).  
**WARNING!  Parsing is for the purpose of colourisation, e.g. in order to produce the desired result from Recolour_Objects.  Therefore, although the inputted Data is not changed, the Data outputted almost certainly will be changed, so should be assumed to be false.**  
After parsing, the legend tags are the definitive reference for what each colour means, not the outputted data values. In particular, if `colour_as_class` = true, the parsed data will take far fewer distinct values than the number of polylines in a large network.  To parse numerical data that uses a numerical format different to your system's normal setting (e.g. with a different radix character ',' or '.' or thousands separator ',' or '_'), set `locale` to the corresponding IETF RFC1766,  ISO 3166 Alpha-2 code (e.g. `fr`, `cn`, `pl`).  See the readme for  further details.
"""

__author__ = 'James Parrott'
__version__ = '2.0'



import sys
import os
import functools
import importlib

from ghpythonlib.componentbase import executingcomponent as component
import Grasshopper
import scriptcontext as sc

import_module = importlib.import_module
try:
    reload #type: ignore
except NameError:
    reload = importlib.reload

try:
    basestring #type: ignore
except NameError:
    basestring = str

try:
    ghdoc #type: ignore
except NameError:
    from .custom.skel.basic.ghdoc import ghdoc

ZIP_FILE_NAME = 'sdna-gh'
PACKAGE_NAME = 'sDNA_GH'
PLUG_IN_NAME = 'sDNA'               
RELOAD_IF_ALREADY_IMPORTED = False
REPOSITORY = os.path.dirname(os.path.dirname(ghdoc.Path)) if ghdoc.Path else None
# Assume we are in repo_folder/dev/sDNA_build_components.gh

USER_INSTALLATION_FOLDER = os.path.join(
                                    Grasshopper.Folders.DefaultUserObjectFolder
                                   ,ZIP_FILE_NAME
                                   )
SELFTEST = 'selftest'




class Output(object): 

    def set_logger(self, logger, flush = True):
        self.logger = logger
        if flush and self.tmp_logs:
            self.flush()

    def __init__(self
                ,tmp_logs = None
                ,logger = None
                ):
        if not isinstance(tmp_logs, list): #assert not isinstance(None, list)
            tmp_logs = []
        self.tmp_logs = tmp_logs
        self.set_logger(logger, flush = False)



    def store(self, message, logging_level):
        self.tmp_logs.append( (message, logging_level) )

    def __call__(self, message, logging_level = "INFO", logging_dict = {}):
        #type: (str, str, dict, list) -> str
        
        #logger.debug(s)

        if logging_dict == {} and self.logger is not None: 
            logging_dict = dict( DEBUG = self.logger.debug
                                ,INFO = self.logger.info
                                ,WARNING = self.logger.warning
                                ,ERROR = self.logger.error
                                ,CRITICAL = self.logger.critical
                                )

        logging_level = logging_level.upper()
        if logging_level in logging_dict:
            logging_dict[logging_level](message)
        else:
            self.store(message, logging_level)

        return '%s : %s ' % (logging_level, message)

    def __getattr__(self, attr):
        return functools.partial(self.__call__, logging_level = attr.upper())

    def flush(self):
        tmp_logs = self.tmp_logs[:] # __call__ might cache back to tmp_logs
        self.tmp_logs[:] = [] # Mutate list initialised with.  Avoid double 
                              # logging in case re - stored in tmp_logs
        for tmp_log_message, tmp_log_level in tmp_logs:
            self.__call__(tmp_log_message, tmp_log_level)

output = Output()


class InvalidArgsError(Exception):
    
    """Custom exception to log the error message, and to at least allow 
       attempts to give users actionable advice to fix the issue, in 
       the event of a problem.  
    """
    message_fmt = 'Invalid import args: %s'
    def __init__(self
                ,message_fmt = ''
                ,message = ''
                ,logger = output
                , **kwargs
                ):
        if message_fmt and isinstance(message_fmt, basestring):
            self.message_fmt = message_fmt
        if kwargs and (not message or not isinstance(message, basestring)):
            message = self.message_fmt % kwargs
        logger.error(message)
        self.kwargs = kwargs
        super(InvalidArgsError, self).__init__(message)    


class ModuleNameError(InvalidArgsError):
    message_fmt = 'Invalid module name: %s'


class FilePathError(InvalidArgsError):
    message_fmt = 'Invalid path to import module from: %s'


# We only know the sDNA version to import as a string.  This is more secure too.
def strict_import(module_name = ''
                 ,folder = ''
                 ,sub_folder = ''
                 ,logger = output
                 ,reload_already_imported = RELOAD_IF_ALREADY_IMPORTED
                 ):

    # type: (str, str, str, type[any], bool) -> type[any]
    """ Imports the named module from the specified folder\subfolder only, 
        and returns it.
        
        Avoids name clashes and casual hijack attempts.  In some 
        environments supporting a Python implementation (such as 
        GhPython in Grasshopper) it may not be desirable to ask the user 
        to set PYTHONPATH.  Hence here, we save sys.path to a tmp 
        variable, set sys.path to the specified folders, attempt the 
        import in a try: block, and restore sys.path in a finally: block
    """
    if not module_name or not isinstance(module_name, basestring):
        raise ModuleNameError(module_name = module_name
                             ,folder = folder
                             ,sub_folder = sub_folder
                             ,logger = logger
                             )
    logger.debug(module_name)
    if module_name in sys.modules:   # sys.modules is also shared between GHPython components 
                                     # (and is even saved until Rhino is closed).
        logger.debug('Module %s already in sys.modules' % module_name)
        if reload_already_imported:
            logger.debug('Reloading %s.... ' % module_name)
            reload(sys.modules[module_name]) # type: ignore
        return sys.modules[module_name]
    #
    #
    # Load module_name for first time:
    #
    #
    search_path = os.path.join(folder, sub_folder)

    if (search_path 
        and isinstance(search_path, basestring) 
        and os.path.isdir(search_path)):
        #
        logger.debug('Search path == %s' % search_path)
        #if search_folder_only:
        #    sys.path = [search_path]
        if search_path not in sys.path:
            sys.path.insert(0, search_path)
    else:
        raise FilePathError(module_name = module_name
                           ,search_path = search_path
                           ,logger = logger
                           )

    logger.debug('Trying import... ')
    module = import_module(module_name, '')           

    return module       


class ModulesNotFoundError(InvalidArgsError):
    message_fmt = 'Modules not found in any location %s'


def load_modules(m_names
                ,folders
                ,logger = output
                ,module_name_error_msg = 'Please supply valid names of modules to import, %s'
                ,folders_error_msg = 'Please supply valid folders to import from. %s'
                ,modules_not_found_msg = 'Specified modules not found in any folder, %s'):
    #type(str/ Iterable, list, type[any], str, str) -> tuple / None
    """ Tries to import all modules in m_names, from the first folder in 
        folders to contain a .py or .pyc files with the same name as each 
        module.

        Returns a tuple of all the modules and the path they were found in.  Else 
        raises a ModulesNotFoundError.
    """
    if not m_names:
        raise ModuleNameError(message_fmt = 'No module names supplied, m_names = %s'
                             ,m_names = m_names
                             ,logger = logger
                             )

    if any( not isinstance(m_name, basestring) for m_name in m_names ):
        # if m_names is a basestring, the error is not raised 
        raise ModuleNameError(message_fmt = module_name_error_msg
                             ,m_names = m_names
                             ,logger = logger
                             )
    
    if isinstance(m_names, basestring):
        m_names = [m_names] 

    logger.debug('m_names == %s of type : %s' % (m_names, type(m_names).__name__))

    logger.debug('Testing paths : %s ' % folders)
    
    if isinstance(folders, basestring):
        folders = [folders]

    if not any(os.path.isdir(folder) or os.path.isdir(os.path.dirname(folder)) 
               for folder in folders
              ):
        raise FilePathError(message_fmt = folders_error_msg
                           ,m_names = m_names
                           ,logger = logger
                           )

    for folder in folders:
        logger.debug('Type(folder) : %s' % type(folder).__name__)
        logger.debug('Type(path) : %s path == %s' %(type(folder).__name__, folder))

        if os.path.isfile(folder):
            folder = os.path.dirname(folder)
        if all( any(os.path.isfile(os.path.join(folder, name.replace('.', os.sep) + ending)) 
                    for ending in ['.py','.pyc'] 
                   )
                for name in m_names
              ):
            #
            logger.debug('Importing %s' % repr(m_names))

            return tuple(strict_import(name, folder, '', logger = logger) 
                         for name in m_names
                        ) + (folder,)
            # tuple of modules, followed by the path to them
    raise ModulesNotFoundError(message_fmt = modules_not_found_msg
                              ,m_names = m_names
                              ,folders = folders
                              ,logger = logger
                              )




if __name__ == '__main__': # False in a compiled component.  But then the user
                           # can't add or remove Params to the component.  
    
    # Grasshopper will look for class MyComponent(component) in global scope
    # so a main function is a little tricky to define.

    nick_name = ghenv.Component.NickName #type: ignore


    if (REPOSITORY and 
        nick_name == 'Build_components'):
        #
        sDNA_GH_search_path = REPOSITORY 
        # builder can only load sDNA_GH from its parent directory, 
        # e.g. if in a dir one level up in the main repo
        # such as sDNA_build_components.gh.
    else:
        sDNA_GH_search_path = USER_INSTALLATION_FOLDER


    sc.doc = ghdoc #type: ignore

    output.debug(sDNA_GH_search_path)

    class sDNA_GH(object):
        pass

    if 'sDNA_GH.main' in sys.modules:
        sDNA_GH.main = sys.modules['sDNA_GH.main']
    else:
        sDNA_GH.main, _ = load_modules(m_names = PACKAGE_NAME + '.main'
                                      ,folders = sDNA_GH_search_path
                                      ,folders_error_msg = 'Please unzip %s.zip '
                                                           %ZIP_FILE_NAME
                                                           +' in the folder %s '
                                                           %Grasshopper.Folders.DefaultUserObjectFolder
                                                           +'and ensure a subfolder called %s is created '
                                                           %os.path.join(ZIP_FILE_NAME, PACKAGE_NAME)
                                                           +'inside it, containing main.py ' 
                                                           +'and all the sDNA_GH python files '
                                                           +'including those within other subfolders. ' 
                                      ,modules_not_found_msg = 'Some sDNA_GH files may be missing.  '
                                                              +'Please: 1) Copy %s.zip into: %s '
                                                              %(ZIP_FILE_NAME
                                                               ,Grasshopper.Folders.DefaultUserObjectFolder
                                                               )
                                                              +'2) Unblock it if necessary. '
                                                              +'3) Right click '
                                                              +'it, select Extract All... and click Extract, '
                                                              +'to extract it to that location. '
                                                              +'4) Ensure that main.py and all sDNA_GH python' 
                                                              +' files and subfolders are inside: %s '
                                                              %os.path.join(USER_INSTALLATION_FOLDER
                                                                           ,PACKAGE_NAME
                                                                           )
                                                              +'5) Reinitialise the component or restart Rhino.'
                                      )         


    logger = sDNA_GH.main.logger.getChild('launcher')
    output.set_logger(logger, flush = True)


    class MyComponent(component):
        pass  # Required.  Idiomatic to Grasshopper.  Must be called "MyComponent"  
            # too (it is looked for by the parser or scope checker?) otherwise 
            # Grasshopper may not find the subclass of on 
            # component.  Even though we overwrite this class on the next line
            # immediately below.  

    MyComponent = sDNA_GH.main.sDNA_GH_Component
    # Grasshopper calls MyComponent.RunScript automatically.


    if nick_name.replace(' ','').replace('_','').lower() == SELFTEST:  


        unit_tests, _ = load_modules('%s.tests.unit_tests.%s_unit_tests' % ((PACKAGE_NAME,)*2)
                                    ,sDNA_GH_search_path
                                    )

        
        MyComponent = unit_tests.make_test_running_component_class(
                                         MyComponent
                                        ,package_location = sDNA_GH_search_path
                                        )
        # Grasshopper calls MyComponent.RunScript automatically.
# ---------- end parse_data ----------
panel = Panel(type_x)
panel_2 = Panel(parse_data.out)
gradient = Gradient(
    LowerLimit=parse_data.plot_min,
    UpperLimit=parse_data.plot_max,
    Parameter=parse_data.Data,
    stops=[0: RGB(234, 38, 0), 0.25: RGB(234, 126, 0), 0.519: RGB(254, 244, 84), 0.75: RGB(173, 203, 249), 1: RGB(75, 107, 169)])
recolour_objects = Recolour_Objects(go=parse_data.OK, plot_min=parse_data.plot_min, plot_max=parse_data.plot_max, Data=gradient, Geom=parse_data.Geom)  # -> out, OK, opts, Geom, Data, leg_cols, leg_tags, leg_frame; inputs go: list, opts: list, plot_min: list, plot_max: list, Data: tree, Geom: list, bbox: list, field: list, field_prefix: list
#   port go: true: runs tools. false: do not run tools but still read other Params.
#   port opts: sDNA_GH options data structure. Python dictionary.
#   port plot_min: Minimum data value to parse. Lower values (and their objects) are omitted. Automatically calculated if unset.
#   port plot_max: Maximum data value to parse. Higher values (and their objects) are omitted. Automatically calculated if unset.
#   port Data: A Data Tree of a list of keys and list of corresponding values for each object in Geom.
#   port Geom: A list of Geometric objects.
#   port bbox: Bounding box of geometry. Used to calculate extent of leg_frame.Calculated from shapefiles by the Read_shapefile component. [x_min, y_min, x_max, y_max], all Numbers.
#   port field: The field name / key value of the results field to parse and/or plot. Default: BtEn
#   port field_prefix: If "field" is not set, the field names / key value of the results field are searched for the first one that starts with field_prefix. WARNING: without care, this may allow unfair comparisons and incorrect conclusions to be drawn between different result sets. The search may return BtE10 on one component, and BtE10000000 on another (the two can be very different Network measures). If found, this field is parsed or plotted. and outputted in "field". Default: BtE
#   port OK: true: tools ran successfully. false: tools did not run, or there was an error.
#   port opts: sDNA_GH options data structure. Python dictionary.
#   port Geom: A list of Geometric objects.
#   port Data: A Data Tree of a list of keys and list of corresponding values for each object in Geom.
#   port leg_cols: Colour values for a legend.
#   port leg_tags: Tag names, for a legend.
#   port leg_frame: A Rectangle, suitable for a legend frame.
# ---------- recolour_objects: Python ----------
#! /usr/bin/awk NR==3
# -*- coding: utf-8 -*-
# This module requires Grasshopper Python (Rhino3D)

# MIT License

# Copyright (c) [2021] [Cardiff University, a body incorporated
# by Royal Charter and a registered charity (number:
# 1136855) whose administrative offices are at 7th floor 30-
# 36 Newport Road, University CF24 0DE, Wales, UK]

# Permission is hereby granted, free of charge, to any person obtaining a copy
# of this software and associated documentation files (the "Software"), to deal
# in the Software without restriction, including without limitation the rights
# to use, copy, modify, merge, publish, distribute, sublicense, and/or sell
# copies of the Software, and to permit persons to whom the Software is
# furnished to do so, subject to the following conditions:

# The above copyright notice and this permission notice shall be included in all
# copies or substantial portions of the Software.

# THE SOFTWARE IS PROVIDED "AS IS", WITHOUT WARRANTY OF ANY KIND, EXPRESS OR
# IMPLIED, INCLUDING BUT NOT LIMITED TO THE WARRANTIES OF MERCHANTABILITY,
# FITNESS FOR A PARTICULAR PURPOSE AND NONINFRINGEMENT. IN NO EVENT SHALL THE
# AUTHORS OR COPYRIGHT HOLDERS BE LIABLE FOR ANY CLAIM, DAMAGES OR OTHER
# LIABILITY, WHETHER IN AN ACTION OF CONTRACT, TORT OR OTHERWISE, ARISING FROM,
# OUT OF OR IN CONNECTION WITH THE SOFTWARE OR THE USE OR OTHER DEALINGS IN THE
# SOFTWARE.



"""Recolour objects (and legend tags) based on pre-parsed and pre-normalised data, or already calculated colours (as RGB triples).  If unparsed data is inputted, Parse_Data is first called.  Custom colour curves are supported using a 3D quadratic spline between the triples of numbers: `rgb_min`, `rgb_mid` and `rgb_max`.  Otherwise, use the Grasshopper Colour Gradient internally (via Node In Code) by setting `Col_Grad` to true and picking a setting from 0 to 7 for `Col_Grad_num` (0 : 'EarthlyBrown', 1 : 'Forest', 2 : 'GreyScale', 3 : 'Heat', 4 : 'Pink', 5 : 'Spectrum', 6 : 'Traffic', 7 : 'Zebra').  Set `line_width` to control the width of the line of Rhino geom objects  (the default is 4).

Create a legend by connecting `leg_cols`, `leg_tags` and `leg_frame` to a Grasshopper Legend component.  The coordinates of the corners of the Rectangle provided in `leg_frame` may be overridden by specifying `leg_extent` (xmin, ymin, xmax, ymax); alternatively any rectangle object can be passed into `leg_frame` on the GH Legend component itself.  Custom legend tag templates and class boundaries are supported via four format strings (`first_leg_tag_str`, `gen_leg_tag_str`, `last_leg_tag_str` and `num_format`) as per Parse_Data.  

To recolour Grasshopper geometry instead of Rhino Geometry (i.e. unbaked objects), connect the `Data` and `Geom` outputs to a Grasshopper Custom Preview component (line widths of GH objects cannot be increased).  
"""

__author__ = 'James Parrott'
__version__ = '2.0'



import sys
import os
import functools
import importlib

from ghpythonlib.componentbase import executingcomponent as component
import Grasshopper
import scriptcontext as sc

import_module = importlib.import_module
try:
    reload #type: ignore
except NameError:
    reload = importlib.reload

try:
    basestring #type: ignore
except NameError:
    basestring = str

try:
    ghdoc #type: ignore
except NameError:
    from .custom.skel.basic.ghdoc import ghdoc

ZIP_FILE_NAME = 'sdna-gh'
PACKAGE_NAME = 'sDNA_GH'
PLUG_IN_NAME = 'sDNA'               
RELOAD_IF_ALREADY_IMPORTED = False
REPOSITORY = os.path.dirname(os.path.dirname(ghdoc.Path)) if ghdoc.Path else None
# Assume we are in repo_folder/dev/sDNA_build_components.gh

USER_INSTALLATION_FOLDER = os.path.join(
                                    Grasshopper.Folders.DefaultUserObjectFolder
                                   ,ZIP_FILE_NAME
                                   )
SELFTEST = 'selftest'




class Output(object): 

    def set_logger(self, logger, flush = True):
        self.logger = logger
        if flush and self.tmp_logs:
            self.flush()

    def __init__(self
                ,tmp_logs = None
                ,logger = None
                ):
        if not isinstance(tmp_logs, list): #assert not isinstance(None, list)
            tmp_logs = []
        self.tmp_logs = tmp_logs
        self.set_logger(logger, flush = False)



    def store(self, message, logging_level):
        self.tmp_logs.append( (message, logging_level) )

    def __call__(self, message, logging_level = "INFO", logging_dict = {}):
        #type: (str, str, dict, list) -> str
        
        #logger.debug(s)

        if logging_dict == {} and self.logger is not None: 
            logging_dict = dict( DEBUG = self.logger.debug
                                ,INFO = self.logger.info
                                ,WARNING = self.logger.warning
                                ,ERROR = self.logger.error
                                ,CRITICAL = self.logger.critical
                                )

        logging_level = logging_level.upper()
        if logging_level in logging_dict:
            logging_dict[logging_level](message)
        else:
            self.store(message, logging_level)

        return '%s : %s ' % (logging_level, message)

    def __getattr__(self, attr):
        return functools.partial(self.__call__, logging_level = attr.upper())

    def flush(self):
        tmp_logs = self.tmp_logs[:] # __call__ might cache back to tmp_logs
        self.tmp_logs[:] = [] # Mutate list initialised with.  Avoid double 
                              # logging in case re - stored in tmp_logs
        for tmp_log_message, tmp_log_level in tmp_logs:
            self.__call__(tmp_log_message, tmp_log_level)

output = Output()


class InvalidArgsError(Exception):
    
    """Custom exception to log the error message, and to at least allow 
       attempts to give users actionable advice to fix the issue, in 
       the event of a problem.  
    """
    message_fmt = 'Invalid import args: %s'
    def __init__(self
                ,message_fmt = ''
                ,message = ''
                ,logger = output
                , **kwargs
                ):
        if message_fmt and isinstance(message_fmt, basestring):
            self.message_fmt = message_fmt
        if kwargs and (not message or not isinstance(message, basestring)):
            message = self.message_fmt % kwargs
        logger.error(message)
        self.kwargs = kwargs
        super(InvalidArgsError, self).__init__(message)    


class ModuleNameError(InvalidArgsError):
    message_fmt = 'Invalid module name: %s'


class FilePathError(InvalidArgsError):
    message_fmt = 'Invalid path to import module from: %s'


# We only know the sDNA version to import as a string.  This is more secure too.
def strict_import(module_name = ''
                 ,folder = ''
                 ,sub_folder = ''
                 ,logger = output
                 ,reload_already_imported = RELOAD_IF_ALREADY_IMPORTED
                 ):

    # type: (str, str, str, type[any], bool) -> type[any]
    """ Imports the named module from the specified folder\subfolder only, 
        and returns it.
        
        Avoids name clashes and casual hijack attempts.  In some 
        environments supporting a Python implementation (such as 
        GhPython in Grasshopper) it may not be desirable to ask the user 
        to set PYTHONPATH.  Hence here, we save sys.path to a tmp 
        variable, set sys.path to the specified folders, attempt the 
        import in a try: block, and restore sys.path in a finally: block
    """
    if not module_name or not isinstance(module_name, basestring):
        raise ModuleNameError(module_name = module_name
                             ,folder = folder
                             ,sub_folder = sub_folder
                             ,logger = logger
                             )
    logger.debug(module_name)
    if module_name in sys.modules:   # sys.modules is also shared between GHPython components 
                                     # (and is even saved until Rhino is closed).
        logger.debug('Module %s already in sys.modules' % module_name)
        if reload_already_imported:
            logger.debug('Reloading %s.... ' % module_name)
            reload(sys.modules[module_name]) # type: ignore
        return sys.modules[module_name]
    #
    #
    # Load module_name for first time:
    #
    #
    search_path = os.path.join(folder, sub_folder)

    if (search_path 
        and isinstance(search_path, basestring) 
        and os.path.isdir(search_path)):
        #
        logger.debug('Search path == %s' % search_path)
        #if search_folder_only:
        #    sys.path = [search_path]
        if search_path not in sys.path:
            sys.path.insert(0, search_path)
    else:
        raise FilePathError(module_name = module_name
                           ,search_path = search_path
                           ,logger = logger
                           )

    logger.debug('Trying import... ')
    module = import_module(module_name, '')           

    return module       


class ModulesNotFoundError(InvalidArgsError):
    message_fmt = 'Modules not found in any location %s'


def load_modules(m_names
                ,folders
                ,logger = output
                ,module_name_error_msg = 'Please supply valid names of modules to import, %s'
                ,folders_error_msg = 'Please supply valid folders to import from. %s'
                ,modules_not_found_msg = 'Specified modules not found in any folder, %s'):
    #type(str/ Iterable, list, type[any], str, str) -> tuple / None
    """ Tries to import all modules in m_names, from the first folder in 
        folders to contain a .py or .pyc files with the same name as each 
        module.

        Returns a tuple of all the modules and the path they were found in.  Else 
        raises a ModulesNotFoundError.
    """
    if not m_names:
        raise ModuleNameError(message_fmt = 'No module names supplied, m_names = %s'
                             ,m_names = m_names
                             ,logger = logger
                             )

    if any( not isinstance(m_name, basestring) for m_name in m_names ):
        # if m_names is a basestring, the error is not raised 
        raise ModuleNameError(message_fmt = module_name_error_msg
                             ,m_names = m_names
                             ,logger = logger
                             )
    
    if isinstance(m_names, basestring):
        m_names = [m_names] 

    logger.debug('m_names == %s of type : %s' % (m_names, type(m_names).__name__))

    logger.debug('Testing paths : %s ' % folders)
    
    if isinstance(folders, basestring):
        folders = [folders]

    if not any(os.path.isdir(folder) or os.path.isdir(os.path.dirname(folder)) 
               for folder in folders
              ):
        raise FilePathError(message_fmt = folders_error_msg
                           ,m_names = m_names
                           ,logger = logger
                           )

    for folder in folders:
        logger.debug('Type(folder) : %s' % type(folder).__name__)
        logger.debug('Type(path) : %s path == %s' %(type(folder).__name__, folder))

        if os.path.isfile(folder):
            folder = os.path.dirname(folder)
        if all( any(os.path.isfile(os.path.join(folder, name.replace('.', os.sep) + ending)) 
                    for ending in ['.py','.pyc'] 
                   )
                for name in m_names
              ):
            #
            logger.debug('Importing %s' % repr(m_names))

            return tuple(strict_import(name, folder, '', logger = logger) 
                         for name in m_names
                        ) + (folder,)
            # tuple of modules, followed by the path to them
    raise ModulesNotFoundError(message_fmt = modules_not_found_msg
                              ,m_names = m_names
                              ,folders = folders
                              ,logger = logger
                              )




if __name__ == '__main__': # False in a compiled component.  But then the user
                           # can't add or remove Params to the component.  
    
    # Grasshopper will look for class MyComponent(component) in global scope
    # so a main function is a little tricky to define.

    nick_name = ghenv.Component.NickName #type: ignore


    if (REPOSITORY and 
        nick_name == 'Build_components'):
        #
        sDNA_GH_search_path = REPOSITORY 
        # builder can only load sDNA_GH from its parent directory, 
        # e.g. if in a dir one level up in the main repo
        # such as sDNA_build_components.gh.
    else:
        sDNA_GH_search_path = USER_INSTALLATION_FOLDER


    sc.doc = ghdoc #type: ignore

    output.debug(sDNA_GH_search_path)

    class sDNA_GH(object):
        pass

    if 'sDNA_GH.main' in sys.modules:
        sDNA_GH.main = sys.modules['sDNA_GH.main']
    else:
        sDNA_GH.main, _ = load_modules(m_names = PACKAGE_NAME + '.main'
                                      ,folders = sDNA_GH_search_path
                                      ,folders_error_msg = 'Please unzip %s.zip '
                                                           %ZIP_FILE_NAME
                                                           +' in the folder %s '
                                                           %Grasshopper.Folders.DefaultUserObjectFolder
                                                           +'and ensure a subfolder called %s is created '
                                                           %os.path.join(ZIP_FILE_NAME, PACKAGE_NAME)
                                                           +'inside it, containing main.py ' 
                                                           +'and all the sDNA_GH python files '
                                                           +'including those within other subfolders. ' 
                                      ,modules_not_found_msg = 'Some sDNA_GH files may be missing.  '
                                                              +'Please: 1) Copy %s.zip into: %s '
                                                              %(ZIP_FILE_NAME
                                                               ,Grasshopper.Folders.DefaultUserObjectFolder
                                                               )
                                                              +'2) Unblock it if necessary. '
                                                              +'3) Right click '
                                                              +'it, select Extract All... and click Extract, '
                                                              +'to extract it to that location. '
                                                              +'4) Ensure that main.py and all sDNA_GH python' 
                                                              +' files and subfolders are inside: %s '
                                                              %os.path.join(USER_INSTALLATION_FOLDER
                                                                           ,PACKAGE_NAME
                                                                           )
                                                              +'5) Reinitialise the component or restart Rhino.'
                                      )         


    logger = sDNA_GH.main.logger.getChild('launcher')
    output.set_logger(logger, flush = True)


    class MyComponent(component):
        pass  # Required.  Idiomatic to Grasshopper.  Must be called "MyComponent"  
            # too (it is looked for by the parser or scope checker?) otherwise 
            # Grasshopper may not find the subclass of on 
            # component.  Even though we overwrite this class on the next line
            # immediately below.  

    MyComponent = sDNA_GH.main.sDNA_GH_Component
    # Grasshopper calls MyComponent.RunScript automatically.


    if nick_name.replace(' ','').replace('_','').lower() == SELFTEST:  


        unit_tests, _ = load_modules('%s.tests.unit_tests.%s_unit_tests' % ((PACKAGE_NAME,)*2)
                                    ,sDNA_GH_search_path
                                    )

        
        MyComponent = unit_tests.make_test_running_component_class(
                                         MyComponent
                                        ,package_location = sDNA_GH_search_path
                                        )
        # Grasshopper calls MyComponent.RunScript automatically.
# ---------- end recolour_objects ----------
preview = CustomPreview(Geometry=recolour_objects.Geom, Material=recolour_objects.Data)
legend = Legend(Colour=recolour_objects.leg_cols, Tags=recolour_objects.leg_tags, Rectangle=recolour_objects.leg_frame, LegendType=1)
