# Grasshopper definition write_unicode_multiple_fields_to_shp_file.gh (Grasshopper 1.0.7)

read_geom = Read_Geom(go=Toggle(False), selected=Toggle(False))  # -> out, OK, opts, Geom; inputs go: list, opts: list, config: list, selected: list, layer: list, Geom: list
#   port go: true: runs tools. false: do not run tools but still read other Params.
#   port opts: sDNA_GH options data structure. Python dictionary.
#   port config: File path to sDNA_GH options file. Default: C:\Users\James\AppData\Roaming\Grasshopper\UserObjects\sdna-gh\sDNA_GH\config.toml
#   port selected: true : only read from selection. false: read all. Default: False
#   port layer: Text. Names of the layers : read geometry only from those layers. Any value not the name of a layer: read all layers. Default:
#   port Geom: A list of geometric objects. Requires GUIDs of Rhino objects or native/embedded Grasshopper geometry. To use Rhino objects referenced from Grasshopper parameter objects (instead of their Grasshopper versions which are often obscured unless the Rhino shapes are set to Hidden) run the output of the Geometry (Geo) or Curve (Crv) through a Guid (ID) parameter object first. Note: For sDNA tools all the geometric objects must all be polylines. For write_Shp all the objects must be of the type in shp_type (default: POLYLINEZ).
#   port OK: true: tools ran successfully. false: tools did not run, or there was an error.
#   port opts: sDNA_GH options data structure. Python dictionary.
#   port Geom: A list of geometric objects. Requires GUIDs of Rhino objects or native/embedded Grasshopper geometry. To use Rhino objects referenced from Grasshopper parameter objects (instead of their Grasshopper versions which are often obscured unless the Rhino shapes are set to Hidden) run the output of the Geometry (Geo) or Curve (Crv) through a Guid (ID) parameter object first. Note: For sDNA tools all the geometric objects must all be polylines. For write_Shp all the objects must be of the type in shp_type (default: POLYLINEZ).
# ---------- read_geom: Python ----------
#! /usr/bin/awk NR==3
# -*- coding: utf-8 -*-
# This module requires Grasshopper Python (Rhino3D)

# MIT License

# Copyright (c) [2021] [Cardiff University, a body incorporated
# by Royal Charter and a registered charity (number:
# 1136855) whose administrative offices are at 7th floor 30-
# 36 Newport Road, University CF24 0DE, Wales, UK]

# Permission is hereby granted, free of charge, to any person obtaining a copy
# of this software and associated documentation files (the "Software"), to deal
# in the Software without restriction, including without limitation the rights
# to use, copy, modify, merge, publish, distribute, sublicense, and/or sell
# copies of the Software, and to permit persons to whom the Software is
# furnished to do so, subject to the following conditions:

# The above copyright notice and this permission notice shall be included in all
# copies or substantial portions of the Software.

# THE SOFTWARE IS PROVIDED "AS IS", WITHOUT WARRANTY OF ANY KIND, EXPRESS OR
# IMPLIED, INCLUDING BUT NOT LIMITED TO THE WARRANTIES OF MERCHANTABILITY,
# FITNESS FOR A PARTICULAR PURPOSE AND NONINFRINGEMENT. IN NO EVENT SHALL THE
# AUTHORS OR COPYRIGHT HOLDERS BE LIABLE FOR ANY CLAIM, DAMAGES OR OTHER
# LIABILITY, WHETHER IN AN ACTION OF CONTRACT, TORT OR OTHERWISE, ARISING FROM,
# OUT OF OR IN CONNECTION WITH THE SOFTWARE OR THE USE OR OTHER DEALINGS IN THE
# SOFTWARE.



"""Gets strings of the uuid references to Rhino polylines for subsequent sDNA_GH tools..  

Set `selected` to true, to only read objects that are selected.  Similarly, specify `layer` to the name of a layer, to only read objects from that layer.  If the component has `sync = false`, an input Params that has had its value set, when subsequently disconnected will fallback to whatever its previous value was. If `sync = True` it will remember its previous setting, in which case to go back to selecting all layers, `layer` must be set to any value that is not the name of a layer.  Similarly, to go back to selecting everything (not just selected geometry) set `selected = false`.
"""

__author__ = 'James Parrott'
__version__ = '2.2.0'



import sys
import os
import functools
import importlib

from ghpythonlib.componentbase import executingcomponent as component
import Grasshopper
import scriptcontext as sc

import_module = importlib.import_module
try:
    reload #type: ignore
except NameError:
    reload = importlib.reload

try:
    basestring #type: ignore
except NameError:
    basestring = str

try:
    ghdoc #type: ignore
except NameError:
    from .custom.skel.basic.ghdoc import ghdoc

ZIP_FILE_NAME = 'sdna-gh'
PACKAGE_NAME = 'sDNA_GH'
PLUG_IN_NAME = 'sDNA'               
RELOAD_IF_ALREADY_IMPORTED = False
REPOSITORY = os.path.dirname(os.path.dirname(ghdoc.Path)) if ghdoc.Path else None
# Assume we are in repo_folder/dev/sDNA_build_components.gh

USER_INSTALLATION_FOLDER = os.path.join(
                                    Grasshopper.Folders.DefaultUserObjectFolder
                                   ,ZIP_FILE_NAME
                                   )
SELFTEST = 'selftest'




class Output(object): 

    def set_logger(self, logger, flush = True):
        self.logger = logger
        if flush and self.tmp_logs:
            self.flush()

    def __init__(self
                ,tmp_logs = None
                ,logger = None
                ):
        if not isinstance(tmp_logs, list): #assert not isinstance(None, list)
            tmp_logs = []
        self.tmp_logs = tmp_logs
        self.set_logger(logger, flush = False)



    def store(self, message, logging_level):
        self.tmp_logs.append( (message, logging_level) )

    def __call__(self, message, logging_level = "INFO", logging_dict = {}):
        #type: (str, str, dict, list) -> str
        
        #logger.debug(s)

        if logging_dict == {} and self.logger is not None: 
            logging_dict = dict( DEBUG = self.logger.debug
                                ,INFO = self.logger.info
                                ,WARNING = self.logger.warning
                                ,ERROR = self.logger.error
                                ,CRITICAL = self.logger.critical
                                )

        logging_level = logging_level.upper()
        if logging_level in logging_dict:
            logging_dict[logging_level](message)
        else:
            self.store(message, logging_level)

        return '%s : %s ' % (logging_level, message)

    def __getattr__(self, attr):
        return functools.partial(self.__call__, logging_level = attr.upper())

    def flush(self):
        tmp_logs = self.tmp_logs[:] # __call__ might cache back to tmp_logs
        self.tmp_logs[:] = [] # Mutate list initialised with.  Avoid double 
                              # logging in case re - stored in tmp_logs
        for tmp_log_message, tmp_log_level in tmp_logs:
            self.__call__(tmp_log_message, tmp_log_level)

output = Output()


class InvalidArgsError(Exception):
    
    """Custom exception to log the error message, and to at least allow 
       attempts to give users actionable advice to fix the issue, in 
       the event of a problem.  
    """
    message_fmt = 'Invalid import args: %s'
    def __init__(self
                ,message_fmt = ''
                ,message = ''
                ,logger = output
                , **kwargs
                ):
        if message_fmt and isinstance(message_fmt, basestring):
            self.message_fmt = message_fmt
        if kwargs and (not message or not isinstance(message, basestring)):
            message = self.message_fmt % kwargs
        logger.error(message)
        self.kwargs = kwargs
        super(InvalidArgsError, self).__init__(message)    


class ModuleNameError(InvalidArgsError):
    message_fmt = 'Invalid module name: %s'


class FilePathError(InvalidArgsError):
    message_fmt = 'Invalid path to import module from: %s'


# We only know the sDNA version to import as a string.  This is more secure too.
def strict_import(module_name = ''
                 ,folder = ''
                 ,sub_folder = ''
                 ,logger = output
                 ,reload_already_imported = RELOAD_IF_ALREADY_IMPORTED
                 ):

    # type: (str, str, str, type[any], bool) -> type[any]
    """ Imports the named module from the specified folder\subfolder only, 
        and returns it.
        
        Avoids name clashes and casual hijack attempts.  In some 
        environments supporting a Python implementation (such as 
        GhPython in Grasshopper) it may not be desirable to ask the user 
        to set PYTHONPATH.  Hence here, we insert the specified folder
        into sys.path (if they are not already in there).
    """
    if not module_name or not isinstance(module_name, basestring):
        raise ModuleNameError(module_name = module_name
                             ,folder = folder
                             ,sub_folder = sub_folder
                             ,logger = logger
                             )
    logger.debug(module_name)
    if module_name in sys.modules:   # sys.modules is also shared between GHPython components 
                                     # (and is even saved until Rhino is closed).
        logger.debug('Module %s already in sys.modules' % module_name)
        if reload_already_imported:
            logger.debug('Reloading %s.... ' % module_name)
            reload(sys.modules[module_name]) # type: ignore
        return sys.modules[module_name]
    #
    #
    # Load module_name for first time:
    #
    #
    search_path = os.path.join(folder, sub_folder)

    if (search_path 
        and isinstance(search_path, basestring) 
        and os.path.isdir(search_path)):
        #
        logger.debug('Search path == %s' % search_path)
        #if search_folder_only:
        #    sys.path = [search_path]
        if search_path not in sys.path:
            sys.path.insert(0, search_path)
    else:
        raise FilePathError(module_name = module_name
                           ,search_path = search_path
                           ,logger = logger
                           )

    logger.debug('Trying import... ')
    module = import_module(module_name, '')           

    return module       


class ModulesNotFoundError(InvalidArgsError):
    message_fmt = 'Modules not found in any location %s'


def load_modules(m_names
                ,folders
                ,logger = output
                ,module_name_error_msg = 'Please supply valid names of modules to import, %s'
                ,folders_error_msg = 'Please supply valid folders to import from. %s'
                ,modules_not_found_msg = 'Specified modules not found in any folder, %s'):
    #type(str/ Iterable, list, type[any], str, str) -> tuple / None
    """ Tries to import all modules in m_names, from the first folder in 
        folders to contain a .py or .pyc files with the same name as each 
        module.

        Returns a tuple of all the modules and the path they were found in.  Else 
        raises a ModulesNotFoundError.
    """
    if not m_names:
        raise ModuleNameError(message_fmt = 'No module names supplied, m_names = %s'
                             ,m_names = m_names
                             ,logger = logger
                             )

    if any( not isinstance(m_name, basestring) for m_name in m_names ):
        # if m_names is a basestring, the error is not raised 
        raise ModuleNameError(message_fmt = module_name_error_msg
                             ,m_names = m_names
                             ,logger = logger
                             )
    
    if isinstance(m_names, basestring):
        m_names = [m_names] 

    logger.debug('m_names == %s of type : %s' % (m_names, type(m_names).__name__))

    logger.debug('Testing paths : %s ' % folders)
    
    if isinstance(folders, basestring):
        folders = [folders]

    if not any(os.path.isdir(folder) or os.path.isdir(os.path.dirname(folder)) 
               for folder in folders
              ):
        raise FilePathError(message_fmt = folders_error_msg
                           ,m_names = m_names
                           ,logger = logger
                           )

    for folder in folders:
        logger.debug('Type(folder) : %s' % type(folder).__name__)
        logger.debug('Type(path) : %s path == %s' %(type(folder).__name__, folder))

        if os.path.isfile(folder):
            folder = os.path.dirname(folder)
        if all( any(os.path.isfile(os.path.join(folder, name.replace('.', os.sep) + ending)) 
                    for ending in ['.py','.pyc'] 
                   )
                for name in m_names
              ):
            #
            logger.debug('Importing %s' % repr(m_names))

            return tuple(strict_import(name, folder, '', logger = logger) 
                         for name in m_names
                        ) + (folder,)
            # tuple of modules, followed by the path to them
    raise ModulesNotFoundError(message_fmt = modules_not_found_msg
                              ,m_names = m_names
                              ,folders = folders
                              ,logger = logger
                              )




if __name__ == '__main__': # False in a compiled component.  But then the user
                           # can't add or remove Params to the component.  
    
    # Grasshopper will look for class MyComponent(component) in global scope
    # so a main function is a little tricky to define.

    nick_name = ghenv.Component.NickName #type: ignore


    if (REPOSITORY and 
        nick_name == 'Build_components'):
        #
        sDNA_GH_search_path = REPOSITORY 
        # builder can only load sDNA_GH from its parent directory, 
        # e.g. if in a dir one level up in the main repo
        # such as sDNA_build_components.gh.
    else:
        sDNA_GH_search_path = USER_INSTALLATION_FOLDER


    sc.doc = ghdoc #type: ignore

    output.debug(sDNA_GH_search_path)

    class sDNA_GH(object):
        pass

    if 'sDNA_GH.main' in sys.modules:
        sDNA_GH.main = sys.modules['sDNA_GH.main']
    else:
        sDNA_GH.main, _ = load_modules(m_names = PACKAGE_NAME + '.main'
                                      ,folders = sDNA_GH_search_path
                                      ,folders_error_msg = 'Please unzip %s.zip '
                                                           %ZIP_FILE_NAME
                                                           +' in the folder %s '
                                                           %Grasshopper.Folders.DefaultUserObjectFolder
                                                           +'and ensure a subfolder called %s is created '
                                                           %os.path.join(ZIP_FILE_NAME, PACKAGE_NAME)
                                                           +'inside it, containing main.py ' 
                                                           +'and all the sDNA_GH python files '
                                                           +'including those within other subfolders. ' 
                                      ,modules_not_found_msg = 'Some sDNA_GH files may be missing.  '
                                                              +'Please: 1) Copy %s.zip into: %s '
                                                              %(ZIP_FILE_NAME
                                                               ,Grasshopper.Folders.DefaultUserObjectFolder
                                                               )
                                                              +'2) Unblock it if necessary. '
                                                              +'3) Right click '
                                                              +'it, select Extract All... and click Extract, '
                                                              +'to extract it to that location. '
                                                              +'4) Ensure that main.py and all sDNA_GH python' 
                                                              +' files and subfolders are inside: %s '
                                                              %os.path.join(USER_INSTALLATION_FOLDER
                                                                           ,PACKAGE_NAME
                                                                           )
                                                              +'5) Reinitialise the component or restart Rhino.'
                                      )         


    logger = sDNA_GH.main.logger.getChild('launcher')
    output.set_logger(logger, flush = True)


    class MyComponent(component):
        pass  # Required.  Idiomatic to Grasshopper.  Must be called "MyComponent"  
            # too (it is looked for by the parser or scope checker?) otherwise 
            # Grasshopper may not find the subclass of on 
            # component.  Even though we overwrite this class on the next line
            # immediately below.  

    MyComponent = sDNA_GH.main.sDNA_GH_Component
    # Grasshopper calls MyComponent.RunScript automatically.


    if nick_name.replace(' ','').replace('_','').lower() == SELFTEST:  


        unit_tests, _ = load_modules('%s.tests.unit_tests.%s_unit_tests' % ((PACKAGE_NAME,)*2)
                                    ,sDNA_GH_search_path
                                    )

        
        MyComponent = unit_tests.make_test_running_component_class(
                                         MyComponent
                                        ,package_location = sDNA_GH_search_path
                                        )
        # Grasshopper calls MyComponent.RunScript automatically.
# ---------- end read_geom ----------
read_usertext = Read_Usertext(go=read_geom.OK, Geom=read_geom.Geom)  # -> out, OK, opts, Data; inputs go: list, opts: list, Geom: list, compute_vals: list
#   port go: true: runs tools. false: do not run tools but still read other Params.
#   port opts: sDNA_GH options data structure. Python dictionary.
#   port Geom: A list of geometric objects. Requires GUIDs of Rhino objects or native/embedded Grasshopper geometry. To use Rhino objects referenced from Grasshopper parameter objects (instead of their Grasshopper versions which are often obscured unless the Rhino shapes are set to Hidden) run the output of the Geometry (Geo) or Curve (Crv) through a Guid (ID) parameter object first. Note: For sDNA tools all the geometric objects must all be polylines. For write_Shp all the objects must be of the type in shp_type (default: POLYLINEZ).
#   port compute_vals: true : apply Rhino.RhinoApp.ParseTextField to vals that are attribute User Text computed fields. false: do nothing. Default: True
#   port OK: true: tools ran successfully. false: tools did not run, or there was an error.
#   port opts: sDNA_GH options data structure. Python dictionary.
#   port Data: A Data Tree of a list of keys and list of corresponding values for each object in Geom.
# ---------- read_usertext: Python ----------
#! /usr/bin/awk NR==3
# -*- coding: utf-8 -*-
# This module requires Grasshopper Python (Rhino3D)

# MIT License

# Copyright (c) [2021] [Cardiff University, a body incorporated
# by Royal Charter and a registered charity (number:
# 1136855) whose administrative offices are at 7th floor 30-
# 36 Newport Road, University CF24 0DE, Wales, UK]

# Permission is hereby granted, free of charge, to any person obtaining a copy
# of this software and associated documentation files (the "Software"), to deal
# in the Software without restriction, including without limitation the rights
# to use, copy, modify, merge, publish, distribute, sublicense, and/or sell
# copies of the Software, and to permit persons to whom the Software is
# furnished to do so, subject to the following conditions:

# The above copyright notice and this permission notice shall be included in all
# copies or substantial portions of the Software.

# THE SOFTWARE IS PROVIDED "AS IS", WITHOUT WARRANTY OF ANY KIND, EXPRESS OR
# IMPLIED, INCLUDING BUT NOT LIMITED TO THE WARRANTIES OF MERCHANTABILITY,
# FITNESS FOR A PARTICULAR PURPOSE AND NONINFRINGEMENT. IN NO EVENT SHALL THE
# AUTHORS OR COPYRIGHT HOLDERS BE LIABLE FOR ANY CLAIM, DAMAGES OR OTHER
# LIABILITY, WHETHER IN AN ACTION OF CONTRACT, TORT OR OTHERWISE, ARISING FROM,
# OUT OF OR IN CONNECTION WITH THE SOFTWARE OR THE USE OR OTHER DEALINGS IN THE
# SOFTWARE.



"""Reads all User Text from the list of Rhino objects in `Geom` - these must be Rhino objects from Read_Geom (Grasshopper references to Rhino objects, e.g. from a geom Param will not work).  If `auto_get_Geom` = true and if no Read_Geom component is connected to its inputs, Read_Geom is first called.  If `compute_vals` = true, values starting and ending in `%` referring to a Rhino object's UUID (e.g. `%<CurveLength("ac4669e5-53a6-4c2b-9080-bbc67129d93e")>%`) are computed using Rhino.RhinoApp.ParseTextField.
"""

__author__ = 'James Parrott'
__version__ = '2.2.0'



import sys
import os
import functools
import importlib

from ghpythonlib.componentbase import executingcomponent as component
import Grasshopper
import scriptcontext as sc

import_module = importlib.import_module
try:
    reload #type: ignore
except NameError:
    reload = importlib.reload

try:
    basestring #type: ignore
except NameError:
    basestring = str

try:
    ghdoc #type: ignore
except NameError:
    from .custom.skel.basic.ghdoc import ghdoc

ZIP_FILE_NAME = 'sdna-gh'
PACKAGE_NAME = 'sDNA_GH'
PLUG_IN_NAME = 'sDNA'               
RELOAD_IF_ALREADY_IMPORTED = False
REPOSITORY = os.path.dirname(os.path.dirname(ghdoc.Path)) if ghdoc.Path else None
# Assume we are in repo_folder/dev/sDNA_build_components.gh

USER_INSTALLATION_FOLDER = os.path.join(
                                    Grasshopper.Folders.DefaultUserObjectFolder
                                   ,ZIP_FILE_NAME
                                   )
SELFTEST = 'selftest'




class Output(object): 

    def set_logger(self, logger, flush = True):
        self.logger = logger
        if flush and self.tmp_logs:
            self.flush()

    def __init__(self
                ,tmp_logs = None
                ,logger = None
                ):
        if not isinstance(tmp_logs, list): #assert not isinstance(None, list)
            tmp_logs = []
        self.tmp_logs = tmp_logs
        self.set_logger(logger, flush = False)



    def store(self, message, logging_level):
        self.tmp_logs.append( (message, logging_level) )

    def __call__(self, message, logging_level = "INFO", logging_dict = {}):
        #type: (str, str, dict, list) -> str
        
        #logger.debug(s)

        if logging_dict == {} and self.logger is not None: 
            logging_dict = dict( DEBUG = self.logger.debug
                                ,INFO = self.logger.info
                                ,WARNING = self.logger.warning
                                ,ERROR = self.logger.error
                                ,CRITICAL = self.logger.critical
                                )

        logging_level = logging_level.upper()
        if logging_level in logging_dict:
            logging_dict[logging_level](message)
        else:
            self.store(message, logging_level)

        return '%s : %s ' % (logging_level, message)

    def __getattr__(self, attr):
        return functools.partial(self.__call__, logging_level = attr.upper())

    def flush(self):
        tmp_logs = self.tmp_logs[:] # __call__ might cache back to tmp_logs
        self.tmp_logs[:] = [] # Mutate list initialised with.  Avoid double 
                              # logging in case re - stored in tmp_logs
        for tmp_log_message, tmp_log_level in tmp_logs:
            self.__call__(tmp_log_message, tmp_log_level)

output = Output()


class InvalidArgsError(Exception):
    
    """Custom exception to log the error message, and to at least allow 
       attempts to give users actionable advice to fix the issue, in 
       the event of a problem.  
    """
    message_fmt = 'Invalid import args: %s'
    def __init__(self
                ,message_fmt = ''
                ,message = ''
                ,logger = output
                , **kwargs
                ):
        if message_fmt and isinstance(message_fmt, basestring):
            self.message_fmt = message_fmt
        if kwargs and (not message or not isinstance(message, basestring)):
            message = self.message_fmt % kwargs
        logger.error(message)
        self.kwargs = kwargs
        super(InvalidArgsError, self).__init__(message)    


class ModuleNameError(InvalidArgsError):
    message_fmt = 'Invalid module name: %s'


class FilePathError(InvalidArgsError):
    message_fmt = 'Invalid path to import module from: %s'


# We only know the sDNA version to import as a string.  This is more secure too.
def strict_import(module_name = ''
                 ,folder = ''
                 ,sub_folder = ''
                 ,logger = output
                 ,reload_already_imported = RELOAD_IF_ALREADY_IMPORTED
                 ):

    # type: (str, str, str, type[any], bool) -> type[any]
    """ Imports the named module from the specified folder\subfolder only, 
        and returns it.
        
        Avoids name clashes and casual hijack attempts.  In some 
        environments supporting a Python implementation (such as 
        GhPython in Grasshopper) it may not be desirable to ask the user 
        to set PYTHONPATH.  Hence here, we insert the specified folder
        into sys.path (if they are not already in there).
    """
    if not module_name or not isinstance(module_name, basestring):
        raise ModuleNameError(module_name = module_name
                             ,folder = folder
                             ,sub_folder = sub_folder
                             ,logger = logger
                             )
    logger.debug(module_name)
    if module_name in sys.modules:   # sys.modules is also shared between GHPython components 
                                     # (and is even saved until Rhino is closed).
        logger.debug('Module %s already in sys.modules' % module_name)
        if reload_already_imported:
            logger.debug('Reloading %s.... ' % module_name)
            reload(sys.modules[module_name]) # type: ignore
        return sys.modules[module_name]
    #
    #
    # Load module_name for first time:
    #
    #
    search_path = os.path.join(folder, sub_folder)

    if (search_path 
        and isinstance(search_path, basestring) 
        and os.path.isdir(search_path)):
        #
        logger.debug('Search path == %s' % search_path)
        #if search_folder_only:
        #    sys.path = [search_path]
        if search_path not in sys.path:
            sys.path.insert(0, search_path)
    else:
        raise FilePathError(module_name = module_name
                           ,search_path = search_path
                           ,logger = logger
                           )

    logger.debug('Trying import... ')
    module = import_module(module_name, '')           

    return module       


class ModulesNotFoundError(InvalidArgsError):
    message_fmt = 'Modules not found in any location %s'


def load_modules(m_names
                ,folders
                ,logger = output
                ,module_name_error_msg = 'Please supply valid names of modules to import, %s'
                ,folders_error_msg = 'Please supply valid folders to import from. %s'
                ,modules_not_found_msg = 'Specified modules not found in any folder, %s'):
    #type(str/ Iterable, list, type[any], str, str) -> tuple / None
    """ Tries to import all modules in m_names, from the first folder in 
        folders to contain a .py or .pyc files with the same name as each 
        module.

        Returns a tuple of all the modules and the path they were found in.  Else 
        raises a ModulesNotFoundError.
    """
    if not m_names:
        raise ModuleNameError(message_fmt = 'No module names supplied, m_names = %s'
                             ,m_names = m_names
                             ,logger = logger
                             )

    if any( not isinstance(m_name, basestring) for m_name in m_names ):
        # if m_names is a basestring, the error is not raised 
        raise ModuleNameError(message_fmt = module_name_error_msg
                             ,m_names = m_names
                             ,logger = logger
                             )
    
    if isinstance(m_names, basestring):
        m_names = [m_names] 

    logger.debug('m_names == %s of type : %s' % (m_names, type(m_names).__name__))

    logger.debug('Testing paths : %s ' % folders)
    
    if isinstance(folders, basestring):
        folders = [folders]

    if not any(os.path.isdir(folder) or os.path.isdir(os.path.dirname(folder)) 
               for folder in folders
              ):
        raise FilePathError(message_fmt = folders_error_msg
                           ,m_names = m_names
                           ,logger = logger
                           )

    for folder in folders:
        logger.debug('Type(folder) : %s' % type(folder).__name__)
        logger.debug('Type(path) : %s path == %s' %(type(folder).__name__, folder))

        if os.path.isfile(folder):
            folder = os.path.dirname(folder)
        if all( any(os.path.isfile(os.path.join(folder, name.replace('.', os.sep) + ending)) 
                    for ending in ['.py','.pyc'] 
                   )
                for name in m_names
              ):
            #
            logger.debug('Importing %s' % repr(m_names))

            return tuple(strict_import(name, folder, '', logger = logger) 
                         for name in m_names
                        ) + (folder,)
            # tuple of modules, followed by the path to them
    raise ModulesNotFoundError(message_fmt = modules_not_found_msg
                              ,m_names = m_names
                              ,folders = folders
                              ,logger = logger
                              )




if __name__ == '__main__': # False in a compiled component.  But then the user
                           # can't add or remove Params to the component.  
    
    # Grasshopper will look for class MyComponent(component) in global scope
    # so a main function is a little tricky to define.

    nick_name = ghenv.Component.NickName #type: ignore


    if (REPOSITORY and 
        nick_name == 'Build_components'):
        #
        sDNA_GH_search_path = REPOSITORY 
        # builder can only load sDNA_GH from its parent directory, 
        # e.g. if in a dir one level up in the main repo
        # such as sDNA_build_components.gh.
    else:
        sDNA_GH_search_path = USER_INSTALLATION_FOLDER


    sc.doc = ghdoc #type: ignore

    output.debug(sDNA_GH_search_path)

    class sDNA_GH(object):
        pass

    if 'sDNA_GH.main' in sys.modules:
        sDNA_GH.main = sys.modules['sDNA_GH.main']
    else:
        sDNA_GH.main, _ = load_modules(m_names = PACKAGE_NAME + '.main'
                                      ,folders = sDNA_GH_search_path
                                      ,folders_error_msg = 'Please unzip %s.zip '
                                                           %ZIP_FILE_NAME
                                                           +' in the folder %s '
                                                           %Grasshopper.Folders.DefaultUserObjectFolder
                                                           +'and ensure a subfolder called %s is created '
                                                           %os.path.join(ZIP_FILE_NAME, PACKAGE_NAME)
                                                           +'inside it, containing main.py ' 
                                                           +'and all the sDNA_GH python files '
                                                           +'including those within other subfolders. ' 
                                      ,modules_not_found_msg = 'Some sDNA_GH files may be missing.  '
                                                              +'Please: 1) Copy %s.zip into: %s '
                                                              %(ZIP_FILE_NAME
                                                               ,Grasshopper.Folders.DefaultUserObjectFolder
                                                               )
                                                              +'2) Unblock it if necessary. '
                                                              +'3) Right click '
                                                              +'it, select Extract All... and click Extract, '
                                                              +'to extract it to that location. '
                                                              +'4) Ensure that main.py and all sDNA_GH python' 
                                                              +' files and subfolders are inside: %s '
                                                              %os.path.join(USER_INSTALLATION_FOLDER
                                                                           ,PACKAGE_NAME
                                                                           )
                                                              +'5) Reinitialise the component or restart Rhino.'
                                      )         


    logger = sDNA_GH.main.logger.getChild('launcher')
    output.set_logger(logger, flush = True)


    class MyComponent(component):
        pass  # Required.  Idiomatic to Grasshopper.  Must be called "MyComponent"  
            # too (it is looked for by the parser or scope checker?) otherwise 
            # Grasshopper may not find the subclass of on 
            # component.  Even though we overwrite this class on the next line
            # immediately below.  

    MyComponent = sDNA_GH.main.sDNA_GH_Component
    # Grasshopper calls MyComponent.RunScript automatically.


    if nick_name.replace(' ','').replace('_','').lower() == SELFTEST:  


        unit_tests, _ = load_modules('%s.tests.unit_tests.%s_unit_tests' % ((PACKAGE_NAME,)*2)
                                    ,sDNA_GH_search_path
                                    )

        
        MyComponent = unit_tests.make_test_running_component_class(
                                         MyComponent
                                        ,package_location = sDNA_GH_search_path
                                        )
        # Grasshopper calls MyComponent.RunScript automatically.
# ---------- end read_usertext ----------
panel = Panel(read_usertext.Data)
write_shp = Write_Shp(go=read_usertext.OK, Geom=read_geom.Geom, Data=read_usertext.Data, encoding="utf8")  # -> out, OK, opts, file; inputs go: list, opts: list, Geom: list, Data: tree, file: list, prj: list, input_key_str: list, config: list
#   port go: true: runs tools. false: do not run tools but still read other Params.
#   port opts: sDNA_GH options data structure. Python dictionary.
#   port Geom: A list of geometric objects. Requires GUIDs of Rhino objects or native/embedded Grasshopper geometry. To use Rhino objects referenced from Grasshopper parameter objects (instead of their Grasshopper versions which are often obscured unless the Rhino shapes are set to Hidden) run the output of the Geometry (Geo) or Curve (Crv) through a Guid (ID) parameter object first. Note: For sDNA tools all the geometric objects must all be polylines. For write_Shp all the objects must be of the type in shp_type (default: POLYLINEZ).
#   port Data: A Data Tree of a list of keys and list of corresponding values for each object in Geom.
#   port file: File path of the shape file.
#   port prj: File path of the projection file (.prj) to use for the new shapefile. Default :
#   port input_key_str: Format string containing a prefix, a {name} field, and a postfix, to enable more descriptive User Text key names. Default: {name} Only User Text key names matching this pattern will have their values written to shape files by Write_Shp,under the field name in {name}, which can have a max of 10 chars in Write_Shp. The actual values of name in User Text keys must also be specified to the sDNA tools that use them.
#   port config: File path to sDNA_GH options file. Default: C:\Users\James\AppData\Roaming\Grasshopper\UserObjects\sdna-gh\sDNA_GH\config.toml
#   port OK: true: tools ran successfully. false: tools did not run, or there was an error.
#   port opts: sDNA_GH options data structure. Python dictionary.
#   port file: File path of the shape file.
# ---------- write_shp: Python ----------
#! /usr/bin/awk NR==3
# -*- coding: utf-8 -*-
# This module requires Grasshopper Python (Rhino3D)

# MIT License

# Copyright (c) [2021] [Cardiff University, a body incorporated
# by Royal Charter and a registered charity (number:
# 1136855) whose administrative offices are at 7th floor 30-
# 36 Newport Road, University CF24 0DE, Wales, UK]

# Permission is hereby granted, free of charge, to any person obtaining a copy
# of this software and associated documentation files (the "Software"), to deal
# in the Software without restriction, including without limitation the rights
# to use, copy, modify, merge, publish, distribute, sublicense, and/or sell
# copies of the Software, and to permit persons to whom the Software is
# furnished to do so, subject to the following conditions:

# The above copyright notice and this permission notice shall be included in all
# copies or substantial portions of the Software.

# THE SOFTWARE IS PROVIDED "AS IS", WITHOUT WARRANTY OF ANY KIND, EXPRESS OR
# IMPLIED, INCLUDING BUT NOT LIMITED TO THE WARRANTIES OF MERCHANTABILITY,
# FITNESS FOR A PARTICULAR PURPOSE AND NONINFRINGEMENT. IN NO EVENT SHALL THE
# AUTHORS OR COPYRIGHT HOLDERS BE LIABLE FOR ANY CLAIM, DAMAGES OR OTHER
# LIABILITY, WHETHER IN AN ACTION OF CONTRACT, TORT OR OTHERWISE, ARISING FROM,
# OUT OF OR IN CONNECTION WITH THE SOFTWARE OR THE USE OR OTHER DEALINGS IN THE
# SOFTWARE.



"""Writes a DataTree in `Data` and a list of polylines in `Geom` to a shapefile.  If not specified in `file`, a default file name based on the Rhino doc or Grasshopper doc name is used (unless `auto_update_Rhino_doc_path = false`).  `overwrite_shp` = true overwrites existing files; false or creates new files up to a maximum of `max_new_files`.  **WARNING!  Shapefiles created with default names (due to no valid file path being specified in `file` by the user) will be deleted by subsequent sDNA tools if `strict_no_del` = false, `overwrite_shp` = false, and `del_after_sDNA` = true.**  To create a projection (.prj) file for the new shapefile, specify the path of an existing .prj file in `prj`.  If no Data is supplied, if no read_User_Text component is connected to its input, and if `auto_read_User_Text` is true, this tool will first call read_User_Text.  To work with sDNA, data records are only written to the Shapefile (associated with a shape corresponding to a Rhino / GH polyline) if its field matches the template string specified in `input_key_str`.  The field name has a maximum of 10 characters long, and is taken from the `{name}` value (in the key name if it originated as User Text). To write all data with any key name (shorter then 11 characters) to the Shapefile, set `input_key_str` to `{name}`.  Rhino and Grasshopper shapes must support certain methods (to retrieve the points list of their vertices) to be written to shp files of the following types: `PolylineVertices` for `POLYLINE`s and `POLYGON`s, `PointCoordinates` for `POINT`s, `PointCloudPoints` for `MULTIPOINT`, and `MeshVertices` for `MULTIPATCH`.  Please note:  `MULTIPATCH`s are not supported, and `POINT`s and `MULTIPOINT`s are experimental and untested.
"""

__author__ = 'James Parrott'
__version__ = '2.2.0'



import sys
import os
import functools
import importlib

from ghpythonlib.componentbase import executingcomponent as component
import Grasshopper
import scriptcontext as sc

import_module = importlib.import_module
try:
    reload #type: ignore
except NameError:
    reload = importlib.reload

try:
    basestring #type: ignore
except NameError:
    basestring = str

try:
    ghdoc #type: ignore
except NameError:
    from .custom.skel.basic.ghdoc import ghdoc

ZIP_FILE_NAME = 'sdna-gh'
PACKAGE_NAME = 'sDNA_GH'
PLUG_IN_NAME = 'sDNA'               
RELOAD_IF_ALREADY_IMPORTED = False
REPOSITORY = os.path.dirname(os.path.dirname(ghdoc.Path)) if ghdoc.Path else None
# Assume we are in repo_folder/dev/sDNA_build_components.gh

USER_INSTALLATION_FOLDER = os.path.join(
                                    Grasshopper.Folders.DefaultUserObjectFolder
                                   ,ZIP_FILE_NAME
                                   )
SELFTEST = 'selftest'




class Output(object): 

    def set_logger(self, logger, flush = True):
        self.logger = logger
        if flush and self.tmp_logs:
            self.flush()

    def __init__(self
                ,tmp_logs = None
                ,logger = None
                ):
        if not isinstance(tmp_logs, list): #assert not isinstance(None, list)
            tmp_logs = []
        self.tmp_logs = tmp_logs
        self.set_logger(logger, flush = False)



    def store(self, message, logging_level):
        self.tmp_logs.append( (message, logging_level) )

    def __call__(self, message, logging_level = "INFO", logging_dict = {}):
        #type: (str, str, dict, list) -> str
        
        #logger.debug(s)

        if logging_dict == {} and self.logger is not None: 
            logging_dict = dict( DEBUG = self.logger.debug
                                ,INFO = self.logger.info
                                ,WARNING = self.logger.warning
                                ,ERROR = self.logger.error
                                ,CRITICAL = self.logger.critical
                                )

        logging_level = logging_level.upper()
        if logging_level in logging_dict:
            logging_dict[logging_level](message)
        else:
            self.store(message, logging_level)

        return '%s : %s ' % (logging_level, message)

    def __getattr__(self, attr):
        return functools.partial(self.__call__, logging_level = attr.upper())

    def flush(self):
        tmp_logs = self.tmp_logs[:] # __call__ might cache back to tmp_logs
        self.tmp_logs[:] = [] # Mutate list initialised with.  Avoid double 
                              # logging in case re - stored in tmp_logs
        for tmp_log_message, tmp_log_level in tmp_logs:
            self.__call__(tmp_log_message, tmp_log_level)

output = Output()


class InvalidArgsError(Exception):
    
    """Custom exception to log the error message, and to at least allow 
       attempts to give users actionable advice to fix the issue, in 
       the event of a problem.  
    """
    message_fmt = 'Invalid import args: %s'
    def __init__(self
                ,message_fmt = ''
                ,message = ''
                ,logger = output
                , **kwargs
                ):
        if message_fmt and isinstance(message_fmt, basestring):
            self.message_fmt = message_fmt
        if kwargs and (not message or not isinstance(message, basestring)):
            message = self.message_fmt % kwargs
        logger.error(message)
        self.kwargs = kwargs
        super(InvalidArgsError, self).__init__(message)    


class ModuleNameError(InvalidArgsError):
    message_fmt = 'Invalid module name: %s'


class FilePathError(InvalidArgsError):
    message_fmt = 'Invalid path to import module from: %s'


# We only know the sDNA version to import as a string.  This is more secure too.
def strict_import(module_name = ''
                 ,folder = ''
                 ,sub_folder = ''
                 ,logger = output
                 ,reload_already_imported = RELOAD_IF_ALREADY_IMPORTED
                 ):

    # type: (str, str, str, type[any], bool) -> type[any]
    """ Imports the named module from the specified folder\subfolder only, 
        and returns it.
        
        Avoids name clashes and casual hijack attempts.  In some 
        environments supporting a Python implementation (such as 
        GhPython in Grasshopper) it may not be desirable to ask the user 
        to set PYTHONPATH.  Hence here, we insert the specified folder
        into sys.path (if they are not already in there).
    """
    if not module_name or not isinstance(module_name, basestring):
        raise ModuleNameError(module_name = module_name
                             ,folder = folder
                             ,sub_folder = sub_folder
                             ,logger = logger
                             )
    logger.debug(module_name)
    if module_name in sys.modules:   # sys.modules is also shared between GHPython components 
                                     # (and is even saved until Rhino is closed).
        logger.debug('Module %s already in sys.modules' % module_name)
        if reload_already_imported:
            logger.debug('Reloading %s.... ' % module_name)
            reload(sys.modules[module_name]) # type: ignore
        return sys.modules[module_name]
    #
    #
    # Load module_name for first time:
    #
    #
    search_path = os.path.join(folder, sub_folder)

    if (search_path 
        and isinstance(search_path, basestring) 
        and os.path.isdir(search_path)):
        #
        logger.debug('Search path == %s' % search_path)
        #if search_folder_only:
        #    sys.path = [search_path]
        if search_path not in sys.path:
            sys.path.insert(0, search_path)
    else:
        raise FilePathError(module_name = module_name
                           ,search_path = search_path
                           ,logger = logger
                           )

    logger.debug('Trying import... ')
    module = import_module(module_name, '')           

    return module       


class ModulesNotFoundError(InvalidArgsError):
    message_fmt = 'Modules not found in any location %s'


def load_modules(m_names
                ,folders
                ,logger = output
                ,module_name_error_msg = 'Please supply valid names of modules to import, %s'
                ,folders_error_msg = 'Please supply valid folders to import from. %s'
                ,modules_not_found_msg = 'Specified modules not found in any folder, %s'):
    #type(str/ Iterable, list, type[any], str, str) -> tuple / None
    """ Tries to import all modules in m_names, from the first folder in 
        folders to contain a .py or .pyc files with the same name as each 
        module.

        Returns a tuple of all the modules and the path they were found in.  Else 
        raises a ModulesNotFoundError.
    """
    if not m_names:
        raise ModuleNameError(message_fmt = 'No module names supplied, m_names = %s'
                             ,m_names = m_names
                             ,logger = logger
                             )

    if any( not isinstance(m_name, basestring) for m_name in m_names ):
        # if m_names is a basestring, the error is not raised 
        raise ModuleNameError(message_fmt = module_name_error_msg
                             ,m_names = m_names
                             ,logger = logger
                             )
    
    if isinstance(m_names, basestring):
        m_names = [m_names] 

    logger.debug('m_names == %s of type : %s' % (m_names, type(m_names).__name__))

    logger.debug('Testing paths : %s ' % folders)
    
    if isinstance(folders, basestring):
        folders = [folders]

    if not any(os.path.isdir(folder) or os.path.isdir(os.path.dirname(folder)) 
               for folder in folders
              ):
        raise FilePathError(message_fmt = folders_error_msg
                           ,m_names = m_names
                           ,logger = logger
                           )

    for folder in folders:
        logger.debug('Type(folder) : %s' % type(folder).__name__)
        logger.debug('Type(path) : %s path == %s' %(type(folder).__name__, folder))

        if os.path.isfile(folder):
            folder = os.path.dirname(folder)
        if all( any(os.path.isfile(os.path.join(folder, name.replace('.', os.sep) + ending)) 
                    for ending in ['.py','.pyc'] 
                   )
                for name in m_names
              ):
            #
            logger.debug('Importing %s' % repr(m_names))

            return tuple(strict_import(name, folder, '', logger = logger) 
                         for name in m_names
                        ) + (folder,)
            # tuple of modules, followed by the path to them
    raise ModulesNotFoundError(message_fmt = modules_not_found_msg
                              ,m_names = m_names
                              ,folders = folders
                              ,logger = logger
                              )




if __name__ == '__main__': # False in a compiled component.  But then the user
                           # can't add or remove Params to the component.  
    
    # Grasshopper will look for class MyComponent(component) in global scope
    # so a main function is a little tricky to define.

    nick_name = ghenv.Component.NickName #type: ignore


    if (REPOSITORY and 
        nick_name == 'Build_components'):
        #
        sDNA_GH_search_path = REPOSITORY 
        # builder can only load sDNA_GH from its parent directory, 
        # e.g. if in a dir one level up in the main repo
        # such as sDNA_build_components.gh.
    else:
        sDNA_GH_search_path = USER_INSTALLATION_FOLDER


    sc.doc = ghdoc #type: ignore

    output.debug(sDNA_GH_search_path)

    class sDNA_GH(object):
        pass

    if 'sDNA_GH.main' in sys.modules:
        sDNA_GH.main = sys.modules['sDNA_GH.main']
    else:
        sDNA_GH.main, _ = load_modules(m_names = PACKAGE_NAME + '.main'
                                      ,folders = sDNA_GH_search_path
                                      ,folders_error_msg = 'Please unzip %s.zip '
                                                           %ZIP_FILE_NAME
                                                           +' in the folder %s '
                                                           %Grasshopper.Folders.DefaultUserObjectFolder
                                                           +'and ensure a subfolder called %s is created '
                                                           %os.path.join(ZIP_FILE_NAME, PACKAGE_NAME)
                                                           +'inside it, containing main.py ' 
                                                           +'and all the sDNA_GH python files '
                                                           +'including those within other subfolders. ' 
                                      ,modules_not_found_msg = 'Some sDNA_GH files may be missing.  '
                                                              +'Please: 1) Copy %s.zip into: %s '
                                                              %(ZIP_FILE_NAME
                                                               ,Grasshopper.Folders.DefaultUserObjectFolder
                                                               )
                                                              +'2) Unblock it if necessary. '
                                                              +'3) Right click '
                                                              +'it, select Extract All... and click Extract, '
                                                              +'to extract it to that location. '
                                                              +'4) Ensure that main.py and all sDNA_GH python' 
                                                              +' files and subfolders are inside: %s '
                                                              %os.path.join(USER_INSTALLATION_FOLDER
                                                                           ,PACKAGE_NAME
                                                                           )
                                                              +'5) Reinitialise the component or restart Rhino.'
                                      )         


    logger = sDNA_GH.main.logger.getChild('launcher')
    output.set_logger(logger, flush = True)


    class MyComponent(component):
        pass  # Required.  Idiomatic to Grasshopper.  Must be called "MyComponent"  
            # too (it is looked for by the parser or scope checker?) otherwise 
            # Grasshopper may not find the subclass of on 
            # component.  Even though we overwrite this class on the next line
            # immediately below.  

    MyComponent = sDNA_GH.main.sDNA_GH_Component
    # Grasshopper calls MyComponent.RunScript automatically.


    if nick_name.replace(' ','').replace('_','').lower() == SELFTEST:  


        unit_tests, _ = load_modules('%s.tests.unit_tests.%s_unit_tests' % ((PACKAGE_NAME,)*2)
                                    ,sDNA_GH_search_path
                                    )

        
        MyComponent = unit_tests.make_test_running_component_class(
                                         MyComponent
                                        ,package_location = sDNA_GH_search_path
                                        )
        # Grasshopper calls MyComponent.RunScript automatically.
# ---------- end write_shp ----------
read_shp = Read_Shp(go=write_shp.OK, file=write_shp.file, encoding="utf8")  # -> out, OK, opts, Geom, Data, abbrevs, fields, bbox, invalid, encoding; inputs go: list, opts: list, file: list, Geom: list, bake: list, ignore_invalid: list
#   port go: true: runs tools. false: do not run tools but still read other Params.
#   port opts: sDNA_GH options data structure. Python dictionary.
#   port file: File path of the shape file.
#   port Geom: A list of geometric objects. Requires GUIDs of Rhino objects or native/embedded Grasshopper geometry. To use Rhino objects referenced from Grasshopper parameter objects (instead of their Grasshopper versions which are often obscured unless the Rhino shapes are set to Hidden) run the output of the Geometry (Geo) or Curve (Crv) through a Guid (ID) parameter object first. Note: For sDNA tools all the geometric objects must all be polylines. For write_Shp all the objects must be of the type in shp_type (default: POLYLINEZ).
#   port bake: If new shapes are created, thentrue: bakes the shapefile polylines to Rhino. false: creates Grasshopper polylines only. Default: False
#   port ignore_invalid: True: suppress errors from failing to add shapes to Rhino/GH document. False: skip shapes that could not be added to the document. Default: False If True, the reasons why those shapes are incompatible with Rhino are viewable in *invalid*, but they are also logged as warnings (or errors if False) to *out* and any *log_file* Five validity criteria are defined here:https://developer.rhino3d.com/api/RhinoCommon/html/P_Rhino_Geometry_Polyline_IsValid.htm
#   port OK: true: tools ran successfully. false: tools did not run, or there was an error.
#   port opts: sDNA_GH options data structure. Python dictionary.
#   port Geom: A list of geometric objects. Requires GUIDs of Rhino objects or native/embedded Grasshopper geometry. To use Rhino objects referenced from Grasshopper parameter objects (instead of their Grasshopper versions which are often obscured unless the Rhino shapes are set to Hidden) run the output of the Geometry (Geo) or Curve (Crv) through a Guid (ID) parameter object first. Note: For sDNA tools all the geometric objects must all be polylines. For write_Shp all the objects must be of the type in shp_type (default: POLYLINEZ).
#   port Data: A Data Tree of a list of keys and list of corresponding values for each object in Geom.
#   port abbrevs: Abbreviations of sDNA results from the ...names.csv file.
#   port fields: Field names from the Shapefile. Set field to one of these values to parse and/or plot it.
#   port bbox: Bounding box from the Shapefile. Used to calculate leg_frame by the Recolour_objects component. [x_min, y_min, x_max, y_max]. All Numbers.
#   port invalid: Duplicates specific console output in out. Details why particular shapes (if any) in the shapefile could not be added to a document in Rhino, raising errors. ignore_invalid (currently: False) must be True to read invalid, to suppress those same errors (errors stop this and all output Params from receiving data).
# ---------- read_shp: Python ----------
#! /usr/bin/awk NR==3
# -*- coding: utf-8 -*-
# This module requires Grasshopper Python (Rhino3D)

# MIT License

# Copyright (c) [2021] [Cardiff University, a body incorporated
# by Royal Charter and a registered charity (number:
# 1136855) whose administrative offices are at 7th floor 30-
# 36 Newport Road, University CF24 0DE, Wales, UK]

# Permission is hereby granted, free of charge, to any person obtaining a copy
# of this software and associated documentation files (the "Software"), to deal
# in the Software without restriction, including without limitation the rights
# to use, copy, modify, merge, publish, distribute, sublicense, and/or sell
# copies of the Software, and to permit persons to whom the Software is
# furnished to do so, subject to the following conditions:

# The above copyright notice and this permission notice shall be included in all
# copies or substantial portions of the Software.

# THE SOFTWARE IS PROVIDED "AS IS", WITHOUT WARRANTY OF ANY KIND, EXPRESS OR
# IMPLIED, INCLUDING BUT NOT LIMITED TO THE WARRANTIES OF MERCHANTABILITY,
# FITNESS FOR A PARTICULAR PURPOSE AND NONINFRINGEMENT. IN NO EVENT SHALL THE
# AUTHORS OR COPYRIGHT HOLDERS BE LIABLE FOR ANY CLAIM, DAMAGES OR OTHER
# LIABILITY, WHETHER IN AN ACTION OF CONTRACT, TORT OR OTHERWISE, ARISING FROM,
# OUT OF OR IN CONNECTION WITH THE SOFTWARE OR THE USE OR OTHER DEALINGS IN THE
# SOFTWARE.



"""Reads in polylines and associated data records from a shapefile of polylines.  Creates new objects if `new_geom` = true or no objects corresponding to the shapefile are specified in `Geom`.  Specify the path of the .shp file to read in `file`.  **WARNING!  If a valid file path was not specified in `file` on a preceding Write_Shp component, and that file was used by an sDNA tool, Read_Shp deletes sDNA output shapefiles with default names if `strict_no_del` = false, `overwrite_shp` = false, and `del_after_read` = true.**  If a list of existing geometry is provided in `Geom` that corresponds to (is the same length as) the data records in the shapefile, and if new_geom = false, only the data is read from the shapefile.  Otherwise the polylines in the shapefile are added as new Rhino Polyline objects if bake = true; otherwise as Grasshopper Polyline objects.  The bounding box output `bbox` is provided to create a legend frame within Recolour_Objects (its value is calculated from the shape file).  The abbreviations and field names from an sDNA results field file (if a file with the same name ending in .names.csv exists) are also read in, and supplied on `abbrevs` so that a drop-down list may be created, for easy selection of the data field for subsequent parsing and plotting.  If no separate Recolour_Objects Component is detected connected to the component's outputs downstream and `auto_plot_data = true`, Recolour_Objects is called afterwards.  
"""

__author__ = 'James Parrott'
__version__ = '2.2.0'



import sys
import os
import functools
import importlib

from ghpythonlib.componentbase import executingcomponent as component
import Grasshopper
import scriptcontext as sc

import_module = importlib.import_module
try:
    reload #type: ignore
except NameError:
    reload = importlib.reload

try:
    basestring #type: ignore
except NameError:
    basestring = str

try:
    ghdoc #type: ignore
except NameError:
    from .custom.skel.basic.ghdoc import ghdoc

ZIP_FILE_NAME = 'sdna-gh'
PACKAGE_NAME = 'sDNA_GH'
PLUG_IN_NAME = 'sDNA'               
RELOAD_IF_ALREADY_IMPORTED = False
REPOSITORY = os.path.dirname(os.path.dirname(ghdoc.Path)) if ghdoc.Path else None
# Assume we are in repo_folder/dev/sDNA_build_components.gh

USER_INSTALLATION_FOLDER = os.path.join(
                                    Grasshopper.Folders.DefaultUserObjectFolder
                                   ,ZIP_FILE_NAME
                                   )
SELFTEST = 'selftest'




class Output(object): 

    def set_logger(self, logger, flush = True):
        self.logger = logger
        if flush and self.tmp_logs:
            self.flush()

    def __init__(self
                ,tmp_logs = None
                ,logger = None
                ):
        if not isinstance(tmp_logs, list): #assert not isinstance(None, list)
            tmp_logs = []
        self.tmp_logs = tmp_logs
        self.set_logger(logger, flush = False)



    def store(self, message, logging_level):
        self.tmp_logs.append( (message, logging_level) )

    def __call__(self, message, logging_level = "INFO", logging_dict = {}):
        #type: (str, str, dict, list) -> str
        
        #logger.debug(s)

        if logging_dict == {} and self.logger is not None: 
            logging_dict = dict( DEBUG = self.logger.debug
                                ,INFO = self.logger.info
                                ,WARNING = self.logger.warning
                                ,ERROR = self.logger.error
                                ,CRITICAL = self.logger.critical
                                )

        logging_level = logging_level.upper()
        if logging_level in logging_dict:
            logging_dict[logging_level](message)
        else:
            self.store(message, logging_level)

        return '%s : %s ' % (logging_level, message)

    def __getattr__(self, attr):
        return functools.partial(self.__call__, logging_level = attr.upper())

    def flush(self):
        tmp_logs = self.tmp_logs[:] # __call__ might cache back to tmp_logs
        self.tmp_logs[:] = [] # Mutate list initialised with.  Avoid double 
                              # logging in case re - stored in tmp_logs
        for tmp_log_message, tmp_log_level in tmp_logs:
            self.__call__(tmp_log_message, tmp_log_level)

output = Output()


class InvalidArgsError(Exception):
    
    """Custom exception to log the error message, and to at least allow 
       attempts to give users actionable advice to fix the issue, in 
       the event of a problem.  
    """
    message_fmt = 'Invalid import args: %s'
    def __init__(self
                ,message_fmt = ''
                ,message = ''
                ,logger = output
                , **kwargs
                ):
        if message_fmt and isinstance(message_fmt, basestring):
            self.message_fmt = message_fmt
        if kwargs and (not message or not isinstance(message, basestring)):
            message = self.message_fmt % kwargs
        logger.error(message)
        self.kwargs = kwargs
        super(InvalidArgsError, self).__init__(message)    


class ModuleNameError(InvalidArgsError):
    message_fmt = 'Invalid module name: %s'


class FilePathError(InvalidArgsError):
    message_fmt = 'Invalid path to import module from: %s'


# We only know the sDNA version to import as a string.  This is more secure too.
def strict_import(module_name = ''
                 ,folder = ''
                 ,sub_folder = ''
                 ,logger = output
                 ,reload_already_imported = RELOAD_IF_ALREADY_IMPORTED
                 ):

    # type: (str, str, str, type[any], bool) -> type[any]
    """ Imports the named module from the specified folder\subfolder only, 
        and returns it.
        
        Avoids name clashes and casual hijack attempts.  In some 
        environments supporting a Python implementation (such as 
        GhPython in Grasshopper) it may not be desirable to ask the user 
        to set PYTHONPATH.  Hence here, we insert the specified folder
        into sys.path (if they are not already in there).
    """
    if not module_name or not isinstance(module_name, basestring):
        raise ModuleNameError(module_name = module_name
                             ,folder = folder
                             ,sub_folder = sub_folder
                             ,logger = logger
                             )
    logger.debug(module_name)
    if module_name in sys.modules:   # sys.modules is also shared between GHPython components 
                                     # (and is even saved until Rhino is closed).
        logger.debug('Module %s already in sys.modules' % module_name)
        if reload_already_imported:
            logger.debug('Reloading %s.... ' % module_name)
            reload(sys.modules[module_name]) # type: ignore
        return sys.modules[module_name]
    #
    #
    # Load module_name for first time:
    #
    #
    search_path = os.path.join(folder, sub_folder)

    if (search_path 
        and isinstance(search_path, basestring) 
        and os.path.isdir(search_path)):
        #
        logger.debug('Search path == %s' % search_path)
        #if search_folder_only:
        #    sys.path = [search_path]
        if search_path not in sys.path:
            sys.path.insert(0, search_path)
    else:
        raise FilePathError(module_name = module_name
                           ,search_path = search_path
                           ,logger = logger
                           )

    logger.debug('Trying import... ')
    module = import_module(module_name, '')           

    return module       


class ModulesNotFoundError(InvalidArgsError):
    message_fmt = 'Modules not found in any location %s'


def load_modules(m_names
                ,folders
                ,logger = output
                ,module_name_error_msg = 'Please supply valid names of modules to import, %s'
                ,folders_error_msg = 'Please supply valid folders to import from. %s'
                ,modules_not_found_msg = 'Specified modules not found in any folder, %s'):
    #type(str/ Iterable, list, type[any], str, str) -> tuple / None
    """ Tries to import all modules in m_names, from the first folder in 
        folders to contain a .py or .pyc files with the same name as each 
        module.

        Returns a tuple of all the modules and the path they were found in.  Else 
        raises a ModulesNotFoundError.
    """
    if not m_names:
        raise ModuleNameError(message_fmt = 'No module names supplied, m_names = %s'
                             ,m_names = m_names
                             ,logger = logger
                             )

    if any( not isinstance(m_name, basestring) for m_name in m_names ):
        # if m_names is a basestring, the error is not raised 
        raise ModuleNameError(message_fmt = module_name_error_msg
                             ,m_names = m_names
                             ,logger = logger
                             )
    
    if isinstance(m_names, basestring):
        m_names = [m_names] 

    logger.debug('m_names == %s of type : %s' % (m_names, type(m_names).__name__))

    logger.debug('Testing paths : %s ' % folders)
    
    if isinstance(folders, basestring):
        folders = [folders]

    if not any(os.path.isdir(folder) or os.path.isdir(os.path.dirname(folder)) 
               for folder in folders
              ):
        raise FilePathError(message_fmt = folders_error_msg
                           ,m_names = m_names
                           ,logger = logger
                           )

    for folder in folders:
        logger.debug('Type(folder) : %s' % type(folder).__name__)
        logger.debug('Type(path) : %s path == %s' %(type(folder).__name__, folder))

        if os.path.isfile(folder):
            folder = os.path.dirname(folder)
        if all( any(os.path.isfile(os.path.join(folder, name.replace('.', os.sep) + ending)) 
                    for ending in ['.py','.pyc'] 
                   )
                for name in m_names
              ):
            #
            logger.debug('Importing %s' % repr(m_names))

            return tuple(strict_import(name, folder, '', logger = logger) 
                         for name in m_names
                        ) + (folder,)
            # tuple of modules, followed by the path to them
    raise ModulesNotFoundError(message_fmt = modules_not_found_msg
                              ,m_names = m_names
                              ,folders = folders
                              ,logger = logger
                              )




if __name__ == '__main__': # False in a compiled component.  But then the user
                           # can't add or remove Params to the component.  
    
    # Grasshopper will look for class MyComponent(component) in global scope
    # so a main function is a little tricky to define.

    nick_name = ghenv.Component.NickName #type: ignore


    if (REPOSITORY and 
        nick_name == 'Build_components'):
        #
        sDNA_GH_search_path = REPOSITORY 
        # builder can only load sDNA_GH from its parent directory, 
        # e.g. if in a dir one level up in the main repo
        # such as sDNA_build_components.gh.
    else:
        sDNA_GH_search_path = USER_INSTALLATION_FOLDER


    sc.doc = ghdoc #type: ignore

    output.debug(sDNA_GH_search_path)

    class sDNA_GH(object):
        pass

    if 'sDNA_GH.main' in sys.modules:
        sDNA_GH.main = sys.modules['sDNA_GH.main']
    else:
        sDNA_GH.main, _ = load_modules(m_names = PACKAGE_NAME + '.main'
                                      ,folders = sDNA_GH_search_path
                                      ,folders_error_msg = 'Please unzip %s.zip '
                                                           %ZIP_FILE_NAME
                                                           +' in the folder %s '
                                                           %Grasshopper.Folders.DefaultUserObjectFolder
                                                           +'and ensure a subfolder called %s is created '
                                                           %os.path.join(ZIP_FILE_NAME, PACKAGE_NAME)
                                                           +'inside it, containing main.py ' 
                                                           +'and all the sDNA_GH python files '
                                                           +'including those within other subfolders. ' 
                                      ,modules_not_found_msg = 'Some sDNA_GH files may be missing.  '
                                                              +'Please: 1) Copy %s.zip into: %s '
                                                              %(ZIP_FILE_NAME
                                                               ,Grasshopper.Folders.DefaultUserObjectFolder
                                                               )
                                                              +'2) Unblock it if necessary. '
                                                              +'3) Right click '
                                                              +'it, select Extract All... and click Extract, '
                                                              +'to extract it to that location. '
                                                              +'4) Ensure that main.py and all sDNA_GH python' 
                                                              +' files and subfolders are inside: %s '
                                                              %os.path.join(USER_INSTALLATION_FOLDER
                                                                           ,PACKAGE_NAME
                                                                           )
                                                              +'5) Reinitialise the component or restart Rhino.'
                                      )         


    logger = sDNA_GH.main.logger.getChild('launcher')
    output.set_logger(logger, flush = True)


    class MyComponent(component):
        pass  # Required.  Idiomatic to Grasshopper.  Must be called "MyComponent"  
            # too (it is looked for by the parser or scope checker?) otherwise 
            # Grasshopper may not find the subclass of on 
            # component.  Even though we overwrite this class on the next line
            # immediately below.  

    MyComponent = sDNA_GH.main.sDNA_GH_Component
    # Grasshopper calls MyComponent.RunScript automatically.


    if nick_name.replace(' ','').replace('_','').lower() == SELFTEST:  


        unit_tests, _ = load_modules('%s.tests.unit_tests.%s_unit_tests' % ((PACKAGE_NAME,)*2)
                                    ,sDNA_GH_search_path
                                    )

        
        MyComponent = unit_tests.make_test_running_component_class(
                                         MyComponent
                                        ,package_location = sDNA_GH_search_path
                                        )
        # Grasshopper calls MyComponent.RunScript automatically.
# ---------- end read_shp ----------
panel_2 = Panel(read_shp.fields)
panel_3 = Panel(read_shp.encoding)
panel_4 = Panel(write_shp.out)
panel_5 = Panel(read_shp.Data)
unload_sdna = Unload_sDNA(unload=Button())  # -> out, a
# ---------- unload_sdna: Python ----------
#! /usr/bin/awk NR==3
# -*- coding: utf-8 -*-
# This module requires Grasshopper Python (Rhino3D)

# MIT License

# Copyright (c) [2021] [Cardiff University, a body incorporated
# by Royal Charter and a registered charity (number:
# 1136855) whose administrative offices are at 7th floor 30-
# 36 Newport Road, UniversityCF24 0DE, Wales, UK]

# Permission is hereby granted, free of charge, to any person obtaining a copy
# of this software and associated documentation files (the "Software"), to deal
# in the Software without restriction, including without limitation the rights
# to use, copy, modify, merge, publish, distribute, sublicense, and/or sell
# copies of the Software, and to permit persons to whom the Software is
# furnished to do so, subject to the following conditions:

# The above copyright notice and this permission notice shall be included in all
# copies or substantial portions of the Software.

# THE SOFTWARE IS PROVIDED "AS IS", WITHOUT WARRANTY OF ANY KIND, EXPRESS OR
# IMPLIED, INCLUDING BUT NOT LIMITED TO THE WARRANTIES OF MERCHANTABILITY,
# FITNESS FOR A PARTICULAR PURPOSE AND NONINFRINGEMENT. IN NO EVENT SHALL THE
# AUTHORS OR COPYRIGHT HOLDERS BE LIABLE FOR ANY CLAIM, DAMAGES OR OTHER
# LIABILITY, WHETHER IN AN ACTION OF CONTRACT, TORT OR OTHERWISE, ARISING FROM,
# OUT OF OR IN CONNECTION WITH THE SOFTWARE OR THE USE OR OTHER DEALINGS IN THE
# SOFTWARE.

""" Unload the sDNA_GH Python package and all sDNA modules, by removing them from GhPython's shared cache (sys.modules).  The 
    next sDNA_GH component to run will then reload the package and installation-wide options file (config.toml), and any specified 
    options including a project specific config.toml, without otherwise having to restart Rhino to clear its cache.
"""

__author__ = 'James Parrott'
__version__ = '2.0'


from ghpythonlib.componentbase import executingcomponent as component

class MyComponent(component):
    
    def RunScript(self, unload, update):
        import sys  #Imported here to avoid weird bug 
                    # (unloading/forgetting of sys - IronPython only?)
        #https://discourse.mcneel.com/t/failed-import-of-sys-library-in-ghpython/98696


        print('sDNA_GH packages and modules in sys.modules:')
        print('\n'.join([key for key in sys.modules if 'sdna' in key.lower()]))
        def is_imported(s):
            return s in sys.modules
        if unload is True:
            if 'logging' in sys.modules:
                sys.modules['logging'].shutdown()
            shared_cached_modules_etc = sys.modules.copy().keys()
            for y in shared_cached_modules_etc:
                if 'sdna' in y.lower():
                    del sys.modules[y]
        
        
                
        print('sDNA_GH imported == %s' % is_imported('sDNA_GH'))
        print('sDNA_GH.tools imported == %s' % is_imported('sDNA_GH.tools'))
        print('sDNAUISpec imported == %s' % is_imported('sDNAUISpec'))
        print('runsdnacommand == %s' % is_imported('runsdnacommand'))

        
        return
# ---------- end unload_sdna ----------
