# Grasshopper definition test_multiple_components_GH_geom.gh (Grasshopper 1.0.7)

geo = Geometry([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])
write_shp = WriteShapefile(go=Toggle(True), Geom=geo)  # -> OK, opts, file; inputs go: list, opts: list, file: list, Geom: list, Data: tree, config: list
# ---------- write_shp: Python ----------
#! /usr/bin/python as module, Grasshopper Python as script / main
# -*- coding: utf-8 -*-
__author__ = 'James Parrott'
__version__ = '0.02'


import os, sys
from importlib import import_module
if (not hasattr(__builtins__, 'reload') 
    and (isinstance(__builtins__, dict) 
         and 'reload' not in __builtins__ )):  
    from importlib import reload 
    # reload was builtin until Python 3.4
    # __builtins__ is a dict in GhPython not a module as elsewhere


sDNA_GH_subfolder = 'sDNA_GH' 
sDNA_GH_package = 'sDNA_GH'               
reload_config_and_other_modules_if_already_loaded = False


# There may be multiple components, all running this same launcher code.
# Therefore we want the root logger to live in the sDNA_GH.setup module
# that they each import.  Te logging system is configurable by the user,
# but only through the options that are read in during the main package
# import, and we want to create logs before this too.  So before a 
# component has imported sDNA_GH.setup, logging is routed through output, 
# a callable instance of Output, with a cache, defined below.  output's cache 
# is flushed through the normal logging system, after a logger has been set up 
# according to the user's configuration, after the main package import.
#
# This Output class is used to define two Classes from this single 
# code definition.  Python scripts can happily import themselves, but here
# this is because all the code in this file 
# must be read into a GhPython component via its the code input (which 
# essentially copy and pastes it to there).
# The first function definition is when the code in this file runs 
# in a GH component.  
# The second function definition is during import of sDNA_GH below, 
# as it itself imports this function from .launcher
# Therefore there really are two functions in Python, with two separate caches.
#
# The behaviours can be different of course if changes are made to one and not
# the other, e.g. if the code is forgotten to be copied into the component.

class Output(object): 

    def set_logger(self, logger, flush = True):
        self.logger = logger
        if flush and self.tmp_logs:
            self.flush()

    def __init__(self
                ,tmp_logs = None
                ,logger = None
                ):
        if not isinstance(tmp_logs, list): #assert not isinstance(None, list)
            tmp_logs = []
        self.tmp_logs = tmp_logs
        if logger is not None:
            self.set_logger(logger, flush = False)



    def store(self, message, logging_level):
        self.tmp_logs.append( (message, logging_level) )

    def __call__(self, message, logging_level = "INFO", logging_dict = {}):
        #type: (str, str, dict, list) -> str
        
        #print(s)

        if logging_dict == {} and hasattr(self, 'logger'): 
            logging_dict = dict( DEBUG = self.logger.debug
                                ,INFO = self.logger.info
                                ,WARNING = self.logger.warning
                                ,ERROR = self.logger.error
                                ,CRITICAL = self.logger.critical
                                )

        logging_level = logging_level.upper()
        if logging_level in logging_dict:
            logging_dict[logging_level](message)
        else:
            self.store(message, logging_level)

        return logging_level + ' : ' + message + ' '

    def flush(self):
        tmp_logs = self.tmp_logs[:] # __call__ might cache back to tmp_logs
        self.tmp_logs[:] = [] # Mutate list initialised with
        for tmp_log_message, tmp_log_level in tmp_logs:
            self.__call__(tmp_log_message, tmp_log_level)

output = Output()





# We only know the sDNA version to import as a string.  This is more secure too.
def strict_import(  module_name = ''
                   ,folder = ''
                   ,sub_folder = ''
                   ,output = output
                   ,search_folder_only = False
                   ):

    # type: (str, str, str, function, bool) -> type[any]
    #
    if module_name == '':
        output('No module to import','INFO')
        return None
    output(module_name,'DEBUG')
    if module_name in sys.modules:   # sys.modules is also shared between GHPython components 
                                     # (and is even saved until Rhino is closed).
        output('Module ' + module_name + ' already in sys.modules.  ','DEBUG')
        if reload_config_and_other_modules_if_already_loaded:
            output('Reloading ' +  module_name  + '.... ','DEBUG')
            reload(sys.modules[module_name]) # type: ignore
        return sys.modules[module_name]
    #
    #
    # Load module_name for first time:
    #
    #
    search_path = os.path.join(folder, sub_folder)

    tmp = sys.path
    if search_path and isinstance(search_path, str) and os.path.isdir(search_path):
        output('Search path == ' + search_path, 'DEBUG')
        if search_folder_only:
            sys.path = [search_path]
        else:
            sys.path.insert(0, search_path)
    else:
        output('Invalid search path : ' + search_path, 'DEBUG')
        if search_folder_only:
            return None

    output('Trying import... ','DEBUG')
    module = import_module(module_name, '')           
    sys.path = tmp
    return module       



def load_modules(m_names, path_lists):
    m_names = m_names if isinstance(m_names, tuple) else [m_names] 
    output('m_names == ' + str(m_names) + ' of type : ' + type(m_names).__name__,'DEBUG')
    if any((name.startswith('.') or name.startswith('..')) in name for name in m_names):
        output(m_names,'DEBUG')
        raise ImportError( output('Relative import attempted, but not supported','CRITICAL') )

    output('Testing paths : ' + '\n'.join(map(str,path_lists)),'DEBUG')
    output('Type(path_lists) : ' + type(path_lists).__name__,'DEBUG')


    for path_list in path_lists:
        test_paths = path_list if isinstance(path_list, list) else [path_list]
        test_paths = test_paths[:]
        output('Type(path_list) : ' + type(path_list).__name__,'DEBUG')
        output('Type(test_paths) : ' + type(test_paths).__name__,'DEBUG')

        for path in test_paths:
            output('Type(path) : ' + type(path).__name__ + ' path == ' + path,'DEBUG')
            if os.path.isfile(path):
                path = os.path.dirname(path)
            if all( any(os.path.isfile(os.path.join(path, name.replace('.', os.sep) + ending)) 
                        for ending in ['.py','.pyc'] 
                        )
                    for name in m_names
                ):
                output('Importing ' + str(m_names) +' ','DEBUG')
                return tuple(strict_import(name, path, '') for name in m_names) + (path,)
                # tuple of modules, followed by the path to them
    return None


if __name__ == '__main__': # False in a compiled component.  But then the user
                           # can't add or remove Params to the component.  
    
    # Grasshopper will look for class MyComponent(component) in global scope
    # so a main function is a little tricky to define.

    from ghpythonlib.componentbase import executingcomponent as component
    import Grasshopper
    import scriptcontext as sc
    # Do Grasshopper API imports here separately to
    # Let the above functions be accessed outside the GhPython


    sDNA_GH_search_paths = [ os.path.join(Grasshopper.Folders.DefaultUserObjectFolder
                                         , sDNA_GH_subfolder
                                         ) 
                           ]
                                            #join(Grasshopper.Folders.DefaultAssemblyFolder, sDNA_GH_subfolder) ]  
                                            # Grasshopper.Folders.AppDataFolder + r'\Libraries'
                                            # %appdata%  + r'\Grasshopper\Libraries'
                                            # os.getenv('APPDATA') + r'\Grasshopper\Libraries'
                                            # Grasshopper.Folders.AppDataFolder + r'\UserObjects'
                                            # %appdata%  + r'\Grasshopper\UserObjects'
                                            # os.getenv('APPDATA') + r'\Grasshopper\UserObjects'

    sDNA_GH_search_paths += [os.path.join(Grasshopper.Folders.DefaultAssemblyFolder
                                         ,sDNA_GH_subfolder
                                         ) 
                            ]  # Might need to install sDNA_GH 
                               # in \Grasshopper\Libraries in Rhino 6?

    nick_name = ghenv.Component.NickName #type: ignore


    sc.doc = ghdoc #type: ignore

    print(sDNA_GH_search_paths)

    class sDNA_GH(object):
        pass
    sDNA_GH.setup, _ = load_modules(sDNA_GH_package + '.setup'
                             ,sDNA_GH_search_paths
                             )         


    logger = sDNA_GH.setup.logger.getChild('launcher')
    output.set_logger(logger, flush = True)


    class MyComponent(component):
        pass  # Required.  Idiomatic to Grasshopper.  Must be called "MyComponent"  
            # too, otherwise Grasshopper may not find the class building on 
            # component.  Despite component being passed to the class decorator
            # and overwriting this very class immediately below.  
            # Initial parser step / scope check trips this?

    MyComponent = sDNA_GH.setup.sDNA_GH_Component


    if nick_name.replace(' ','').replace('_','').lower() == 'selftest':  

        if sys.argv[0].endswith(os.path.join(sDNA_GH_package,'__main__.py')):   
            from .tests.unit_tests import unit_tests_sDNA_GH
        else:
            unit_tests_sDNA_GH, _ = load_modules('sDNA_GH.tests.unit_tests.unit_tests_sDNA_GH'
                                                ,sDNA_GH_search_paths
                                                )

        MyComponent._RunScript = MyComponent.RunScript
        MyComponent.RunScript = unit_tests_sDNA_GH.run_launcher_tests
# ---------- end write_shp ----------
update = Button()
toggle = BooleanToggle(False)
unload_ghsdna = Button()
toggle_2 = BooleanToggle(False)
sdna_integral = IntegralAnalysis(go=write_shp.OK, file=write_shp.file)  # -> OK, opts, file; inputs go: list, opts: list, file: list, config: list; same code as write_shp
load_config = LoadConfiguration(
    go=Toggle(True),
    auto_get_Geom=toggle,
    auto_read_Usertext=toggle,
    auto_write_Shp=toggle_2,
    auto_read_Shp=toggle_2,
    auto_plot_data=toggle_2)  # -> OK, opts; inputs go: list, opts: list, config: list; same code as write_shp
read_shp = ReadShapefile(go=sdna_integral.OK, file=sdna_integral.file, Geom=geo)  # -> OK, opts, Geom, Data, gdm, abbrevs, fields, bbox; inputs go: list, opts: list, file: list, Geom: list; same code as write_shp
python = GhPythonScript(del_GHsDNA=unload_ghsdna, update=update)  # -> out, a
# ---------- python: Python ----------
#! /usr/bin/python2.7
# -*- coding: utf-8 -*-
__author__ = 'James Parrott'
__version__ = '0.00'
__copyright__ = 'Cardiff University'
__license__ = {  'Python standard library modules and ' : 'Python Software Foundation 2.7.18' # https://docs.python.org/2.7/license.html
                ,'wrapper_logging' : 'Python Software Foundation 2.7.18'
                ,'wrapper_pyshp' : 'MIT' # https://pypi.org/project/pyshp/ 
                ,'sDNAUISpec.py' : 'MIT' # https://github.com/fiftysevendegreesofrad/sdna_open/blob/master/LICENSE.md
                ,'everything else' : 'same as for sDNA ' # https://sdna.cardiff.ac.uk/sdna/legal-license/ 
               }

import sys, os, Grasshopper, logging
#print('\n'.join([key for key in sys.modules if 'sDNA' in key]))
#print('functools' in sys.modules)
print('Our packages and modules in sys.modules:')
print('\n'.join([key for key in sys.modules if 'sdna' in key.lower() and not '.' in key]))
#print os.getenv('APPDATA')
#print ghdoc.Path
#print Grasshopper.Folders.DefaultAssemblyFolder
#print Grasshopper.Folders.AppDataFolder
#print sys.argv[0]
#print("Classmethod found == " + str('classmethod' in __builtins__))
def is_imported(s):
    return s in sys.modules
if del_GHsDNA == True:
    if 'logging' in sys.modules:
        sys.modules['logging'].shutdown()
    shared_cached_modules_etc = sys.modules.copy().keys()
    for y in shared_cached_modules_etc:
        if 'sDNA' in y or y == 'runsdnacommand':
            del sys.modules[y]


        
print('GHsDNA imported == ' + str(is_imported('GHsDNA')))
print('GHsDNA.tools imported == ' + str(is_imported('GHsDNA.tools')))
print('sDNAUISpec imported == ' + str(is_imported('sDNAUISpec')))
print('runsdnacommand == ' + str(is_imported('runsdnacommand')))
if False: #is_imported('GHsDNA'):
    print sys.modules['GHsDNA'].__all__
    print dir(sys.modules['GHsDNA'])
    if is_imported('GHsDNA.tools'):
        print dir(sys.modules['GHsDNA.tools'])
    if hasattr(sys.modules['GHsDNA'],'third_party_python_modules'):
        print dir(sys.modules['GHsDNA'].third_party_python_modules)

#print sys.modules.keys()
#print os.getcwd()
#print sys.path[0]
#print 'a' in globals()
#a = "This is a!"
#print('\n'.join(dir(sys.modules['GHsDNA'].third_party_python_modules)))
# ---------- end python ----------
panel = Panel(python.out)
parse_data = ParseData(go=read_shp.OK, Geom=read_shp.Geom, Data=read_shp.Data)  # -> OK, opts, plot_min, plot_max, Data, Geom, gdm; inputs go: list, opts: list, Geom: list, Data: tree, field: list, plot_max: list, plot_min: list, class_bounds: list; same code as write_shp
gradient = Gradient(
    LowerLimit=parse_data.plot_min,
    UpperLimit=parse_data.plot_max,
    Parameter=parse_data.Data,
    stops=[0: RGB(234, 38, 0), 0.25: RGB(234, 126, 0), 0.5: RGB(254, 244, 84), 0.75: RGB(173, 203, 249), 1: RGB(75, 107, 169)])
recolour_objects = RecolourObjects(
    go=parse_data.OK,
    plot_min=parse_data.plot_min,
    plot_max=parse_data.plot_max,
    Data=gradient,
    Geom=parse_data.Geom,
    bbox=read_shp.bbox)  # -> OK, opts, Geom, Data, leg_cols, leg_tags, leg_frame; inputs go: list, opts: list, plot_min: list, plot_max: list, Data: tree, Geom: list, bbox: list, field: list; same code as write_shp
legend = Legend(Colour=recolour_objects.leg_cols, Tags=recolour_objects.leg_tags, Rectangle=recolour_objects.leg_frame, LegendType=1)
preview = CustomPreview(Geometry=recolour_objects.Geom, Material=recolour_objects.Data)
